# Dynamo graph Journal_ByStrippedBlocks.dyn (Dynamo 1.3.1.1736)

# group: INPUT
# note: QUESTION:
# Does the graph execute okay? Do any nodes turn yellow?
journal_file_path = Filename("C:\Users\adieckmann\Desktop\journal.0183_stripped.txt")

# group: Journal.Create
fromPath = FileObject(journal_file_path)  # "File.FromPath"
readText = File.ReadText(fromPath)
byString = Custom[Journal.ByString](str=readText)  # Creates a queriable object from the contents of a Revit journal file

code_block = CodeBlock { 2018; 2; 22; 14; }
byDateAndTime = DateTime.ByDateAndTime(code_block.out0, code_block.out1, code_block.out2, code_block.out3)
code_block_2 = CodeBlock { 2018; 2; 22; 14; 10; }
byDateAndTime_2 = DateTime.ByDateAndTime(code_block_2.out0, code_block_2.out1, code_block_2.out2, code_block_2.out3, code_block_2.out4)
python_script = Python(IN[0]=byString, IN[1]=byDateAndTime, IN[2]=byDateAndTime_2)  # frozen
# ---------- python_script.python (12 lines) ----------
import clr

self = IN[0]
fromDateTime = IN[1]
toDateTime = IN[2]

tslist = self.GetLinesByType("JournalTimeStamp")
if fromDateTime: tslist = [x for x in tslist if x.DateTime > fromDateTime]
if toDateTime: tslist = [x for x in tslist if x.DateTime < toDateTime]


OUT = self.GetLinesByBlocks([x.Block for x in tslist])
# ----------------------------------------
directory_path = Directory("C:\Users\adieckmann\Desktop")
boolean = BoolSelector(false)
fileName = FilePath.FileName(journal_file_path, boolean)
code_block_3 = CodeBlock(original=fileName) { original + "_stripped.txt"; }
combine = FilePath.Combine(directory_path, code_block_3)
boolean_2 = BoolSelector(true)
stripComments = Custom[Journal.StripComments](journal=byString, preserveTimestamps=boolean_2)  # Strips all comments from the original journal string and only returns all (re-formatted) lines that are potentially relevant for journal playback.
writeText = File.WriteText(combine, stripComments)
