# Dynamo graph APIMessagesRevisited.dyn (Dynamo 1.3.1.1736)

# group: INPUT
file_path = Filename("..\..\..\..\Dropbox\journals\avinor\B03\journal.0534.txt")

# group: Evaluate Journal
fromPath = FileObject(file_path)  # "File.FromPath"
readText = File.ReadText(fromPath)
byString = Custom[Journal.ByString](str=readText)  # Creates a queriable object from the contents of a Revit journal file

string = StringInput("JournalAPIMessage")
linesByType = Custom[Journal.LinesByType](journal=byString, journalLineType=string)  # Retrieves all JournalLines of a given type from a given journal
type = Custom[JournalAPIMessage.Type](journalAPIMessage=linesByType)  # Returns the type of an APIMessage line
code_block = CodeBlock(type=type) { type == "AddedPushbutton"; }
filterByBoolMask = List.FilterByBoolMask(list=linesByType, mask=code_block)
text = Custom[JournalAPIMessage.Text](journalAPIMessage=filterByBoolMask.in)  # Returns the text from an APIMessage line
python_script = Python(IN[0]=filterByBoolMask.in)
# ---------- python_script.python (12 lines) ----------
import clr

lines = IN[0]

OUT = []

for line in lines:
	if line.MessageType == "AddedPushbutton":
		pba = line.MessageText.split(", ")[-1].replace("assembly: ","").replace("assembly ","")
		
		
		OUT.append(pba)
# ----------------------------------------
members = Custom[Object.Members](element=python_script)  # Gets a list of all members (properties and methods) of a selected element
python_script_2 = Python(IN[0]=byString)
# ---------- python_script_2.python (69 lines) ----------
import clr

class LoadedAssembly:
	def __init__(self, name, classname, path, vendor, initialEvent):
		self.Name = name
		self.Class = classname
		self.Path = path
		self.Filename = path.split("\\")[-1]
		self.Vendor = vendor
		self.GUID = None
		self.Events = [initialEvent]
	def __repr__(self):
		return "LoadedAssembly"

journal = IN[0]
loadedAssemblies = []
replacedCommands = {}
OUT = []
apimsgs = journal.GetLinesByType("JournalAPIMessage")

for apimsg in apimsgs:
	if apimsg.MessageText.startswith("Starting"):
		startdata1 = apimsg.MessageText.split("Application: ")[-1].split(", Class: ")
		startdata2 = startdata1[-1].split(", Vendor : ")
		startdata3 = startdata2[-1].split(", Assembly: ") 
		appname = startdata1[0]
		classname = startdata2[0]
		path = startdata3[-1]
		vendor = startdata3[0]
		loadedAssemblies.append(LoadedAssembly(appname, classname, path, vendor, apimsg))
		
for apimsg in apimsgs:
	if apimsg.MessageText.startswith("Registering") or apimsg.MessageText.startswith("Unregistering") or apimsg.MessageText.startswith("API registering") or apimsg.MessageText.startswith("API unregistering"):
		regevt = apimsg.MessageText.split("by application ")[-1].rsplit(" (",1)
		appname = regevt[0]
		appguid = regevt[1][:-2]
		foundByGUID = [x for x in loadedAssemblies if x.GUID == appguid]
		if len(foundByGUID) > 0: foundByGUID[0].Events.append(apimsg)
		else:
			foundByName = [x for x in loadedAssemblies if x.Name == appname and x.GUID == None]
			if len(foundByName) > 0:
				foundByName[0].GUID = appguid
				foundByName[0].Events.append(apimsg)
	elif apimsg.MessageText.startswith("Replacing"):
		replname = apimsg.MessageText.split("from application '",1)[-1].split("'",1)[0]
		replpath = apimsg.MessageText.split("'",2)[1]
		replcommand = apimsg.MessageText.split("Replacing command id '",1)[-1].split("'",1)[0]
		# TODO: Replace with FoundByPath/FoundByFilename method
		foundByName = [x for x in loadedAssemblies if x.Name == replname]
		if len(foundByName) > 0: 
			foundByName[0].Events.append(apimsg)
			replacedCommands[replcommand] = foundByName[0]
	elif apimsg.MessageText.startswith("Restoring"):
		restcommand = apimsg.MessageText.split("Restoring command id '",1)[-1].split("'",1)[0]
		if restcommand in replacedCommands:
			replacedCommands[restcommand].Events.append(apimsg)
	elif apimsg.MessageText.startswith("Added pushbutton"):
		pbpath = apimsg.MessageText.split(", ")[-1].replace("assembly: ","").replace("assembly ","")
		foundByPath = [x for x in loadedAssemblies if x.Path == pbpath]
		if len(foundByPath) > 0: foundByPath[0].Events.append(apimsg)
		else:
			foundByFilename = [x for x in loadedAssemblies if x.Filename == pbpath.rsplit("\\",1)[-1]]
			if len(foundByFilename) > 0: foundByFilename[0].Events.append(apimsg)
	elif apimsg.MessageText.startswith("System."):
		excguid = apimsg.MessageText.split("). Changes made by this handler are going to be discarded.",1)[0].rsplit(" (",1)[-1]
		foundByGUID = [x for x in loadedAssemblies if x.GUID == excguid]
		if len(foundByGUID) > 0: foundByGUID[0].Events.append(apimsg)

OUT = loadedAssemblies
# ----------------------------------------
events = Custom[LoadedAssembly.Events](loadedAssembly=python_script_2)  # Returns all journal lines associated with a given LoadedAssembly
text_2 = Custom[JournalAPIMessage.Text](journalAPIMessage=events@L2)
GUID = Custom[LoadedAssembly.GUID](loadedAssembly=python_script_2)  # Returns the GUID of a given LoadedAssembly
name = Custom[LoadedAssembly.Name](loadedAssembly=python_script_2)  # Returns the name of a given LoadedAssembly
class_ = Custom[LoadedAssembly.Class](loadedAssembly=python_script_2)  # Returns the class name of a given LoadedAssembly
path = Custom[LoadedAssembly.Path](loadedAssembly=python_script_2)  # Returns the path of a given LoadedAssembly
filename = Custom[LoadedAssembly.Filename](loadedAssembly=python_script_2)  # Returns the file name of a given LoadedAssembly
vendor = Custom[LoadedAssembly.Vendor](loadedAssembly=python_script_2)  # Returns the vendor information of a given LoadedAssembly
loadedAssemblies = Custom[Journal.LoadedAssemblies]()  # Pulls a list of all loaded assemblies (i.e. addin DLLs) from a given journal; unwired: journal
