# Dynamo graph AnalyzeJournalFiles_ListBased.dyn (Dynamo 1.0.0.1180)

file_path = Filename("..\..\..\Users\adieckmann\AppData\Local\Autodesk\Revit\Autodesk%20Revit%202017\Journals\journal.0920.txt")
fromPath = FileObject(file_path)  # "File.FromPath"

# group: JournalFile.Lines
# note: QUESTION:
# Does the graph execute okay? Do any nodes turn yellow?
readText = File.ReadText(fromPath)
string = StringInput("\n")
split = String.Split(readText, string)
trimLeadingWhitespace = String.TrimLeadingWhitespace(split)
python_script = Python(IN[0]=trimLeadingWhitespace)
# ---------- python_script.python (99 lines) ----------
import clr

lines = IN[0]
types = []
newlines = []
blocks = []
linecounter = []
i = 1
b = 0
for line in lines:
	# ignore empty lines
	if len(line) < 2:
		pass
	elif line.startswith("'C ") or line.startswith("'H ") or line.startswith("'E "):
		types.append('Timestamp')
		linecounter.append(i)
		newlines.append(line)
		b += 1
		blocks.append(b)
	elif ":< API_SUCCESS { " in line:
		types.append('API Success')
		linecounter.append(i)
		newlines.append(line)
		blocks.append(b)
	elif ":< API_ERROR { " in line:
		types.append('API Error')
		linecounter.append(i)
		newlines.append(line)
		blocks.append(b)
	elif ":: Delta VM: " in line or line.startswith("' 0:< Initial VM: "):
		types.append('Memory Metrics')
		linecounter.append(i)
		newlines.append(line)
		blocks.append(b)
	elif ":< GUI Resource Usage GDI: " in line:
		types.append('GUI Resource Usage')
		linecounter.append(i)
		newlines.append(line)
		blocks.append(b)
	# append linebreaks to previous line
	elif newlines[len(newlines)-1][-1] == "_":
		newlines[len(newlines)-1] = newlines[len(newlines)-1][:-1] + line
	elif line[0] == "'":
		# append linebreaks in API Success messages
		if line[1] != " " and types[len(types)-1] == 'API Success' and not newlines[len(newlines)-1].endswith("}"):
			newlines[len(newlines)-1] = newlines[len(newlines)-1] + " " + line[1:]
		# append linebreaks in API Error messages
		elif line[1] != " " and types[len(types)-1] == 'API Error' and not newlines[len(newlines)-1].endswith("}"):
			newlines[len(newlines)-1] = newlines[len(newlines)-1] + " " + line[1:]
		else:
			types.append('Comment')
			linecounter.append(i)
			newlines.append(line)
			blocks.append(b)
	# append linebreaks in commands
	elif line[0] == ",":
		newlines[len(newlines)-1] = (newlines[len(newlines)-1] + line).replace(" _,",",")
	elif line.startswith("Jrn.Data "):
		types.append('Journal Data')
		linecounter.append(i)
		newlines.append(line)
		blocks.append(b)
	elif line.startswith("Jrn.Directive "):
		types.append('Journal Directive')
		linecounter.append(i)
		newlines.append(line)
		blocks.append(b)
	elif line.startswith("Jrn.Command "):
		types.append('Journal Command')
		linecounter.append(i)
		newlines.append(line)
		blocks.append(b)
	elif line.startswith("Jrn.Key "):
		types.append('Journal Keyboard Event')
		linecounter.append(i)
		newlines.append(line)
		blocks.append(b)
	elif line.startswith("Jrn.AddInEvent "):
		types.append('Journal Addin Event')
		linecounter.append(i)
		newlines.append(line)
		blocks.append(b)
	elif line.startswith('Jrn.Wheel') or line.startswith('Jrn.MouseMove') or line.startswith('Jrn.LButtonUp') or line.startswith('Jrn.LButtonDown')  or line.startswith('Jrn.LButtonDblClk') or line.startswith('Jrn.MButtonUp') or line.startswith('Jrn.MButtonDown') or line.startswith('Jrn.RButtonUp') or line.startswith('Jrn.RButtonDown'):
		types.append('Journal Mouse Event')
		linecounter.append(i)
		newlines.append(line)
		blocks.append(b)
	elif line.startswith('Jrn.Activate') or line.startswith('Jrn.AppButtonEvent') or line.startswith('Jrn.Browser') or line.startswith('Jrn.Close') or line.startswith('Jrn.ComboBox') or line.startswith('Jrn.Edit') or line.startswith('Jrn.Grid') or line.startswith('Jrn.ListBox') or line.startswith('Jrn.PropertiesPalette') or line.startswith('Jrn.PushButton') or line.startswith('Jrn.RadioButton') or line.startswith('Jrn.RibbonEvent') or line.startswith('Jrn.SliderCtrl') or line.startswith('Jrn.TabCtrl') or line.startswith('Jrn.TreeCtrl'):
		types.append('Journal UI Event')
		linecounter.append(i)
		newlines.append(line)
		blocks.append(b)
	else:
		types.append('Misc Command')
		linecounter.append(i)
		newlines.append(line)
		blocks.append(b)
	i += 1
OUT = (newlines,types,linecounter,blocks)
# ----------------------------------------
code_block = CodeBlock(seq=python_script)
# ---------- code_block.designscript (8 lines) ----------
// Lines
seq[0];
// Types
seq[1];
// Line numbers
seq[2];
// Blocks
seq[3];
# ----------------------------------------

line_content = Watch(code_block.out0)
line_type = Watch(code_block.out1)
line_numbers = Watch(code_block.out2)

# group: Isolate Timestamps
code_block_2 = CodeBlock(type=code_block.out1) { type == "Timestamp"; }
filterByBoolMask = List.FilterByBoolMask(list=code_block.out0, mask=code_block_2)

# group: JournalFileTimestamp.Evaluate
python_script_2 = Python(IN[0]=filterByBoolMask.in)
# ---------- python_script_2.python (20 lines) ----------
import clr
timestamps = IN[0]
delta = []
timestr = []
desc = []
types = []
previous_timestamp = None

for ts in timestamps:
	types.append(ts[1])
	ts1 = ts.split(";")	
	timestr.append(ts1[0][3:])
	ts2 = ts1[0].split()[2]
	ts3 = ts2.split(":")
	ts4 = float(ts3[0]) * 3600 + float(ts3[1]) * 60 + float(ts3[2])
	if previous_timestamp: delta.append(ts4 - previous_timestamp)
	else: delta.append(0)
	previous_timestamp = ts4
	desc.append(ts1[1][7:])
OUT = (timestr,delta,desc,types)
# ----------------------------------------
code_block_3 = CodeBlock(seq=python_script_2)
# ---------- code_block_3.designscript (8 lines) ----------
// Timestamp
seq[0];
// Delta
seq[1];
// Decription
seq[2];
// Type
seq[3];
# ----------------------------------------

timestamps = Watch(code_block_3.out0)
timestamp_deltas = Watch(code_block_3.out1)
timestamp_descriptions = Watch(code_block_3.out2)
timestamp_types = Watch(code_block_3.out3)

# group: Isolate API Messages
code_block_4 = CodeBlock(type=code_block.out1) { type == "API Success" || type == "API Error"; }
filterByBoolMask_2 = List.FilterByBoolMask(list=code_block.out0, mask=code_block_4)

# group: JournalAPIMessage.Evaluate
python_script_3 = Python(IN[0]=filterByBoolMask_2.in)
# ---------- python_script_3.python (14 lines) ----------
import clr
lines = IN[0]
msgs = []
types = []

for line in lines:
	l1 = line.split("{ ")[1].split(" }")[0]
	msgs.append(l1.strip())
	if ":< API_SUCCESS { " in line:
		types.append("API Success")
	elif ":< API_ERROR { " in line:
		types.append("API Error")
	else: types.append(None)
OUT = (msgs,types)
# ----------------------------------------
code_block_5 = CodeBlock(seq=python_script_3)
# ---------- code_block_5.designscript (4 lines) ----------
// Message
seq[0];
// Type
seq[1];
# ----------------------------------------

api_messages = Watch(code_block_5.out0)
api_message_types = Watch(code_block_5.out1)

# group: Isolate Journal Commands
code_block_6 = CodeBlock(type=code_block.out1) { type == "Journal Command"; }
filterByBoolMask_3 = List.FilterByBoolMask(list=code_block.out0, mask=code_block_6)

# group: JournalCommand.Evaluate
python_script_4 = Python(IN[0]=filterByBoolMask_3.in)
# ---------- python_script_4.python (13 lines) ----------
import clr
commands = IN[0]
types = []
IDs = []
desc = []

for comm in commands:
	c1 = comm.split('" , "')
	types.append(c1[0][13:])
	c2 = c1[1].split(" , ")
	desc.append(c2[0])
	IDs.append(c2[1][:-1])
OUT = (IDs,desc,types)
# ----------------------------------------
code_block_7 = CodeBlock(seq=python_script_4)
# ---------- code_block_7.designscript (6 lines) ----------
// ID
seq[0];
// Description
seq[1];
// Type
seq[2];
# ----------------------------------------

command_ids = Watch(code_block_7.out0)
command_descriptions = Watch(code_block_7.out1)
command_types = Watch(code_block_7.out2)

# group: Isolate Journal Data
code_block_8 = CodeBlock(type=code_block.out1) { type == "Journal Data"; }
filterByBoolMask_4 = List.FilterByBoolMask(list=code_block.out0, mask=code_block_8)

# group: JournalData.Evaluate
python_script_5 = Python(IN[0]=filterByBoolMask_4.in)
# ---------- python_script_5.python (14 lines) ----------
import clr
data = IN[0]
keys = []
values = []

for d in data:
	d1 = d.split('"  , ')
	keys.append(d1[0][10:])
	d2 = d1[1].split(",")
	d4 = []
	for d3 in d2:
		d4.append(d3.strip().replace('"',''))
	values.append(d4)
OUT = (keys,values)
# ----------------------------------------
code_block_9 = CodeBlock(seq=python_script_5)
# ---------- code_block_9.designscript (4 lines) ----------
// Key
seq[0];
// Value
seq[1];
# ----------------------------------------

data_values = Watch(code_block_9.out1)
data_keys = Watch(code_block_9.out0)

# group: Isolate Journal Directives
code_block_10 = CodeBlock(type=code_block.out1) { type == "Journal Directive"; }
filterByBoolMask_5 = List.FilterByBoolMask(list=code_block.out0, mask=code_block_10)

# group: JournalDirective.Evaluate
python_script_6 = Python(IN[0]=filterByBoolMask_5.in)
# ---------- python_script_6.python (14 lines) ----------
import clr
directives = IN[0]
keys = []
values = []

for d in directives:
	d1 = d.split('"  , ')
	keys.append(d1[0][15:])
	d2 = d1[1].split(",")
	d4 = []
	for d3 in d2:
		d4.append(d3.strip().replace('"',''))
	values.append(d4)
OUT = (keys,values)
# ----------------------------------------
code_block_11 = CodeBlock(seq=python_script_6)
# ---------- code_block_11.designscript (4 lines) ----------
// Key
seq[0];
// Values
seq[1];
# ----------------------------------------

directive_values = Watch(code_block_11.out1)
directive_keys = Watch(code_block_11.out0)

# group: Isolate any remaining commands
code_block_12 = CodeBlock(type=code_block.out1) { type == "Misc Command"; }
filterByBoolMask_6 = List.FilterByBoolMask(list=code_block.out0, mask=code_block_12)

watch = Watch(filterByBoolMask_6.in)

# group: Isolate Keyboard Events
code_block_13 = CodeBlock(type=code_block.out1) { type == "Journal Keyboard Event"; }
filterByBoolMask_7 = List.FilterByBoolMask(list=code_block.out0, mask=code_block_13)

# group: JournalKeyboardEvent.Evaluate
python_script_7 = Python(IN[0]=filterByBoolMask_7.in)
# ---------- python_script_7.python (8 lines) ----------
import clr
lines = IN[0]
keys = []

for line in lines:
	keys.append(line.split('"')[1])
	
OUT = keys
# ----------------------------------------

keys = Watch(python_script_7)

# group: Isolate Mouse Events
code_block_14 = CodeBlock(type=code_block.out1) { type == "Journal Mouse Event"; }
filterByBoolMask_8 = List.FilterByBoolMask(list=code_block.out0, mask=code_block_14)

# group: JournalMouseEvent.Evaluate
python_script_8 = Python(IN[0]=filterByBoolMask_8.in)
# ---------- python_script_8.python (15 lines) ----------
import clr
lines = IN[0]
types = []
data = []

for line in lines:
	m1 = line.split(" ",1)
	types.append(m1[0][4:].strip())
	m2 = m1[1].split(",")
	m4 = []
	for m3 in m2:
		m4.append(int(m3.strip()))
	data.append(m4)
	
OUT = (types,data)
# ----------------------------------------
code_block_15 = CodeBlock(seq=python_script_8)
# ---------- code_block_15.designscript (4 lines) ----------
// Type
seq[0];
// Data
seq[1];
# ----------------------------------------

event_types = Watch(code_block_15.out0)
event_data = Watch(code_block_15.out1)

# group: Isolate GUI Resource Usage
code_block_16 = CodeBlock(type=code_block.out1) { type == "GUI Resource Usage"; }
filterByBoolMask_9 = List.FilterByBoolMask(list=code_block.out0, mask=code_block_16)

# group: JournalGUIResourceUsage.Evaluate
python_script_9 = Python(IN[0]=filterByBoolMask_9.in)
# ---------- python_script_9.python (10 lines) ----------
import clr
lines = IN[0]
OUT = []

for line in lines:
	g1 = line.split(",")
	g3 = []
	for g2 in g1:
		g3.append(int(g2.strip().split()[-1]))
	OUT.append(g3)
# ----------------------------------------

transpose = List.Transpose(python_script_9)

# group (continued): JournalGUIResourceUsage.Evaluate
code_block_17 = CodeBlock(seq=transpose)
# ---------- code_block_17.designscript (6 lines) ----------
// Available
seq[0];
// Used
seq[1];
// User
seq[2];
# ----------------------------------------

available = Watch(code_block_17.out0)
used = Watch(code_block_17.out1)
user = Watch(code_block_17.out2)

# group: Isolate Memory Metrics
code_block_18 = CodeBlock(type=code_block.out1) { type == "Memory Metrics"; }
filterByBoolMask_10 = List.FilterByBoolMask(list=code_block.out0, mask=code_block_18)

# group: JournalMemoryMetrics.Evaluate
python_script_10 = Python(IN[0]=filterByBoolMask_10.in)
# ---------- python_script_10.python (33 lines) ----------
import clr
lines = IN[0]
vm_avail = []
vm_used = []
vm_peak = []
ram_avail = []
ram_used = []
ram_peak = []
data = []

for line in lines:
	if "Initial VM" in line:
		m1 = line.split(":",2)[2].replace(";","").split()
	else:
		m1 = line.split(":",6)[6].split()
	m3 = []
	for m2 in m1:
		if m2.isdigit(): 
			m3.append(int(m2))
	vm_avail.append(m3[0])
	vm_used.append(m3[1])
	if len(m3) == 6:
		vm_peak.append(m3[2])
		ram_avail.append(m3[3])
		ram_used.append(m3[4])
		ram_peak.append(m3[5])
	elif len(m3) == 4:
		vm_peak.append(None)
		ram_avail.append(m3[2])
		ram_used.append(m3[3])
		ram_peak.append(None)
		
OUT = (vm_avail,vm_used,vm_peak,ram_avail,ram_used,ram_peak)	
# ----------------------------------------
code_block_19 = CodeBlock(seq=python_script_10)
# ---------- code_block_19.designscript (12 lines) ----------
// VM Available
seq[0];
// VM Used
seq[1];
// VM Peak
seq[2];
// RAM Available
seq[3];
// RAM Used
seq[4];
// RAM Peak
seq[5];
# ----------------------------------------

vm_used = Watch(code_block_19.out1)
vm_peak = Watch(code_block_19.out2)
vm_available = Watch(code_block_19.out0)
ram_peak = Watch(code_block_19.out5)
ram_used = Watch(code_block_19.out4)
ram_available = Watch(code_block_19.out3)

# group: Isolate any remaining comments
code_block_20 = CodeBlock(type=code_block.out1) { type == "Comment"; }
filterByBoolMask_11 = List.FilterByBoolMask(list=code_block.out0, mask=code_block_20)

watch_2 = Watch(filterByBoolMask_11.in)

# group: Get unique line types
uniqueItems = List.UniqueItems(code_block.out1)
sort = List.Sort(uniqueItems)

unique_line_types = Watch(sort)

# group: Isolate Addin Events
code_block_21 = CodeBlock(type=code_block.out1) { type == "Journal Addin Event"; }
filterByBoolMask_12 = List.FilterByBoolMask(list=code_block.out0, mask=code_block_21)

# group: JournalAddinEvent.Evaluate
python_script_11 = Python(IN[0]=filterByBoolMask_12.in)
# ---------- python_script_11.python (8 lines) ----------
import clr
lines = IN[0]
keys = []

for line in lines:
	keys.append(line.split('"')[3])
	
OUT = keys
# ----------------------------------------

addin_event_message = Watch(python_script_11)

# group: IsolateUI Events
code_block_22 = CodeBlock(type=code_block.out1) { type == "Journal UI Event"; }
filterByBoolMask_13 = List.FilterByBoolMask(list=code_block.out0, mask=code_block_22)

# group: JournalUIEvent.Evaluate
python_script_12 = Python(IN[0]=filterByBoolMask_13.in)
# ---------- python_script_12.python (21 lines) ----------
import clr
directives = IN[0]
types = []
values = []

for d in directives:
	d1 = d.split(" ",1)
	types.append(d1[0][4:])
	d2 = d1[1].split(",")
	d4 = []
	for d3 in d2:
		d5 = d3.strip().replace('"','').strip()
		if d1[0][4:] == "RibbonEvent":
			d6 = d5.split(":")
			for d7 in d6:
				d7 = d7.strip()
				if d7 != "": d4.append(d7)
		else:
			if d5 != "": d4.append(d5)
	values.append(d4)
OUT = (types,values)
# ----------------------------------------
code_block_23 = CodeBlock(seq=python_script_12)  # same code as code_block_15

event_types_2 = Watch(code_block_23.out0)
event_data_2 = Watch(code_block_23.out1)

# group: Identify remaining command types
string_2 = StringInput(" ")
split_2 = String.Split(filterByBoolMask_6.in, string_2)
transpose_2 = List.Transpose(split_2)
firstItem = List.FirstItem(transpose_2)
groupByKey = List.GroupByKey(list=filterByBoolMask_6.in, keys=firstItem)

# note: QUESTION:
# Do you see more than three items in this list? (Dim, Set, Jrn.Size)
watch_3 = Watch(groupByKey.unique_keys)
watch_4 = Watch(groupByKey.groups)

# group: Identify remaining comment types
string_3 = StringInput(" ")
split_3 = String.Split(filterByBoolMask_11.in, string_3)
transpose_3 = List.Transpose(split_3)
firstItem_2 = List.FirstItem(transpose_3)
groupByKey_2 = List.GroupByKey(list=filterByBoolMask_11.in, keys=firstItem_2)

watch_5 = Watch(groupByKey_2.unique_keys)
# note: QUESTION:
# Would you like to be able to pull any of this data from the journal file?
watch_6 = Watch(groupByKey_2.groups)
block = Watch(code_block.out3)
