# Dynamo graph JournalHealthCheck.dyn (Dynamo 1.3.1.1736)

# group: Inputs
directory_path_target = Directory("C:\temp")
filename_sheetname = StringInput("JournalHealthCheck")
directory_path_source = Directory("U:\Desktop\journals\SyncError")

# group: Read source directory
string = StringInput("*.txt")
contents = Custom[Directory.Contents+](directoryPath=directory_path_source, searchString=string)  # Unlike the built-in node Directory.Contents, this node browses a directory recursively and returns all relevant files contained in subfolders as well.
fromPath = FileObject(contents)  # "File.FromPath"

# group: Create journal objects
readText = File.ReadText(fromPath)
byString = Custom[Journal.ByString](str=readText@L1)

# group: Pull relevant meta data
revitBranch = Custom[Journal.RevitBranch](journal=byString)
revitBuild = Custom[Journal.RevitBuild](journal=byString)
revitVersion = Custom[Journal.RevitVersion](journal=byString)
startupTime = Custom[Journal.StartupTime](journal=byString)
sessionTerminatedProperly = Custom[Journal.SessionTerminatedProperly](journal=byString)
sessionTime = Custom[Journal.SessionTime](journal=byString)
processingTime = Custom[Journal.ProcessingTime](journal=byString)
user = Custom[Journal.User](journal=byString)
isInPlaybackMode = Custom[Journal.IsInPlaybackMode](journal=byString)
playbackInterrupted = Custom[Journal.PlaybackInterrupted](journal=byString)
OSVersion = Custom[Journal.OSVersion](journal=byString)
minVMAvailable = Custom[Journal.MinVMAvailable](journal=byString)
minRAMAvailable = Custom[Journal.MinRAMAvailable](journal=byString)
maxVMPeak = Custom[Journal.MaxVMPeak](journal=byString)
maxRAMPeak = Custom[Journal.MaxRAMPeak](journal=byString)
machine = Custom[Journal.Machine](journal=byString)
containsExceptions = Custom[Journal.ContainsExceptions](journal=byString)
containsAPIErrors = Custom[Journal.ContainsAPIErrors](journal=byString)
size = Custom[File.Size](file=fromPath)  # Returns the file size of a given file.
create = List.Create(contents, revitBranch, revitBuild, revitVersion, startupTime, sessionTerminatedProperly, sessionTime, processingTime, user, isInPlaybackMode, playbackInterrupted, OSVersion, minVMAvailable, minRAMAvailable, maxVMPeak, maxRAMPeak, machine, containsExceptions, containsAPIErrors, size.megabytes)

# group: Process data for export
string_2 = StringInput("")
replaceNulls = Lists.Manage.ReplaceNulls(create, string_2)
type = Object.Type(replaceNulls)
code_block = CodeBlock(obj=type) { obj == "System.String"; }
string_from_object = FromObject(replaceNulls)
if_ = If(test=code_block, true=replaceNulls, false=string_from_object)

# group: Create headings and add data
string_3 = StringInput("""JournalPath
RevitBranch
RevitBuild
RevitVersion
StartupTime
SessionTerminatedProperly
SessionTime
ProcessingTime
User
IsInPlaybackMode
PlaybackInterrupted
OSVersion
MinVMAvailable
MinRAMAvailable
MaxVMPeak
MaxRAMPeak
Machine
ContainsExceptions
ContainsAPIErrors
FileSize""")
string_4 = StringInput("\n")
split = String.Split(string_3, string_4)
create_2 = List.Create(split)
transpose = List.Transpose(if_)
join = List.Join(create_2, transpose)

# group: Write to Excel
combine = FilePath.Combine(directory_path_target, filename_sheetname)
code_block_2 = CodeBlock(filename=combine) { filename + ".xlsx"; }
code_block_3 = CodeBlock { 0; }
boolean = BoolSelector(true)
writeToFile = Excel.WriteToFile(filePath=code_block_2, sheetName=filename_sheetname, startRow=code_block_3, startCol=code_block_3, data=join, overWrite=boolean)
