# Dynamo graph Journal_DynamoActivities.dyn (Dynamo 1.3.1.1736)

# group: INPUT
journal_file_path = Filename("..\..\..\Journals\_dynamo\DynamoStuff.journal.0250.txt")

# group: Journal.Create
fromPath = FileObject(journal_file_path)  # "File.FromPath"
readText = File.ReadText(fromPath)
byString = Custom[Journal.ByString](str=readText)  # Creates a queriable object from the contents of a Revit journal file

python_script = Python(IN[0]=byString)
# ---------- python_script.python (58 lines) ----------
import clr

self = IN[0]

class DynamoSession:
	def __init__(self, launchEvent, playerSession):
		self.LaunchEvent = launchEvent
		self.Start = launchEvent.GetDateTimeOfBlock()
		self.IsPlayerSession = playerSession
		self.ShutdownEvent = None
		self.End = None
		self.Duration = None
		self.Scripts = []
		self.ScriptsCount = 0
		self.TransactionsCount = 0
	def __repr__(self):
		return 'JournalDynamoSession'
		
class DynamoScript:
	def __init__(self, openEvent):
		self.OpenEvent = openEvent
		self.TimeStamp = openEvent.GetDateTimeOfBlock()
		self.FileName = None
		self.Transactions = []
		self.TransactionsCount = 0
	def __repr__(self):
		return 'JournalDynamoScript'

# Create Dynamo session events
uiSessions = [DynamoSession(x, False) for x in self.GetLinesByTypeAndProperty("JournalCommand", "CommandID", "ID_VISUAL_PROGRAMMING_DYNAMO")]
playerSessions = [DynamoSession(x, True) for x in self.GetLinesByTypeAndProperty("JournalCommand", "CommandID", "ID_FILE_TOPOSURFACE_LINK")]
dynamoSessions = uisessions
# Bind shutdowns to sessions
for dynamoShutdown in self.GetLinesByTypeAndProperty("JournalAddinEvent", "MessageText", "WpfWindow(_this,Dynamo).Close()"):
	shutdownTime = dynamoShutdown.GetDateTimeOfBlock()
	i = 0
	for dynamoSession in dynamoSessions:
		if dynamoSession.Start > shutdownTime:
			dynamoSessions[i-1].ShutdownEvent = dynamoShutdown
			dynamoSessions[i-1].End = shutdownTime
			dynamoSessions[i-1].Duration = shutdownTime - dynamoSessions[i-1].Start
			break
		i += 1
# Bind scripts to events
allAddinEvents = self.GetLinesByType("JournalAddinEvent")
for dynamoOpen in [x for x in allAddinEvents if x.MessageText.startswith("FileDialog(Win7Open,Open Dynamo Definition")]:
	# Exclude custom nodes
	if ".dyn,Dynamo Definitions" in dynamoOpen.MessageText:
		for dynamoSession in dynamoSessions:
			if dynamoOpen.Number > dynamoSession.LaunchEvent.Number and dynamoOpen.Number < dynamoSession.ShutdownEvent.Number:
				thisScript = DynamoScript(dynamoOpen)
				thisScript.FileName = dynamoOpen.MessageText.split(".SelectFile(")[1].split("\.dyn,")[0]
				dynamoSession.Scripts.append(thisScript)
				dynamoSession.ScriptsCount += 1
				break		
# Bind transactions to scripts

OUT = dynamoSessions
# ----------------------------------------
python_script_2 = Python(IN[0]=python_script)
# ---------- python_script_2.python (8 lines) ----------
import clr

sessions = IN[0]
start = [x.Start for x in sessions]
end = [x.End for x in sessions]
time = [x.Duration for x in sessions]

OUT = [(x. Start, x.End, x.Duration, x. Scripts) for x in sessions]
# ----------------------------------------
code_block = CodeBlock(seq=python_script_2) { seq[0][3][0]; }
members = Custom[Object.Members](element=code_block)  # Gets a list of all members (properties and methods) of a selected element
python_script_3 = Python(IN[0]=code_block)
# ---------- python_script_3.python (3 lines) ----------
import clr

OUT = IN[0].FileName
# ----------------------------------------
