# Dynamo graph Journal_UnprocessedData.dyn (Dynamo 1.3.4.6666)

directory_path = Directory("U:\Journals\Journals")

# group: Evaluate Journals
string = StringInput("*.txt")
contents = Custom[Directory.Contents+](directoryPath=directory_path, searchString=string)  # Unlike the built-in node Directory.Contents, this node browses a directory recursively and returns all relevant files contained in subfolders as well.
byPath = Custom[Journal.ByPath](path=contents)  # Creates a queryable object from the contents of a Revit journal file

# group: Identify unclassified JournalMiscCommands
string_2 = StringInput("JournalMiscCommand")
linesByType = Custom[Journal.GetLinesByType](journal=byPath@L1, journalLineType=string_2)  # "Journal.LinesByType"
flatten = Flatten(linesByType)
rawText = Custom[JournalLine.RawText](journalLine=flatten)
string_3 = StringInput(" ")
split = String.Split(rawText, string_3)
transpose = List.Transpose(split)
firstItem = List.FirstItem(transpose)
groupByKey = List.GroupByKey(list=rawText, keys=firstItem)
string_4 = StringInput("""Dim
Set
Jrn.Size""")
string_5 = StringInput("\n")
split_2 = String.Split(string_4, string_5)
containsItem = List.ContainsItem(list=split_2, item=groupByKey.unique_keys)
filterByBoolMask = List.FilterByBoolMask(list=groupByKey.groups, mask=containsItem)
watch = Watch(filterByBoolMask.out)
filterByBoolMask_2 = List.FilterByBoolMask(list=groupByKey.unique_keys, mask=containsItem)
watch_2 = Watch(filterByBoolMask_2.out)

# group: JournalComment TEST
string_6 = StringInput("JournalComment")
linesByType_2 = Custom[Journal.GetLinesByType](journal=byPath, journalLineType=string_6)  # "Journal.LinesByType"
flatten_2 = Flatten(linesByType_2)
rawText_2 = Custom[JournalLine.RawText](journalLine=flatten_2)
string_7 = StringInput(" ")
split_3 = String.Split(rawText_2, string_7)
transpose_2 = List.Transpose(split_3)
firstItem_2 = List.FirstItem(transpose_2)
groupByKey_2 = List.GroupByKey(list=rawText_2, keys=firstItem_2)
count = List.Count(groupByKey_2.groups@L2)
create = List.Create(groupByKey_2.unique_keys, count, groupByKey_2.groups)
code_block = CodeBlock { 1; }
boolean = BoolSelector(true)
sortListOfLists = Custom[List.SortListOfLists](seq=create, sortIndex=code_block, orderDescending=boolean)  # Sorts a list of lists by one of its sublists
code_block_2 = CodeBlock(seq=sortListOfLists)
# ---------- code_block_2.designscript (6 lines) ----------
// Starts with
seq[0];
// # of Instances
seq[1];
// Instances
seq[2];
# ----------------------------------------
watch_3 = Watch(code_block_2.out0)
watch_4 = Watch(code_block_2.out2)
watch_5 = Watch(code_block_2.out1)
