# Dynamo graph Journalysis_OO_WithoutBlocks.dyn (Dynamo 1.0.0.1180)

file_path = Filename("c:\netz\adieckmann\Desktop\journals\Journals_dhess\journal.0455.txt")
fromPath = FileObject(file_path)  # "File.FromPath"

# group: JournalFile.Lines
# note: QUESTION:
# Does the graph execute okay? Do any nodes turn yellow?
readText = File.ReadText(fromPath)
string = StringInput("\n")
split = String.Split(readText, string)
trimLeadingWhitespace = String.TrimLeadingWhitespace(split)
python_script = Python(IN[0]=trimLeadingWhitespace)  # frozen
# ---------- python_script.python (99 lines) ----------
import clr

lines = IN[0]
types = []
newlines = []
blocks = []
linecounter = []
i = 1
b = 0
for line in lines:
	# ignore empty lines
	if len(line) < 2:
		pass
	elif line.startswith("'C ") or line.startswith("'H ") or line.startswith("'E "):
		types.append('Timestamp')
		linecounter.append(i)
		newlines.append(line)
		b += 1
		blocks.append(b)
	elif ":< API_SUCCESS { " in line:
		types.append('API Success')
		linecounter.append(i)
		newlines.append(line)
		blocks.append(b)
	elif ":< API_ERROR { " in line:
		types.append('API Error')
		linecounter.append(i)
		newlines.append(line)
		blocks.append(b)
	elif ":: Delta VM: " in line or line.startswith("' 0:< Initial VM: "):
		types.append('Memory Metrics')
		linecounter.append(i)
		newlines.append(line)
		blocks.append(b)
	elif ":< GUI Resource Usage GDI: " in line:
		types.append('GUI Resource Usage')
		linecounter.append(i)
		newlines.append(line)
		blocks.append(b)
	# append linebreaks to previous line
	elif newlines[len(newlines)-1][-1] == "_":
		newlines[len(newlines)-1] = newlines[len(newlines)-1][:-1] + line
	elif line[0] == "'":
		# append linebreaks in API Success messages
		if line[1] != " " and types[len(types)-1] == 'API Success' and not newlines[len(newlines)-1].endswith("}"):
			newlines[len(newlines)-1] = newlines[len(newlines)-1] + " " + line[1:]
		# append linebreaks in API Error messages
		elif line[1] != " " and types[len(types)-1] == 'API Error' and not newlines[len(newlines)-1].endswith("}"):
			newlines[len(newlines)-1] = newlines[len(newlines)-1] + " " + line[1:]
		else:
			types.append('Comment')
			linecounter.append(i)
			newlines.append(line)
			blocks.append(b)
	# append linebreaks in commands
	elif line[0] == ",":
		newlines[len(newlines)-1] = (newlines[len(newlines)-1] + line).replace(" _,",",")
	elif line.startswith("Jrn.Data "):
		types.append('Journal Data')
		linecounter.append(i)
		newlines.append(line)
		blocks.append(b)
	elif line.startswith("Jrn.Directive "):
		types.append('Journal Directive')
		linecounter.append(i)
		newlines.append(line)
		blocks.append(b)
	elif line.startswith("Jrn.Command "):
		types.append('Journal Command')
		linecounter.append(i)
		newlines.append(line)
		blocks.append(b)
	elif line.startswith("Jrn.Key "):
		types.append('Journal Keyboard Event')
		linecounter.append(i)
		newlines.append(line)
		blocks.append(b)
	elif line.startswith("Jrn.AddInEvent "):
		types.append('Journal Addin Event')
		linecounter.append(i)
		newlines.append(line)
		blocks.append(b)
	elif line.startswith('Jrn.Wheel') or line.startswith('Jrn.MouseMove') or line.startswith('Jrn.LButtonUp') or line.startswith('Jrn.LButtonDown')  or line.startswith('Jrn.LButtonDblClk') or line.startswith('Jrn.MButtonUp') or line.startswith('Jrn.MButtonDown') or line.startswith('Jrn.RButtonUp') or line.startswith('Jrn.RButtonDown'):
		types.append('Journal Mouse Event')
		linecounter.append(i)
		newlines.append(line)
		blocks.append(b)
	elif line.startswith('Jrn.Activate') or line.startswith('Jrn.AppButtonEvent') or line.startswith('Jrn.Browser') or line.startswith('Jrn.Close') or line.startswith('Jrn.ComboBox') or line.startswith('Jrn.Edit') or line.startswith('Jrn.Grid') or line.startswith('Jrn.ListBox') or line.startswith('Jrn.PropertiesPalette') or line.startswith('Jrn.PushButton') or line.startswith('Jrn.RadioButton') or line.startswith('Jrn.RibbonEvent') or line.startswith('Jrn.SliderCtrl') or line.startswith('Jrn.TabCtrl') or line.startswith('Jrn.TreeCtrl'):
		types.append('Journal UI Event')
		linecounter.append(i)
		newlines.append(line)
		blocks.append(b)
	else:
		types.append('Misc Command')
		linecounter.append(i)
		newlines.append(line)
		blocks.append(b)
	i += 1
OUT = (newlines,types,linecounter,blocks)
# ----------------------------------------
code_block = CodeBlock(seq=python_script)
# ---------- code_block.designscript (8 lines) ----------
// Lines
seq[0];
// Types
seq[1];
// Line numbers
seq[2];
// Blocks
seq[3];
# ----------------------------------------

line_content = Watch(code_block.out0)
line_type = Watch(code_block.out1)
line_numbers = Watch(code_block.out2)

# group: Isolate Timestamps
code_block_2 = CodeBlock(type=code_block.out1) { type == "Timestamp"; }
filterByBoolMask = List.FilterByBoolMask(list=code_block.out0, mask=code_block_2)

# group: JournalFileTimestamp.Evaluate
python_script_2 = Python(IN[0]=filterByBoolMask.in)
# ---------- python_script_2.python (20 lines) ----------
import clr
timestamps = IN[0]
delta = []
timestr = []
desc = []
types = []
previous_timestamp = None

for ts in timestamps:
	types.append(ts[1])
	ts1 = ts.split(";")	
	timestr.append(ts1[0][3:])
	ts2 = ts1[0].split()[2]
	ts3 = ts2.split(":")
	ts4 = float(ts3[0]) * 3600 + float(ts3[1]) * 60 + float(ts3[2])
	if previous_timestamp: delta.append(ts4 - previous_timestamp)
	else: delta.append(0)
	previous_timestamp = ts4
	desc.append(ts1[1][7:])
OUT = (timestr,delta,desc,types)
# ----------------------------------------
code_block_3 = CodeBlock(seq=python_script_2)
# ---------- code_block_3.designscript (8 lines) ----------
// Timestamp
seq[0];
// Delta
seq[1];
// Decription
seq[2];
// Type
seq[3];
# ----------------------------------------

timestamps = Watch(code_block_3.out0)
timestamp_deltas = Watch(code_block_3.out1)
timestamp_descriptions = Watch(code_block_3.out2)
timestamp_types = Watch(code_block_3.out3)

# group: Isolate any remaining commands
code_block_4 = CodeBlock(type=code_block.out1) { type == "Misc Command"; }
filterByBoolMask_2 = List.FilterByBoolMask(list=code_block.out0, mask=code_block_4)

watch = Watch(filterByBoolMask_2.in)

# group: Isolate Keyboard Events
code_block_5 = CodeBlock(type=code_block.out1) { type == "Journal Keyboard Event"; }
filterByBoolMask_3 = List.FilterByBoolMask(list=code_block.out0, mask=code_block_5)

# group: JournalKeyboardEvent.Evaluate
python_script_3 = Python(IN[0]=filterByBoolMask_3.in)
# ---------- python_script_3.python (8 lines) ----------
import clr
lines = IN[0]
keys = []

for line in lines:
	keys.append(line.split('"')[1])
	
OUT = keys
# ----------------------------------------

keys = Watch(python_script_3)

# group: Isolate any remaining comments
code_block_6 = CodeBlock(type=code_block.out1) { type == "Comment"; }
filterByBoolMask_4 = List.FilterByBoolMask(list=code_block.out0, mask=code_block_6)

watch_2 = Watch(filterByBoolMask_4.in)

# group: Get unique line types
uniqueItems = List.UniqueItems(code_block.out1)
sort = List.Sort(uniqueItems)

unique_line_types = Watch(sort)

# group: Isolate Addin Events
code_block_7 = CodeBlock(type=code_block.out1) { type == "Journal Addin Event"; }
filterByBoolMask_5 = List.FilterByBoolMask(list=code_block.out0, mask=code_block_7)

# group: JournalAddinEvent.Evaluate
python_script_4 = Python(IN[0]=filterByBoolMask_5.in)
# ---------- python_script_4.python (8 lines) ----------
import clr
lines = IN[0]
keys = []

for line in lines:
	keys.append(line.split('"')[3])
	
OUT = keys
# ----------------------------------------

addin_event_message = Watch(python_script_4)

# group: Identify remaining command types
string_2 = StringInput(" ")
split_2 = String.Split(filterByBoolMask_2.in, string_2)
transpose = List.Transpose(split_2)
firstItem = List.FirstItem(transpose)
groupByKey = List.GroupByKey(list=filterByBoolMask_2.in, keys=firstItem)

# note: QUESTION:
# Do you see more than three items in this list? (Dim, Set, Jrn.Size)
watch_3 = Watch(groupByKey.unique_keys)
watch_4 = Watch(groupByKey.groups)

# group: Identify remaining comment types
string_3 = StringInput(" ")
split_3 = String.Split(filterByBoolMask_4.in, string_3)
transpose_2 = List.Transpose(split_3)
firstItem_2 = List.FirstItem(transpose_2)
groupByKey_2 = List.GroupByKey(list=filterByBoolMask_4.in, keys=firstItem_2)

watch_5 = Watch(groupByKey_2.unique_keys)
# note: QUESTION:
# Would you like to be able to pull any of this data from the journal file?
watch_6 = Watch(groupByKey_2.groups)
block = Watch(code_block.out3)
string_4 = StringInput("JournalData")
code_block_8 = CodeBlock { 34; }
code_block_9 = CodeBlock { 30..34; }
code_block_10 = CodeBlock { {"JournalData","JournalDirective"}; }

# group: Journal
byFile = Python(IN[0]=trimLeadingWhitespace)  # "JournalFile.ByFile"
# ---------- byFile.python (288 lines) ----------
import clr

class JournalFile:
	def __init__(self, lines, version, username, models):
		self.Lines = lines
		self.LineCount = len(lines)
		self.Version = version
		self.User = username
		self.LoadedModels = set(models)
		self.Blocks = []
		self.BlockCount = 0
	def __repr__(self):
		return 'JournalFile'
	def GetBlockByNumber(self,block):
		return [x for x in self.Blocks if x.Number == block][0]
	def GetBlockByNumbers(self,blocks):
		return [x for x in self.Blocks if x.Number in blocks]
	def GetLinesByBlockNumber(self,block):
		return [x for x in self.Lines if x.BlockNumber == block]
	def GetLinesByBlockNumbers(self,blocks):
		return [x for x in self.Lines if x.BlockNumber in blocks]
	def GetLinesByType(self,type):
		return [x for x in self.Lines if x.Type == type]
	def GetLinesByTypes(self,types):
		return [x for x in self.Lines if x.Type in types]
"""
class JournalBlock:
	def __init__(self, number, lines):
		self.Number = number
		self.Lines = lines
		self.LineCount = len(lines)
		self.Timestamp = lines[0]
	def __repr__(self):
		return 'JournalBlock'"""

class JournalLine:
	def __init__(self, number, raw, block, type):
		self.Number = number
		self.RawText = raw
		self.BlockNumber = block
		self.Type = type
		self.Block = None
	def __repr__(self):
		return 'JournalLine'

class JournalAddinEvent(JournalLine):
	def __repr__(self):
		return 'JournalAddinEvent'

class JournalAPIMessage(JournalLine):
	def __init__(self, number, raw, block, type, msg_type):
		JournalLine.__init__(self, number, raw, block, type)
		self.MessageType = msg_type
		self.MessageText = ''
	def __repr__(self):
		return 'JournalAPIMessage'

class JournalCommand(JournalLine):
	def __init__(self, number, raw, block, type):
		JournalLine.__init__(self, number, raw, block, type)
		self.CommandType = ''
		self.CommandDescription = ''
		self.CommandID = ''
	def __repr__(self):
		return 'JournalCommand'

class JournalComment(JournalLine):
	def __repr__(self):
		return 'JournalComment'

class JournalData(JournalLine):
	def __init__(self, number, raw, block, type):
		JournalLine.__init__(self, number, raw, block, type)
		self.Key = ''
		self.Values = []
	def __repr__(self):
		return 'JournalData'

class JournalDirective(JournalLine):
	def __init__(self, number, raw, block, type):
		JournalLine.__init__(self, number, raw, block, type)
		self.Key = ''
		self.Values = []
	def __repr__(self):
		return 'JournalDirective'

class JournalGUIResourceUsage(JournalLine):
	def __init__(self, number, raw, block, type):
		JournalLine.__init__(self, number, raw, block, type)
		self.Available = 0
		self.Used = 0
		self.User = 0
	def __repr__(self):
		return 'JournalGUIResourceUsage'

class JournalKeyboardEvent(JournalLine):
	def __repr__(self):
		return 'JournalKeyboardEvent'
		
class JournalMemoryMetrics(JournalLine):
	def __init__(self, number, raw, block, type):
		JournalLine.__init__(self, number, raw, block, type)
		self.VMAvailable = 0
		self.VMUsed = 0
		self.VMPeak = 0
		self.RAMAvailable = 0
		self.RAMUsed = 0
		self.RAMPeak = 0
	def __repr__(self):
		return 'JournalMemoryMetrics'

class JournalMiscCommand(JournalLine):
	def __repr__(self):
		return 'JournalMiscCommand'

class JournalMouseEvent(JournalLine):
	def __init__(self, number, raw, block, type):
		JournalLine.__init__(self, number, raw, block, type)
		self.MouseEventType = ''
		self.Data = []
	def __repr__(self):
		return 'JournalMouseEvent'
		
class JournalTimeStamp(JournalLine):
	def __repr__(self):
		return 'JournalTimeStamp'

class JournalUIEvent(JournalLine):
	def __init__(self, number, raw, block, type):
		JournalLine.__init__(self, number, raw, block, type)
		self.UIEventType = ''
		self.Data = []
	def __repr__(self):
		return 'JournalUInEvent'

lines = IN[0]
lineObjs = []
jVersion = ''
jUsername = ''
jModels = []
i = 1
b = 0
# Round 1: Create line objects
for line in lines:
	# ignore empty lines
	if len(line) < 2:
		pass
	elif line.startswith("'C ") or line.startswith("'H ") or line.startswith("'E "):
		b += 1
		lineObjs.append(JournalTimeStamp(i,line,b,'JournalTimeStamp'))
	elif ":< API_SUCCESS { " in line:
		lineObjs.append(JournalAPIMessage(i,line,b,'JournalAPIMessage','Success'))
	elif ":< API_ERROR { " in line:
		lineObjs.append(JournalAPIMessage(i,line,b,'JournalAPIMessage','Error'))
	elif ":: Delta VM: " in line or line.startswith("' 0:< Initial VM: "):
		lineObjs.append(JournalMemoryMetrics(i,line,b,'JournalMemoryMetrics'))
	elif ":< GUI Resource Usage GDI: " in line:
		lineObjs.append(JournalGUIResourceUsage(i,line,b,'JournalGUIResourceUsage'))
	elif line.startswith("Jrn.Data "):
		lineObjs.append(JournalData(i,line,b,'JournalData'))
	elif line.startswith("Jrn.Directive "):
		lineObjs.append(JournalDirective(i,line,b,'JournalDirective'))
	elif line.startswith("Jrn.Command "):
		lineObjs.append(JournalCommand(i,line,b,'JournalCommand'))
	elif line.startswith("Jrn.Key "):
		lineObjs.append(JournalKeyboardEvent(i,line,b,'JournalKeyboardEvent'))
	elif line.startswith("Jrn.AddInEvent "):
		lineObjs.append(JournalAddinEvent(i,line,b,'JournalAddinEvent'))
	elif line.startswith('Jrn.Wheel') or line.startswith('Jrn.MouseMove') or line.startswith('Jrn.LButtonUp') or line.startswith('Jrn.LButtonDown')  or line.startswith('Jrn.LButtonDblClk') or line.startswith('Jrn.MButtonUp') or line.startswith('Jrn.MButtonDown') or line.startswith('Jrn.RButtonUp') or line.startswith('Jrn.RButtonDown'):
		lineObjs.append(JournalMouseEvent(i,line,b,'JournalMouseEvent'))
	elif line.startswith('Jrn.Activate') or line.startswith('Jrn.AppButtonEvent') or line.startswith('Jrn.Browser') or line.startswith('Jrn.Close') or line.startswith('Jrn.ComboBox') or line.startswith('Jrn.Edit') or line.startswith('Jrn.Grid') or line.startswith('Jrn.ListBox') or line.startswith('Jrn.PropertiesPalette') or line.startswith('Jrn.PushButton') or line.startswith('Jrn.RadioButton') or line.startswith('Jrn.RibbonEvent') or line.startswith('Jrn.SliderCtrl') or line.startswith('Jrn.TabCtrl') or line.startswith('Jrn.TreeCtrl'):
		lineObjs.append(JournalUIEvent(i,line,b,'JournalUIEvent'))
	# append linebreaks to previous line
	elif lineObjs[-1].RawText[-1] == "_":
		lineObjs[-1].RawText = lineObjs[-1].RawText[:-1] + line
	# append linebreaks in commands
	elif line[0] == ",":
		lineObjs[-1].RawText = (lineObjs[-1].RawText + line).replace(" _,",",")
	elif line[0] == "'":
		# append linebreaks in API Messages
		if line[1] != " " and lineObjs[-1].Type == 'JournalAPIMessage' and not lineObjs[-1].RawText.endswith("}"):
			lineObjs[-1].RawText += " " + line[1:]
		else:
			lineObjs.append(JournalComment(i,line,b,'JournalComment'))
	else:
		lineObjs.append(JournalMiscCommand(i,line,b,'JournalMiscCommand'))
	i += 1

# Round 2: Process raw multiline text and fill type-specific attributes
for line in lineObjs:
	if line.Type == 'JournalAPIMessage':
		line.MessageText = line.RawText.split("{ ")[1].split(" }")[0].strip()
	elif line.Type == 'JournalDirective':
		d1 = line.RawText.split('"  , ')
		line.Key = d1[0][15:]
		for d2 in d1[1].split(","):
			line.Values.append(d2.strip().replace('"',''))
		# Add Revit version to journal metadata
		if line.Key == 'Version':
			jVersion = line.Values[0]
		# Add username to journal metadata
		elif line.Key == 'Username':
			jUsername = line.Values[0]
	elif line.Type == 'JournalData':
		d1 = line.RawText.split('"  , ')
		line.Key = d1[0][10:]
		for d2 in d1[1].split(","):
			line.Values.append(d2.strip().replace('"',''))
		# Add model list to journal metadata
		if line.Key == 'File Name' and line.Values[0] == 'IDOK':
			jModels.append(line.Values[1])
	elif line.Type == 'JournalCommand':
		c1 = line.RawText.split('" , "')
		line.CommandType = c1[0][13:]
		c2 = c1[1].split(" , ")
		line.CommandDescription = c2[0]
		line.CommandID = c2[1][:-1]
	elif line.Type == 'JournalMouseEvent':
		m1 = line.RawText.split(" ",1)
		line.MouseEventType = m1[0][4:].strip()
		for m2 in m1[1].split(","):
			line.Data.append(int(m2.strip()))
	elif line.Type == 'JournalGUIResourceUsage':
		g2 = []
		for g1 in line.RawText.split(","):
			g2.append(int(g1.strip().split()[-1]))
		line.Available = g2[0]
		line.Used = g2[1]
		line.User = g2[2]
	elif line.Type == 'JournalUIEvent':
		d1 = line.RawText.split(" ",1)
		line.UIEventType = d1[0][4:]
		for d2 in d1[1].split(","):
			d3 = d2.strip().replace('"','').strip()
			if line.UIEventType == "RibbonEvent":
				for d4 in d3.split(":"):
					d4 = d4.strip()
					if d4 != "": line.Data.append(d4)
			elif d3 != "": line.Data.append(d3)
	elif line.Type == 'JournalMemoryMetrics':
		if "Initial VM" in line.RawText:
			m1 = line.RawText.split(":",2)[2].replace(";","").split()
		else:
			m1 = line.RawText.split(":",6)[6].split()
		m3 = []
		m4 = []
		for m2 in m1:
			if m2.isdigit(): 
				m3.append(int(m2))
			elif m2 in ("Avail","Used","Peak"):
				m4.append(m2)
		line.VMAvailable = m3[0]
		line.VMUsed = m3[1]
		if len(m3) == 6:		
			line.VMPeak = m3[2]
			line.RAMAvailable = m3[3]
			line.RAMUsed = m3[4]
			line.RAMPeak = m3[5]
		elif len(m3) == 5:
			if m4[2] == "Avail":
				line.VMPeak = None
				line.RAMAvailable = m3[2]
				line.RAMUsed = m3[3]
				line.RAMPeak = m3[4]
			elif m4[2] == "Peak":
				line.VMPeak = m3[2]
				line.RAMAvailable = m3[3]
				line.RAMUsed = m3[4]
				line.RAMPeak = None
		elif len(m3) == 4:
			line.VMPeak = None
			line.RAMAvailable = m3[2]
			line.RAMUsed = m3[3]
			line.RAMPeak = None

# Round 3: Create blocks and create relationships to journal and lines
journal = JournalFile(lineObjs, jVersion, jUsername, jModels)
"""i = 0
blocks = []
while i < (b + 1):
	blocks.append(JournalBlock(i, journal.GetLinesByBlockNumber(1)))
	i += 1
journal.Blocks = blocks
journal.BlockCount = b + 1
for line in lineObjs:
	line.Block = blocks[line.BlockNumber]"""
	
OUT = journal
# ----------------------------------------
lines = Python(IN[0]=byFile)  # "JournalFile.Lines"
# ---------- lines.python (3 lines) ----------
import clr

OUT = IN[0].Lines
# ----------------------------------------
version = Python(IN[0]=byFile)  # "JournalFile.Version"
# ---------- version.python (3 lines) ----------
import clr

OUT = IN[0].Version
# ----------------------------------------
user = Python(IN[0]=byFile)  # "JournalFile.User"
# ---------- user.python (3 lines) ----------
import clr

OUT = IN[0].User
# ----------------------------------------
loadedModels = Python(IN[0]=byFile)  # "JournalFile.LoadedModels"
# ---------- loadedModels.python (3 lines) ----------
import clr

OUT = IN[0].LoadedModels
# ----------------------------------------
getLinesByType = Python(IN[0]=byFile, IN[1]=string_4)  # "JournalFile.GetLinesByType"
# ---------- getLinesByType.python (3 lines) ----------
import clr

OUT = IN[0].GetLinesByType(IN[1])
# ----------------------------------------
getLinesByBlockNumber = Python(IN[0]=byFile, IN[1]=code_block_8)  # "JournalFile.GetLinesByBlockNumber"
# ---------- getLinesByBlockNumber.python (3 lines) ----------
import clr

OUT = IN[0].GetLinesByBlockNumber(IN[1])
# ----------------------------------------
blockCount = Python(IN[0]=byFile)  # "JournalFile.BlockCount"
# ---------- blockCount.python (3 lines) ----------
import clr

OUT = IN[0].BlockCount
# ----------------------------------------
blocks = Python(IN[0]=byFile)  # "JournalFile.Blocks"; frozen
# ---------- blocks.python (3 lines) ----------
import clr

OUT = IN[0].Blocks
# ----------------------------------------
getBlockByNumber = Python(IN[0]=byFile, IN[1]=code_block_8)  # "JournalFile.GetBlockByNumber"; frozen
# ---------- getBlockByNumber.python (3 lines) ----------
import clr

OUT = IN[0].GetBlockByNumber(IN[1])
# ----------------------------------------
getBlockByNumbers = Python(IN[0]=byFile, IN[1]=code_block_9)  # "JournalFile.GetBlockByNumbers"; frozen
# ---------- getBlockByNumbers.python (3 lines) ----------
import clr

OUT = IN[0].GetBlockByNumbers(IN[1])
# ----------------------------------------
getLinesByBlockNumbers = Python(IN[0]=byFile, IN[1]=code_block_9)  # "JournalFile.GetLinesByBlockNumbers"
# ---------- getLinesByBlockNumbers.python (3 lines) ----------
import clr

OUT = IN[0].GetLinesByBlockNumbers(IN[1])
# ----------------------------------------
getLinesByTypes = Python(IN[0]=byFile, IN[1]=code_block_10)  # "JournalFile.GetLinesByTypes"
# ---------- getLinesByTypes.python (3 lines) ----------
import clr

OUT = IN[0].GetLinesByTypes(IN[1])
# ----------------------------------------

# group: Lines
blockNumber = Python(IN[0]=lines)  # "JournalLine.BlockNumber"
# ---------- blockNumber.python (6 lines) ----------
import clr

lines = IN[0]
OUT = []
for line in lines:
	OUT.append(line.BlockNumber)
# ----------------------------------------
number = Python(IN[0]=lines)  # "JournalLine.Number"
# ---------- number.python (6 lines) ----------
import clr

lines = IN[0]
OUT = []
for line in lines:
	OUT.append(line.Number)
# ----------------------------------------
rawText = Python(IN[0]=lines)  # "JournalLine.RawText"
# ---------- rawText.python (6 lines) ----------
import clr

lines = IN[0]
OUT = []
for line in lines:
	OUT.append(line.RawText)
# ----------------------------------------
type = Python(IN[0]=lines)  # "JournalLine.Type"
# ---------- type.python (6 lines) ----------
import clr

lines = IN[0]
OUT = []
for line in lines:
	OUT.append(line.Type)
# ----------------------------------------
block_2 = Python(IN[0]=lines)  # "JournalLine.Block"
# ---------- block_2.python (6 lines) ----------
import clr

lines = IN[0]
OUT = []
for line in lines:
	OUT.append(line.Block)
# ----------------------------------------

# group: API Messages
code_block_11 = CodeBlock(type=type) { type == "JournalAPIMessage"; }
filterByBoolMask_6 = List.FilterByBoolMask(list=lines, mask=code_block_11)
messageText = Python(IN[0]=filterByBoolMask_6.in)  # "JournalAPIMessage.MessageText"
# ---------- messageText.python (9 lines) ----------
import clr

lines = IN[0]
OUT = []
for line in lines:
	if line.Type == "JournalAPIMessage":
		OUT.append(line.MessageText)
	else:
		OUT.append(None)
# ----------------------------------------
messageType = Python(IN[0]=filterByBoolMask_6.in)  # "JournalAPIMessage.MessageType"
# ---------- messageType.python (9 lines) ----------
import clr

lines = IN[0]
OUT = []
for line in lines:
	if line.Type == "JournalAPIMessage":
		OUT.append(line.MessageType)
	else:
		OUT.append(None)
# ----------------------------------------

# group: Directives
code_block_12 = CodeBlock(type=type) { type == "JournalDirective"; }
filterByBoolMask_7 = List.FilterByBoolMask(list=lines, mask=code_block_12)
values = Python(IN[0]=filterByBoolMask_7.in)  # "JournalDirective.Values"
# ---------- values.python (9 lines) ----------
import clr

lines = IN[0]
OUT = []
for line in lines:
	if line.Type == "JournalDirective":
		OUT.append(line.Values)
	else:
		OUT.append([])
# ----------------------------------------
key = Python(IN[0]=filterByBoolMask_7.in)  # "JournalDirective.Key"
# ---------- key.python (9 lines) ----------
import clr

lines = IN[0]
OUT = []
for line in lines:
	if line.Type == "JournalDirective":
		OUT.append(line.Key)
	else:
		OUT.append(None)
# ----------------------------------------

# group: Data
code_block_13 = CodeBlock(type=type) { type == "JournalData"; }
filterByBoolMask_8 = List.FilterByBoolMask(list=lines, mask=code_block_13)
values_2 = Python(IN[0]=filterByBoolMask_8.in)  # "JournalData.Values"
# ---------- values_2.python (9 lines) ----------
import clr

lines = IN[0]
OUT = []
for line in lines:
	if line.Type == "JournalData":
		OUT.append(line.Values)
	else:
		OUT.append([])
# ----------------------------------------
key_2 = Python(IN[0]=filterByBoolMask_8.in)  # "JournalData.Key"
# ---------- key_2.python (9 lines) ----------
import clr

lines = IN[0]
OUT = []
for line in lines:
	if line.Type == "JournalData":
		OUT.append(line.Key)
	else:
		OUT.append(None)
# ----------------------------------------

# group: Commands
code_block_14 = CodeBlock(type=type) { type == "JournalCommand"; }
filterByBoolMask_9 = List.FilterByBoolMask(list=lines, mask=code_block_14)
commandType = Python(IN[0]=filterByBoolMask_9.in)  # "JournalCommand.CommandType"
# ---------- commandType.python (9 lines) ----------
import clr

lines = IN[0]
OUT = []
for line in lines:
	if line.Type == "JournalCommand":
		OUT.append(line.CommandType)
	else:
		OUT.append(None)
# ----------------------------------------
commandDescription = Python(IN[0]=filterByBoolMask_9.in)  # "JournalCommand.CommandDescription"
# ---------- commandDescription.python (9 lines) ----------
import clr

lines = IN[0]
OUT = []
for line in lines:
	if line.Type == "JournalCommand":
		OUT.append(line.CommandDescription)
	else:
		OUT.append(None)
# ----------------------------------------
commandID = Python(IN[0]=filterByBoolMask_9.in)  # "JournalCommand.CommandID"
# ---------- commandID.python (9 lines) ----------
import clr

lines = IN[0]
OUT = []
for line in lines:
	if line.Type == "JournalCommand":
		OUT.append(line.CommandID)
	else:
		OUT.append(None)
# ----------------------------------------

# group: Mouse Events
code_block_15 = CodeBlock(type=type) { type == "JournalMouseEvent"; }
filterByBoolMask_10 = List.FilterByBoolMask(list=lines, mask=code_block_15)
data = Python(IN[0]=filterByBoolMask_10.in)  # "JournalMouseEvent.Data"
# ---------- data.python (9 lines) ----------
import clr

lines = IN[0]
OUT = []
for line in lines:
	if line.Type == "JournalMouseEvent":
		OUT.append(line.Data)
	else:
		OUT.append([])
# ----------------------------------------
mouseEventType = Python(IN[0]=filterByBoolMask_10.in)  # "JournalMouseEvent.MouseEventType"
# ---------- mouseEventType.python (9 lines) ----------
import clr

lines = IN[0]
OUT = []
for line in lines:
	if line.Type == "JournalMouseEvent":
		OUT.append(line.MouseEventType)
	else:
		OUT.append(None)
# ----------------------------------------

# group: GUI Resource Usage
code_block_16 = CodeBlock(type=type) { type == "JournalGUIResourceUsage"; }
filterByBoolMask_11 = List.FilterByBoolMask(list=lines, mask=code_block_16)
available = Python(IN[0]=filterByBoolMask_11.in)  # "JournalGUIResourceUsage.Available"
# ---------- available.python (9 lines) ----------
import clr

lines = IN[0]
OUT = []
for line in lines:
	if line.Type == "JournalGUIResourceUsage":
		OUT.append(line.Available)
	else:
		OUT.append(None)
# ----------------------------------------
used = Python(IN[0]=filterByBoolMask_11.in)  # "JournalGUIResourceUsage.Used"
# ---------- used.python (9 lines) ----------
import clr

lines = IN[0]
OUT = []
for line in lines:
	if line.Type == "JournalGUIResourceUsage":
		OUT.append(line.Used)
	else:
		OUT.append(None)
# ----------------------------------------
user_2 = Python(IN[0]=filterByBoolMask_11.in)  # "JournalGUIResourceUsage.User"
# ---------- user_2.python (9 lines) ----------
import clr

lines = IN[0]
OUT = []
for line in lines:
	if line.Type == "JournalGUIResourceUsage":
		OUT.append(line.User)
	else:
		OUT.append(None)
# ----------------------------------------

lineCount = Python(IN[0]=byFile)  # "JournalFile.LineCount"
# ---------- lineCount.python (3 lines) ----------
import clr

OUT = IN[0].LineCount
# ----------------------------------------

# group: Blocks
lines_2 = Python(IN[0]=blocks)  # "JournalBlock.Lines"
# ---------- lines_2.python (6 lines) ----------
import clr

blocks = IN[0]
OUT = []
for block in blocks:
	OUT.append(block.Lines)
# ----------------------------------------
lineCount_2 = Python(IN[0]=blocks)  # "JournalBlock.LineCount"
# ---------- lineCount_2.python (6 lines) ----------
import clr

blocks = IN[0]
OUT = []
for block in blocks:
	OUT.append(block.LineCount)
# ----------------------------------------
number_2 = Python(IN[0]=blocks)  # "JournalBlock.Number"
# ---------- number_2.python (6 lines) ----------
import clr

blocks = IN[0]
OUT = []
for block in blocks:
	OUT.append(block.Number)
# ----------------------------------------
timestamp = Python(IN[0]=blocks)  # "JournalBlock.Timestamp"
# ---------- timestamp.python (6 lines) ----------
import clr

blocks = IN[0]
OUT = []
for block in blocks:
	OUT.append(block.Timestamp)
# ----------------------------------------

# group: UI Events
code_block_17 = CodeBlock(type=type) { type == "JournalUIEvent"; }
filterByBoolMask_12 = List.FilterByBoolMask(list=lines, mask=code_block_17)
UIEventType = Python(IN[0]=filterByBoolMask_12.in)  # "JournalUIEvent.UIEventType"
# ---------- UIEventType.python (9 lines) ----------
import clr

lines = IN[0]
OUT = []
for line in lines:
	if line.Type == "JournalUIEvent":
		OUT.append(line.UIEventType)
	else:
		OUT.append(None)
# ----------------------------------------
data_2 = Python(IN[0]=filterByBoolMask_12.in)  # "JournalUIEvent.Data"
# ---------- data_2.python (9 lines) ----------
import clr

lines = IN[0]
OUT = []
for line in lines:
	if line.Type == "JournalUIEvent":
		OUT.append(line.Data)
	else:
		OUT.append([])
# ----------------------------------------

# group: Memory Metrics
code_block_18 = CodeBlock(type=type) { type == "JournalMemoryMetrics"; }
filterByBoolMask_13 = List.FilterByBoolMask(list=lines, mask=code_block_18)
VMAvailable = Python(IN[0]=filterByBoolMask_13.in)  # "JournalMemoryMetrics.VMAvailable"
# ---------- VMAvailable.python (9 lines) ----------
import clr

lines = IN[0]
OUT = []
for line in lines:
	if line.Type == "JournalMemoryMetrics":
		OUT.append(line.VMAvailable)
	else:
		OUT.append(None)
# ----------------------------------------
VMUsed = Python(IN[0]=filterByBoolMask_13.in)  # "JournalMemoryMetrics.VMUsed"
# ---------- VMUsed.python (9 lines) ----------
import clr

lines = IN[0]
OUT = []
for line in lines:
	if line.Type == "JournalMemoryMetrics":
		OUT.append(line.VMUsed)
	else:
		OUT.append(None)
# ----------------------------------------
VMPeak = Python(IN[0]=filterByBoolMask_13.in)  # "JournalMemoryMetrics.VMPeak"
# ---------- VMPeak.python (9 lines) ----------
import clr

lines = IN[0]
OUT = []
for line in lines:
	if line.Type == "JournalMemoryMetrics":
		OUT.append(line.VMPeak)
	else:
		OUT.append(None)
# ----------------------------------------
RAMAvailable = Python(IN[0]=filterByBoolMask_13.in)  # "JournalMemoryMetrics.RAMAvailable"
# ---------- RAMAvailable.python (9 lines) ----------
import clr

lines = IN[0]
OUT = []
for line in lines:
	if line.Type == "JournalMemoryMetrics":
		OUT.append(line.RAMAvailable)
	else:
		OUT.append(None)
# ----------------------------------------
RAMUsed = Python(IN[0]=filterByBoolMask_13.in)  # "JournalMemoryMetrics.RAMUsed"
# ---------- RAMUsed.python (9 lines) ----------
import clr

lines = IN[0]
OUT = []
for line in lines:
	if line.Type == "JournalMemoryMetrics":
		OUT.append(line.RAMUsed)
	else:
		OUT.append(None)
# ----------------------------------------
RAMPeak = Python(IN[0]=filterByBoolMask_13.in)  # "JournalMemoryMetrics.RAMPeak"
# ---------- RAMPeak.python (9 lines) ----------
import clr

lines = IN[0]
OUT = []
for line in lines:
	if line.Type == "JournalMemoryMetrics":
		OUT.append(line.RAMPeak)
	else:
		OUT.append(None)
# ----------------------------------------
