# Dynamo graph KeyboardShortcuts.dyn (Dynamo 1.3.1.1736)

# group: INPUT
file_path = Filename("C:\Users\adieckmann\Desktop\KeyboardShortcuts.xml")

# group: Evaluate Journal
fromPath = FileObject(file_path)  # "File.FromPath"
readText = File.ReadText(fromPath)

python_script = Python(IN[0]=readText)
# ---------- python_script.python (36 lines) ----------
import clr
import sys
pyt_path = r'C:\Program Files (x86)\IronPython 2.7\Lib'
sys.path.append(pyt_path)
import xml.etree.ElementTree as ET

elementlist = []

root = ET.fromstring(IN[0])
CommandNames = []
CommandIDs = []
CommandShortcuts = []
CommandPaths = []
CommandHasShortcuts = []
CommandHasPaths = []

for child in root:
	if child.tag == "ShortcutItem":
		CommandNames.append(child.get("CommandName"))
		CommandIDs.append(child.get("CommandId"))
		shortcuts = child.get("Shortcuts") 
		if shortcuts == None:
			CommandShortcuts.append([])
			CommandHasShortcuts.append(False)
		else:
			CommandShortcuts.append(shortcuts.split("#"))
			CommandHasShortcuts.append(True)
		paths = child.get("Paths") 
		if paths == None:
			CommandPaths.append([])
			CommandHasPaths.append(False)
		else:
			CommandPaths.append(paths.split("; "))
			CommandHasPaths.append(True)

OUT = (CommandNames, CommandIDs, CommandShortcuts, CommandPaths, CommandHasShortcuts, CommandHasPaths)
# ----------------------------------------
code_block = CodeBlock(seq=python_script) { seq[0]; seq[1]; seq[2]; seq[3]; seq[4]; seq[5]; }
watch = Watch(code_block.out0)
watch_2 = Watch(code_block.out1)
watch_3 = Watch(code_block.out3)
watch_4 = Watch(code_block.out2)
watch_5 = Watch(code_block.out4)
watch_6 = Watch(code_block.out5)
