# Dynamo graph NewJournalLineFilters.dyn (Dynamo 1.3.1.1736)

# group: INPUT
file_path = Filename("..\..\..\Desktop\journals\Journals_dhess\journal.0453.txt")

# group: Evaluate Journal
fromPath = FileObject(file_path)  # "File.FromPath"
readText = File.ReadText(fromPath)
byString = Custom[Journal.ByString](str=readText)

string = StringInput("\n")
split = String.Split(readText, string)
trimLeadingWhitespace = String.TrimLeadingWhitespace(split)
python_script = Python(IN[0]=trimLeadingWhitespace)
# ---------- python_script.python (400 lines) ----------
import clr
import sys
sys.path.append("C:\Program Files (x86)\IronPython 2.7\Lib")
import os
import time
processing_started = time.time()

class Journal:
	def __init__(self, lines, version, username, blockcount, path, build, branch, machinename, osversion):
		self.Lines = lines
		self.LineCount = len(lines)
		self.Version = version
		self.User = username	
		self.BlockCount = blockcount
		self.Path = path
		self.ProcessingTime = None
		self.SessionTime = None
		self.StartupTime = None
		self.SessionTerminatedProperly = False
		self.IsInPlaybackMode = False
		self.PlaybackInterrupted = False
		self.Build = build
		self.Branch = branch
		self.ContainsAPIErrors = False
		self.ContainsExceptions = False
		self.Machine = machinename
		self.OSVersion = osversion
		self.MaxRAMPeak = None
		self.MinRAMAvailable = None
		self.MaxVMPeak = None
		self.MinVMAvailable = None
	def __repr__(self):
		return 'Journal'
	def GetLinesByBlock(self, block):
		return [x for x in self.Lines if x.Block == block]
	def GetLinesByBlocks(self, blocks):
		return [x for x in self.Lines if x.Block in blocks]
	def GetLinesByType(self, type):
		return [x for x in self.Lines if x.Type == type]
	def GetLinesByTypeAndProperty(self, type, prop, val):
		return [x for x in self.Lines if x.Type == type and getattr(x, prop) == val]
	def GetLinesByTypes(self, types):
		return [x for x in self.Lines if x.Type in types]

class JournalLine:
	def __init__(self, number, raw, block, type):
		self.Number = number
		self.RawText = raw
		self.Block = block
		self.Type = type
		self.Journal = None
	def __repr__(self):
		return 'JournalLine'
	def AllNext(self):
		if self.Journal.Lines.index(self) + 1 < self.Journal.LineCount:
			return self.Journal.Lines[self.Journal.Lines.index(self) + 1:]
		else: return []
	def AllNextOfType(self, type):
		return [x for x in self.AllNext() if x.Type == type]
	def AllNextOfTypeAndProperty(self, type, prop, val):
		return [x for x in self.AllNext() if x.Type == type and getattr(x, prop) == val]
	def AllPrevious(self):
		if self.Journal.Lines.index(self) - 1 > -1:
			return self.Journal.Lines[:self.Journal.Lines.index(self)]
		else: return []
	def AllPreviousOfType(self, type):
		return [x for x in self.AllPrevious() if x.Type == type]
	def AllPreviousOfTypeAndProperty(self, type, prop, val):
		return [x for x in self.AllPrevious() if x.Type == type and getattr(x, prop) == val]
	def Next(self):
		if self.Journal.Lines.index(self) + 1 < self.Journal.LineCount:
			return self.Journal.Lines[self.Journal.Lines.index(self) + 1]
		else: return None
	def NextOfType(self, type):
		allnext = self.AllNextOfType(type)
		if len(allnext) > 0: return allnext[0]
		else: return None
	def NextOfTypeAndProperty(self, type, prop, val):
		allnext = self.AllNextOfTypeAndProperty(type, prop, val)
		if len(allnext) > 0: return allnext[0]
		else: return None
	def Previous(self):
		if self.Journal.Lines.index(self) - 1 > -1:
			return self.Journal.Lines[self.Journal.Lines.index(self) - 1]
		else: return None
	def PreviousOfType(self, type):
		allprev = self.AllPreviousOfType(type)
		if len(allprev) > 0: return allprev[-1]
		else: return None
	def PreviousOfTypeAndProperty(self, type, prop, val):
		allprev = self.AllPreviousOfTypeAndProperty(type, prop, val)
		if len(allprev) > 0: return allprev[-1]
		else: return None

class JournalAddinEvent(JournalLine):
	def __init__(self, number, raw, block, type):
		JournalLine.__init__(self, number, raw, block, type)
		self.MessageText = None
	def __repr__(self):
		return 'JournalAddinEvent'

class JournalAPIMessage(JournalLine):
	def __init__(self, number, raw, block, type, msg_type):
		JournalLine.__init__(self, number, raw, block, type)
		self.MessageType = msg_type
		self.MessageText = None
	def __repr__(self):
		return 'JournalAPIMessage'

class JournalCommand(JournalLine):
	def __init__(self, number, raw, block, type):
		JournalLine.__init__(self, number, raw, block, type)
		self.CommandType = None
		self.CommandDescription = None
		self.CommandID = None
	def __repr__(self):
		return 'JournalCommand'

class JournalComment(JournalLine):
	def __repr__(self):
		return 'JournalComment'

class JournalData(JournalLine):
	def __init__(self, number, raw, block, type):
		JournalLine.__init__(self, number, raw, block, type)
		self.Key = None
		self.Values = []
	def __repr__(self):
		return 'JournalData'

class JournalDirective(JournalLine):
	def __init__(self, number, raw, block, type):
		JournalLine.__init__(self, number, raw, block, type)
		self.Key = None
		self.Values = []
	def __repr__(self):
		return 'JournalDirective'

class JournalGUIResourceUsage(JournalLine):
	def __init__(self, number, raw, block, type):
		JournalLine.__init__(self, number, raw, block, type)
		self.Available = None
		self.Used = None
		self.User = None
	def __repr__(self):
		return 'JournalGUIResourceUsage'

class JournalKeyboardEvent(JournalLine):
	def __init__(self, number, raw, block, type):
		JournalLine.__init__(self, number, raw, block, type)
		self.Key = None
	def __repr__(self):
		return 'JournalKeyboardEvent'
		
class JournalMemoryMetrics(JournalLine):
	def __init__(self, number, raw, block, type):
		JournalLine.__init__(self, number, raw, block, type)
		self.VMAvailable = None
		self.VMUsed = None
		self.VMPeak = None
		self.RAMAvailable = None
		self.RAMUsed = None
		self.RAMPeak = None
	def __repr__(self):
		return 'JournalMemoryMetrics'

class JournalMiscCommand(JournalLine):
	def __repr__(self):
		return 'JournalMiscCommand'

class JournalMouseEvent(JournalLine):
	def __init__(self, number, raw, block, type):
		JournalLine.__init__(self, number, raw, block, type)
		self.MouseEventType = None
		self.Data = []
	def __repr__(self):
		return 'JournalMouseEvent'
		
class JournalTimeStamp(JournalLine):
	def __init__(self, number, raw, block, type):
		JournalLine.__init__(self, number, raw, block, type)
		self.TimeStampType = None
		self.DateTime = None
		self.Description = None
	def __repr__(self):
		return 'JournalTimeStamp'

class JournalUIEvent(JournalLine):
	def __init__(self, number, raw, block, type):
		JournalLine.__init__(self, number, raw, block, type)
		self.UIEventType = None
		self.Data = []
	def __repr__(self):
		return 'JournalUIEvent'

lines = IN[0]
lineObjs = []
jVersion = None
jUsername = None
jMachineName = None
jOSVersion = None
jPath = None
i = 1
b = 0
# Round 1: Create line objects
for line in lines:
	# ignore empty lines
	if len(line) < 2:
		pass
	elif line.startswith("'C ") or line.startswith("'H ") or line.startswith("'E "):
		b += 1
		lineObjs.append(JournalTimeStamp(i,line,b,'JournalTimeStamp'))
	elif ":< API_SUCCESS { " in line:
		lineObjs.append(JournalAPIMessage(i,line,b,'JournalAPIMessage','Success'))
	elif ":< API_ERROR { " in line:
		lineObjs.append(JournalAPIMessage(i,line,b,'JournalAPIMessage','Error'))
	elif ":: Delta VM: " in line or line.startswith("' 0:< Initial VM: "):
		lineObjs.append(JournalMemoryMetrics(i,line,b,'JournalMemoryMetrics'))
	elif ":< GUI Resource Usage GDI: " in line:
		lineObjs.append(JournalGUIResourceUsage(i,line,b,'JournalGUIResourceUsage'))
	elif line.startswith("Jrn.Data "):
		lineObjs.append(JournalData(i,line,b,'JournalData'))
	elif line.startswith("Jrn.Directive "):
		lineObjs.append(JournalDirective(i,line,b,'JournalDirective'))
	elif line.startswith("Jrn.Command "):
		lineObjs.append(JournalCommand(i,line,b,'JournalCommand'))
	elif line.startswith("Jrn.Key "):
		lineObjs.append(JournalKeyboardEvent(i,line,b,'JournalKeyboardEvent'))
	elif line.startswith("Jrn.AddInEvent "):
		lineObjs.append(JournalAddinEvent(i,line,b,'JournalAddinEvent'))
	elif line.startswith('Jrn.Wheel') or line.startswith('Jrn.MouseMove') or line.startswith('Jrn.LButtonUp') or line.startswith('Jrn.LButtonDown') or line.startswith('Jrn.LButtonDblClk') or line.startswith('Jrn.MButtonUp') or line.startswith('Jrn.MButtonDown') or line.startswith('Jrn.MButtonDblClk') or line.startswith('Jrn.RButtonUp') or line.startswith('Jrn.RButtonDown') or line.startswith('Jrn.RButtonDblClk'):
		lineObjs.append(JournalMouseEvent(i,line,b,'JournalMouseEvent'))
	elif line.startswith('Jrn.Activate') or line.startswith('Jrn.AppButtonEvent') or line.startswith('Jrn.Browser') or line.startswith('Jrn.Close') or line.startswith('Jrn.ComboBox') or line.startswith('Jrn.Edit') or line.startswith('Jrn.Grid') or line.startswith('Jrn.ListBox') or line.startswith('Jrn.PropertiesPalette') or line.startswith('Jrn.PushButton') or line.startswith('Jrn.RadioButton') or line.startswith('Jrn.RibbonEvent') or line.startswith('Jrn.SliderCtrl') or line.startswith('Jrn.TabCtrl') or line.startswith('Jrn.TreeCtrl'):
		lineObjs.append(JournalUIEvent(i,line,b,'JournalUIEvent'))
	# append linebreaks to previous line
	elif lineObjs[-1].RawText[-1] == "_":
		lineObjs[-1].RawText = lineObjs[-1].RawText[:-1] + line
	# append linebreaks in commands
	elif line[0] == ",":
		lineObjs[-1].RawText = (lineObjs[-1].RawText + line).replace(" _,",",")
	elif line[0] == "'":
		# append linebreaks in API Messages
		if line[1] != " " and lineObjs[-1].Type == 'JournalAPIMessage' and not lineObjs[-1].RawText.endswith("}"):
			lineObjs[-1].RawText += " " + line[1:]
		else:
			lineObjs.append(JournalComment(i,line,b,'JournalComment'))
	else:
		lineObjs.append(JournalMiscCommand(i,line,b,'JournalMiscCommand'))
	i += 1
jBlockCount = b

# Round 2: Process raw multiline text and fill type-specific attributes
machineNameFound = False
OSVersionFound = False
for line in lineObjs:
	if line.Type == 'JournalAPIMessage':
		line.MessageText = line.RawText.split("{ ")[1].split(" }")[0].strip()
	elif line.Type == 'JournalDirective':
		d1 = line.RawText.split('"  , ')
		line.Key = d1[0][15:]
		for d2 in d1[1].split(","):
			line.Values.append(d2.strip().replace('"',''))
		# Add Revit version to journal metadata
		if line.Key == 'Version':
			jVersion = int(line.Values[0][:4])
		# Add username to journal metadata
		elif line.Key == 'Username':
			jUsername = line.Values[0]
	elif line.Type == 'JournalData':
		d1 = line.RawText.split('"  , ')
		line.Key = d1[0][10:]
		for d2 in d1[1].split(","):
			line.Values.append(d2.strip().replace('"',''))
	elif line.Type == 'JournalCommand':
		c1 = line.RawText.split('" , "')
		line.CommandType = c1[0][13:]
		c2 = c1[1].split(" , ")
		line.CommandDescription = c2[0]
		line.CommandID = c2[1][:-1]
	elif line.Type == 'JournalMouseEvent':
		m1 = line.RawText.split(" ",1)
		line.MouseEventType = m1[0][4:].strip()
		for m2 in m1[1].split(","):
			line.Data.append(int(m2.strip()))
	elif line.Type == 'JournalKeyboardEvent':
		line.Key = line.RawText.split('"')[1]
	elif line.Type == 'JournalGUIResourceUsage':
		g2 = []
		for g1 in line.RawText.split(","):
			g2.append(int(g1.strip().split()[-1]))
		line.Available = g2[0]
		line.Used = g2[1]
		line.User = g2[2]
	elif line.Type == 'JournalUIEvent':
		d1 = line.RawText.split(" ",1)
		line.UIEventType = d1[0][4:]
		for d2 in d1[1].split(","):
			d3 = d2.strip().replace('"','').strip()
			if line.UIEventType == "RibbonEvent":
				for d4 in d3.split(":"):
					d4 = d4.strip()
					if d4 != "": line.Data.append(d4)
			elif d3 != "": line.Data.append(d3)
	elif line.Type == 'JournalAddinEvent':
		line.MessageText = line.RawText.split('"')[3]
	elif line.Type == 'JournalTimeStamp':
		line.TimeStampType = line.RawText[1]
		ts1 = line.RawText.split(";")	
		line.DateTime = time.strptime(ts1[0][3:])
		line.Description = ts1[1][7:].strip()
	elif line.Type == 'JournalMemoryMetrics':
		if "Initial VM" in line.RawText:
			m1 = line.RawText.split(":",2)[2].replace(";","").split()
		else:
			m1 = line.RawText.split(":",6)[6].split()
		m3 = []
		m4 = []
		for m2 in m1:
			if m2.isdigit(): 
				m3.append(int(m2))
			elif m2 in ("Avail","Used","Peak"):
				m4.append(m2)
		line.VMAvailable = m3[0]
		line.VMUsed = m3[1]
		if len(m3) == 6:		
			line.VMPeak = m3[2]
			line.RAMAvailable = m3[3]
			line.RAMUsed = m3[4]
			line.RAMPeak = m3[5]
		elif len(m3) == 5:
			if m4[2] == "Avail":
				line.VMPeak = None
				line.RAMAvailable = m3[2]
				line.RAMUsed = m3[3]
				line.RAMPeak = m3[4]
			elif m4[2] == "Peak":
				line.VMPeak = m3[2]
				line.RAMAvailable = m3[3]
				line.RAMUsed = m3[4]
				line.RAMPeak = None
		elif len(m3) == 4:
			line.VMPeak = None
			line.RAMAvailable = m3[2]
			line.RAMUsed = m3[3]
			line.RAMPeak = None
	elif line.Type == 'JournalComment':
		if "this journal =" in line.RawText:
			jPath = line.RawText.split("=")[1].strip()
		elif line.RawText.startswith("' Build:"):
			jBuild = line.RawText.split(":")[1].strip()
		elif line.RawText.startswith("' Branch:"):
			jBranch = line.RawText.split(":")[1].strip()
		elif not OSVersionFound:
			if "Caption :" in line.RawText:
				jOSVersion = line.RawText.split(":")[-1].strip()
				OSVersionFound = True
		elif not machineNameFound:
			if "Additional IP address/name found for host" in line.RawText:
				jMachineName = line.RawText.split(":")[1].split(" ")[-1]
				machineNameFound = True

# Create journal object
journal = Journal(lineObjs, jVersion, jUsername, jBlockCount, jPath, jBuild, jBranch, jMachineName, jOSVersion)
for line in journal.Lines:
	line.Journal = journal

# Compute total session time
ts = journal.GetLinesByType('JournalTimeStamp')
journal.SessionTime = ts[-1].DateTime - ts[0].DateTime
# Find out if the session was terminated properly
if ts[-1].Description == "finished recording journal file":
	journal.SessionTerminatedProperly = True
# Find out if journal is in playback mode
if len([x for x in ts if x.Description.startswith("started journal file playback")]) > 0:
	journal.IsInPlaybackMode = True
	# Find out if journal playback was interrupted
	if len([x for x in ts if x.Description.startswith("stopped at line") and x.Description.endswith("journal file playback")]) > 0:
		journal.PlaybackInterrupted = True
# Find out if journal contains recorded exceptions
if len([x for x in ts if x.Description.startswith("ExceptionCode")]) > 0:
	journal.ContainsExceptions = True
# Find out if any API errors occured
apimsgs = journal.GetLinesByType('JournalAPIMessage')
if len([x for x in apimsgs if x.MessageType == "Error"]) > 0:
	journal.ContainsAPIErrors = True
# Compute Revit startup time
comms = journal.GetLinesByType('JournalCommand')
startup = [x.Block for x in comms if x.CommandID == "ID_STARTUP_PAGE"]
if len(startup) > 0:
	journal.StartupTime = [x.DateTime for x in ts if x.Block == startup[0]][0] - ts[0].DateTime
# Compute max/min memory values of session
mm = journal.GetLinesByType('JournalMemoryMetrics')
journal.MaxRAMPeak = max([x.RAMPeak for x in mm])
journal.MinRAMAvailable = min([x.RAMAvailable for x in mm])
journal.MaxVMPeak = max([x.VMPeak for x in mm])
journal.MinVMAvailable = min([x.VMAvailable for x in mm])
# Compute total processing time of this node
journal.ProcessingTime = time.time() - processing_started

OUT = journal
# ----------------------------------------
python_script_2 = Python(IN[0]=python_script)
# ---------- python_script_2.python (15 lines) ----------
import clr

OUT = []
if IN[0].__repr__() == 'Journal':
	# Option 1: Sync with settings from ribbon
	allPushButtonEvents = IN[0].GetLinesByTypeAndProperty('JournalUIEvent', 'UIEventType', 'PushButton')
	allSyncs1StartCandidates = [x for x in allPushButtonEvents if x.Data[2] == 'Dialog_Revit_PartitionsSaveToMaster']
	allSyncs1Start = [x for x in allSyncs1StartCandidates if x.Data[4] == 'IDOK']
	allSyncs1StartTimeStamps = [x.Next() for x in allSyncs1Start]
	
	# Option 2: Quick sync from ribbon
	# Option 3: Sync with settings via keyboard shortcut
	# Option 4: Quick sync via keyboard shortcut
	# Option 5: Sync on exit
OUT = allSyncs1StartTimeStamps
# ----------------------------------------
string_2 = StringInput("JournalCommand")
# note: AllNextOfType
python_script_3 = Python(IN[0]=python_script_2, IN[1]=string_2)
# ---------- python_script_3.python (12 lines) ----------
import clr

def process_input(func, input1, input2):
	if isinstance(input1, list): return [func(x, input2) for x in input1]
	else: return func(input1, input2)
	
def journalLineAllNextOfType(jline, type):
	if hasattr(jline, 'AllNextOfType'): 
		return jline.AllNextOfType(type)
	else: return None

OUT = process_input(journalLineAllNextOfType, IN[0], IN[1])
# ----------------------------------------
# note: AllPreviousOfType
python_script_4 = Python(IN[0]=python_script_2, IN[1]=string_2)
# ---------- python_script_4.python (12 lines) ----------
import clr

def process_input(func, input1, input2):
	if isinstance(input1, list): return [func(x, input2) for x in input1]
	else: return func(input1, input2)
	
def journalLineAllPreviousOfType(jline, type):
	if hasattr(jline, 'AllPreviousOfType'): 
		return jline.AllPreviousOfType(type)
	else: return None

OUT = process_input(journalLineAllPreviousOfType, IN[0], IN[1])
# ----------------------------------------
# note: NextOfType
python_script_5 = Python(IN[0]=python_script_2, IN[1]=string_2)
# ---------- python_script_5.python (12 lines) ----------
import clr

def process_input(func, input1, input2):
	if isinstance(input1, list): return [func(x, input2) for x in input1]
	else: return func(input1, input2)
	
def journalLineNextOfType(jline, type):
	if hasattr(jline, 'NextOfType'): 
		return jline.NextOfType(type)
	else: return None

OUT = process_input(journalLineNextOfType, IN[0], IN[1])
# ----------------------------------------
# note: PreviousOfType
python_script_6 = Python(IN[0]=python_script_2, IN[1]=string_2)
# ---------- python_script_6.python (12 lines) ----------
import clr

def process_input(func, input1, input2):
	if isinstance(input1, list): return [func(x, input2) for x in input1]
	else: return func(input1, input2)
	
def journalLinePreviousOfType(jline, type):
	if hasattr(jline, 'PreviousOfType'): 
		return jline.PreviousOfType(type)
	else: return None

OUT = process_input(journalLinePreviousOfType, IN[0], IN[1])
# ----------------------------------------
string_3 = StringInput("CommandID")
string_4 = StringInput("ID_CANCEL_EDITOR")
# note: AllNextOfTypeAndProperty
python_script_7 = Python(IN[0]=python_script_2, IN[1]=string_2, IN[2]=string_3, IN[3]=string_4)
# ---------- python_script_7.python (12 lines) ----------
import clr

def process_input(func, input1, input2):
	if isinstance(input1, list): return [func(x, input2) for x in input1]
	else: return func(input1, input2)
	
def journalLineAllNextOfType(jline, type):
	if hasattr(jline, 'AllNextOfType'): 
		return jline.AllNextOfType(type)
	else: return None

OUT = process_input(journalLineAllNextOfTypeAndProperty, IN[0], IN[1], IN[2], IN[3])
# ----------------------------------------
