# Dynamo graph PythonExamples.dyn (Dynamo 1.3.1.1736)

# group: INPUT
file_path = Filename("..\..\..\Desktop\journals\journal.0855.txt")

# group: Evaluate Journal
fromPath = FileObject(file_path)  # "File.FromPath"
readText = File.ReadText(fromPath)
byString = Custom[Journal.ByString](str=readText)

# group: Python Examples
# note: When was a model closed during the session?
python_script = Python(IN[0]=byString)
# ---------- python_script.python (12 lines) ----------
import clr

OUT = []
files = []
ts = []
if IN[0].__repr__() == 'Journal':
	allUIEvents = IN[0].GetLinesByType('JournalUIEvent')
	closingEvents = [x for x in allUIEvents if x.UIEventType == 'Close']
	for event in closingEvents:
		files.append(event.Data[0][1:-1])
		ts.append(IN[0].GetLinesByBlock(event.Block)[0].DateTime)
OUT = (files,ts)
# ----------------------------------------
watch = Watch(python_script)

# group: Extract unique list of API error messages
string = StringInput("JournalAPIMessage")
string_2 = StringInput("MessageType")
string_3 = StringInput("Error")
getLinesByTypeAndProperty = Custom[Journal.GetLinesByTypeAndProperty](journal=byString, journalLineType=string, property=string_2, value=string_3)
text = Custom[JournalAPIMessage.Text](journalAPIMessage=getLinesByTypeAndProperty)
uniqueItems = List.UniqueItems(text)
watch_2 = Watch(uniqueItems)
string_4 = StringInput("""import clr

OUT = []
if IN[0].__repr__() == 'Journal':
 OUT = set([x.MessageText for x in IN[0].GetLinesByTypeAndProperty('JournalAPIMessage', 'MessageType', 'Error')])""")
python_script_from_string = PythonStringNode(script=string_4, IN[0]=byString)
watch_3 = Watch(python_script_from_string)

# group: Extract unique list of commands triggered by a keyboard shortcut
string_5 = StringInput("JournalCommand")
string_6 = StringInput("CommandType")
string_7 = StringInput("KeyboardShortcut")
getLinesByTypeAndProperty_2 = Custom[Journal.GetLinesByTypeAndProperty](journal=byString, journalLineType=string_5, property=string_6, value=string_7)
ID = Custom[JournalCommand.ID](journalCommand=getLinesByTypeAndProperty_2)
uniqueItems_2 = List.UniqueItems(ID)
watch_4 = Watch(uniqueItems_2)
string_8 = StringInput("""import clr

OUT = []
if IN[0].__repr__() == 'Journal':
 OUT = set([x.CommandID for x in IN[0].GetLinesByTypeAndProperty('JournalCommand', 'CommandType', 'KeyboardShortcut')])""")
python_script_from_string_2 = PythonStringNode(script=string_8, IN[0]=byString)
watch_5 = Watch(python_script_from_string_2)
