# Dynamo graph Slave.dyn (Dynamo 1.3.1.1736)

file_path = Filename("C:\Users\adieckmann\Desktop\journaldata.csv")
fromPath = FileObject(file_path)  # "File.FromPath"
readText = File.ReadText(fromPath)
fromCSV = Custom[List.FromCSV](CSVstring=readText)  # Converts the content of a given CSV file to a list
directory_path = Directory("Z:\U\Desktop\journals")
string = StringInput("*.txt")
contents = Custom[Directory.Contents+](directoryPath=directory_path, searchString=string)  # Unlike the built-in node Directory.Contents, this node browses a directory recursively and returns all relevant files contained in subfolders as well.
firstItem = List.FirstItem(fromCSV@L2)
containsItem = List.ContainsItem(list=firstItem, item=contents)
filterByBoolMask = List.FilterByBoolMask(list=contents, mask=containsItem)
number = DoubleInput(10)
takeItems = List.TakeItems(list=filterByBoolMask.out, amount=number)
fromPath_2 = FileObject(takeItems)  # "File.FromPath"
readText_2 = File.ReadText(fromPath_2)
byString = Custom[Journal.ByString](str=readText_2@L1)
revitBranch = Custom[Journal.RevitBranch](journal=byString)
revitBuild = Custom[Journal.RevitBuild](journal=byString)
revitVersion = Custom[Journal.RevitVersion](journal=byString)
startupTime = Custom[Journal.StartupTime](journal=byString)
sessionTerminatedProperly = Custom[Journal.SessionTerminatedProperly](journal=byString)
sessionTime = Custom[Journal.SessionTime](journal=byString)
processingTime = Custom[Journal.ProcessingTime](journal=byString)
user = Custom[Journal.User](journal=byString)
isInPlaybackMode = Custom[Journal.IsInPlaybackMode](journal=byString)
playbackInterrupted = Custom[Journal.PlaybackInterrupted](journal=byString)
create = List.Create(takeItems, revitBranch, revitBuild, revitVersion, startupTime, sessionTerminatedProperly, sessionTime, processingTime, user, isInPlaybackMode, playbackInterrupted)
string_2 = StringInput("")
replaceNulls = Lists.Manage.ReplaceNulls(create, string_2)
type = Object.Type(replaceNulls)
code_block = CodeBlock(obj=type) { obj == "System.String"; }
string_from_object = FromObject(replaceNulls)
if_ = If(test=code_block, true=replaceNulls, false=string_from_object)
transpose = List.Transpose(if_)
join = List.Join(fromCSV, transpose)
writeToFile = CSV.WriteToFile(file_path, join)
