# Dynamo graph UnprocessedData.dyn (Dynamo 1.3.1.1736)

# group: INPUT
file_path = Filename("..\..\..\..\Desktop\AnalyzeJournalFiles.dyn")

# group: Evaluate Journal
fromPath = FileObject(file_path)  # "File.FromPath"
readText = File.ReadText(fromPath)
byString = Custom[Journal.ByString](str=readText)

# group: JournalMiscCommand TEST
string = StringInput("JournalMiscCommand")
getLinesByType = Custom[Journal.GetLinesByType](journal=byString, journalLineType=string)
rawText = Custom[JournalLine.RawText](journalLine=getLinesByType)
watch = Watch(rawText)
string_2 = StringInput(" ")
split = String.Split(rawText, string_2)
transpose = List.Transpose(split)
firstItem = List.FirstItem(transpose)
groupByKey = List.GroupByKey(list=rawText, keys=firstItem)
# note: QUESTION:
# Do you see more than three items in this list? (Dim, Set, Jrn.Size)
watch_2 = Watch(groupByKey.unique_keys)
watch_3 = Watch(groupByKey.groups)

# group: JournalComment TEST
string_3 = StringInput("JournalComment")
getLinesByType_2 = Custom[Journal.GetLinesByType](journal=byString, journalLineType=string_3)
rawText_2 = Custom[JournalLine.RawText](journalLine=getLinesByType_2)
string_4 = StringInput(" ")
split_2 = String.Split(rawText_2, string_4)
transpose_2 = List.Transpose(split_2)
firstItem_2 = List.FirstItem(transpose_2)
groupByKey_2 = List.GroupByKey(list=rawText_2, keys=firstItem_2)
# note: QUESTION:
# Would you like to be able to pull any of this data from the journal file?
watch_4 = Watch(groupByKey_2.unique_keys)
watch_5 = Watch(groupByKey_2.groups)
watch_6 = Watch(rawText_2)
