# Dynamo graph GenerateNodeDocumentationMarkdownFiles.dyn (Dynamo 2.12.1.8246)
# packages: Clockwork for Dynamo 2.x 2.6.0

# group: Generate Node Documentation Markdown Files
# note: This graph generates a markdown node documentation file for the doc folder.

# group: INPUTS
package_directory_path = Directory("C:\Users\adsk\Documents\andreas\repos\Journalysis")  # graph input
text_template = StringInput("""{DEPENDENCIES}{1}## Sample file
- Download sample file: [All{0}Nodes.dyn](https://raw.githubusercontent.com/andydandy74/Journalysis/master/samples/{VERSION}/All{0}Nodes.dyn)
- [More sample files](https://github.com/andydandy74/Journalysis/tree/master/samples/2.x) {MORESAMPLES}

## Useful links
- [Journalysis repository on GitHub](https://github.com/andydandy74/Journalysis)
- [Report an issue](https://github.com/andydandy74/Journalysis/issues)
- [Version history](https://github.com/andydandy74/Journalysis/wiki/Version-history)
- [Journalysis wiki](https://github.com/andydandy74/Journalysis/wiki)

![Journalysis logo](https://raw.githubusercontent.com/andydandy74/Journalysis/master/icons/raw/JournalysisLogoDocs.png)""")
dependencies = StringInput("""## Dependencies
As of Revit 2023 you will need to install the package DynamoIronPython2.7 (version 2.5 of that package for Revit 2023/24, version 3.2 for Revit 2025).

""")
more_samples = StringInput("(from the 2.x package but should work in 3.x, too)")
regex_for_sample_files = StringInput("\.(Journal|WorksharingLog|KeyboardShortcuts)\.")
journal_line_types = StringInput("""JournalAddinEvent
JournalAPIMessage
JournalBasicFileInfo
JournalCommand
JournalData
JournalDirective
JournalGUIResourceUsage
JournalKeyboardEvent
JournalMemoryMetrics
JournalMouseEvent
JournalSystemInformation
JournalTimeStamp
JournalUIEvent
JournalWorksharingEvent""")
background_info_journal_line = StringInput("""## Background information
[Learn more about the {0} line type](https://github.com/andydandy74/Journalysis/wiki/JournalLine-types#{1})

""")  # "Background info journal line tyoes"

n2_x_vs_3_x = BoolSelector(true)  # "2.x vs. 3.x"

# group: Package target version
string = StringInput("2.x")
string_2 = StringInput("3.x")
if_ = RefactoredIf(test=n2_x_vs_3_x, true=string, false=string_2)

# group: Get node names from directory
code_block = CodeBlock(path=package_directory_path, version=if_) { path + "\\nodes\\" + version; }
fromPath = DirectoryObject(path=code_block)  # "Directory.FromPath"
string_3 = StringInput("*.dyf")  # graph input
getDirectoryContents = FileSystem.GetDirectoryContents(directory=fromPath, searchString=string_3)

# group: Package-specific content
string_4 = StringInput("{VERSION}")
replace = String.Replace(string=text_template, searchFor=string_4, replaceWith=if_)
string_5 = StringInput("{DEPENDENCIES}")
string_6 = StringInput("")
if_2 = RefactoredIf(test=n2_x_vs_3_x, true=dependencies, false=string_6)
replace_2 = String.Replace(string=replace, searchFor=string_5, replaceWith=if_2)
string_7 = StringInput("{MORESAMPLES}")
if_3 = RefactoredIf(test=n2_x_vs_3_x, true=string_6, false=more_samples)
replace_3 = String.Replace(string=replace_2, searchFor=string_7, replaceWith=if_3)

# group: Create background info section for journal line types
string_8 = StringInput("\n")
split = String.Split(string=journal_line_types, separator0=string_8)
boolean = BoolSelector(false)
fileName = FileSystem.FileName(path=getDirectoryContents.files, withExtension=boolean)
string_9 = StringInput(".")
split_2 = String.Split(string=fileName, separator0=string_9)
firstItem = List.FirstItem(list=split_2@L2)
contains = List.Contains(list=split, item=firstItem@L1)
toLower = String.ToLower(string=firstItem)
list_create = List.Create(item0=firstItem, item1=toLower)
transpose = List.Transpose(lists=list_create)
replace_4 = Custom[String.Replace+](str=background_info_journal_line, replacements=transpose@L2)  # package Clockwork for Dynamo 2.x; Replaces multiple items in a given string. Items in the string have to be denoted as {0], {1}, ..., {n} - corresponding to the respective list index of the replacement string.
code_block_2 = CodeBlock(isLineType=contains, bkgInfo=replace_4) { isLineType ? bkgInfo : ""; }

# group: Generate node docs
properties = Custom[CustomNode.Properties](path=getDirectoryContents.files)  # package Clockwork for Dynamo 2.x; Extracts information from a custom node.
code_block_3 = CodeBlock(path=package_directory_path, version=if_) { path + "\\doc\\" + version; }
code_block_4 = CodeBlock(p1=properties.Category, p2=properties.Name, path=code_block_3)
# ---------- code_block_4.designscript (4 lines) ----------
//  doc code
docCode = p1 + "." + p2;
// filename
path + "\\" + docCode + ".md";
# ----------------------------------------
findRegularExpression = Custom[Regex.FindRegularExpression](RegEx=regex_for_sample_files, str=code_block_4.docCode)  # package Clockwork for Dynamo 2.x; Returns all occurences of a regular expression within a string (or list of strings). The syntax for regular expressions is explained at http://ironpython-test.readthedocs.org/en/latest/howto/regex.html
firstItem_2 = List.FirstItem(list=findRegularExpression@L2)
list_create_2 = List.Create(item0=firstItem_2, item1=code_block_2)
transpose_2 = List.Transpose(lists=list_create_2)
replace_5 = Custom[String.Replace+](str=replace_3, replacements=transpose_2@L2)
writeText = FileSystem.WriteText(filePath=code_block_4.out1, text=replace_5)
