# Dynamo custom node Helpers.AllJournalAPIMessageTypes.dyf (Dynamo 1.3.1.1736)
# category: Journalysis.Journal.Helpers.Query
# Lists all JournalAPIMessage types

string = StringInput("""AddedPushbutton
Exception
RegisteredExternalServer
RegisteredExternalService
RegisteringCommandEvent
RegisteringEvent
ReplacingCommandID
RestoringCommandID
StartingExternalApp
StartingExternalDBApp
Unknown
UnregisteringEvent""")
string_2 = StringInput("\n")
split = String.Split(string, string_2)
seq = Output(split)
