# Dynamo custom node Helpers.AllJournalSystemInformationTypes.dyf (Dynamo 1.3.1.1736)
# category: Journalysis.Journal.Helpers.Query
# Lists all JournalSystemInformation types

string = StringInput("""OperatingSystem
Printer
PrinterConfiguration
Processor
Unknown
VideoController""")
string_2 = StringInput("\n")
split = String.Split(string, string_2)
seq = Output(split)
