# Dynamo custom node Helpers.AllJournalTimeStampTypes.dyf (Dynamo 1.3.1.1736)
# category: Journalysis.Journal.Helpers.Query
# Lists all JournalTimeStamp types

string = StringInput("""C
E
H""")
string_2 = StringInput("\n")
split = String.Split(string, string_2)
seq = Output(split)
