# Dynamo custom node Journal.RevitBranch.dyf (Dynamo 1.3.1.1736)
# category: Journalysis.Journal.Query
# Returns the Revit branch from a given journal

journal = Input()
python_script = Python(IN[0]=journal)
# ---------- python_script.python (11 lines) ----------
import clr

def process_input(func, input):
	if isinstance(input, list): return [func(x) for x in input]
	else: return func(input)
	
def journalBranch(journal):
	if journal.__repr__() == 'Journal': return journal.Branch
	else: return None

OUT = process_input(journalBranch,IN[0])
# ----------------------------------------
str = Output(python_script)
