# Dynamo custom node Journal.SessionTerminatedProperly.dyf (Dynamo 1.3.1.1736)
# category: Journalysis.Journal.Actions
# Computes whether the Revit session  of the given journal was terminated properly

journal = Input()
python_script = Python(IN[0]=journal)
# ---------- python_script.python (11 lines) ----------
import clr

def process_input(func, input):
	if isinstance(input, list): return [func(x) for x in input]
	else: return func(input)
	
def journalSessionTerminatedProperly(journal):
	if journal.__repr__() == 'Journal': return journal.WasSessionTerminatedProperly()
	else: return False

OUT = process_input(journalSessionTerminatedProperly,IN[0])
# ----------------------------------------
bool = Output(python_script)
