# Dynamo custom node JournalAPIMessage.Type.dyf (Dynamo 1.3.1.1736)
# category: Journalysis.Journal.JournalLine.APIMessage.Query
# Returns the type of an APIMessage line

journalAPIMessage = Input()
python_script = Python(IN[0]=journalAPIMessage)
# ---------- python_script.python (11 lines) ----------
import clr

def process_input(func, input):
	if isinstance(input, list): return [func(x) for x in input]
	else: return func(input)
	
def journalAPIMessageType(japimsg):
	if japimsg.__repr__() == 'JournalAPIMessage': return japimsg.MessageType
	else: return None

OUT = process_input(journalAPIMessageType,IN[0])
# ----------------------------------------
str = Output(python_script)
