# Dynamo custom node JournalGUIResourceUsage.User.dyf (Dynamo 1.3.1.1736)
# category: Journalysis.Journal.JournalLine.GUIResourceUsage.Query

journalGUIResourceUsage = Input()
python_script = Python(IN[0]=journalGUIResourceUsage)
# ---------- python_script.python (11 lines) ----------
import clr

def process_input(func, input):
	if isinstance(input, list): return [func(x) for x in input]
	else: return func(input)
	
def journalGUIResourceUsageUser(jguiru):
	if jguiru.__repr__() == 'JournalGUIResourceUsage': return jguiru.User
	else: return None

OUT = process_input(journalGUIResourceUsageUser,IN[0])
# ----------------------------------------
int = Output(python_script)
