# Dynamo custom node JournalMemoryMetrics.RAMUsed.dyf (Dynamo 1.3.1.1736)
# category: Journalysis.Journal.JournalLine.MemoryMetrics.Query
# Returns the used RAM of a MemoryMetrics line

journalMemoryMetrics = Input()
python_script = Python(IN[0]=journalMemoryMetrics)
# ---------- python_script.python (11 lines) ----------
import clr

def process_input(func, input):
	if isinstance(input, list): return [func(x) for x in input]
	else: return func(input)
	
def journalMemoryMetricsRAMUsed(jmm):
	if jmm.__repr__() == 'JournalMemoryMetrics': return jmm.RAMUsed
	else: return None

OUT = process_input(journalMemoryMetricsRAMUsed,IN[0])
# ----------------------------------------
int = Output(python_script)
