# Dynamo custom node JournalWorksharingEvent.Text.dyf (Dynamo 1.3.1.1736)
# category: Journalysis.Journal.JournalLine.WorksharingEvent.Query
# Returns the recorded text of a given JournalWorksharingEvent

journalWorksharingEvent = Input()
python_script = Python(IN[0]=journalWorksharingEvent)
# ---------- python_script.python (11 lines) ----------
import clr

def process_input(func, input):
	if isinstance(input, list): return [func(x) for x in input]
	else: return func(input)
	
def journalWSEventText(jwsevent):
	if jwsevent.__repr__() == 'JournalWorksharingEvent': return jwsevent.Text
	else: return None

OUT = process_input(journalWSEventText,IN[0])
# ----------------------------------------
str = Output(python_script)
