# Dynamo custom node KeyboardShortcutCommand.ID.dyf (Dynamo 1.3.4.6666)
# category: Journalysis.KeyboardShortcuts.KeyboardShortcutCommand.Query
# Returns the ID of a given command

keyboardShortcutCommand = Input()
python_script = Python(IN[0]=keyboardShortcutCommand)
# ---------- python_script.python (11 lines) ----------
import clr

def process_input(func, input):
	if isinstance(input, list): return [func(x) for x in input]
	else: return func(input)
	
def ksCommandID(ksc):
	if ksc.__repr__() == 'KeyboardShortcutCommand': return ksc.ID
	else: return None

OUT = process_input(ksCommandID,IN[0])
# ----------------------------------------
str = Output(python_script)
