# Dynamo custom node LoadedAssembly.Name.dyf (Dynamo 1.3.1.1736)
# category: Journalysis.Journal.LoadedAssembly.Query
# Returns the name of a given LoadedAssembly

loadedAssembly = Input()
python_script = Python(IN[0]=loadedAssembly)
# ---------- python_script.python (11 lines) ----------
import clr

def process_input(func, input):
	if isinstance(input, list): return [func(x) for x in input]
	else: return func(input)
	
def LAName(assembly):
	if assembly.__repr__() == 'LoadedAssembly': return assembly.Name
	else: return None

OUT = process_input(LAName,IN[0])
# ----------------------------------------
str = Output(python_script)
