# Dynamo custom node LoadedLink.FullPath.dyf (Dynamo 1.3.4.6666)
# category: Journalysis.WorksharingLog.WorksharingSession.LoadedLink.Query
# Returns the full path of a given loaded link

loadedLink = Input()
python_script = Python(IN[0]=loadedLink)
# ---------- python_script.python (11 lines) ----------
import clr

def process_input(func, input):
	if isinstance(input, list): return [func(x) for x in input]
	else: return func(input)
	
def LoadedLinkFullPath(link):
	if link.__repr__() == 'LoadedLink': return link.FullPath
	else: return None

OUT = process_input(LoadedLinkFullPath,IN[0])
# ----------------------------------------
str = Output(python_script)
