# Dynamo custom node LoadedLink.LoadDuration.dyf (Dynamo 1.3.4.6666)
# category: Journalysis.WorksharingLog.WorksharingSession.LoadedLink.Query
# Returns the load duration of a given loaded link

loadedLink = Input()
python_script = Python(IN[0]=loadedLink)
# ---------- python_script.python (11 lines) ----------
import clr

def process_input(func, input):
	if isinstance(input, list): return [func(x) for x in input]
	else: return func(input)
	
def LoadedLinkDuration(link):
	if link.__repr__() == 'LoadedLink': return link.LoadDuration
	else: return None

OUT = process_input(LoadedLinkDuration,IN[0])
# ----------------------------------------
timeSpan = Output(python_script)
