# Dynamo custom node LoadedLink.LoadStart.dyf (Dynamo 1.3.4.6666)
# category: Journalysis.WorksharingLog.WorksharingSession.LoadedLink.Query
# Returns the date and time a given loaded link started loading

loadedLink = Input()
python_script = Python(IN[0]=loadedLink)
# ---------- python_script.python (11 lines) ----------
import clr

def process_input(func, input):
	if isinstance(input, list): return [func(x) for x in input]
	else: return func(input)
	
def LoadedLinkStart(link):
	if link.__repr__() == 'LoadedLink': return link.LoadStart
	else: return None

OUT = process_input(LoadedLinkStart,IN[0])
# ----------------------------------------
dateTime = Output(python_script)
