# Dynamo custom node Paths.AllJournalDirectories.dyf (Dynamo 1.3.4.6666)
# category: Journalysis.Journal.Paths.Query
# Retrieves a list of all journal folders on the current machine

python_script = Python()
# ---------- python_script.python (3 lines) ----------
import clr
from System import Environment
OUT = Environment.GetFolderPath(Environment.SpecialFolder.LocalApplicationData)
# ----------------------------------------
string = StringInput("Autodesk\Revit")
combine = FilePath.Combine(python_script, string)
fromPath = DirectoryObject(combine)  # "Directory.FromPath"
contents = Directory.Contents(fromPath)
fileName = FilePath.FileName(contents.out1)
string_2 = StringInput("Autodesk Revit")
startsWith = String.StartsWith(str=fileName, searchFor=string_2)
filterByBoolMask = List.FilterByBoolMask(list=contents.out1, mask=startsWith)
string_3 = StringInput("Journals")
code_block = CodeBlock(dir=filterByBoolMask.in, folder=string_3) { dir + "\\" + folder; }
seq = Output(code_block)
