# Dynamo custom node Helpers.AllJournalAPIMessageTypes.dyf (Dynamo 2.12.1.8246)
# category: Journalysis.Journal.Query
# Lists all JournalAPIMessage types

string = StringInput("""AddedPushbutton
AssemblyVersionConflict
Exception
RegisteredExternalServer
RegisteredExternalService
RegisteringCommandEvent
RegisteringEvent
ReplacingCommandID
RestoringCommandID
StartingExternalApp
StartingExternalDBApp
Unknown
UnregisteringEvent""")  # graph input
string_2 = StringInput("\n")  # graph input
split = String.Split(string=string, separator0=string_2)
seq = Output(split)
