# Dynamo custom node Helpers.AllJournalCommandTypes.dyf (Dynamo 2.0.3.8810)
# category: Journalysis.Journal.Helpers.Query
# Lists all known JournalCommand types

string = StringInput("""AccelKey
Internal
KeyboardShortcut
PrintPreviewUI
Ribbon
StartupPage
StatusBar
SystemMenu""")  # graph input
string_2 = StringInput("\n")  # graph input
split = String.Split(str=string, separater0=string_2)
seq = Output(split)
