# Dynamo custom node Helpers.AllJournalLineTypes.dyf (Dynamo 2.0.3.8810)
# category: Journalysis.Journal.Helpers.Query
# Lists all JournalLine types

string = StringInput("""JournalAddinEvent
JournalAPIMessage
JournalBasicFileInfo
JournalCommand
JournalComment
JournalData
JournalDirective
JournalGUIResourceUsage
JournalKeyboardEvent
JournalMemoryMetrics
JournalMiscCommand
JournalMouseEvent
JournalSystemInformation
JournalTimeStamp
JournalUIEvent
JournalWorksharingEvent""")  # graph input
string_2 = StringInput("\n")  # graph input
split = String.Split(str=string, separater0=string_2)
seq = Output(split)
