# Dynamo custom node Helpers.AllJournalMouseEventTypes.dyf (Dynamo 2.0.3.8810)
# category: Journalysis.Journal.Helpers.Query
# Lists all JournalMouseEvent types

string = StringInput("""LButtonDblClk
LButtonDown
LButtonUp
MButtonDblClk
MButtonDown
MButtonUp
MouseMove
RButtonDblClk
RButtonDown
RButtonUp
Scroll
Wheel""")  # graph input
string_2 = StringInput("\n")  # graph input
split = String.Split(str=string, separater0=string_2)
seq = Output(split)
