# Dynamo custom node Helpers.AllJournalSystemInformationTypes.dyf (Dynamo 2.0.3.8810)
# category: Journalysis.Journal.Helpers.Query
# Lists all JournalSystemInformation types

string = StringInput("""OperatingSystem
Printer
PrinterConfiguration
Processor
Unknown
VideoController""")  # graph input
string_2 = StringInput("\n")  # graph input
split = String.Split(str=string, separater0=string_2)
seq = Output(split)
