# Dynamo custom node Helpers.AllJournalTimeStampTypes.dyf (Dynamo 2.0.3.8810)
# category: Journalysis.Journal.Helpers.Query
# Lists all JournalTimeStamp types

string = StringInput("""C
E
H""")  # graph input
string_2 = StringInput("\n")  # graph input
split = String.Split(str=string, separater0=string_2)
seq = Output(split)
