# Dynamo custom node Helpers.AllJournalUIEventTypes.dyf (Dynamo 2.0.3.8810)
# category: Journalysis.Journal.Helpers.Query
# Lists all JournalUIEvent types

string = StringInput("""Activate
AppButtonEvent
Browser
Checkbox
Close
ComboBox
DropFiles
Edit
Grid
ListBox
Maximize
Minimize
PropertiesPalette
PushButton
RadioButton
Restore
RibbonEvent
SBTrayAction
Size
SliderCtrl
TabCtrl
TreeCtrl
WidgetEvent""")  # graph input
string_2 = StringInput("\n")  # graph input
split = String.Split(str=string, separater0=string_2)
seq = Output(split)
