# Dynamo custom node Helpers.AllLoadedModelEventTypes.dyf (Dynamo 2.0.3.8810)
# category: Journalysis.Journal.Helpers.Query
# Lists all LoadedModelEvent types

string = StringInput("""Open_Dialog
Open_DragDrop
Open_Recent
Loaded""")  # graph input
string_2 = StringInput("\n")  # graph input
split = String.Split(str=string, separater0=string_2)
seq = Output(split)
