# Dynamo custom node Helpers.FindSyncEventOverlaps.dyf (Dynamo 2.0.3.8810)
# category: Journalysis.WorksharingLog.Helpers.Actions
# Identifies groups of SyncEvents that overlap in a given WorksharingLog. Expects a list of *all* SyncEvents of *all* WorksharingSessions within a WorksharingLog.

SyncEvents = Input(SyncEvents: var[]..[])
create = List.Create(item0=SyncEvents)
flatten = List.Flatten(list=create)
python_script = Python(IN[0]=flatten)
# ---------- python_script.python (14 lines) ----------
data = [(x.Start, x.End, x) for x in IN[0]]
# sort by end first, then by start
data.sort(key=lambda x: x[1])
data.sort(key=lambda x: x[0])
l = len(data)
overlaps = []
for i in xrange(l):
	for j in xrange(i+1, l):
		x = data[i]
		y = data[j]
		# identify overlaps
		if (y[0]<=x[1]): overlaps.append([x[2], y[2]])

OUT = overlaps
# ----------------------------------------
SyncEvents_2 = Output(python_script)  # "SyncEvents"
