# Dynamo custom node Journal.FirstLines.dyf (Dynamo 2.0.3.8810)
# category: Journalysis.Journal.Actions
# Gets the first N lines of a given journal (faster than OOTB list operations).

journal = Input(journal: var[]..[])
numberOfLines = Input(numberOfLines: int)
python_script = Python(IN[0]=journal, IN[1]=numberOfLines)
# ---------- python_script.python (15 lines) ----------
import clr

def process_input(func, input):
	if isinstance(input[0], list): 
		if isinstance(input[1], list): return [func(x, y) for x, y in zip(input[0], input[1])]
		else: return [func(x, input[1]) for x in input[0]]
	else: 
		if isinstance(input[1], list): return [func(input[0], x) for x in input[1]]
		else: return func(input[0], input[1])
	
def journalFirstLines(journal, num):
	if journal.__repr__() == 'Journal': return journal.GetFirstLines(num)
	else: return None

OUT = process_input(journalFirstLines,IN)
# ----------------------------------------
journalLines = Output(python_script)
