# Dynamo custom node Journal.IsInPlaybackMode.dyf (Dynamo 2.0.3.8810)
# category: Journalysis.Journal.Actions
# Computes whether a given journal is in playback mode

journal = Input(journal: var[]..[])
python_script = Python(IN[0]=journal)
# ---------- python_script.python (11 lines) ----------
import clr

def process_input(func, input):
	if isinstance(input, list): return [func(x) for x in input]
	else: return func(input)
	
def journalIsInPlaybackMode(journal):
	if journal.__repr__() == 'Journal': return journal.IsInPlaybackMode()
	else: return False

OUT = process_input(journalIsInPlaybackMode,IN[0])
# ----------------------------------------
bool = Output(python_script)
