# Dynamo custom node Journal.LinesByType.dyf (Dynamo 2.0.3.8810)
# category: Journalysis.Journal.Actions
# Retrieves all JournalLines of a given type from a given journal

journal = Input(journal: var[]..[])
journalLineType = Input(journalLineType: string)
python_script = Python(IN[0]=journal, IN[1]=journalLineType)
# ---------- python_script.python (13 lines) ----------
import clr

def process_input(func, inputs):
	if isinstance(inputs[0], list): return [func(x, inputs[1]) for x in inputs[0]]
	else: return func(inputs[0], inputs[1])
	
def journalLinesByType(journal, type):
	if journal.__repr__() == 'Journal': 
		if isinstance(type, list): return journal.GetLinesByTypes(type)
		else: return journal.GetLinesByType(type)
	else: return None

OUT = process_input(journalLinesByType, IN)
# ----------------------------------------
journalLines = Output(python_script)
