# Dynamo custom node Journal.Machine.dyf (Dynamo 2.0.3.8810)
# category: Journalysis.Journal.Query
# Returns the computer name from a given journal

journal = Input(journal: var[]..[])
python_script = Python(IN[0]=journal)
# ---------- python_script.python (11 lines) ----------
import clr

def process_input(func, input):
	if isinstance(input, list): return [func(x) for x in input]
	else: return func(input)
	
def journalMachine(journal):
	if journal.__repr__() == 'Journal': return journal.Machine
	else: return None

OUT = process_input(journalMachine,IN[0])
# ----------------------------------------
str = Output(python_script)
