# Dynamo custom node Journal.MaxRAMPeak.dyf (Dynamo 2.0.3.8810)
# category: Journalysis.Journal.Actions
# Computes the maximum RAM used during a Revit session based on the given journal

journal = Input(journal: var[]..[])
python_script = Python(IN[0]=journal)
# ---------- python_script.python (11 lines) ----------
import clr

def process_input(func, input):
	if isinstance(input, list): return [func(x) for x in input]
	else: return func(input)
	
def journalMaxRAMPeak(journal):
	if journal.__repr__() == 'Journal': return journal.GetMaxRAMPeak()
	else: return None

OUT = process_input(journalMaxRAMPeak,IN[0])
# ----------------------------------------
int = Output(python_script)
