# Dynamo custom node Journal.StartupTime.dyf (Dynamo 2.0.3.8810)
# category: Journalysis.Journal.Actions
# Computes the time it took Revit to display the startup screen based on the given journal

journal = Input(journal: var[]..[])
python_script = Python(IN[0]=journal)
# ---------- python_script.python (11 lines) ----------
import clr

def process_input(func, input):
	if isinstance(input, list): return [func(x) for x in input]
	else: return func(input)
	
def journalStartupTime(journal):
	if journal.__repr__() == 'Journal': return journal.GetStartupTime()
	else: return None

OUT = process_input(journalStartupTime,IN[0])
# ----------------------------------------
timeSpan = Output(python_script)
