# Dynamo custom node JournalAddinEvent.Text.dyf (Dynamo 2.0.3.8810)
# category: Journalysis.Journal.JournalLine.AddinEvent.Query
# Returns the text from an AddinEvent line

journalAddinEvent = Input(journalAddinEvent: var[]..[])
pythonScript = Python(IN[0]=journalAddinEvent)
# ---------- pythonScript.python (11 lines) ----------
import clr

def process_input(func, input):
	if isinstance(input, list): return [func(x) for x in input]
	else: return func(input)
	
def journalAddinEventMessageText(jaddinevent):
	if jaddinevent.__repr__() == 'JournalAddinEvent': return jaddinevent.MessageText
	else: return None

OUT = process_input(journalAddinEventMessageText,IN[0])
# ----------------------------------------
str = Output(pythonScript)
