# Dynamo custom node JournalBasicFileInfo.LastSavePath.dyf (Dynamo 2.0.3.8810)
# category: Journalysis.Journal.JournalLine.BasicFileInfo.Query
# Returns the last save path from a BasicFileInfo line

journalBasicFileInfo = Input(journalBasicFileInfo: var[]..[])
python_script = Python(IN[0]=journalBasicFileInfo)
# ---------- python_script.python (11 lines) ----------
import clr

def process_input(func, input):
	if isinstance(input, list): return [func(x) for x in input]
	else: return func(input)
	
def journalBFILastSavePath(jbfi):
	if jbfi.__repr__() == 'JournalBasicFileInfo': return jbfi.LastSavePath
	else: return None

OUT = process_input(journalBFILastSavePath,IN[0])
# ----------------------------------------
str = Output(python_script)
