# Dynamo custom node JournalCommand.ID.dyf (Dynamo 2.0.3.8810)
# category: Journalysis.Journal.JournalLine.Command.Query
# Returns the command ID of a JournalCommand line

journalCommand = Input(journalCommand: var[]..[])
python_script = Python(IN[0]=journalCommand)
# ---------- python_script.python (11 lines) ----------
import clr

def process_input(func, input):
	if isinstance(input, list): return [func(x) for x in input]
	else: return func(input)
	
def journalCommandID(jcommand):
	if jcommand.__repr__() == 'JournalCommand': return jcommand.CommandID
	else: return None

OUT = process_input(journalCommandID,IN[0])
# ----------------------------------------
str = Output(python_script)
