# Dynamo custom node JournalData.Values.dyf (Dynamo 2.0.3.8810)
# category: Journalysis.Journal.JournalLine.Data.Query
# Returns the values from a JournalData line

journalData = Input(journalData: var[]..[])
python_script = Python(IN[0]=journalData)
# ---------- python_script.python (11 lines) ----------
import clr

def process_input(func, input):
	if isinstance(input, list): return [func(x) for x in input]
	else: return func(input)
	
def journalDataValues(jdata):
	if jdata.__repr__() == 'JournalData': return jdata.Values
	else: return []

OUT = process_input(journalDataValues,IN[0])
# ----------------------------------------
seq = Output(python_script)
