# Dynamo custom node JournalLine.AllNextOfType.dyf (Dynamo 2.0.3.8810)
# category: Journalysis.Journal.JournalLine.Actions
# Retrieves all lines of a given type after the given line from the journal

journalLine = Input(journalLine: var[]..[])
journalLineType = Input(journalLineType: var[]..[])
python_script = Python(IN[0]=journalLine, IN[1]=journalLineType)
# ---------- python_script.python (12 lines) ----------
import clr

def process_input(func, input1, input2):
	if isinstance(input1, list): return [func(x, input2) for x in input1]
	else: return func(input1, input2)
	
def journalLineAllNextOfType(jline, type):
	if hasattr(jline, 'AllNextOfType'): 
		return jline.AllNextOfType(type)
	else: return None

OUT = process_input(journalLineAllNextOfType, IN[0], IN[1])
# ----------------------------------------
journalLines = Output(python_script)
