# Dynamo custom node JournalLine.AllPrevious.dyf (Dynamo 2.0.3.8810)
# category: Journalysis.Journal.JournalLine.Actions
# Retrieves all lines before the given line from the journal

journalLine = Input(journalLine: var[]..[])
python_script = Python(IN[0]=journalLine)
# ---------- python_script.python (12 lines) ----------
import clr

def process_input(func, input):
	if isinstance(input, list): return [func(x) for x in input]
	else: return func(input)
	
def journalLineAllPrevious(jline):
	if hasattr(jline, 'AllPrevious'): 
		return jline.AllPrevious()
	else: return None

OUT = process_input(journalLineAllPrevious, IN[0])
# ----------------------------------------
journalLines = Output(python_script)
