# Dynamo custom node JournalLine.DateTimeOfBlock.dyf (Dynamo 2.0.3.8810)
# category: Journalysis.Journal.JournalLine.Actions
# Retrieves the date and time of the block of a given JournalLine

journalLine = Input(journalLine: var[]..[])
python_script = Python(IN[0]=journalLine)
# ---------- python_script.python (12 lines) ----------
import clr

def process_input(func, input):
	if isinstance(input, list): return [func(x) for x in input]
	else: return func(input)
	
def journalLineDateTime(jline):
	if hasattr(jline, 'GetDateTimeOfBlock'): 
		return jline.GetDateTimeOfBlock()
	else: return None

OUT = process_input(journalLineDateTime, IN[0])
# ----------------------------------------
dateTime = Output(python_script)
