# Dynamo custom node JournalMemoryMetrics.VMAvailable.dyf (Dynamo 2.0.3.8810)
# category: Journalysis.Journal.JournalLine.MemoryMetrics.Query
# Returns the available VM of a MemoryMetrics line

journalMemoryMetrics = Input(journalMemoryMetrics: var[]..[])
python_script = Python(IN[0]=journalMemoryMetrics)
# ---------- python_script.python (11 lines) ----------
import clr

def process_input(func, input):
	if isinstance(input, list): return [func(x) for x in input]
	else: return func(input)
	
def journalMemoryMetricsVMAvailable(jmm):
	if jmm.__repr__() == 'JournalMemoryMetrics': return jmm.VMAvailable
	else: return None

OUT = process_input(journalMemoryMetricsVMAvailable,IN[0])
# ----------------------------------------
int = Output(python_script)
