# Dynamo custom node JournalSystemInformation.Item.dyf (Dynamo 2.0.3.8810)
# category: Journalysis.Journal.JournalLine.SystemInformation.Query
# Returns the item number of a given JournalSystemInformation line

journalSystemInformation = Input(journalSystemInformation: var[]..[])
python_script = Python(IN[0]=journalSystemInformation)
# ---------- python_script.python (11 lines) ----------
import clr

def process_input(func, input):
	if isinstance(input, list): return [func(x) for x in input]
	else: return func(input)
	
def journalSysInfoItem(jsysinfo):
	if hasattr(jsysinfo, 'SystemInformationType'): return jsysinfo.ItemNumber
	else: return None

OUT = process_input(journalSysInfoItem,IN[0])
# ----------------------------------------
int = Output(python_script)
