# Dynamo custom node JournalTimeStamp.DebugInfoType.dyf (Dynamo 2.12.1.8246)
# category: Journalysis.Journal.JournalLine.Query
# Returns the debug information type (error, warning or info) if any.

journalTimeStamp = Input(journalTimeStamp: var[]..[])
python_script = Python(IN[0]=journalTimeStamp)  # IronPython2
# ---------- python_script.python (11 lines) ----------
import clr

def process_input(func, input):
	if isinstance(input, list): return [func(x) for x in input]
	else: return func(input)
	
def journalTimeStampDebugInfoType(input):
	if input.__repr__() == 'JournalTimeStamp': return input.DebugInfoType
	else: return None

OUT = process_input(journalTimeStampDebugInfoType,IN[0])
# ----------------------------------------
str = Output(python_script)
