# Dynamo custom node JournalTimeStamp.Description.dyf (Dynamo 2.0.3.8810)
# category: Journalysis.Journal.JournalLine.TimeStamp.Query
# Returns the description of a TimeStamp line

journalTimeStamp = Input(journalTimeStamp: var[]..[])
python_script = Python(IN[0]=journalTimeStamp)
# ---------- python_script.python (11 lines) ----------
import clr

def process_input(func, input):
	if isinstance(input, list): return [func(x) for x in input]
	else: return func(input)
	
def journalTimeStampDescription(input):
	if input.__repr__() == 'JournalTimeStamp': return input.Description
	else: return None

OUT = process_input(journalTimeStampDescription,IN[0])
# ----------------------------------------
str = Output(python_script)
