# Dynamo custom node JournalWorksharingEvent.DateTime.dyf (Dynamo 2.0.3.8810)
# category: Journalysis.Journal.JournalLine.WorksharingEvent.Query
# Returns the date and time of a given JournalWorksharingEvent

journalWorksharingEvent = Input(journalWorksharingEvent: var[]..[])
python_script = Python(IN[0]=journalWorksharingEvent)
# ---------- python_script.python (11 lines) ----------
import clr

def process_input(func, input):
	if isinstance(input, list): return [func(x) for x in input]
	else: return func(input)
	
def journalWSEventDateTime(jwsevent):
	if jwsevent.__repr__() == 'JournalWorksharingEvent': return jwsevent.DateTime
	else: return None

OUT = process_input(journalWSEventDateTime,IN[0])
# ----------------------------------------
dateTime = Output(python_script)
