# Dynamo custom node JournalWorksharingEvent.SessionID.dyf (Dynamo 2.0.3.8810)
# category: Journalysis.Journal.JournalLine.WorksharingEvent.Query
# Returns the session ID (used in the worksharing log of the central file) of a given JournalWorksharingEvent

journalWorksharingEvent = Input(journalWorksharingEvent: var[]..[])
python_script = Python(IN[0]=journalWorksharingEvent)
# ---------- python_script.python (11 lines) ----------
import clr

def process_input(func, input):
	if isinstance(input, list): return [func(x) for x in input]
	else: return func(input)
	
def journalWSEventID(jwsevent):
	if jwsevent.__repr__() == 'JournalWorksharingEvent': return jwsevent.SessionID
	else: return None

OUT = process_input(journalWSEventID,IN[0])
# ----------------------------------------
str = Output(python_script)
