# Dynamo custom node KeyboardShortcutCommand.HasPaths.dyf (Dynamo 2.0.3.8810)
# category: Journalysis.KeyboardShortcuts.KeyboardShortcutCommand.Query
# Returns whether a given command has any paths assigned

keyboardShortcutCommand = Input(keyboardShortcutCommand: var[]..[])
python_script = Python(IN[0]=keyboardShortcutCommand)
# ---------- python_script.python (11 lines) ----------
import clr

def process_input(func, input):
	if isinstance(input, list): return [func(x) for x in input]
	else: return func(input)
	
def ksCommandHasPaths(ksc):
	if ksc.__repr__() == 'KeyboardShortcutCommand': return ksc.HasPaths
	else: return False

OUT = process_input(ksCommandHasPaths,IN[0])
# ----------------------------------------
bool = Output(python_script)
