# Dynamo custom node KeyboardShortcutCommand.Name.dyf (Dynamo 2.0.3.8810)
# category: Journalysis.KeyboardShortcuts.KeyboardShortcutCommand.Query
# Returns the name of a given command

keyboardShortcutCommand = Input(keyboardShortcutCommand: var[]..[])
python_script = Python(IN[0]=keyboardShortcutCommand)
# ---------- python_script.python (11 lines) ----------
import clr

def process_input(func, input):
	if isinstance(input, list): return [func(x) for x in input]
	else: return func(input)
	
def ksCommandName(ksc):
	if ksc.__repr__() == 'KeyboardShortcutCommand': return ksc.Name
	else: return None

OUT = process_input(ksCommandName,IN[0])
# ----------------------------------------
str = Output(python_script)
