# Dynamo custom node KeyboardShortcutCommand.Paths.dyf (Dynamo 2.0.3.8810)
# category: Journalysis.KeyboardShortcuts.KeyboardShortcutCommand.Query
# Returns all paths assigned to a given command

keyboardShortcutCommand = Input(keyboardShortcutCommand: var[]..[])
python_script = Python(IN[0]=keyboardShortcutCommand)
# ---------- python_script.python (11 lines) ----------
import clr

def process_input(func, input):
	if isinstance(input, list): return [func(x) for x in input]
	else: return func(input)
	
def ksCommandPaths(ksc):
	if ksc.__repr__() == 'KeyboardShortcutCommand': return ksc.Paths
	else: return []

OUT = process_input(ksCommandPaths,IN[0])
# ----------------------------------------
seq = Output(python_script)
