# Dynamo custom node KeyboardShortcuts.CommandCountWithShortcuts.dyf (Dynamo 2.0.3.8810)
# category: Journalysis.KeyboardShortcuts.Query
# Returns the total number of commands that have a shortcut assigned in a given KeyboardShirtcuts object

keyboardShortcuts = Input(keyboardShortcuts: var[]..[])
python_script = Python(IN[0]=keyboardShortcuts)
# ---------- python_script.python (2 lines) ----------
if IN[0].__repr__() == 'KeyboardShortcuts': OUT = IN[0].CommandCountWithShortcuts
else: OUT = None
# ----------------------------------------
int = Output(python_script)
