# Dynamo custom node KeyboardShortcuts.Commands.dyf (Dynamo 2.0.3.8810)
# category: Journalysis.KeyboardShortcuts.Query
# Returns all commands from a given KeyboardShirtcuts object

keyboardShortcuts = Input(keyboardShortcuts: var[]..[])
python_script = Python(IN[0]=keyboardShortcuts)
# ---------- python_script.python (2 lines) ----------
if IN[0].__repr__() == 'KeyboardShortcuts': OUT = IN[0].Commands
else: OUT = None
# ----------------------------------------
keyboardShortcutCommands = Output(python_script)
