# Dynamo custom node KeyboardShortcuts.CommandsWithShortcuts.dyf (Dynamo 2.0.3.8810)
# category: Journalysis.KeyboardShortcuts.Actions
# Returns all commands that have a shortcut assigned from a given KeyboardShirtcuts object

keyboardShortcuts = Input(keyboardShortcuts: var[]..[])
python_script = Python(IN[0]=keyboardShortcuts)
# ---------- python_script.python (2 lines) ----------
if IN[0].__repr__() == 'KeyboardShortcuts': OUT = IN[0].GetCommandsWithShortcuts()
else: OUT = None
# ----------------------------------------
seq = Output(python_script)
