# Dynamo custom node LoadedAssembly.Events.dyf (Dynamo 2.0.3.8810)
# category: Journalysis.Journal.LoadedAssembly.Query
# Returns all journal lines associated with a given LoadedAssembly.
# ATTENTION: Note that this will most likely not catch all AddedPushbutton events of a given assembly.

loadedAssembly = Input(loadedAssembly: var[]..[])
python_script = Python(IN[0]=loadedAssembly)
# ---------- python_script.python (11 lines) ----------
import clr

def process_input(func, input):
	if isinstance(input, list): return [func(x) for x in input]
	else: return func(input)
	
def LAEvents(assembly):
	if assembly.__repr__() == 'LoadedAssembly': return assembly.Events
	else: return []

OUT = process_input(LAEvents,IN[0])
# ----------------------------------------
journalLines = Output(python_script)
