# Dynamo custom node LoadedAssembly.Filename.dyf (Dynamo 2.0.3.8810)
# category: Journalysis.Journal.LoadedAssembly.Query
# Returns the file name of a given LoadedAssembly

loadedAssembly = Input(loadedAssembly: var[]..[])
python_script = Python(IN[0]=loadedAssembly)
# ---------- python_script.python (11 lines) ----------
import clr

def process_input(func, input):
	if isinstance(input, list): return [func(x) for x in input]
	else: return func(input)
	
def LAFilename(assembly):
	if assembly.__repr__() == 'LoadedAssembly': return assembly.Filename
	else: return None

OUT = process_input(LAFilename,IN[0])
# ----------------------------------------
str = Output(python_script)
