# Dynamo custom node LoadedLink.FileName.dyf (Dynamo 2.0.3.8810)
# category: Journalysis.WorksharingLog.WorksharingSession.LoadedLink.Query
# Returns the file name of a given loaded link

loadedLink = Input(loadedLink: var[]..[])
python_script = Python(IN[0]=loadedLink)
# ---------- python_script.python (11 lines) ----------
import clr

def process_input(func, input):
	if isinstance(input, list): return [func(x) for x in input]
	else: return func(input)
	
def LoadedLinkFileName(link):
	if link.__repr__() == 'LoadedLink': return link.FileName
	else: return None

OUT = process_input(LoadedLinkFileName,IN[0])
# ----------------------------------------
str = Output(python_script)
