# Dynamo custom node LoadedLink.LoadStart.dyf (Dynamo 2.0.3.8810)
# category: Journalysis.WorksharingLog.WorksharingSession.LoadedLink.Query
# Returns the date and time a given loaded link started loading

loadedLink = Input(loadedLink: var[]..[])
python_script = Python(IN[0]=loadedLink)
# ---------- python_script.python (11 lines) ----------
import clr

def process_input(func, input):
	if isinstance(input, list): return [func(x) for x in input]
	else: return func(input)
	
def LoadedLinkStart(link):
	if link.__repr__() == 'LoadedLink': return link.LoadStart
	else: return None

OUT = process_input(LoadedLinkStart,IN[0])
# ----------------------------------------
dateTime = Output(python_script)
