# Dynamo custom node Paths.JournalDirectoryByVersion.dyf (Dynamo 2.0.3.8810)
# category: Journalysis.Journal.Paths.Actions
# Retrieves the path of the journal directory for a given Revit version.

allJournalDirectories = Custom[Paths.AllJournalDirectories]()  # Retrieves a list of all journal folders on the current machine
revitVersion = Input(revitVersion: string)
contains = String.Contains(str=allJournalDirectories, searchFor=revitVersion)
filterByBoolMask = List.FilterByBoolMask(list=allJournalDirectories, mask=contains)
firstItem = List.FirstItem(list=filterByBoolMask.in)
path = Output(firstItem)
