# Dynamo custom node RecordedException.AppGUID.dyf (Dynamo 2.12.1.8246)
# category: Journalysis.Journal.Query
# Returns the GUID of the addin responsible for the exception (if any)

recordedException = Input(recordedException: var[]..[])
python_script = Python(IN[0]=recordedException)  # IronPython2
# ---------- python_script.python (11 lines) ----------
import clr

def process_input(func, input):
	if isinstance(input, list): return [func(x) for x in input]
	else: return func(input)
	
def RecordedExceptionAppGUID(input):
	if input.__repr__() == 'RecordedException': return input.AppGUID
	else: return None

OUT = process_input(RecordedExceptionAppGUID,IN[0])
# ----------------------------------------
str = Output(python_script)
