# Dynamo custom node RecordedException.JournalLine.dyf (Dynamo 2.12.1.8246)
# category: Journalysis.Journal.Query
# Returns the journal line where the exception was recorded

recordedException = Input(recordedException: var[]..[])
python_script = Python(IN[0]=recordedException)  # IronPython2
# ---------- python_script.python (11 lines) ----------
import clr

def process_input(func, input):
	if isinstance(input, list): return [func(x) for x in input]
	else: return func(input)
	
def RecordedExceptionJournalLine(input):
	if input.__repr__() == 'RecordedException': return input.JournalLine
	else: return None

OUT = process_input(RecordedExceptionJournalLine,IN[0])
# ----------------------------------------
journalLine = Output(python_script)
