# Dynamo custom node WorksharingLog.ProcessingTime.dyf (Dynamo 2.0.3.8810)
# category: Journalysis.WorksharingLog.Query
# Returns the amount of time it took to process the given WorksharingLog

worksharingLog = Input(worksharingLog: var[]..[])
python_script = Python(IN[0]=worksharingLog)
# ---------- python_script.python (11 lines) ----------
import clr

def process_input(func, input):
	if isinstance(input, list): return [func(x) for x in input]
	else: return func(input)
	
def WSLogProcessingTime(wslog):
	if wslog.__repr__() == 'WorksharingLog': return wslog.ProcessingTime
	else: return None

OUT = process_input(WSLogProcessingTime,IN[0])
# ----------------------------------------
create = TimeSpan.Create(seconds=python_script)
timeSpan = Output(create)
