# Dynamo custom node WorksharingLog.SessionCount.dyf (Dynamo 2.0.3.8810)
# category: Journalysis.WorksharingLog.Query
# Returns the number of sessions recorded in a given WorksharingLog

worksharingLog = Input(worksharingLog: var[]..[])
python_script = Python(IN[0]=worksharingLog)
# ---------- python_script.python (11 lines) ----------
import clr

def process_input(func, input):
	if isinstance(input, list): return [func(x) for x in input]
	else: return func(input)
	
def WSLogSessionCount(wslog):
	if wslog.__repr__() == 'WorksharingLog': return wslog.SessionCount
	else: return None

OUT = process_input(WSLogSessionCount,IN[0])
# ----------------------------------------
int = Output(python_script)
