# Dynamo custom node WorksharingSession.CreatesDetached.dyf (Dynamo 2.0.3.8810)
# category: Journalysis.WorksharingLog.WorksharingSession.Actions

worksharingSession = Input(worksharingSession: var[]..[])
python_script = Python(IN[0]=worksharingSession)
# ---------- python_script.python (11 lines) ----------
import clr

def process_input(func, input):
	if isinstance(input, list): return [func(x) for x in input]
	else: return func(input)
	
def WSSessionCreatesDetached(wssess):
	if wssess.__repr__() == 'WorksharingSession': return wssess.CreatesDetached()
	else: return None

OUT = process_input(WSSessionCreatesDetached,IN[0])
# ----------------------------------------
bool = Output(python_script)
