# Dynamo custom node WorksharingSession.CreatesNewCentral.dyf (Dynamo 2.0.3.8810)
# category: Journalysis.WorksharingLog.WorksharingSession.Actions
# Determines if a new central model was created in a given WorksharingSession

worksharingSession = Input(worksharingSession: var[]..[])
python_script = Python(IN[0]=worksharingSession)
# ---------- python_script.python (11 lines) ----------
import clr

def process_input(func, input):
	if isinstance(input, list): return [func(x) for x in input]
	else: return func(input)
	
def WSSessionCreatesNewCentral(wssess):
	if wssess.__repr__() == 'WorksharingSession': return wssess.CreatesNewCentral()
	else: return None

OUT = process_input(WSSessionCreatesNewCentral,IN[0])
# ----------------------------------------
bool = Output(python_script)
