# Dynamo custom node WorksharingSession.Date.dyf (Dynamo 2.0.3.8810)
# category: Journalysis.WorksharingLog.WorksharingSession.Query
# Returns the date of a given WorksharingSession

worksharingSession = Input(worksharingSession: var[]..[])
python_script = Python(IN[0]=worksharingSession)
# ---------- python_script.python (11 lines) ----------
import clr

def process_input(func, input):
	if isinstance(input, list): return [func(x) for x in input]
	else: return func(input)
	
def WSSessionDate(wssess):
	if wssess.__repr__() == 'WorksharingSession': return wssess.Date
	else: return None

OUT = process_input(WSSessionDate,IN[0])
# ----------------------------------------
dateTime = Output(python_script)
