# Dynamo custom node WorksharingSession.Events.dyf (Dynamo 2.0.3.8810)
# category: Journalysis.WorksharingLog.WorksharingSession.Query
# Returns all recorded events of a given WorksharingSession

worksharingSession = Input(worksharingSession: var[]..[])
python_script = Python(IN[0]=worksharingSession)
# ---------- python_script.python (11 lines) ----------
import clr

def process_input(func, input):
	if isinstance(input, list): return [func(x) for x in input]
	else: return func(input)
	
def WSSessionEvents(wssess):
	if wssess.__repr__() == 'WorksharingSession': return wssess.Events
	else: return []

OUT = process_input(WSSessionEvents,IN[0])
# ----------------------------------------
worksharingEvents = Output(python_script)
