# Dynamo custom node WorksharingSession.HasLoadedLinks.dyf (Dynamo 2.0.3.8810)
# category: Journalysis.WorksharingLog.WorksharingSession.Actions
# Determines if linked models were loaded in this session

worksharingSession = Input(worksharingSession: var[]..[])
python_script = Python(IN[0]=worksharingSession)
# ---------- python_script.python (11 lines) ----------
import clr

def process_input(func, input):
	if isinstance(input, list): return [func(x) for x in input]
	else: return func(input)
	
def WSSessionHasLoadedLinks(wssess):
	if wssess.__repr__() == 'WorksharingSession': return wssess.HasLoadedLinks()
	else: return None

OUT = process_input(WSSessionHasLoadedLinks,IN[0])
# ----------------------------------------
bool = Output(python_script)
