# Dynamo custom node WorksharingSession.LoadedLinks.dyf (Dynamo 2.0.3.8810)
# category: Journalysis.WorksharingLog.WorksharingSession.Actions
# Retrieves a list of loaded links from a given WorkharingSession

worksharingSession = Input(worksharingSession: var[]..[])
python_script = Python(IN[0]=worksharingSession)
# ---------- python_script.python (11 lines) ----------
import clr

def process_input(func, input):
	if isinstance(input, list): return [func(x) for x in input]
	else: return func(input)
	
def WSSessionLoadedLinks(wssess):
	if wssess.__repr__() == 'WorksharingSession': return wssess.GetLoadedLinks()
	else: return None

OUT = process_input(WSSessionLoadedLinks,IN[0])
# ----------------------------------------
LoadedLinks = Output(python_script)
