# Dynamo custom node WorksharingSession.ServerAddress.dyf (Dynamo 2.0.3.8810)
# category: Journalysis.WorksharingLog.WorksharingSession.Query
# Returns the server address (IP or MAC depending on environment) of a given WorksharingSession

worksharingSession = Input(worksharingSession: var[]..[])
python_script = Python(IN[0]=worksharingSession)
# ---------- python_script.python (11 lines) ----------
import clr

def process_input(func, input):
	if isinstance(input, list): return [func(x) for x in input]
	else: return func(input)
	
def WSSessionServerAddress(wssess):
	if wssess.__repr__() == 'WorksharingSession': return wssess.ServerAddress
	else: return None

OUT = process_input(WSSessionServerAddress,IN[0])
# ----------------------------------------
str = Output(python_script)
