# Dynamo custom node WorksharingSession.SyncEvents.dyf (Dynamo 2.0.3.8810)
# category: Journalysis.WorksharingLog.WorksharingSession.Actions
# Extracts all SyncEvents from a given WorkharingSession

worksharingSession = Input(worksharingSession: var[]..[])
python_script = Python(IN[0]=worksharingSession)
# ---------- python_script.python (11 lines) ----------
import clr

def process_input(func, input):
	if isinstance(input, list): return [func(x) for x in input]
	else: return func(input)
	
def WSSessionSyncEvents(wssess):
	if wssess.__repr__() == 'WorksharingSession': return wssess.GetSyncEvents()
	else: return None

OUT = process_input(WSSessionSyncEvents,IN[0])
# ----------------------------------------
SyncEvents = Output(python_script)
