# Dynamo custom node Helpers.AllJournalTimeStampDebugInfoTypes.dyf (Dynamo 3.0.3.7597)
# category: Journalysis.Journal.Query
# Lists all JournalTimeStampDebugInfo types

string = StringInput("""Error
Info
Warning""")  # graph input
string_2 = StringInput("\n")  # graph input
split = String.Split(string=string, separator0=string_2)
seq = Output(split)
