# Dynamo custom node Journal.RevitRelease.dyf (Dynamo 3.3.0.6316)
# category: Journalysis.WorksharingLog.Query
# Returns the Revit release from a given journal

journal = Input(journal: var[]..[])
python_script = Python(IN[0]=journal)  # CPython3
# ---------- python_script.python (11 lines) ----------
import clr

def process_input(func, input):
	if isinstance(input, list): return [func(x) for x in input]
	else: return func(input)
	
def journalRelease(journal):
	if journal.__repr__() == 'Journal': return journal.Release
	else: return None

OUT = process_input(journalRelease,IN[0])
# ----------------------------------------
str = Output(python_script)
