# Dynamo custom node JournalGUIResourceUsage.Available.dyf (Dynamo 2.12.1.8246)
# category: Journalysis.Journal.JournalLine.Query

journalGUIResourceUsage = Input(journalGUIResourceUsage: var[]..[])
python_script = Python(IN[0]=journalGUIResourceUsage)  # CPython3
# ---------- python_script.python (11 lines) ----------
import clr

def process_input(func, input):
	if isinstance(input, list): return [func(x) for x in input]
	else: return func(input)
	
def journalGUIResourceUsageAvailable(jguiru):
	if jguiru.__repr__() == 'JournalGUIResourceUsage': return jguiru.Available
	else: return None

OUT = process_input(journalGUIResourceUsageAvailable,IN[0])
# ----------------------------------------
int = Output(python_script)
