# Dynamo custom node JournalLine.Previous.dyf (Dynamo 2.12.1.8246)
# category: Journalysis.Journal.Actions
# Retrieves the previous line before the given line

journalLine = Input(journalLine: var[]..[])
python_script = Python(IN[0]=journalLine)  # CPython3
# ---------- python_script.python (12 lines) ----------
import clr

def process_input(func, input):
	if isinstance(input, list): return [func(x) for x in input]
	else: return func(input)
	
def journalLinePrevious(jline):
	if hasattr(jline, 'Previous'): 
		return jline.Previous()
	else: return None

OUT = process_input(journalLinePrevious, IN[0])
# ----------------------------------------
journalLine_2 = Output(python_script)  # "journalLine"
