# Dynamo custom node JournalLine.RawText.dyf (Dynamo 2.12.1.8246)
# category: Journalysis.Journal.Query
# Returns the raw text of a given journal line

journalLine = Input(journalLine: var[]..[])
python_script = Python(IN[0]=journalLine)  # CPython3
# ---------- python_script.python (11 lines) ----------
import clr

def process_input(func, input):
	if isinstance(input, list): return [func(x) for x in input]
	else: return func(input)
	
def journalLineRawText(jline):
	if hasattr(jline, 'RawText'): return jline.RawText
	else: return None

OUT = process_input(journalLineRawText,IN[0])
# ----------------------------------------
str = Output(python_script)
