# Dynamo custom node JournalMouseEvent.Type.dyf (Dynamo 2.12.1.8246)
# category: Journalysis.Journal.JournalLine.Query
# Returns the type of a MouseEvent line

journalMouseEvent = Input(journalMouseEvent: var[]..[])
python_code = Python(IN[0]=journalMouseEvent)  # CPython3
# ---------- python_code.python (11 lines) ----------
import clr

def process_input(func, input):
	if isinstance(input, list): return [func(x) for x in input]
	else: return func(input)
	
def journalMouseEventType(input):
	if input.__repr__() == 'JournalMouseEvent': return input.MouseEventType
	else: return None

OUT = process_input(journalMouseEventType,IN[0])
# ----------------------------------------
str = Output(python_code)
