# Dynamo custom node JournalSystemInformation.Type.dyf (Dynamo 2.12.1.8246)
# category: Journalysis.Journal.JournalLine.Query
# Returns the type of a given JournalSystemInformation line

journalSystemInformation = Input(journalSystemInformation: var[]..[])
python_script = Python(IN[0]=journalSystemInformation)  # CPython3
# ---------- python_script.python (11 lines) ----------
import clr

def process_input(func, input):
	if isinstance(input, list): return [func(x) for x in input]
	else: return func(input)
	
def journalSysInfoType(jsysinfo):
	if hasattr(jsysinfo, 'SystemInformationType'): return jsysinfo.SystemInformationType
	else: return None

OUT = process_input(journalSysInfoType,IN[0])
# ----------------------------------------
str = Output(python_script)
