# Dynamo custom node JournalUIEvent.Type.dyf (Dynamo 2.12.1.8246)
# category: Journalysis.Journal.JournalLine.Query
# Returns the type of a UIEvent line

journalUIEvent = Input(journalUIEvent: var[]..[])
python_script = Python(IN[0]=journalUIEvent)  # CPython3
# ---------- python_script.python (11 lines) ----------
import clr

def process_input(func, input):
	if isinstance(input, list): return [func(x) for x in input]
	else: return func(input)
	
def journalUIEventType(input):
	if input.__repr__() == 'JournalUIEvent': return input.UIEventType
	else: return None

OUT = process_input(journalUIEventType,IN[0])
# ----------------------------------------
str = Output(python_script)
