# Dynamo custom node JournalWorksharingEvent.DateTime.dyf (Dynamo 2.12.1.8246)
# category: Journalysis.Journal.JournalLine.Query
# Returns the date and time of a given JournalWorksharingEvent

journalWorksharingEvent = Input(journalWorksharingEvent: var[]..[])
python_script = Python(IN[0]=journalWorksharingEvent)  # CPython3
# ---------- python_script.python (11 lines) ----------
import clr

def process_input(func, input):
	if isinstance(input, list): return [func(x) for x in input]
	else: return func(input)
	
def journalWSEventDateTime(jwsevent):
	if jwsevent.__repr__() == 'JournalWorksharingEvent': return jwsevent.DateTime
	else: return None

OUT = process_input(journalWSEventDateTime,IN[0])
# ----------------------------------------
dateTime = Output(python_script)
