# Dynamo custom node KeyboardShortcuts.CommandByID.dyf (Dynamo 2.12.1.8246)
# category: Journalysis.Actions
# Returns the command that corresponds with the given CommandID

keyboardShortcuts = Input(keyboardShortcuts: var[]..[])
commandID = Input(commandID: string[]..[])
python_script = Python(IN[0]=keyboardShortcuts, IN[1]=commandID)  # CPython3
# ---------- python_script.python (4 lines) ----------
if IN[0].__repr__() == 'KeyboardShortcuts':
	if isinstance(IN[1], list): OUT = [IN[0].GetCommandById(x) for x in IN[1]]
	else: OUT = IN[0].GetCommandById(IN[1])
else: OUT = None
# ----------------------------------------
command = Output(python_script)
