# Dynamo custom node KeyboardShortcuts.CommandCountWithShortcuts.dyf (Dynamo 2.12.1.8246)
# category: Journalysis.Query
# Returns the total number of commands that have a shortcut assigned in a given KeyboardShirtcuts object

keyboardShortcuts = Input(keyboardShortcuts: var[]..[])
python_script = Python(IN[0]=keyboardShortcuts)  # CPython3
# ---------- python_script.python (2 lines) ----------
if IN[0].__repr__() == 'KeyboardShortcuts': OUT = IN[0].CommandCountWithShortcuts
else: OUT = None
# ----------------------------------------
int = Output(python_script)
