# Dynamo custom node KeyboardShortcuts.Commands.dyf (Dynamo 2.16.2.5624)
# category: Journalysis.Query
# Returns all commands from a given KeyboardShirtcuts object

keyboardShortcuts = Input(keyboardShortcuts: var[]..[])
python_script = Python(IN[0]=keyboardShortcuts)  # CPython3
# ---------- python_script.python (2 lines) ----------
if IN[0].__repr__() == 'KeyboardShortcuts': OUT = IN[0].Commands
else: OUT = None
# ----------------------------------------
keyboardShortcutCommands = Output(python_script)
