# Dynamo custom node KeyboardShortcuts.CommandsWithShortcuts.dyf (Dynamo 2.16.2.5624)
# category: Journalysis.Actions
# Returns all commands that have a shortcut assigned from a given KeyboardShirtcuts object

keyboardShortcuts = Input(keyboardShortcuts: var[]..[])
python_script = Python(IN[0]=keyboardShortcuts)  # CPython3
# ---------- python_script.python (2 lines) ----------
if IN[0].__repr__() == 'KeyboardShortcuts': OUT = IN[0].GetCommandsWithShortcuts()
else: OUT = None
# ----------------------------------------
seq = Output(python_script)
