# Dynamo custom node LoadedAssembly.Vendor.dyf (Dynamo 2.12.1.8246)
# category: Journalysis.Journal.Query
# Returns the vendor information of a given LoadedAssembly

loadedAssembly = Input(loadedAssembly: var[]..[])
python_script = Python(IN[0]=loadedAssembly)  # CPython3
# ---------- python_script.python (11 lines) ----------
import clr

def process_input(func, input):
	if isinstance(input, list): return [func(x) for x in input]
	else: return func(input)
	
def LAVendor(assembly):
	if assembly.__repr__() == 'LoadedAssembly': return assembly.Vendor
	else: return None

OUT = process_input(LAVendor,IN[0])
# ----------------------------------------
str = Output(python_script)
