# Dynamo custom node LoadedLink.LoadDuration.dyf (Dynamo 2.12.1.8246)
# category: Journalysis.WorksharingLog.WorksharingSession.Query
# Returns the load duration of a given loaded link

loadedLink = Input(loadedLink: var[]..[])
python_script = Python(IN[0]=loadedLink)  # CPython3
# ---------- python_script.python (11 lines) ----------
import clr

def process_input(func, input):
	if isinstance(input, list): return [func(x) for x in input]
	else: return func(input)
	
def LoadedLinkDuration(link):
	if link.__repr__() == 'LoadedLink': return link.LoadDuration
	else: return None

OUT = process_input(LoadedLinkDuration,IN[0])
# ----------------------------------------
timeSpan = Output(python_script)
