# Dynamo custom node SyncEvent.WasAborted.dyf (Dynamo 2.12.1.8246)
# category: Journalysis.WorksharingLog.WorksharingSession.SyncEvent.Query
# Returns the number of times that Reload Latest occured during a given SyncEvent

syncEvent = Input(syncEvent: var[]..[])
python_script = Python(IN[0]=syncEvent)  # CPython3
# ---------- python_script.python (11 lines) ----------
import clr

def process_input(func, input):
	if isinstance(input, list): return [func(x) for x in input]
	else: return func(input)
	
def SyncEventWasAborted(syncevent):
	if syncevent.__repr__() == 'SyncEvent': return syncevent.WasAborted
	else: return None

OUT = process_input(SyncEventWasAborted,IN[0])
# ----------------------------------------
bool = Output(python_script)
