# Dynamo custom node WorksharingSession.HostAddress.dyf (Dynamo 2.12.1.8246)
# category: Journalysis.WorksharingLog.Query
# Returns the host address (IP or MAC depending on environment) of a given WorksharingSession

worksharingSession = Input(worksharingSession: var[]..[])
python_script = Python(IN[0]=worksharingSession)  # CPython3
# ---------- python_script.python (11 lines) ----------
import clr

def process_input(func, input):
	if isinstance(input, list): return [func(x) for x in input]
	else: return func(input)
	
def WSSessionHostAddress(wssess):
	if wssess.__repr__() == 'WorksharingSession': return wssess.HostAddress
	else: return None

OUT = process_input(WSSessionHostAddress,IN[0])
# ----------------------------------------
str = Output(python_script)
