# Dynamo custom node WorksharingSession.ID.dyf (Dynamo 2.12.1.8246)
# category: Journalysis.WorksharingLog.Query
# Returns the ID of a given WorksharingSession

worksharingSession = Input(worksharingSession: var[]..[])
python_script = Python(IN[0]=worksharingSession)  # CPython3
# ---------- python_script.python (11 lines) ----------
import clr

def process_input(func, input):
	if isinstance(input, list): return [func(x) for x in input]
	else: return func(input)
	
def WSSessionID(wssess):
	if wssess.__repr__() == 'WorksharingSession': return wssess.ID
	else: return None

OUT = process_input(WSSessionID,IN[0])
# ----------------------------------------
str = Output(python_script)
