# Dynamo custom node Helpers.FindSyncEventOverlaps.dyf (Dynamo 3.6.1.9895)
# category: Journalysis.WorksharingLog.Actions
# Identifies groups of SyncEvents that overlap in a given WorksharingLog. Expects a list of *all* SyncEvents of *all* WorksharingSessions within a WorksharingLog.
# packages: PythonNet3 Engine 1.1.1

SyncEvents = Input(SyncEvents: var[]..[])
create = List.Create(item0=SyncEvents)
flatten = List.Flatten(list=create)
python_script = Python(IN[0]=flatten)  # PythonNet3
# ---------- python_script.python (14 lines) ----------
data = [(x.Start, x.End, x) for x in IN[0]]
# sort by end first, then by start
data.sort(key=lambda x: x[1])
data.sort(key=lambda x: x[0])
l = len(data)
overlaps = []
for i in range(l):
	for j in range(i+1, l):
		x = data[i]
		y = data[j]
		# identify overlaps
		if (y[0]<=x[1]): overlaps.append([x[2], y[2]])

OUT = overlaps
# ----------------------------------------
SyncEvents_2 = Output(python_script)  # "SyncEvents"
