# Dynamo custom node Journal.ContainsAPIErrors.dyf (Dynamo 3.6.1.9895)
# category: Journalysis.Actions
# Computes whether a given journal contains any API errors
# packages: PythonNet3 Engine 1.1.1

journal = Input(journal: var[]..[])
python_script = Python(IN[0]=journal)  # PythonNet3
# ---------- python_script.python (11 lines) ----------
import clr

def process_input(func, input):
	if isinstance(input, list): return [func(x) for x in input]
	else: return func(input)
	
def journalContainsAPIErrors(journal):
	if journal.__repr__() == 'Journal': return journal.ContainsAPIErrors()
	else: return False

OUT = process_input(journalContainsAPIErrors,IN[0])
# ----------------------------------------
bool = Output(python_script)
