# Dynamo custom node Journal.DateTimeByBlock.dyf (Dynamo 3.6.1.9895)
# category: Journalysis.Actions
# Retrieves the DateTime of a given block from a given journal
# packages: PythonNet3 Engine 1.1.1

journal = Input(journal: var[]..[])
journalBlock = Input(journalBlock: var[]..[])
python_script = Python(IN[0]=journal, IN[1]=journalBlock)  # PythonNet3
# ---------- python_script.python (6 lines) ----------
import clr

OUT = []
if IN[0].__repr__() == 'Journal':
	if isinstance(IN[1], list): OUT = IN[0].GetDateTimeByBlocks(IN[1])
	else: OUT = IN[0].GetDateTimeByBlock(IN[1])
# ----------------------------------------
dateTime = Output(python_script)
