# Dynamo custom node Journal.LinesByDateTime.dyf (Dynamo 3.6.1.9895)
# category: Journalysis.Actions
# Retrieves all lines of a given journal that fall in a given time window. At least one DateTime needs to be given (from or to).
# packages: PythonNet3 Engine 1.1.1

journal = Input(journal: var[]..[])
fromDateTime = Input(fromDateTime: System.DateTime = null)
toDateTime = Input(toDateTime: System.DateTime = null)
python_script = Python(IN[0]=journal, IN[1]=fromDateTime, IN[2]=toDateTime)  # PythonNet3
# ---------- python_script.python (11 lines) ----------
import clr

def process_input(func, inputs):
	if isinstance(inputs[0], list): return [func(x, inputs[1], inputs[2]) for x in inputs[0]]
	else: return func(inputs[0], inputs[1], inputs[2])
	
def journalLinesByDateTime(journal, fromDateTime, toDateTime):
	if journal.__repr__() == 'Journal': return journal.GetLinesByDateTime(fromDateTime, toDateTime)
	else: return None

OUT = process_input(journalLinesByDateTime, IN)
# ----------------------------------------
journalLines = Output(python_script)
