# Dynamo custom node Journal.RevitBuild.dyf (Dynamo 3.6.1.9895)
# category: Journalysis.Query
# Returns the Revit build from a given journal
# packages: PythonNet3 Engine 1.1.1

journal = Input(journal: var[]..[])
python_script = Python(IN[0]=journal)  # PythonNet3
# ---------- python_script.python (11 lines) ----------
import clr

def process_input(func, input):
	if isinstance(input, list): return [func(x) for x in input]
	else: return func(input)
	
def journalBuild(journal):
	if journal.__repr__() == 'Journal': return journal.Build
	else: return None

OUT = process_input(journalBuild,IN[0])
# ----------------------------------------
str = Output(python_script)
