# Dynamo custom node Journal.SessionTerminatedProperly.dyf (Dynamo 3.6.1.9895)
# category: Journalysis.Actions
# Computes whether the Revit session  of the given journal was terminated properly
# packages: PythonNet3 Engine 1.1.1

journal = Input(journal: var[]..[])
python_script = Python(IN[0]=journal)  # PythonNet3
# ---------- python_script.python (11 lines) ----------
import clr

def process_input(func, input):
	if isinstance(input, list): return [func(x) for x in input]
	else: return func(input)
	
def journalSessionTerminatedProperly(journal):
	if journal.__repr__() == 'Journal': return journal.WasSessionTerminatedProperly()
	else: return False

OUT = process_input(journalSessionTerminatedProperly,IN[0])
# ----------------------------------------
bool = Output(python_script)
