# Dynamo custom node Journal.StartupTime.dyf (Dynamo 3.6.1.9895)
# category: Journalysis.Actions
# Computes the time it took Revit to display the startup screen based on the given journal
# packages: PythonNet3 Engine 1.1.1

journal = Input(journal: var[]..[])
python_script = Python(IN[0]=journal)  # PythonNet3
# ---------- python_script.python (11 lines) ----------
import clr

def process_input(func, input):
	if isinstance(input, list): return [func(x) for x in input]
	else: return func(input)
	
def journalStartupTime(journal):
	if journal.__repr__() == 'Journal': return journal.GetStartupTime()
	else: return None

OUT = process_input(journalStartupTime,IN[0])
# ----------------------------------------
timeSpan = Output(python_script)
