# Dynamo custom node Journal.StripComments.dyf (Dynamo 3.6.1.9895)
# category: Journalysis.Actions
# Strips all comments from the original journal string and only returns all (re-formatted) lines that are potentially relevant for journal playback.
# packages: PythonNet3 Engine 1.1.1

journal = Input(journal: var[]..[])
preserveTimestamps = Input(preserveTimestamps: bool = false)
python_script = Python(IN[0]=journal, IN[1]=preserveTimestamps)  # PythonNet3
# ---------- python_script.python (11 lines) ----------
import clr

def process_input(func, input1, input2):
	if isinstance(input1, list): return [func(x, input2) for x in input1]
	else: return func(input1, input2)
	
def journalStripComments(journal, preserveTimestamps):
	if journal.__repr__() == 'Journal': return journal.StripComments(preserveTimestamps)
	else: return None

OUT = process_input(journalStripComments,IN[0],IN[1])
# ----------------------------------------
str = Output(python_script)
