# Dynamo custom node JournalAPIMessage.IsError.dyf (Dynamo 3.6.1.9895)
# category: Journalysis.Journal.JournalLine.Query
# Returns whether an APIMessage reports an error
# packages: PythonNet3 Engine 1.1.1

journalAPIMessage = Input(journalAPIMessage: var[]..[])
python_script = Python(IN[0]=journalAPIMessage)  # PythonNet3
# ---------- python_script.python (11 lines) ----------
import clr

def process_input(func, input):
	if isinstance(input, list): return [func(x) for x in input]
	else: return func(input)
	
def journalAPIMessageIsError(japimsg):
	if japimsg.__repr__() == 'JournalAPIMessage': return japimsg.IsError
	else: return None

OUT = process_input(journalAPIMessageIsError,IN[0])
# ----------------------------------------
bool = Output(python_script)
