# Dynamo custom node JournalAddinEvent.Text.dyf (Dynamo 3.6.1.9895)
# category: Journalysis.Journal.JournalLine.Query
# Returns the text from an AddinEvent line
# packages: PythonNet3 Engine 1.1.1

journalAddinEvent = Input(journalAddinEvent: var[]..[])
pythonScript = Python(IN[0]=journalAddinEvent)  # PythonNet3
# ---------- pythonScript.python (11 lines) ----------
import clr

def process_input(func, input):
	if isinstance(input, list): return [func(x) for x in input]
	else: return func(input)
	
def journalAddinEventMessageText(jaddinevent):
	if jaddinevent.__repr__() == 'JournalAddinEvent': return jaddinevent.MessageText
	else: return None

OUT = process_input(journalAddinEventMessageText,IN[0])
# ----------------------------------------
str = Output(pythonScript)
