# Dynamo custom node JournalBasicFileInfo.Locale.dyf (Dynamo 3.6.1.9895)
# category: Journalysis.Journal.JournalLine.Query
# Returns the locale a model was saved in from a BasicFileInfo line
# packages: PythonNet3 Engine 1.1.1

journalBasicFileInfo = Input(journalBasicFileInfo: var[]..[])
python_script = Python(IN[0]=journalBasicFileInfo)  # PythonNet3
# ---------- python_script.python (11 lines) ----------
import clr

def process_input(func, input):
	if isinstance(input, list): return [func(x) for x in input]
	else: return func(input)
	
def journalBFILocale(jbfi):
	if jbfi.__repr__() == 'JournalBasicFileInfo': return jbfi.Locale
	else: return None

OUT = process_input(journalBFILocale,IN[0])
# ----------------------------------------
Locale = Output(python_script)
