# Dynamo custom node JournalBasicFileInfo.Worksharing.dyf (Dynamo 3.6.1.9895)
# category: Journalysis.Journal.JournalLine.Query
# Returns the worksharing status from a BasicFileInfo line
# packages: PythonNet3 Engine 1.1.1

journalBasicFileInfo = Input(journalBasicFileInfo: var[]..[])
python_script = Python(IN[0]=journalBasicFileInfo)  # PythonNet3
# ---------- python_script.python (11 lines) ----------
import clr

def process_input(func, input):
	if isinstance(input, list): return [func(x) for x in input]
	else: return func(input)
	
def journalBFIWorksharing(jbfi):
	if jbfi.__repr__() == 'JournalBasicFileInfo': return jbfi.Worksharing
	else: return None

OUT = process_input(journalBFIWorksharing,IN[0])
# ----------------------------------------
str = Output(python_script)
