# Dynamo custom node JournalData.Key.dyf (Dynamo 3.6.1.9895)
# category: Journalysis.Journal.JournalLine.Query
# Returns the key of a JournalData line
# packages: PythonNet3 Engine 1.1.1

journalData = Input(journalData: var[]..[])
python_script = Python(IN[0]=journalData)  # PythonNet3
# ---------- python_script.python (11 lines) ----------
import clr

def process_input(func, input):
	if isinstance(input, list): return [func(x) for x in input]
	else: return func(input)
	
def journalDataKey(jdata):
	if jdata.__repr__() == 'JournalData': return jdata.Key
	else: return None

OUT = process_input(journalDataKey,IN[0])
# ----------------------------------------
str = Output(python_script)
