# Dynamo custom node JournalData.Values.dyf (Dynamo 3.6.1.9895)
# category: Journalysis.Journal.JournalLine.Query
# Returns the values from a JournalData line
# packages: PythonNet3 Engine 1.1.1

journalData = Input(journalData: var[]..[])
python_script = Python(IN[0]=journalData)  # PythonNet3
# ---------- python_script.python (11 lines) ----------
import clr

def process_input(func, input):
	if isinstance(input, list): return [func(x) for x in input]
	else: return func(input)
	
def journalDataValues(jdata):
	if jdata.__repr__() == 'JournalData': return jdata.Values
	else: return []

OUT = process_input(journalDataValues,IN[0])
# ----------------------------------------
seq = Output(python_script)
