# Dynamo custom node JournalDirective.Key.dyf (Dynamo 3.6.1.9895)
# category: Journalysis.Journal.JournalLine.Query
# Returns the key of a JournalDirective line
# packages: PythonNet3 Engine 1.1.1

journalDirective = Input(journalDirective: var[]..[])
python_script = Python(IN[0]=journalDirective)  # PythonNet3
# ---------- python_script.python (11 lines) ----------
import clr

def process_input(func, input):
	if isinstance(input, list): return [func(x) for x in input]
	else: return func(input)
	
def journalDirectiveKey(jdirective):
	if jdirective.__repr__() == 'JournalDirective': return jdirective.Key
	else: return None

OUT = process_input(journalDirectiveKey,IN[0])
# ----------------------------------------
str = Output(python_script)
