# Dynamo custom node JournalGUIResourceUsage.User.dyf (Dynamo 3.6.1.9895)
# category: Journalysis.Journal.JournalLine.Query
# packages: PythonNet3 Engine 1.1.1

journalGUIResourceUsage = Input(journalGUIResourceUsage: var[]..[])
python_script = Python(IN[0]=journalGUIResourceUsage)  # PythonNet3
# ---------- python_script.python (11 lines) ----------
import clr

def process_input(func, input):
	if isinstance(input, list): return [func(x) for x in input]
	else: return func(input)
	
def journalGUIResourceUsageUser(jguiru):
	if jguiru.__repr__() == 'JournalGUIResourceUsage': return jguiru.User
	else: return None

OUT = process_input(journalGUIResourceUsageUser,IN[0])
# ----------------------------------------
int = Output(python_script)
