# Dynamo custom node JournalKeyboardEvent.Key.dyf (Dynamo 3.6.1.9895)
# category: Journalysis.Journal.JournalLine.Query
# Returns the pressed key of a KeyboardEvent line
# packages: PythonNet3 Engine 1.1.1

journalKeyboardEvent = Input(journalKeyboardEvent: var[]..[])
python_script = Python(IN[0]=journalKeyboardEvent)  # PythonNet3
# ---------- python_script.python (11 lines) ----------
import clr

def process_input(func, input):
	if isinstance(input, list): return [func(x) for x in input]
	else: return func(input)
	
def journalKeyboardEventKey(jkeyboardevent):
	if jkeyboardevent.__repr__() == 'JournalKeyboardEvent': return jkeyboardevent.Key
	else: return None

OUT = process_input(journalKeyboardEventKey,IN[0])
# ----------------------------------------
str = Output(python_script)
