# Dynamo custom node JournalLine.Next.dyf (Dynamo 3.6.1.9895)
# category: Journalysis.Journal.Actions
# Retrieves the next line after the given line
# packages: PythonNet3 Engine 1.1.1

journalLine = Input(journalLine: var[]..[])
python_script = Python(IN[0]=journalLine)  # PythonNet3
# ---------- python_script.python (12 lines) ----------
import clr

def process_input(func, input):
	if isinstance(input, list): return [func(x) for x in input]
	else: return func(input)
	
def journalLineNext(jline):
	if hasattr(jline, 'Next'): 
		return jline.Next()
	else: return None

OUT = process_input(journalLineNext, IN[0])
# ----------------------------------------
journalLine_2 = Output(python_script)  # "journalLine"
