# Dynamo custom node JournalLine.NextOfType.dyf (Dynamo 3.6.1.9895)
# category: Journalysis.Journal.Actions
# Retrieves the next line of a given type after the given line from the journal
# packages: PythonNet3 Engine 1.1.1

journalLine = Input(journalLine: var[]..[])
journalLineType = Input(journalLineType: var[]..[])
python_script = Python(IN[0]=journalLine, IN[1]=journalLineType)  # PythonNet3
# ---------- python_script.python (12 lines) ----------
import clr

def process_input(func, input1, input2):
	if isinstance(input1, list): return [func(x, input2) for x in input1]
	else: return func(input1, input2)
	
def journalLineNextOfType(jline, type):
	if hasattr(jline, 'NextOfType'): 
		return jline.NextOfType(type)
	else: return None

OUT = process_input(journalLineNextOfType, IN[0], IN[1])
# ----------------------------------------
journalLine_2 = Output(python_script)  # "journalLine"
