# Dynamo custom node JournalLine.Number.dyf (Dynamo 3.6.1.9895)
# category: Journalysis.Journal.Query
# Returns the line number of a given journal line
# packages: PythonNet3 Engine 1.1.1

journalLine = Input(journalLine: var[]..[])
python_script = Python(IN[0]=journalLine)  # PythonNet3
# ---------- python_script.python (11 lines) ----------
import clr

def process_input(func, input):
	if isinstance(input, list): return [func(x) for x in input]
	else: return func(input)
	
def journalLineNumber(jline):
	if hasattr(jline, 'Number'): return jline.Number
	else: return None

OUT = process_input(journalLineNumber,IN[0])
# ----------------------------------------
int = Output(python_script)
