# Dynamo custom node JournalLine.PreviousOfTypeAndProperty.dyf (Dynamo 3.6.1.9895)
# category: Journalysis.Journal.Actions
# Retrieves the previous line of a given type and property value before the given line from the journal
# packages: PythonNet3 Engine 1.1.1

journalLine = Input(journalLine: var[]..[])
journalLineType = Input(journalLineType: var[]..[])
property = Input(property: var[]..[])
value = Input(value: var[]..[])
python_script = Python(IN[0]=journalLine, IN[1]=journalLineType, IN[2]=property, IN[3]=value)  # PythonNet3
# ---------- python_script.python (13 lines) ----------
import clr

def process_input(func, inputs):
	if isinstance(inputs[1], list) or isinstance(inputs[2], list) or isinstance(inputs[3], list): return None
	elif isinstance(inputs[0], list): return [func(x, inputs[1], inputs[2], inputs[3]) for x in inputs[0]]
	else: return func(inputs[0], inputs[1], inputs[2], inputs[3])
	
def journalLinePreviousOfTypeAndProperty(jline, type, prop, val):
	if hasattr(jline, 'PreviousOfTypeAndProperty'): 
		return jline.PreviousOfTypeAndProperty(type, prop, val)
	else: return None

OUT = process_input(journalLinePreviousOfTypeAndProperty, IN)
# ----------------------------------------
journalLine_2 = Output(python_script)  # "journalLine"
