# Dynamo custom node JournalMemoryMetrics.VMAvailable.dyf (Dynamo 3.6.1.9895)
# category: Journalysis.Journal.JournalLine.Query
# Returns the available VM of a MemoryMetrics line
# packages: PythonNet3 Engine 1.1.1

journalMemoryMetrics = Input(journalMemoryMetrics: var[]..[])
python_script = Python(IN[0]=journalMemoryMetrics)  # PythonNet3
# ---------- python_script.python (11 lines) ----------
import clr

def process_input(func, input):
	if isinstance(input, list): return [func(x) for x in input]
	else: return func(input)
	
def journalMemoryMetricsVMAvailable(jmm):
	if jmm.__repr__() == 'JournalMemoryMetrics': return jmm.VMAvailable
	else: return None

OUT = process_input(journalMemoryMetricsVMAvailable,IN[0])
# ----------------------------------------
int = Output(python_script)
