# Dynamo custom node JournalMouseEvent.Data.dyf (Dynamo 3.6.1.9895)
# category: Journalysis.Journal.JournalLine.Query
# Returns the data from a MouseEvent line
# packages: PythonNet3 Engine 1.1.1

journalMouseEvent = Input(journalMouseEvent: var[]..[])
python_script = Python(IN[0]=journalMouseEvent)  # PythonNet3
# ---------- python_script.python (11 lines) ----------
import clr

def process_input(func, input):
	if isinstance(input, list): return [func(x) for x in input]
	else: return func(input)
	
def journalMouseEventData(input):
	if input.__repr__() == 'JournalMouseEvent': return input.Data
	else: return []

OUT = process_input(journalMouseEventData,IN[0])
# ----------------------------------------
seq = Output(python_script)
