# Dynamo custom node JournalMouseEvent.Type.dyf (Dynamo 3.6.1.9895)
# category: Journalysis.Journal.JournalLine.Query
# Returns the type of a MouseEvent line
# packages: PythonNet3 Engine 1.1.1

journalMouseEvent = Input(journalMouseEvent: var[]..[])
python_code = Python(IN[0]=journalMouseEvent)  # PythonNet3
# ---------- python_code.python (11 lines) ----------
import clr

def process_input(func, input):
	if isinstance(input, list): return [func(x) for x in input]
	else: return func(input)
	
def journalMouseEventType(input):
	if input.__repr__() == 'JournalMouseEvent': return input.MouseEventType
	else: return None

OUT = process_input(journalMouseEventType,IN[0])
# ----------------------------------------
str = Output(python_code)
