# Dynamo custom node JournalSystemInformation.Value.dyf (Dynamo 3.6.1.9895)
# category: Journalysis.Journal.JournalLine.Query
# Returns the value of a given JournalSystemInformation line
# packages: PythonNet3 Engine 1.1.1

journalSystemInformation = Input(journalSystemInformation: var[]..[])
python_script = Python(IN[0]=journalSystemInformation)  # PythonNet3
# ---------- python_script.python (11 lines) ----------
import clr

def process_input(func, input):
	if isinstance(input, list): return [func(x) for x in input]
	else: return func(input)
	
def journalSysInfoValue(jsysinfo):
	if hasattr(jsysinfo, 'SystemInformationType'): return jsysinfo.Value
	else: return None

OUT = process_input(journalSysInfoValue,IN[0])
# ----------------------------------------
str = Output(python_script)
