# Dynamo custom node JournalTimeStamp.DateTime.dyf (Dynamo 3.6.1.9895)
# category: Journalysis.Journal.JournalLine.Query
# Returns the date and time of a TimeStamp line
# packages: PythonNet3 Engine 1.1.1

journalTimeStamp = Input(journalTimeStamp: var[]..[])
python_script = Python(IN[0]=journalTimeStamp)  # PythonNet3
# ---------- python_script.python (11 lines) ----------
import clr

def process_input(func, input):
	if isinstance(input, list): return [func(x) for x in input]
	else: return func(input)
	
def journalTimeStampDateTime(input):
	if input.__repr__() == 'JournalTimeStamp': return input.DateTime
	else: return None

OUT = process_input(journalTimeStampDateTime,IN[0])
# ----------------------------------------
dateTime = Output(python_script)
