# Dynamo custom node JournalUIEvent.Data.dyf (Dynamo 3.6.1.9895)
# category: Journalysis.Journal.JournalLine.Query
# Returns the data from a UIEvent line
# packages: PythonNet3 Engine 1.1.1

journalUIEvent = Input(journalUIEvent: var[]..[])
python_script = Python(IN[0]=journalUIEvent)  # PythonNet3
# ---------- python_script.python (11 lines) ----------
import clr

def process_input(func, input):
	if isinstance(input, list): return [func(x) for x in input]
	else: return func(input)
	
def journalUIEventData(input):
	if input.__repr__() == 'JournalUIEvent': return input.Data
	else: return None

OUT = process_input(journalUIEventData,IN[0])
# ----------------------------------------
seq = Output(python_script)
