# Dynamo custom node JournalUIEvent.Type.dyf (Dynamo 3.6.1.9895)
# category: Journalysis.Journal.JournalLine.Query
# Returns the type of a UIEvent line
# packages: PythonNet3 Engine 1.1.1

journalUIEvent = Input(journalUIEvent: var[]..[])
python_script = Python(IN[0]=journalUIEvent)  # PythonNet3
# ---------- python_script.python (11 lines) ----------
import clr

def process_input(func, input):
	if isinstance(input, list): return [func(x) for x in input]
	else: return func(input)
	
def journalUIEventType(input):
	if input.__repr__() == 'JournalUIEvent': return input.UIEventType
	else: return None

OUT = process_input(journalUIEventType,IN[0])
# ----------------------------------------
str = Output(python_script)
