# Dynamo custom node JournalWorksharingEvent.SessionID.dyf (Dynamo 3.6.1.9895)
# category: Journalysis.Journal.JournalLine.Query
# Returns the session ID (used in the worksharing log of the central file) of a given JournalWorksharingEvent
# packages: PythonNet3 Engine 1.1.1

journalWorksharingEvent = Input(journalWorksharingEvent: var[]..[])
python_script = Python(IN[0]=journalWorksharingEvent)  # PythonNet3
# ---------- python_script.python (11 lines) ----------
import clr

def process_input(func, input):
	if isinstance(input, list): return [func(x) for x in input]
	else: return func(input)
	
def journalWSEventID(jwsevent):
	if jwsevent.__repr__() == 'JournalWorksharingEvent': return jwsevent.SessionID
	else: return None

OUT = process_input(journalWSEventID,IN[0])
# ----------------------------------------
str = Output(python_script)
