# Dynamo custom node JournalWorksharingEvent.Text.dyf (Dynamo 3.6.1.9895)
# category: Journalysis.Journal.JournalLine.Query
# Returns the recorded text of a given JournalWorksharingEvent
# packages: PythonNet3 Engine 1.1.1

journalWorksharingEvent = Input(journalWorksharingEvent: var[]..[])
python_script = Python(IN[0]=journalWorksharingEvent)  # PythonNet3
# ---------- python_script.python (11 lines) ----------
import clr

def process_input(func, input):
	if isinstance(input, list): return [func(x) for x in input]
	else: return func(input)
	
def journalWSEventText(jwsevent):
	if jwsevent.__repr__() == 'JournalWorksharingEvent': return jwsevent.Text
	else: return None

OUT = process_input(journalWSEventText,IN[0])
# ----------------------------------------
str = Output(python_script)
