# Dynamo custom node KeyboardShortcutCommand.HasShortcuts.dyf (Dynamo 3.6.1.9895)
# category: Journalysis.KeyboardShortcuts.Query
# Returns whether a given command has any shortcuts assigned
# packages: PythonNet3 Engine 1.1.1

keyboardShortcutCommand = Input(keyboardShortcutCommand: var[]..[])
python_script = Python(IN[0]=keyboardShortcutCommand)  # PythonNet3
# ---------- python_script.python (11 lines) ----------
import clr

def process_input(func, input):
	if isinstance(input, list): return [func(x) for x in input]
	else: return func(input)
	
def ksCommandHasShortcuts(ksc):
	if ksc.__repr__() == 'KeyboardShortcutCommand': return ksc.HasShortcuts
	else: return False

OUT = process_input(ksCommandHasShortcuts,IN[0])
# ----------------------------------------
bool = Output(python_script)
