# Dynamo custom node KeyboardShortcutCommand.ID.dyf (Dynamo 3.6.1.9895)
# category: Journalysis.KeyboardShortcuts.Query
# Returns the ID of a given command
# packages: PythonNet3 Engine 1.1.1

keyboardShortcutCommand = Input(keyboardShortcutCommand: var[]..[])
python_script = Python(IN[0]=keyboardShortcutCommand)  # PythonNet3
# ---------- python_script.python (11 lines) ----------
import clr

def process_input(func, input):
	if isinstance(input, list): return [func(x) for x in input]
	else: return func(input)
	
def ksCommandID(ksc):
	if ksc.__repr__() == 'KeyboardShortcutCommand': return ksc.ID
	else: return None

OUT = process_input(ksCommandID,IN[0])
# ----------------------------------------
str = Output(python_script)
