# Dynamo custom node KeyboardShortcutCommand.Name.dyf (Dynamo 3.6.1.9895)
# category: Journalysis.KeyboardShortcuts.Query
# Returns the name of a given command
# packages: PythonNet3 Engine 1.1.1

keyboardShortcutCommand = Input(keyboardShortcutCommand: var[]..[])
python_script = Python(IN[0]=keyboardShortcutCommand)  # PythonNet3
# ---------- python_script.python (11 lines) ----------
import clr

def process_input(func, input):
	if isinstance(input, list): return [func(x) for x in input]
	else: return func(input)
	
def ksCommandName(ksc):
	if ksc.__repr__() == 'KeyboardShortcutCommand': return ksc.Name
	else: return None

OUT = process_input(ksCommandName,IN[0])
# ----------------------------------------
str = Output(python_script)
