# Dynamo custom node KeyboardShortcuts.CommandCount.dyf (Dynamo 3.6.1.9895)
# category: Journalysis.Query
# Returns the total number of commands in a given KeyboardShirtcuts object
# packages: PythonNet3 Engine 1.1.1

keyboardShortcuts = Input(keyboardShortcuts: var[]..[])
python_script = Python(IN[0]=keyboardShortcuts)  # PythonNet3
# ---------- python_script.python (4 lines) ----------
import clr

if IN[0].__repr__() == 'KeyboardShortcuts': OUT = IN[0].CommandCount
else: OUT = None
# ----------------------------------------
int = Output(python_script)
