# Dynamo custom node KeyboardShortcuts.CommandCountWithShortcuts.dyf (Dynamo 3.6.1.9895)
# category: Journalysis.Query
# Returns the total number of commands that have a shortcut assigned in a given KeyboardShirtcuts object
# packages: PythonNet3 Engine 1.1.1

keyboardShortcuts = Input(keyboardShortcuts: var[]..[])
python_script = Python(IN[0]=keyboardShortcuts)  # PythonNet3
# ---------- python_script.python (2 lines) ----------
if IN[0].__repr__() == 'KeyboardShortcuts': OUT = IN[0].CommandCountWithShortcuts
else: OUT = None
# ----------------------------------------
int = Output(python_script)
