# Dynamo custom node KeyboardShortcuts.CommandsWithShortcuts.dyf (Dynamo 3.6.1.9895)
# category: Journalysis.Actions
# Returns all commands that have a shortcut assigned from a given KeyboardShirtcuts object
# packages: PythonNet3 Engine 1.1.1

keyboardShortcuts = Input(keyboardShortcuts: var[]..[])
python_script = Python(IN[0]=keyboardShortcuts)  # PythonNet3
# ---------- python_script.python (2 lines) ----------
if IN[0].__repr__() == 'KeyboardShortcuts': OUT = IN[0].GetCommandsWithShortcuts()
else: OUT = None
# ----------------------------------------
seq = Output(python_script)
