# Dynamo custom node LoadedAssembly.Events.dyf (Dynamo 3.6.1.9895)
# category: Journalysis.Journal.Query
# Returns all journal lines associated with a given LoadedAssembly.
# ATTENTION: Note that this will most likely not catch all AddedPushbutton events of a given assembly.
# packages: PythonNet3 Engine 1.1.1

loadedAssembly = Input(loadedAssembly: var[]..[])
python_script = Python(IN[0]=loadedAssembly)  # PythonNet3
# ---------- python_script.python (11 lines) ----------
import clr

def process_input(func, input):
	if isinstance(input, list): return [func(x) for x in input]
	else: return func(input)
	
def LAEvents(assembly):
	if assembly.__repr__() == 'LoadedAssembly': return assembly.Events
	else: return []

OUT = process_input(LAEvents,IN[0])
# ----------------------------------------
journalLines = Output(python_script)
