# Dynamo custom node LoadedAssembly.GUID.dyf (Dynamo 3.6.1.9895)
# category: Journalysis.Journal.Query
# Returns the GUID of a given LoadedAssembly
# packages: PythonNet3 Engine 1.1.1

loadedAssembly = Input(loadedAssembly: var[]..[])
python_script = Python(IN[0]=loadedAssembly)  # PythonNet3
# ---------- python_script.python (11 lines) ----------
import clr

def process_input(func, input):
	if isinstance(input, list): return [func(x) for x in input]
	else: return func(input)
	
def LAGuid(assembly):
	if assembly.__repr__() == 'LoadedAssembly': return assembly.GUID
	else: return None

OUT = process_input(LAGuid,IN[0])
# ----------------------------------------
str = Output(python_script)
