# Dynamo custom node LoadedLink.FileName.dyf (Dynamo 3.6.1.9895)
# category: Journalysis.WorksharingLog.WorksharingSession.Query
# Returns the file name of a given loaded link
# packages: PythonNet3 Engine 1.1.1

loadedLink = Input(loadedLink: var[]..[])
python_script = Python(IN[0]=loadedLink)  # PythonNet3
# ---------- python_script.python (11 lines) ----------
import clr

def process_input(func, input):
	if isinstance(input, list): return [func(x) for x in input]
	else: return func(input)
	
def LoadedLinkFileName(link):
	if link.__repr__() == 'LoadedLink': return link.FileName
	else: return None

OUT = process_input(LoadedLinkFileName,IN[0])
# ----------------------------------------
str = Output(python_script)
