# Dynamo custom node LoadedModel.Events.dyf (Dynamo 3.6.1.9895)
# category: Journalysis.Journal.Query
# Returns all events associated with a loaded model
# packages: PythonNet3 Engine 1.1.1

loadedModel = Input(loadedModel: var[]..[])
python_script = Python(IN[0]=loadedModel)  # PythonNet3
# ---------- python_script.python (11 lines) ----------
import clr

def process_input(func, input):
	if isinstance(input, list): return [func(x) for x in input]
	else: return func(input)
	
def LMEvents(model):
	if model.__repr__() == 'LoadedModel': return model.Events
	else: return []

OUT = process_input(LMEvents,IN[0])
# ----------------------------------------
loadedModelEvents = Output(python_script)
