# Dynamo custom node LoadedModel.VersionHistory.dyf (Dynamo 3.6.1.9895)
# category: Journalysis.Journal.Actions
# Retrieves the version history of a loaded model
# packages: PythonNet3 Engine 1.1.1

loadedModel = Input(loadedModel: var[]..[])
python_script = Python(IN[0]=loadedModel)  # PythonNet3
# ---------- python_script.python (11 lines) ----------
import clr

def process_input(func, input):
	if isinstance(input, list): return [func(x) for x in input]
	else: return func(input)
	
def LMVersionHistory(model):
	if model.__repr__() == 'LoadedModel': return model.GetVersionHistory()
	else: return None

OUT = process_input(LMVersionHistory,IN[0])
# ----------------------------------------
seq = Output(python_script)
