# Dynamo custom node LoadedModelEvent.JournalLine.dyf (Dynamo 3.6.1.9895)
# category: Journalysis.Journal.LoadedModel.Query
# Returns the JournalLIne of a given LoadedModelEvent
# packages: PythonNet3 Engine 1.1.1

loadedModelEvent = Input(loadedModelEvent: var[]..[])
python_script = Python(IN[0]=loadedModelEvent)  # PythonNet3
# ---------- python_script.python (11 lines) ----------
import clr

def process_input(func, input):
	if isinstance(input, list): return [func(x) for x in input]
	else: return func(input)
	
def LMEJournalLine(modelevent):
	if modelevent.__repr__() == 'LoadedModelEvent': return modelevent.JournalLine
	else: return None

OUT = process_input(LMEJournalLine,IN[0])
# ----------------------------------------
journalLine = Output(python_script)
