# Dynamo custom node Paths.AllJournalDirectories.dyf (Dynamo 3.6.1.9895)
# category: Journalysis.Journal.Query
# Retrieves a list of all journal folders on the current machine
# packages: PythonNet3 Engine 1.1.1

python_script = Python()  # PythonNet3; graph input
# ---------- python_script.python (3 lines) ----------
import clr
from System import Environment
OUT = Environment.GetFolderPath(Environment.SpecialFolder.LocalApplicationData)
# ----------------------------------------
string = StringInput("Autodesk\Revit")  # graph input
combinePath = FileSystem.CombinePath(string0=python_script, string1=string)
fromPath = DirectoryObject(path=combinePath)  # "Directory.FromPath"
getDirectoryContents = FileSystem.GetDirectoryContents(directory=fromPath)
fileName = FileSystem.FileName(path=getDirectoryContents.directories)
string_2 = StringInput("Autodesk Revit")  # graph input
startsWith = String.StartsWith(string=fileName, searchFor=string_2)
filterByBoolMask = List.FilterByBoolMask(list=getDirectoryContents.directories, mask=startsWith)
string_3 = StringInput("Journals")  # graph input
code_block = CodeBlock(dir=filterByBoolMask.in, folder=string_3) { dir + "\\" + folder; }
seq = Output(code_block)
