# Dynamo custom node RecordedException.StackTrace.dyf (Dynamo 3.6.1.9895)
# category: Journalysis.Journal.Query
# Returns the stack trace of the exception (if any)
# packages: PythonNet3 Engine 1.1.1

recordedException = Input(recordedException: var[]..[])
python_script = Python(IN[0]=recordedException)  # PythonNet3
# ---------- python_script.python (11 lines) ----------
import clr

def process_input(func, input):
	if isinstance(input, list): return [func(x) for x in input]
	else: return func(input)
	
def RecordedExceptionStackTrace(input):
	if input.__repr__() == 'RecordedException': return input.StackTrace
	else: return None

OUT = process_input(RecordedExceptionStackTrace,IN[0])
# ----------------------------------------
str = Output(python_script)
