# Dynamo custom node WorksharingEvent.Text.dyf (Dynamo 3.6.1.9895)
# category: Journalysis.WorksharingLog.WorksharingSession.Query
# Returns the logged text of a given WorksharingEvent
# packages: PythonNet3 Engine 1.1.1

worksharingEvent = Input(worksharingEvent: var[]..[])
python_script = Python(IN[0]=worksharingEvent)  # PythonNet3
# ---------- python_script.python (11 lines) ----------
import clr

def process_input(func, input):
	if isinstance(input, list): return [func(x) for x in input]
	else: return func(input)
	
def WSEventText(wsevent):
	if wsevent.__repr__() == 'WorksharingEvent': return wsevent.Text
	else: return None

OUT = process_input(WSEventText,IN[0])
# ----------------------------------------
str = Output(python_script)
