# Dynamo custom node WorksharingLog.AllSessionsUseSameBuild.dyf (Dynamo 3.6.1.9895)
# category: Journalysis.Actions
# Determines whether all sessions of a given WorksharingLog use the same Revit build
# packages: PythonNet3 Engine 1.1.1

worksharingLog = Input(worksharingLog: var[]..[])
python_script = Python(IN[0]=worksharingLog)  # PythonNet3
# ---------- python_script.python (11 lines) ----------
import clr

def process_input(func, input):
	if isinstance(input, list): return [func(x) for x in input]
	else: return func(input)
	
def WSLogAllSessionsUseSameBuild(wslog):
	if wslog.__repr__() == 'WorksharingLog': return wslog.AllSessionsUseSameBuild()
	else: return None

OUT = process_input(WSLogAllSessionsUseSameBuild,IN[0])
# ----------------------------------------
bool = Output(python_script)
