# Dynamo custom node WorksharingLog.SessionByID.dyf (Dynamo 3.6.1.9895)
# category: Journalysis.Actions
# Retrieves a WorksharingSession from a WorksharingLog based on the session ID.
# packages: PythonNet3 Engine 1.1.1

worksharingLog = Input(worksharingLog: var[]..[])
sessionID = Input(sessionID: string)
python_script = Python(IN[0]=worksharingLog, IN[1]=sessionID)  # PythonNet3
# ---------- python_script.python (11 lines) ----------
import clr

def process_input(func, input1, input2):
	if isinstance(input2, list): return [func(input1, x) for x in input2]
	else: return func(input1, input2)
	
def WSLogSessionByID(wslog, id):
	if wslog.__repr__() == 'WorksharingLog': return wslog.GetSessionByID(id)
	else: return None

OUT = process_input(WSLogSessionByID, IN[0], IN[1])
# ----------------------------------------
worksharingSession = Output(python_script)
