# Dynamo custom node WorksharingLog.Sessions.dyf (Dynamo 3.6.1.9895)
# category: Journalysis.Query
# Returns all sessions of a given WorksharingLog
# packages: PythonNet3 Engine 1.1.1

worksharingLog = Input(worksharingLog: var[]..[])
python_script = Python(IN[0]=worksharingLog)  # PythonNet3
# ---------- python_script.python (11 lines) ----------
import clr

def process_input(func, input):
	if isinstance(input, list): return [func(x) for x in input]
	else: return func(input)
	
def WSLogSessions(wslog):
	if wslog.__repr__() == 'WorksharingLog': return wslog.Sessions
	else: return []

OUT = process_input(WSLogSessions,IN[0])
# ----------------------------------------
worksharingSessions = Output(python_script)
