# Dynamo custom node WorksharingSession.Build.dyf (Dynamo 3.6.1.9895)
# category: Journalysis.WorksharingLog.Query
# Returns the Revit build of a given WorksharingSession
# packages: PythonNet3 Engine 1.1.1

worksharingSession = Input(worksharingSession: var[]..[])
python_script = Python(IN[0]=worksharingSession)  # PythonNet3
# ---------- python_script.python (11 lines) ----------
import clr

def process_input(func, input):
	if isinstance(input, list): return [func(x) for x in input]
	else: return func(input)
	
def WSSessionBuild(wssess):
	if wssess.__repr__() == 'WorksharingSession': return wssess.RevitBuild
	else: return None

OUT = process_input(WSSessionBuild,IN[0])
# ----------------------------------------
str = Output(python_script)
