# Dynamo custom node WorksharingSession.HasLoadedLinks.dyf (Dynamo 3.6.1.9895)
# category: Journalysis.WorksharingLog.Actions
# Determines if linked models were loaded in this session
# packages: PythonNet3 Engine 1.1.1

worksharingSession = Input(worksharingSession: var[]..[])
python_script = Python(IN[0]=worksharingSession)  # PythonNet3
# ---------- python_script.python (11 lines) ----------
import clr

def process_input(func, input):
	if isinstance(input, list): return [func(x) for x in input]
	else: return func(input)
	
def WSSessionHasLoadedLinks(wssess):
	if wssess.__repr__() == 'WorksharingSession': return wssess.HasLoadedLinks()
	else: return None

OUT = process_input(WSSessionHasLoadedLinks,IN[0])
# ----------------------------------------
bool = Output(python_script)
