# Dynamo custom node WorksharingSession.LoadedLinks.dyf (Dynamo 3.6.1.9895)
# category: Journalysis.WorksharingLog.Actions
# Retrieves a list of loaded links from a given WorkharingSession
# packages: PythonNet3 Engine 1.1.1

worksharingSession = Input(worksharingSession: var[]..[])
python_script = Python(IN[0]=worksharingSession)  # PythonNet3
# ---------- python_script.python (11 lines) ----------
import clr

def process_input(func, input):
	if isinstance(input, list): return [func(x) for x in input]
	else: return func(input)
	
def WSSessionLoadedLinks(wssess):
	if wssess.__repr__() == 'WorksharingSession': return wssess.GetLoadedLinks()
	else: return None

OUT = process_input(WSSessionLoadedLinks,IN[0])
# ----------------------------------------
LoadedLinks = Output(python_script)
