# Dynamo custom node WorksharingSession.ServerAddress.dyf (Dynamo 3.6.1.9895)
# category: Journalysis.WorksharingLog.Query
# Returns the server address (IP or MAC depending on environment) of a given WorksharingSession
# packages: PythonNet3 Engine 1.1.1

worksharingSession = Input(worksharingSession: var[]..[])
python_script = Python(IN[0]=worksharingSession)  # PythonNet3
# ---------- python_script.python (11 lines) ----------
import clr

def process_input(func, input):
	if isinstance(input, list): return [func(x) for x in input]
	else: return func(input)
	
def WSSessionServerAddress(wssess):
	if wssess.__repr__() == 'WorksharingSession': return wssess.ServerAddress
	else: return None

OUT = process_input(WSSessionServerAddress,IN[0])
# ----------------------------------------
str = Output(python_script)
