# Dynamo custom node WorksharingSession.ServerName.dyf (Dynamo 3.6.1.9895)
# category: Journalysis.WorksharingLog.Query
# Returns the server name of a given WorksharingSession
# packages: PythonNet3 Engine 1.1.1

worksharingSession = Input(worksharingSession: var[]..[])
python_script = Python(IN[0]=worksharingSession)  # PythonNet3
# ---------- python_script.python (11 lines) ----------
import clr

def process_input(func, input):
	if isinstance(input, list): return [func(x) for x in input]
	else: return func(input)
	
def WSSessionServerName(wssess):
	if wssess.__repr__() == 'WorksharingSession': return wssess.ServerName
	else: return None

OUT = process_input(WSSessionServerName,IN[0])
# ----------------------------------------
str = Output(python_script)
