# Dynamo custom node WorksharingSession.SyncEvents.dyf (Dynamo 3.6.1.9895)
# category: Journalysis.WorksharingLog.Actions
# Extracts all SyncEvents from a given WorkharingSession
# packages: PythonNet3 Engine 1.1.1

worksharingSession = Input(worksharingSession: var[]..[])
python_script = Python(IN[0]=worksharingSession)  # PythonNet3
# ---------- python_script.python (11 lines) ----------
import clr

def process_input(func, input):
	if isinstance(input, list): return [func(x) for x in input]
	else: return func(input)
	
def WSSessionSyncEvents(wssess):
	if wssess.__repr__() == 'WorksharingSession': return wssess.GetSyncEvents()
	else: return None

OUT = process_input(WSSessionSyncEvents,IN[0])
# ----------------------------------------
SyncEvents = Output(python_script)
