# Dynamo custom node WorksharingSession.WasTerminatedProperly.dyf (Dynamo 3.6.1.9895)
# category: Journalysis.WorksharingLog.Actions
# Determines whether a given WorksharingSession was terminated properly
# packages: PythonNet3 Engine 1.1.1

worksharingSession = Input(worksharingSession: var[]..[])
python_script = Python(IN[0]=worksharingSession)  # PythonNet3
# ---------- python_script.python (11 lines) ----------
import clr

def process_input(func, input):
	if isinstance(input, list): return [func(x) for x in input]
	else: return func(input)
	
def WSSessionWasTerminatedProperly(wssess):
	if wssess.__repr__() == 'WorksharingSession': return wssess.WasTerminatedProperly()
	else: return None

OUT = process_input(WSSessionWasTerminatedProperly,IN[0])
# ----------------------------------------
bool = Output(python_script)
