# Dynamo custom node Helpers.AllJournalCommandTypes.dyf (Dynamo 1.3.1.1736)
# category: Journalysis.Journal.Helpers.Query
# Lists all known JournalCommand types

string = StringInput("""AccelKey
Internal
KeyboardShortcut
PrintPreviewUI
Ribbon
StartupPage
StatusBar
SystemMenu""")
string_2 = StringInput("\n")
split = String.Split(string, string_2)
seq = Output(split)
