# Dynamo custom node Helpers.AllJournalLineTypes.dyf (Dynamo 1.3.1.1736)
# category: Journalysis.Journal.Helpers.Query
# Lists all JournalLine types

string = StringInput("""JournalAddinEvent
JournalAPIMessage
JournalBasicFileInfo
JournalCommand
JournalComment
JournalData
JournalDirective
JournalGUIResourceUsage
JournalKeyboardEvent
JournalMemoryMetrics
JournalMiscCommand
JournalMouseEvent
JournalSystemInformation
JournalTimeStamp
JournalUIEvent
JournalWorksharingEvent""")
string_2 = StringInput("\n")
split = String.Split(string, string_2)
seq = Output(split)
