# Dynamo custom node Helpers.AllJournalMouseEventTypes.dyf (Dynamo 1.3.1.1736)
# category: Journalysis.Journal.Helpers.Query
# Lists all JournalMouseEvent types

string = StringInput("""LButtonDblClk
LButtonDown
LButtonUp
MButtonDblClk
MButtonDown
MButtonUp
MouseMove
RButtonDblClk
RButtonDown
RButtonUp
Scroll
Wheel""")
string_2 = StringInput("\n")
split = String.Split(string, string_2)
seq = Output(split)
