# Dynamo custom node Helpers.AllJournalUIEventTypes.dyf (Dynamo 1.3.1.1736)
# category: Journalysis.Journal.Helpers.Query
# Lists all JournalUIEvent types

string = StringInput("""Activate
AppButtonEvent
Browser
Checkbox
Close
ComboBox
DropFiles
Edit
Grid
ListBox
Maximize
Minimize
PropertiesPalette
PushButton
RadioButton
Restore
RibbonEvent
SBTrayAction
Size
SliderCtrl
TabCtrl
TreeCtrl
WidgetEvent""")
string_2 = StringInput("\n")
split = String.Split(string, string_2)
seq = Output(split)
