# Dynamo custom node Helpers.AllLoadedModelEventTypes.dyf (Dynamo 1.3.1.1736)
# category: Journalysis.Journal.Helpers.Query
# Lists all LoadedModelEvent types

string = StringInput("""Open_Dialog
Open_DragDrop
Open_Recent
Loaded""")
string_2 = StringInput("\n")
split = String.Split(string, string_2)
seq = Output(split)
