# Dynamo custom node Journal.ByString.dyf (Dynamo 1.3.1.1736)
# category: Journalysis.Journal.Create
# Creates a queriable object from the contents of a Revit journal file

str = Input(str : string)
string = StringInput("\n")
split = String.Split(str, string)
trimLeadingWhitespace = String.TrimLeadingWhitespace(split)
python_script = Python(IN[0]=trimLeadingWhitespace)
# ---------- python_script.python (465 lines) ----------
import clr
import sys
sys.path.append("C:\Program Files (x86)\IronPython 2.7\Lib")
import os
import time
processing_started = time.time()

class Journal:
	def __init__(self, lines, version, username, blockcount, path, build, branch, machinename, osversion):
		self.Lines = lines
		self.LineCount = len(lines)
		self.Version = version
		self.User = username	
		self.BlockCount = blockcount
		self.Path = path
		self.Build = build
		self.Branch = branch
		self.Machine = machinename
		self.OSVersion = osversion
		self.ProcessingTime = None
	def __repr__(self):
		return 'Journal'
	def ContainsAPIErrors(self):
		if len([x for x in self.GetLinesByTypeAndProperty('JournalAPIMessage', 'IsError', True)]) > 0: return True
		else: return False
	def ContainsExceptions(self):
		if len([x for x in self.GetLinesByType('JournalTimeStamp') if x.Description.startswith("ExceptionCode")]) > 0: return True
		else: return False
	def GetDate(self):
		return self.GetDateTimeByBlock(1).Date
	def GetDateTimeByBlock(self, block):
		if block == 0: return None
		else: return [x for x in self.GetLinesByType('JournalTimeStamp') if x.Block == block][0].DateTime
	def GetDateTimeByBlocks(self, blocks):
		if 0 in blocks: return None
		else: return [x.DateTime for x in self.GetLinesByType('JournalTimeStamp') if x.Block in blocks]
	def GetLinesByBlock(self, block):
		return [x for x in self.Lines if x.Block == block]
	def GetLinesByBlocks(self, blocks):
		return [x for x in self.Lines if x.Block in blocks]
	def GetLinesByType(self, type):
		return [x for x in self.Lines if x.Type == type]
	def GetLinesByTypeAndProperty(self, type, prop, val):
		return [x for x in self.Lines if x.Type == type and getattr(x, prop) == val]
	def GetLinesByTypes(self, types):
		return [x for x in self.Lines if x.Type in types]
	def GetMaxRAMPeak(self):
		return max([x.RAMPeak for x in self.GetLinesByType('JournalMemoryMetrics')])
	def GetMaxVMPeak(self):
		return max([x.VMPeak for x in self.GetLinesByType('JournalMemoryMetrics')])
	def GetMinRAMAvailable(self):
		return min([x.RAMAvailable for x in self.GetLinesByType('JournalMemoryMetrics')])
	def GetMinVMAvailable(self):
		return min([x.VMAvailable for x in self.GetLinesByType('JournalMemoryMetrics')])
	def GetSessionTime(self):
		ts = self.GetLinesByType('JournalTimeStamp')
		return ts[-1].DateTime - ts[0].DateTime
	def GetStartupTime(self):
		first_ts = self.GetDateTimeByBlock(1)
		startup1 = [x.Block for x in self.GetLinesByTypeAndProperty('JournalCommand', 'CommandID', 'ID_STARTUP_PAGE')]
		if len(startup1) > 0:
			return self.GetDateTimeByBlock(startup1[0]) - first_ts
		else:
			# DynamoAutomation journal playback
			startup2 = [x.Block for x in self.GetLinesByTypeAndProperty('JournalCommand', 'CommandID', 'ID_FILE_MRU_FIRST')]
			if len(startup2) > 0:
				return self.GetDateTimeByBlock(startup2[0]) - first_ts
			else: return None
	def IsInPlaybackMode(self):
		if len([x for x in self.GetLinesByType('JournalTimeStamp') if x.Description.startswith("started journal file playback")]) > 0: return True
		else: return False
	def StripComments(self):
		return "\n".join([x.RawText for x in self.Lines if x.Type in ('JournalAddinEvent', 'JournalCommand', 'JournalData', 'JournalDirective', 'JournalKeyboardEvent', 'JournalMiscCommand', 'JournalMouseEvent', 'JournalUIEvent')])
	def WasPlaybackInterrupted(self):
		if len([x for x in self.GetLinesByType('JournalTimeStamp') if x.Description.startswith("stopped at line") and x.Description.endswith("journal file playback")]) > 0: return True
		else: return False
	def WasSessionTerminatedProperly(self):
		if len([x for x in self.GetLinesByTypeAndProperty('JournalTimeStamp', 'Description', 'finished recording journal file')]) > 0: return True
		else: return False

class JournalLine:
	def __init__(self, number, raw, block, type):
		self.Number = number
		self.RawText = raw
		self.Block = block
		self.Type = type
		self.Journal = None
	def __repr__(self):
		return 'JournalLine'
	def AllNext(self):
		if self.Journal.Lines.index(self) + 1 < self.Journal.LineCount:
			return self.Journal.Lines[self.Journal.Lines.index(self) + 1:]
		else: return []
	def AllNextOfType(self, type):
		return [x for x in self.AllNext() if x.Type == type]
	def AllNextOfTypeAndProperty(self, type, prop, val):
		return [x for x in self.AllNext() if x.Type == type and getattr(x, prop) == val]
	def AllPrevious(self):
		if self.Journal.Lines.index(self) - 1 > -1:
			return self.Journal.Lines[:self.Journal.Lines.index(self)]
		else: return []
	def AllPreviousOfType(self, type):
		return [x for x in self.AllPrevious() if x.Type == type]
	def AllPreviousOfTypeAndProperty(self, type, prop, val):
		return [x for x in self.AllPrevious() if x.Type == type and getattr(x, prop) == val]
	def GetDateTimeOfBlock(self):
		return self.Journal.GetDateTimeByBlock(self.Block)
	def Next(self):
		if self.Journal.Lines.index(self) + 1 < self.Journal.LineCount:
			return self.Journal.Lines[self.Journal.Lines.index(self) + 1]
		else: return None
	def NextOfType(self, type):
		allnext = self.AllNextOfType(type)
		if len(allnext) > 0: return allnext[0]
		else: return None
	def NextOfTypeAndProperty(self, type, prop, val):
		allnext = self.AllNextOfTypeAndProperty(type, prop, val)
		if len(allnext) > 0: return allnext[0]
		else: return None
	def Previous(self):
		if self.Journal.Lines.index(self) - 1 > -1:
			return self.Journal.Lines[self.Journal.Lines.index(self) - 1]
		else: return None
	def PreviousOfType(self, type):
		allprev = self.AllPreviousOfType(type)
		if len(allprev) > 0: return allprev[-1]
		else: return None
	def PreviousOfTypeAndProperty(self, type, prop, val):
		allprev = self.AllPreviousOfTypeAndProperty(type, prop, val)
		if len(allprev) > 0: return allprev[-1]
		else: return None

class JournalAddinEvent(JournalLine):
	def __init__(self, number, raw, block, type):
		JournalLine.__init__(self, number, raw, block, type)
		self.MessageText = None
	def __repr__(self):
		return 'JournalAddinEvent'

class JournalAPIMessage(JournalLine):
	def __init__(self, number, raw, block, type, is_error):
		JournalLine.__init__(self, number, raw, block, type)
		self.IsError = is_error
		self.MessageText = None
		self.MessageType = None
	def __repr__(self):
		return 'JournalAPIMessage'

class JournalBasicFileInfo(JournalLine):
	def __init__(self, number, raw, block, type):
		JournalLine.__init__(self, number, raw, block, type)
		self.Worksharing = None
		self.CentralModelPath = None
		self.LastSavePath = None
		self.Locale = None
		self.FileName = None
	def __repr__(self):
		return 'JournalBasicFileInfo'

class JournalCommand(JournalLine):
	def __init__(self, number, raw, block, type):
		JournalLine.__init__(self, number, raw, block, type)
		self.CommandType = None
		self.CommandDescription = None
		self.CommandID = None
	def __repr__(self):
		return 'JournalCommand'

class JournalComment(JournalLine):
	def __repr__(self):
		return 'JournalComment'

class JournalData(JournalLine):
	def __init__(self, number, raw, block, type):
		JournalLine.__init__(self, number, raw, block, type)
		self.Key = None
		self.Values = []
	def __repr__(self):
		return 'JournalData'

class JournalDirective(JournalLine):
	def __init__(self, number, raw, block, type):
		JournalLine.__init__(self, number, raw, block, type)
		self.Key = None
		self.Values = []
	def __repr__(self):
		return 'JournalDirective'

class JournalGUIResourceUsage(JournalLine):
	def __init__(self, number, raw, block, type):
		JournalLine.__init__(self, number, raw, block, type)
		self.Available = None
		self.Used = None
		self.User = None
	def __repr__(self):
		return 'JournalGUIResourceUsage'

class JournalKeyboardEvent(JournalLine):
	def __init__(self, number, raw, block, type):
		JournalLine.__init__(self, number, raw, block, type)
		self.Key = None
	def __repr__(self):
		return 'JournalKeyboardEvent'
		
class JournalMemoryMetrics(JournalLine):
	def __init__(self, number, raw, block, type):
		JournalLine.__init__(self, number, raw, block, type)
		self.VMAvailable = None
		self.VMUsed = None
		self.VMPeak = None
		self.RAMAvailable = None
		self.RAMUsed = None
		self.RAMPeak = None
	def __repr__(self):
		return 'JournalMemoryMetrics'

class JournalMiscCommand(JournalLine):
	def __repr__(self):
		return 'JournalMiscCommand'

class JournalMouseEvent(JournalLine):
	def __init__(self, number, raw, block, type):
		JournalLine.__init__(self, number, raw, block, type)
		self.MouseEventType = None
		self.Data = []
	def __repr__(self):
		return 'JournalMouseEvent'
		
class JournalTimeStamp(JournalLine):
	def __init__(self, number, raw, block, type):
		JournalLine.__init__(self, number, raw, block, type)
		self.TimeStampType = None
		self.DateTime = None
		self.Description = None
	def __repr__(self):
		return 'JournalTimeStamp'

class JournalUIEvent(JournalLine):
	def __init__(self, number, raw, block, type):
		JournalLine.__init__(self, number, raw, block, type)
		self.UIEventType = None
		self.Data = []
	def __repr__(self):
		return 'JournalUIEvent'

class JournalWorksharingEvent(JournalLine):
	def __init__(self, number, raw, block, type):
		JournalLine.__init__(self, number, raw, block, type)
		self.SessionID = None
		self.DateTime = None
		self.Text = None
	def __repr__(self):
		return 'JournalWorksharingEvent'

lines = IN[0]
lineObjs = []
jVersion = None
jUsername = None
jMachineName = None
jOSVersion = None
jPath = None
i = 1
b = 0
# Round 1: Create line objects
for line in lines:
	# ignore empty lines
	if len(line) < 2:
		pass
	elif line.startswith("'C ") or line.startswith("'H ") or line.startswith("'E "):
		b += 1
		lineObjs.append(JournalTimeStamp(i,line,b,'JournalTimeStamp'))
	elif ":< API_SUCCESS { " in line:
		lineObjs.append(JournalAPIMessage(i,line,b,'JournalAPIMessage',False))
	elif ":< API_ERROR { " in line:
		lineObjs.append(JournalAPIMessage(i,line,b,'JournalAPIMessage',True))
	elif ":: Delta VM: " in line or line.startswith("' 0:< Initial VM: "):
		lineObjs.append(JournalMemoryMetrics(i,line,b,'JournalMemoryMetrics'))
	elif ":< GUI Resource Usage GDI: " in line:
		lineObjs.append(JournalGUIResourceUsage(i,line,b,'JournalGUIResourceUsage'))
	elif line.startswith("' [Jrn.BasicFileInfo]"):
		lineObjs.append(JournalBasicFileInfo(i,line,b,'JournalBasicFileInfo'))
	elif line.startswith("Jrn.Data "):
		lineObjs.append(JournalData(i,line,b,'JournalData'))
	elif line.startswith("Jrn.Directive "):
		lineObjs.append(JournalDirective(i,line,b,'JournalDirective'))
	elif line.startswith("Jrn.Command "):
		lineObjs.append(JournalCommand(i,line,b,'JournalCommand'))
	elif line.startswith("Jrn.Key "):
		lineObjs.append(JournalKeyboardEvent(i,line,b,'JournalKeyboardEvent'))
	elif line.startswith("Jrn.AddInEvent "):
		lineObjs.append(JournalAddinEvent(i,line,b,'JournalAddinEvent'))
	elif line.startswith('Jrn.Wheel') or line.startswith('Jrn.MouseMove') or line.startswith('Jrn.LButtonUp') or line.startswith('Jrn.LButtonDown') or line.startswith('Jrn.LButtonDblClk') or line.startswith('Jrn.MButtonUp') or line.startswith('Jrn.MButtonDown') or line.startswith('Jrn.MButtonDblClk') or line.startswith('Jrn.RButtonUp') or line.startswith('Jrn.RButtonDown') or line.startswith('Jrn.RButtonDblClk') or line.startswith('Jrn.Scroll'):
		lineObjs.append(JournalMouseEvent(i,line,b,'JournalMouseEvent'))
	elif line.startswith('Jrn.Activate') or line.startswith('Jrn.AppButtonEvent') or line.startswith('Jrn.Browser') or line.startswith('Jrn.CheckBox') or line.startswith('Jrn.Close') or line.startswith('Jrn.ComboBox') or line.startswith('Jrn.DropFiles') or line.startswith('Jrn.Edit') or line.startswith('Jrn.Grid') or line.startswith('Jrn.ListBox') or line.startswith('Jrn.Maximize') or line.startswith('Jrn.Minimize') or line.startswith('Jrn.PropertiesPalette') or line.startswith('Jrn.PushButton') or line.startswith('Jrn.RadioButton') or line.startswith('Jrn.RibbonEvent') or line.startswith('Jrn.SBTrayAction') or line.startswith('Jrn.Size') or line.startswith('Jrn.SliderCtrl') or line.startswith('Jrn.TabCtrl') or line.startswith('Jrn.TreeCtrl') or line.startswith('Jrn.WidgetEvent'):
		lineObjs.append(JournalUIEvent(i,line,b,'JournalUIEvent'))
	elif ":< SLOG $" in line:
		lineObjs.append(JournalWorksharingEvent(i,line,b,'JournalWorksharingEvent'))
	# append linebreaks to previous line
	elif lineObjs[-1].RawText[-1] == "_":
		lineObjs[-1].RawText = lineObjs[-1].RawText[:-1] + line
	# append linebreaks in commands
	elif line[0] == ",":
		lineObjs[-1].RawText = (lineObjs[-1].RawText + line).replace(" _,",",")
	elif line[0] == "'":
		# append linebreaks in API Messages
		if line[1] != " " and lineObjs[-1].Type == 'JournalAPIMessage' and not lineObjs[-1].RawText.endswith("}"):
			lineObjs[-1].RawText += " " + line[1:]
		else:
			lineObjs.append(JournalComment(i,line,b,'JournalComment'))
	else:
		lineObjs.append(JournalMiscCommand(i,line,b,'JournalMiscCommand'))
	i += 1
jBlockCount = b

# Round 2: Process raw multiline text and fill type-specific attributes
machineNameFound = False
OSVersionFound = False
for line in lineObjs:
	if line.Type == 'JournalAPIMessage':
		line.MessageText = line.RawText.split("{ ")[1].split(" }")[0].strip()
		if line.MessageText.startswith("Registered an external service"): line.MessageType = "RegisteredExternalService"
		elif line.MessageText.startswith("Registered an external server") or line.MessageText.startswith("An external server has been registered"): line.MessageType = "RegisteredExternalServer"
		elif line.MessageText.startswith("Starting External DB Application"): line.MessageType = "StartingExternalDBApp"
		elif line.MessageText.startswith("Starting External Application"): line.MessageType = "StartingExternalApp"
		elif line.MessageText.startswith("Registering"): line.MessageType = "RegisteringEvent"
		elif line.MessageText.startswith("Replacing command id"): line.MessageType = "ReplacingCommandID"
		elif line.MessageText.startswith("API registering command"): line.MessageType = "RegisteringCommandEvent"
		elif line.MessageText.startswith("Added pushbutton"): line.MessageType = "AddedPushbutton"
		elif line.MessageText.startswith("Unregistering"): line.MessageType = "UnregisteringEvent"
		elif line.MessageText.startswith("Restoring command id"): line.MessageType = "RestoringCommandID"
		elif line.MessageText.startswith("API unregistering command"): line.MessageType = "UnregisteringCommandEvent"
		elif line.MessageText.startswith("System."): line.MessageType = "Exception"
		else: line.MessageType = "Unknown"
	elif line.Type == 'JournalDirective':
		d1 = line.RawText.split('"  , ')
		line.Key = d1[0][15:]
		for d2 in d1[1].split(","):
			line.Values.append(d2.strip().replace('"',''))
		# Add Revit version to journal metadata
		if line.Key == 'Version':
			jVersion = int(line.Values[0][:4])
		# Add username to journal metadata
		elif line.Key == 'Username':
			jUsername = line.Values[0]
	elif line.Type == 'JournalData':
		d1 = line.RawText.split('"  , ')
		line.Key = d1[0][10:]
		for d2 in d1[1].split(","):
			line.Values.append(d2.strip().replace('"',''))
	elif line.Type == 'JournalWorksharingEvent':
		ws = line.RawText.split(':< SLOG ')[-1].split()
		line.SessionID = ws[0]
		line.DateTime = time.strptime(ws[1] + " " + ws[2])
		line.Text = ' '.join(ws[3:])
	elif line.Type == 'JournalCommand':
		c1 = line.RawText.split('" , "')
		line.CommandType = c1[0][13:]
		c2 = c1[1].split(" , ")
		line.CommandDescription = c2[0]
		line.CommandID = c2[1][:-1]
	elif line.Type == 'JournalMouseEvent':
		m1 = line.RawText.split(" ",1)
		line.MouseEventType = m1[0][4:].strip()
		for m2 in m1[1].split(","):
			line.Data.append(int(m2.strip()))
	elif line.Type == 'JournalKeyboardEvent':
		line.Key = line.RawText.split('"')[1]
	elif line.Type == 'JournalBasicFileInfo':
		bfi = map(list, zip(*[x.split(":",1) for x in line.RawText[22:].split("Rvt.Attr.")[1:]]))
		bfidict = dict(zip(bfi[0], [x.strip() for x in bfi[1]]))
		if bfidict["Worksharing"] != "": line.Worksharing = bfidict["Worksharing"]
		if bfidict["CentralModelPath"] != "": line.CentralModelPath = bfidict["CentralModelPath"]
		if bfidict["LastSavePath"] != "": 
			line.LastSavePath = bfidict["LastSavePath"]
			line.FileName = bfidict["LastSavePath"].split("\\")[-1]
		if bfidict["LocaleWhenSaved"] != "": line.Locale = bfidict["LocaleWhenSaved"]
	elif line.Type == 'JournalGUIResourceUsage':
		g2 = []
		for g1 in line.RawText.split(","):
			g2.append(int(g1.strip().split()[-1]))
		line.Available = g2[0]
		line.Used = g2[1]
		line.User = g2[2]
	elif line.Type == 'JournalUIEvent':
		d1 = line.RawText.split(" ",1)
		line.UIEventType = d1[0][4:]
		if line.UIEventType not in ("Maximize", "Minimize", "Restore"):
			for d2 in d1[1].split(","):
				d3 = d2.strip().replace('"','').strip()
				if line.UIEventType in ("RibbonEvent", "SBTrayAction"):
					for d4 in d3.split(":"):
						d4 = d4.strip()
						if d4 != "": line.Data.append(d4)
				elif line.UIEventType == "Browser":
					for d4 in d3.split(">>"):
						d4 = d4.strip()
						if d4 != "": line.Data.append(d4)
				elif d3 != "": line.Data.append(d3)
	elif line.Type == 'JournalAddinEvent':
		line.MessageText = line.RawText.split('"')[3]
	elif line.Type == 'JournalTimeStamp':
		line.TimeStampType = line.RawText[1]
		ts1 = line.RawText.split(";")	
		line.DateTime = time.strptime(ts1[0][3:])
		line.Description = ts1[1][7:].strip()
	elif line.Type == 'JournalMemoryMetrics':
		if "Initial VM" in line.RawText:
			m1 = line.RawText.split(":",2)[2].replace(";","").split()
		else:
			m1 = line.RawText.split(":",6)[6].split()
		m3 = []
		m4 = []
		for m2 in m1:
			if m2.isdigit(): 
				m3.append(int(m2))
			elif m2 in ("Avail","Used","Peak"):
				m4.append(m2)
		line.VMAvailable = m3[0]
		line.VMUsed = m3[1]
		if len(m3) == 6:		
			line.VMPeak = m3[2]
			line.RAMAvailable = m3[3]
			line.RAMUsed = m3[4]
			line.RAMPeak = m3[5]
		elif len(m3) == 5:
			if m4[2] == "Avail":
				line.VMPeak = None
				line.RAMAvailable = m3[2]
				line.RAMUsed = m3[3]
				line.RAMPeak = m3[4]
			elif m4[2] == "Peak":
				line.VMPeak = m3[2]
				line.RAMAvailable = m3[3]
				line.RAMUsed = m3[4]
				line.RAMPeak = None
		elif len(m3) == 4:
			line.VMPeak = None
			line.RAMAvailable = m3[2]
			line.RAMUsed = m3[3]
			line.RAMPeak = None
	elif line.Type == 'JournalComment':
		if "this journal =" in line.RawText:
			jPath = line.RawText.split("=")[1].strip()
		elif line.RawText.startswith("' Build:"):
			jBuild = line.RawText.split(":")[1].strip()
		elif line.RawText.startswith("' Branch:"):
			jBranch = line.RawText.split(":")[1].strip()
		elif not OSVersionFound:
			if "Caption :" in line.RawText:
				jOSVersion = line.RawText.split(":")[-1].strip()
				OSVersionFound = True
		elif not machineNameFound:
			if "Additional IP address/name found for host" in line.RawText:
				jMachineName = line.RawText.split(":")[1].split(" ")[-1]
				machineNameFound = True

# Create journal object
journal = Journal(lineObjs, jVersion, jUsername, jBlockCount, jPath, jBuild, jBranch, jMachineName, jOSVersion)
for line in journal.Lines:
	line.Journal = journal

# Compute total processing time of this node
journal.ProcessingTime = time.time() - processing_started

OUT = journal
# ----------------------------------------
journal = Output(python_script)
