# Dynamo custom node Journal.GetDateTimeByBlock.dyf (Dynamo 1.3.1.1736)
# category: Journalysis.Journal.Actions
# Retrieves the DateTime of a given block from a given journal

journal = Input()
journalBlock = Input()
python_script = Python(IN[0]=journal, IN[1]=journalBlock)
# ---------- python_script.python (6 lines) ----------
import clr

OUT = []
if IN[0].__repr__() == 'Journal':
	if isinstance(IN[1], list): OUT = IN[0].GetDateTimeByBlocks(IN[1])
	else: OUT = IN[0].GetDateTimeByBlock(IN[1])
# ----------------------------------------
dateTime = Output(python_script)
