# Dynamo custom node Journal.GetLinesByBlock.dyf (Dynamo 1.3.1.1736)
# category: Journalysis.Journal.Actions
# Retrieves all JournalLines of a given block from a given journal

journal = Input()
journalBlock = Input(journalBlock : int)
python_script = Python(IN[0]=journal, IN[1]=journalBlock)
# ---------- python_script.python (6 lines) ----------
import clr

OUT = []
if IN[0].__repr__() == 'Journal':
	if isinstance(IN[1], list): OUT = IN[0].GetLinesByBlocks(IN[1])
	else: OUT = IN[0].GetLinesByBlock(IN[1])
# ----------------------------------------
journalLines = Output(python_script)
