# Dynamo custom node Journal.GetLinesByType.dyf (Dynamo 1.3.1.1736)
# category: Journalysis.Journal.Actions
# Retrieves all JournalLines of a given type from a given journal

journal = Input()
journalLineType = Input(journalLineType : string)
python_script = Python(IN[0]=journal, IN[1]=journalLineType)
# ---------- python_script.python (6 lines) ----------
import clr

OUT = []
if IN[0].__repr__() == 'Journal':
	if isinstance(IN[1], list): OUT = IN[0].GetLinesByTypes(IN[1])
	else: OUT = IN[0].GetLinesByType(IN[1])
# ----------------------------------------
journalLines = Output(python_script)
