# Dynamo custom node Journal.GetLinesByTypeAndProperty.dyf (Dynamo 1.3.1.1736)
# category: Journalysis.Journal.Actions
# Retrieves all JournalLines of a given type from a given journal, pre-filtered by a property value

journal = Input()
journalLineType = Input()
property = Input()
value = Input()
python_script = Python(IN[0]=journal, IN[1]=journalLineType, IN[2]=property, IN[3]=value)
# ---------- python_script.python (12 lines) ----------
import clr

def process_input(func, inputs):
	if isinstance(inputs[0], list): return [func(x, inputs[1], inputs[2], inputs[3]) for x in inputs[0]]
	else: return func(inputs[0], inputs[1], inputs[2], inputs[3])
	
def journalLinesByTypeAndProperty(journal, type, prop, val):
	if journal.__repr__() == 'Journal': 
		return journal.GetLinesByTypeAndProperty(type, prop, val)
	else: return None

OUT = process_input(journalLinesByTypeAndProperty, IN)
# ----------------------------------------
journalLines = Output(python_script)
