# Dynamo custom node Journal.LineCount.dyf (Dynamo 1.3.1.1736)
# category: Journalysis.Journal.Query

journal = Input()
python_script = Python(IN[0]=journal)
# ---------- python_script.python (11 lines) ----------
import clr

def process_input(func, input):
	if isinstance(input, list): return [func(x) for x in input]
	else: return func(input)
	
def journalLineCount(input):
	if input.__repr__() == 'Journal': return input.LineCount
	else: return 0

OUT = process_input(journalLineCount,IN[0])
# ----------------------------------------
lineCount = Output(python_script)
