# Dynamo custom node Journal.LoadedModels.dyf (Dynamo 1.3.1.1736)
# category: Journalysis.Journal.Query

journal = Input()
python_script = Python(IN[0]=journal)
# ---------- python_script.python (15 lines) ----------
import clr
import sys
sys.path.append("C:\Program Files (x86)\IronPython 2.7\Lib")
import os

def process_input(func, input):
	if isinstance(input, list): return [func(x) for x in input]
	else: return func(input)

def journalLoadedModels(journal):
	if journal.__repr__() == 'Journal':	
		return set([os.path.normpath(os.path.join(os.path.dirname(IN[0].Path),x.Values[1])) for x in journal.GetLinesByType('JournalData') if x.Key == 'File Name' and x.Values[0] == 'IDOK'])
	else: return []

OUT = process_input(journalLoadedModels,IN[0])
# ----------------------------------------
loadedModels = Output(python_script)
