# Dynamo custom node Journal.MaxVMPeak.dyf (Dynamo 1.3.1.1736)
# category: Journalysis.Journal.Actions

journal = Input()
python_script = Python(IN[0]=journal)
# ---------- python_script.python (11 lines) ----------
import clr

def process_input(func, input):
	if isinstance(input, list): return [func(x) for x in input]
	else: return func(input)
	
def journalMaxVMPeak(journal):
	if journal.__repr__() == 'Journal': return journal.GetMaxVMPeak()
	else: return None

OUT = process_input(journalMaxVMPeak,IN[0])
# ----------------------------------------
int = Output(python_script)
