# Dynamo custom node Journal.StripComments.dyf (Dynamo 1.3.1.1736)
# category: Journalysis.Journal.Actions
# Strips all comments from the original journal string and only returns all (re-formatted) lines that are potentially relevant for journal playback.

journal = Input()
preserveTimestamps = Input(preserveTimestamps : bool = false)
python_script = Python(IN[0]=journal, IN[1]=preserveTimestamps)
# ---------- python_script.python (11 lines) ----------
import clr

def process_input(func, input1, input2):
	if isinstance(input, list): return [func(x, input2) for x in input1]
	else: return func(input1, input2)
	
def journalStripComments(journal, preserveTimestamps):
	if journal.__repr__() == 'Journal': return journal.StripComments(preserveTimestamps)
	else: return None

OUT = process_input(journalStripComments,IN[0],IN[1])
# ----------------------------------------
str = Output(python_script)
