# Dynamo custom node Journal.Version.dyf (Dynamo 1.3.1.1736)
# category: Journalysis.Journal.Query

journal = Input()
python_script = Python(IN[0]=journal)
# ---------- python_script.python (11 lines) ----------
import clr

def process_input(func, input):
	if isinstance(input, list): return [func(x) for x in input]
	else: return func(input)
	
def journalVersion(journal):
	if journal.__repr__() == 'Journal': return journal.Version
	else: return None

OUT = process_input(journalVersion,IN[0])
# ----------------------------------------
version = Output(python_script)
