# Dynamo custom node JournalAPIMessage.Text.dyf (Dynamo 1.3.1.1736)
# category: Journalysis.JournalLine.APIMessage.Query

journalAPIMessage = Input()
python_script = Python(IN[0]=journalAPIMessage)
# ---------- python_script.python (11 lines) ----------
import clr

def process_input(func, input):
	if isinstance(input, list): return [func(x) for x in input]
	else: return func(input)
	
def journalAPIMessageText(japimsg):
	if japimsg.__repr__() == 'JournalAPIMessage': return japimsg.MessageText
	else: return None

OUT = process_input(journalAPIMessageText,IN[0])
# ----------------------------------------
text = Output(python_script)
