# Dynamo custom node JournalAddinEvent.MessageText.dyf (Dynamo 1.3.1.1736)
# category: Journalysis.JournalLine.AddinEvent.Query

journalAddinEvent = Input()
pythonScript = Python(IN[0]=journalAddinEvent)
# ---------- pythonScript.python (11 lines) ----------
import clr

def process_input(func, input):
	if isinstance(input, list): return [func(x) for x in input]
	else: return func(input)
	
def journalAddinEventMessageText(input):
	if input.__repr__() == 'JournalAddinEvent': return input.MessageText
	else: return 0

OUT = process_input(journalAddinEventMessageText,IN[0])
# ----------------------------------------
messageText = Output(pythonScript)
