# Dynamo custom node JournalBasicFileInfo.Locale.dyf (Dynamo 1.3.1.1736)
# category: Journalysis.Journal.JournalLine.BasicFileInfo.Query
# Returns the locale a model was saved in from a BasicFileInfo line

journalBasicFileInfo = Input()
python_script = Python(IN[0]=journalBasicFileInfo)
# ---------- python_script.python (11 lines) ----------
import clr

def process_input(func, input):
	if isinstance(input, list): return [func(x) for x in input]
	else: return func(input)
	
def journalBFILocale(jbfi):
	if jbfi.__repr__() == 'JournalBasicFileInfo': return jbfi.Locale
	else: return None

OUT = process_input(journalBFILocale,IN[0])
# ----------------------------------------
Locale = Output(python_script)
