# Dynamo custom node JournalDirective.Values.dyf (Dynamo 1.3.1.1736)
# category: Journalysis.JournalLine.Directive.Query

journalDirective = Input()
python_script = Python(IN[0]=journalDirective)
# ---------- python_script.python (11 lines) ----------
import clr

def process_input(func, input):
	if isinstance(input, list): return [func(x) for x in input]
	else: return func(input)
	
def journalDirectiveValues(input):
	if input.__repr__() == 'JournalDirective': return input.Values
	else: return []

OUT = process_input(journalDirectiveValues,IN[0])
# ----------------------------------------
values = Output(python_script)
