# Dynamo custom node JournalLine.AllNext.dyf (Dynamo 1.3.1.1736)
# category: Journalysis.JournalLine.JournalLine.Actions
# Retrieves all lines after the given line from the journal

journalLine = Input()
python_script = Python(IN[0]=journalLine)
# ---------- python_script.python (12 lines) ----------
import clr

def process_input(func, input):
	if isinstance(input, list): return [func(x) for x in input]
	else: return func(input)
	
def journalLineAllNext(jline):
	if hasattr(jline, 'AllNext'): 
		return jline.AllNext()
	else: return None

OUT = process_input(journalLineAllNext, IN[0])
# ----------------------------------------
journalLines = Output(python_script)
