# Dynamo custom node JournalLine.AllPreviousOfType.dyf (Dynamo 1.3.1.1736)
# category: Journalysis.JournalLine.JournalLine.Actions
# Retrieves all lines of a given type before the given line from the journal

journalLine = Input()
journalLineType = Input()
python_script = Python(IN[0]=journalLine, IN[1]=journalLineType)
# ---------- python_script.python (12 lines) ----------
import clr

def process_input(func, input1, input2):
	if isinstance(input1, list): return [func(x, input2) for x in input1]
	else: return func(input1, input2)
	
def journalLineAllPreviousOfType(jline, type):
	if hasattr(jline, 'AllPreviousOfType'): 
		return jline.AllPreviousOfType(type)
	else: return None

OUT = process_input(journalLineAllPreviousOfType, IN[0], IN[1])
# ----------------------------------------
journalLines = Output(python_script)
