# Dynamo custom node JournalLine.Block.dyf (Dynamo 1.3.1.1736)
# category: Journalysis.JournalLine.JournalLine.Query
# Returns the block number of a given journal line

journalLine = Input()
python_script = Python(IN[0]=journalLine)
# ---------- python_script.python (11 lines) ----------
import clr

def process_input(func, input):
	if isinstance(input, list): return [func(x) for x in input]
	else: return func(input)
	
def journalLineBlock(jline):
	if hasattr(jline, 'Block'): return jline.Block
	else: return None

OUT = process_input(journalLineBlock,IN[0])
# ----------------------------------------
int = Output(python_script)
