# Dynamo custom node JournalLine.GetDateTimeOfBlock.dyf (Dynamo 1.3.1.1736)
# category: Journalysis.JournalLine.JournalLine.Actions

journalLine = Input()
python_script = Python(IN[0]=journalLine)
# ---------- python_script.python (12 lines) ----------
import clr

def process_input(func, input):
	if isinstance(input, list): return [func(x) for x in input]
	else: return func(input)
	
def journalLineDateTime(jline):
	if hasattr(jline, 'GetDateTimeOfBlock'): 
		return jline.GetDateTimeOfBlock()
	else: return None

OUT = process_input(journalLineDateTime, IN[0])
# ----------------------------------------
dateTime = Output(python_script)
