# Dynamo custom node JournalLine.Next.dyf (Dynamo 1.3.1.1736)
# category: Journalysis.JournalLine.Actions

journalLine = Input()
journal = Input()
python_script = Python(IN[0]=journalLine, IN[1]=journal)
# ---------- python_script.python (17 lines) ----------
import clr

def process_input(func, input1, input2):
	if isinstance(input1, list) and isinstance(input2, list): 
		return map(func, input1, input2)
	elif isinstance(input1, list): 
		return [func(x, input2) for x in input1]
	elif isinstance(input2, list):
		return None
	else: return func(input1, input2)
	
def journalLineNext(jline, journal):
	if hasattr(jline, 'Next') and journal.__repr__() == 'Journal': 
		return jline.Next(journal)
	else: return None

OUT = process_input(journalLineNext, IN[0], IN[1])
# ----------------------------------------
journalLine_2 = Output(python_script)  # "journalLine"
