# Dynamo custom node JournalLine.Type.dyf (Dynamo 1.3.1.1736)
# category: Journalysis.JournalLine.JournalLine.Query
# Returns the type of a given journal line

journalLine = Input()
python_script = Python(IN[0]=journalLine)
# ---------- python_script.python (11 lines) ----------
import clr

def process_input(func, input):
	if isinstance(input, list): return [func(x) for x in input]
	else: return func(input)
	
def journalLineType(jline):
	if hasattr(jline, 'Type'): return jline.Type
	else: return None

OUT = process_input(journalLineType,IN[0])
# ----------------------------------------
str = Output(python_script)
