# Dynamo custom node JournalLineTypes.All.dyf (Dynamo 1.3.1.1736)
# category: Journalysis.JournalLineType.Query

string = StringInput("""JournalAddinEvent
JournalAPIMessage
JournalCommand
JournalComment
JournalData
JournalDirective
JournalGUIResourceUsage
JournalKeyboardEvent
JournalMemoryMetrics
JournalMiscCommand
JournalMouseEvent
JournalTimeStamp
JournalUIEvent""")
string_2 = StringInput("\n")
split = String.Split(string, string_2)
journalLineTypes = Output(split)
