# Dynamo custom node JournalMemoryMetrics.VMAvailable.dyf (Dynamo 1.3.1.1736)
# category: Journalysis.JournalLine.MemoryMetrics.Query

journalMemoryMetrics = Input()
python_script = Python(IN[0]=journalMemoryMetrics)
# ---------- python_script.python (11 lines) ----------
import clr

def process_input(func, input):
	if isinstance(input, list): return [func(x) for x in input]
	else: return func(input)
	
def journalMemoryMetricsVMAvailable(input):
	if input.__repr__() == 'JournalMemoryMetrics': return input.VMAvailable
	else: return None

OUT = process_input(journalMemoryMetricsVMAvailable,IN[0])
# ----------------------------------------
VMAvailable = Output(python_script)
