# Dynamo custom node JournalSystemInformation.Key.dyf (Dynamo 1.3.1.1736)
# category: Journalysis.Journal.JournalLine.SystemInformation.Query
# Returns the key of a given JournalSystemInformation line

journalSystemInformation = Input()
python_script = Python(IN[0]=journalSystemInformation)
# ---------- python_script.python (11 lines) ----------
import clr

def process_input(func, input):
	if isinstance(input, list): return [func(x) for x in input]
	else: return func(input)
	
def journalSysInfoKey(jsysinfo):
	if hasattr(jsysinfo, 'SystemInformationType'): return jsysinfo.Key
	else: return None

OUT = process_input(journalSysInfoKey,IN[0])
# ----------------------------------------
str = Output(python_script)
