# Dynamo custom node JournalSystemInformation.Value.dyf (Dynamo 1.3.1.1736)
# category: Journalysis.Journal.JournalLine.SystemInformation.Query
# Returns the value of a given JournalSystemInformation line

journalSystemInformation = Input()
python_script = Python(IN[0]=journalSystemInformation)
# ---------- python_script.python (11 lines) ----------
import clr

def process_input(func, input):
	if isinstance(input, list): return [func(x) for x in input]
	else: return func(input)
	
def journalSysInfoValue(jsysinfo):
	if hasattr(jsysinfo, 'SystemInformationType'): return jsysinfo.Value
	else: return None

OUT = process_input(journalSysInfoValue,IN[0])
# ----------------------------------------
str = Output(python_script)
