# Dynamo custom node JournalTimeStamp.DateTime.dyf (Dynamo 1.3.1.1736)
# category: Journalysis.Journal.JournalLine.TimeStamp.Query
# Returns the date and time of a TimeStamp line

journalTimeStamp = Input()
python_script = Python(IN[0]=journalTimeStamp)
# ---------- python_script.python (11 lines) ----------
import clr

def process_input(func, input):
	if isinstance(input, list): return [func(x) for x in input]
	else: return func(input)
	
def journalTimeStampDateTime(input):
	if input.__repr__() == 'JournalTimeStamp': return input.DateTime
	else: return None

OUT = process_input(journalTimeStampDateTime,IN[0])
# ----------------------------------------
dateTime = Output(python_script)
