# Dynamo custom node JournalTimeStamp.Type.dyf (Dynamo 1.3.1.1736)
# category: Journalysis.Journal.JournalLine.TimeStamp.Query
# Returns the type of a TimeStamp line

journalTimeStamp = Input()
python_script = Python(IN[0]=journalTimeStamp)
# ---------- python_script.python (11 lines) ----------
import clr

def process_input(func, input):
	if isinstance(input, list): return [func(x) for x in input]
	else: return func(input)
	
def journalTimeStampType(input):
	if input.__repr__() == 'JournalTimeStamp': return input.TimeStampType
	else: return None

OUT = process_input(journalTimeStampType,IN[0])
# ----------------------------------------
str = Output(python_script)
