# Dynamo custom node KeyboardShortcuts.CommandByID.dyf (Dynamo 1.3.4.6666)
# category: Journalysis.KeyboardShortcuts.Actions
# Returns the command that corresponds with the given CommandID

keyboardShortcuts = Input()
commandID = Input(commandID : string[]..[])
python_script = Python(IN[0]=keyboardShortcuts, IN[1]=commandID)
# ---------- python_script.python (4 lines) ----------
if IN[0].__repr__() == 'KeyboardShortcuts':
	if isinstance(IN[1], list): OUT = [IN[0].GetCommandById(x) for x in IN[1]]
	else: OUT = IN[0].GetCommandById(IN[1])
else: OUT = None
# ----------------------------------------
command = Output(python_script)
