# Dynamo custom node KeyboardShortcuts.CommandCount.dyf (Dynamo 1.3.1.1736)
# category: Journalysis.KeyboardShortcuts.Query
# Returns the total number of commands in a given KeyboardShirtcuts object

keyboardShortcuts = Input()
python_script = Python(IN[0]=keyboardShortcuts)
# ---------- python_script.python (4 lines) ----------
import clr

if IN[0].__repr__() == 'KeyboardShortcuts': OUT = IN[0].CommandCount
else: OUT = None
# ----------------------------------------
int = Output(python_script)
