# Dynamo custom node KeyboardShortcuts.CommandCountWithShortcuts.dyf (Dynamo 1.3.1.1736)
# category: Journalysis.KeyboardShortcuts.Query

keyboardShortcuts = Input()
python_script = Python(IN[0]=keyboardShortcuts)
# ---------- python_script.python (2 lines) ----------
if IN[0].__repr__() == 'KeyboardShortcuts': OUT = IN[0].CommandCountWithShortcuts
else: OUT = None
# ----------------------------------------
int = Output(python_script)
