# Dynamo custom node KeyboardShortcuts.Commands.dyf (Dynamo 1.3.1.1736)
# category: Journalysis.KeyboardShortcuts.Query
# Returns all commands from a given KeyboardShirtcuts object

keyboardShortcuts = Input()
python_script = Python(IN[0]=keyboardShortcuts)
# ---------- python_script.python (2 lines) ----------
if IN[0].__repr__() == 'KeyboardShortcuts': OUT = IN[0].Commands
else: OUT = None
# ----------------------------------------
keyboardShortcutCommands = Output(python_script)
