# Dynamo custom node LoadedAssembly.GUID.dyf (Dynamo 1.3.1.1736)
# category: Journalysis.Journal.LoadedAssembly.Query
# Returns the GUID of a given LoadedAssembly

loadedAssembly = Input()
python_script = Python(IN[0]=loadedAssembly)
# ---------- python_script.python (11 lines) ----------
import clr

def process_input(func, input):
	if isinstance(input, list): return [func(x) for x in input]
	else: return func(input)
	
def LAGuid(assembly):
	if assembly.__repr__() == 'LoadedAssembly': return assembly.GUID
	else: return None

OUT = process_input(LAGuid,IN[0])
# ----------------------------------------
str = Output(python_script)
