# Dynamo custom node LoadedModel.FileName.dyf (Dynamo 1.3.1.1736)
# category: Journalysis.LoadedModel.Query
# Returns the file name of a loaded model

loadedModel = Input()
python_script = Python(IN[0]=loadedModel)
# ---------- python_script.python (11 lines) ----------
import clr

def process_input(func, input):
	if isinstance(input, list): return [func(x) for x in input]
	else: return func(input)
	
def LMFileName(model):
	if model.__repr__() == 'LoadedModel': return model.FileName
	else: return None

OUT = process_input(LMFileName,IN[0])
# ----------------------------------------
str = Output(python_script)
