# Dynamo custom node LoadedModel.Path.dyf (Dynamo 1.3.1.1736)
# category: Journalysis.Journal.LoadedModel.Query
# Returns the Rpath of a loaded model

loadedModel = Input()
python_script = Python(IN[0]=loadedModel)
# ---------- python_script.python (11 lines) ----------
import clr

def process_input(func, input):
	if isinstance(input, list): return [func(x) for x in input]
	else: return func(input)
	
def LMPath(model):
	if model.__repr__() == 'LoadedModel': return model.Path
	else: return None

OUT = process_input(LMPath,IN[0])
# ----------------------------------------
str = Output(python_script)
