# Dynamo custom node Paths.AllKeyboardShortcutFiles.dyf (Dynamo 1.3.4.6666)
# category: Journalysis.KeyboardShortcuts.Paths.Query
# Retrieves a list of all journal folders on the current machine

python_script = Python()
# ---------- python_script.python (3 lines) ----------
import clr
from System import Environment
OUT = Environment.GetFolderPath(Environment.SpecialFolder.ApplicationData)
# ----------------------------------------
string = StringInput("Autodesk\Revit")
combine = FilePath.Combine(python_script, string)
fromPath = DirectoryObject(combine)  # "Directory.FromPath"
contents = Directory.Contents(fromPath)
fileName = FilePath.FileName(contents.out1)
string_2 = StringInput("Autodesk Revit")
startsWith = String.StartsWith(str=fileName, searchFor=string_2)
filterByBoolMask = List.FilterByBoolMask(list=contents.out1, mask=startsWith)
code_block = CodeBlock(dir=filterByBoolMask.in) { dir + "\\KeyboardShortcuts.xml"; }
exists = File.Exists(code_block)
filterByBoolMask_2 = List.FilterByBoolMask(list=code_block, mask=exists)
seq = Output(filterByBoolMask_2.in)
