# Dynamo custom node SyncEvent.End.dyf (Dynamo 1.3.1.1736)
# category: Journalysis.WorksharingLog.WorksharingSession.SyncEvent.Query
# Returns the date and time a given SyncEvent concluded

syncEvent = Input()
python_script = Python(IN[0]=syncEvent)
# ---------- python_script.python (11 lines) ----------
import clr

def process_input(func, input):
	if isinstance(input, list): return [func(x) for x in input]
	else: return func(input)
	
def SyncEventEnd(syncevent):
	if syncevent.__repr__() == 'SyncEvent': return syncevent.End
	else: return None

OUT = process_input(SyncEventEnd,IN[0])
# ----------------------------------------
dateTime = Output(python_script)
