# Dynamo custom node WorksharingLog.ByPath.dyf (Dynamo 1.3.3.4651)
# category: Journalysis.WorksharingLog.Create
# Creates a queryable object from a Revit worksharing log

path = Input(path : string)
python_script = Python(IN[0]=path)
# ---------- python_script.python (149 lines) ----------
import clr
import time

class WorksharingLog:
	def __init__(self, version, sessions):
		self.Version = version
		self.Sessions = sessions
		self.SessionCount = len(sessions)
		self.ProcessingTime = None
	def __repr__(self):
		return "WorksharingLog"
	def AllSessionsUseSameBuild(self):
		return len(set([x.RevitBuild for x in self.Sessions])) == 1
	def GetSessionByID(self, ID):
		sessionlookup = [x for x in sessions if x.ID == ID]
		if len(sessionlookup) > 0: return sessionlookup[0]
		else: return None

class WorksharingSession:
	def __init__(self, id):
		self.ID = id
		self.Start = None
		self.End = None
		self.Date = None
		self.Duration = None
		self.User = None
		self.RevitVersion = None
		self.RevitBuild = None
		self.Journal = None
		self.HostAddress = None
		self.HostName = None
		self.ServerAddress = None
		self.ServerName = None
		self.Central = None
		self.Events = []
	def __repr__(self):
		return "WorksharingSession"
	def CreatesDetached(self):
		return self.Events[1].Text == ">Open"
	def CreatesNewCentral(self):
		return len([x for x in self.Events if x.Text == ">Open"]) == 0
	def GetLoadDuration(self):
		if self.CreatesNewCentral(): return None
		else:
			openStart = [x.DateTime for x in self.Events if x.Text == ">Open"][0]
			openEnd = None
			if self.UsesCentralModel(): 
				breakLoop = False
				for event in self.Events:
					if event.Text == ">Open": breakLoop = True
					if event.Text.startswith(">Open") or event.Text.startswith(".Open") or event.Text.startswith("<Open"):
						if event.Text.startswith("<Open"): openEnd = event.DateTime
					# Terminate the loop as soon as we start seeing stuff that's not from the Open block
					# This should give us the timestamp of the last opened link 
					# (if any - otherwise the timestamp of the concluded opening sequence)
					# Of course we only want to start breaking the loop once the Open block has begun
					elif breakLoop == True: break
					else: pass					
			# In local copies, there's a WSConfig block directly following the Open block which we should include here
			# Linked models are loaded in between those blocks
			else: 
				lastOpenLine = [x.DateTime for x in self.Events if x.Text == "<WSConfig"]
				if len(lastOpenLine) > 0: openEnd = lastOpenLine[0]
			if openEnd == None: return None
			else: return openEnd - openStart
	def GetSyncEvents(self):
		events = []
		for event in self.Events:
			if event.Text == ">STC": events.append(SyncEvent(event.DateTime))
			elif event.Text == "<STC" and len(events) > 0:
				events[-1].End = event.DateTime
				events[-1].Duration = event.DateTime - events[-1].Start
		return events
	def HasLoadedLinks(self):
		return len([x for x in self.Events if x.Text == "<OpenLink"]) > 0
	def UsesCentralModel(self):
		if self.CreatesNewCentral(): return True
		else: return len([x for x in self.Events if x.Text.startswith(">Open:Central")]) > 0
	def WasTerminatedProperly(self):
		return self.End != None

class WorksharingEvent:
	def __init__(self, timestamp, text):
		self.DateTime = timestamp
		self.Text = text
	def __repr__(self):
		return "WorksharingEvent"

class SyncEvent:
	def __init__(self, start):
		self.Start = start
		self.End = None
		self.Duration = None
	def __repr__(self):
		return "SyncEvent"

def WSLogFromPath(path):
	try:
		processing_started = time.time()
		sessions = []
		version = None
		with open(path, 'r') as slog:
			for line in slog:
				line = line.lstrip().rstrip('\n')
				if line.startswith("$"):
					contents = line.split()
					session_lookup = [x for x in sessions if x.ID == contents[0]]
					if len(session_lookup) == 0:
						sessions.append(WorksharingSession(contents[0]))
						current_session = sessions[-1]
					else: current_session = session_lookup[0]
					timestamp = time.strptime(contents[1] + " " + contents[2])
					text = ' '.join(contents[3:])
					event = WorksharingEvent(timestamp, text)
					current_session.Events.append(event)
					if text.startswith(">Session"): 
						sessions[-1].Start = timestamp
						sessions[-1].Date = timestamp.Date
					elif text.startswith("<Session"): 
						sessions[-1].End = timestamp
						sessions[-1].Duration = timestamp - sessions[-1].Start
				elif line.startswith("user"): sessions[-1].User = line.split('user="')[-1][:-1]
				elif line.startswith("build"):
					versioninfo = line.split('build="')[-1].split()
					sessions[-1].RevitVersion = int(versioninfo[0])
					sessions[-1].RevitBuild = versioninfo[-1][:-1]
				elif line.startswith("journal"): sessions[-1].Journal = line.split('journal="')[-1][:-1]
				elif line.startswith("host"):
					hostinfo = line.split('host=')[-1].split()
					sessions[-1].HostAddress = hostinfo[0]
					sessions[-1].HostName = hostinfo[-1][1:-1]
				elif line.startswith("server"):
					serverinfo = line.split('server=')[-1].split()
					sessions[-1].ServerAddress = serverinfo[0]
					sessions[-1].ServerName = serverinfo[-1][1:-1]
				elif line.startswith("central"): sessions[-1].Central = line.split('central="')[-1][:-1]
				elif line.startswith("Worksharing"): version = line.split("Version ")[-1].split(",")[0]
		WSLog = WorksharingLog(version, sessions)
		WSLog.ProcessingTime = time.time() - processing_started
		return WSLog
	except:
		import sys
		pyt_path = r'C:\Program Files (x86)\IronPython 2.7\Lib'
		sys.path.append(pyt_path)
		import traceback
		return traceback.format_exc()

if isinstance(IN[0], list): OUT = [WSLogFromPath(x) for x in IN[0]]
else: OUT = WSLogFromPath(IN[0])
# ----------------------------------------
worksharingLog = Output(python_script)
