# Dynamo custom node WorksharingLog.Sessions.dyf (Dynamo 1.3.1.1736)
# category: Journalysis.WorksharingLog.Query
# Returns all sessions of a given WorksharingLog

worksharingLog = Input()
python_script = Python(IN[0]=worksharingLog)
# ---------- python_script.python (11 lines) ----------
import clr

def process_input(func, input):
	if isinstance(input, list): return [func(x) for x in input]
	else: return func(input)
	
def WSLogSessions(wslog):
	if wslog.__repr__() == 'WorksharingLog': return wslog.Sessions
	else: return []

OUT = process_input(WSLogSessions,IN[0])
# ----------------------------------------
worksharingSessions = Output(python_script)
