# Dynamo custom node WorksharingLog.Version.dyf (Dynamo 1.3.1.1736)
# category: Journalysis.WorksharingLog.Query
# Returns the version of a given WorksharingLog

worksharingLog = Input()
python_script = Python(IN[0]=worksharingLog)
# ---------- python_script.python (11 lines) ----------
import clr

def process_input(func, input):
	if isinstance(input, list): return [func(x) for x in input]
	else: return func(input)
	
def WSLogVersion(wslog):
	if wslog.__repr__() == 'WorksharingLog': return wslog.Version
	else: return None

OUT = process_input(WSLogVersion,IN[0])
# ----------------------------------------
str = Output(python_script)
