# Dynamo custom node WorksharingSession.ServerIP.dyf (Dynamo 1.3.1.1736)
# category: Journalysis.WorksharingSession.Query
# Returns the server IP address of a given WorksharingSession

worksharingSession = Input()
python_script = Python(IN[0]=worksharingSession)
# ---------- python_script.python (11 lines) ----------
import clr

def process_input(func, input):
	if isinstance(input, list): return [func(x) for x in input]
	else: return func(input)
	
def WSSessionServerIP(wssess):
	if wssess.__repr__() == 'WorksharingSession': return wssess.ServerIP
	else: return None

OUT = process_input(WSSessionServerIP,IN[0])
# ----------------------------------------
str = Output(python_script)
