# Dynamo custom node WorksharingSession.Start.dyf (Dynamo 1.3.1.1736)
# category: Journalysis.WorksharingLog.WorksharingSession.Query
# Returns the date and time a given WorksharingSession was started

worksharingSession = Input()
python_script = Python(IN[0]=worksharingSession)
# ---------- python_script.python (11 lines) ----------
import clr

def process_input(func, input):
	if isinstance(input, list): return [func(x) for x in input]
	else: return func(input)
	
def WSSessionStart(wssess):
	if wssess.__repr__() == 'WorksharingSession': return wssess.Start
	else: return None

OUT = process_input(WSSessionStart,IN[0])
# ----------------------------------------
dateTime = Output(python_script)
