# Dynamo custom node WorksharingSession.UsesCentralModel.dyf (Dynamo 1.3.1.1736)
# category: Journalysis.WorksharingLog.WorksharingSession.Actions
# Determines if the user was working in the central model (as opposed to a local copy) in a given WorksharingSession

worksharingSession = Input()
python_script = Python(IN[0]=worksharingSession)
# ---------- python_script.python (11 lines) ----------
import clr

def process_input(func, input):
	if isinstance(input, list): return [func(x) for x in input]
	else: return func(input)
	
def WSSessionUsesCentralModel(wssess):
	if wssess.__repr__() == 'WorksharingSession': return wssess.UsesCentralModel()
	else: return None

OUT = process_input(WSSessionUsesCentralModel,IN[0])
# ----------------------------------------
bool = Output(python_script)
