# Dynamo graph Journals_CrashInvestigator.dyn (Dynamo 1.3.4.6666)

# group: Inputs
directory_path_target = Directory("C:\temp")
filename_sheetname = StringInput("Crash_Investigator")
directory_path_source = Directory("U:\Journals\_abstürze_kw10")

# group: Read source directory
string = StringInput("*.txt")
contents = Custom[Directory.Contents+](directoryPath=directory_path_source, searchString=string)  # Unlike the built-in node Directory.Contents, this node browses a directory recursively and returns all relevant files contained in subfolders as well.

# group: Crash Filter
byPath = Custom[Journal.ByPath](path=contents)  # Creates a queryable object from the contents of a Revit journal file
sessionTerminatedProperly = Custom[Journal.SessionTerminatedProperly](journal=byPath)
filterByBoolMask = List.FilterByBoolMask(list=contents, mask=sessionTerminatedProperly)
filterByBoolMask_2 = List.FilterByBoolMask(list=byPath, mask=sessionTerminatedProperly)

# group: API Errors
string_2 = StringInput("JournalAPIMessage")
string_3 = StringInput("IsError")
boolean = BoolSelector(true)
linesByTypeAndProperty = Custom[Journal.LinesByTypeAndProperty](journal=filterByBoolMask_2.out, journalLineType=string_2, property=string_3, value=boolean)  # Retrieves all JournalLines of a given type from a given journal, pre-filtered by a property value
text = Custom[JournalAPIMessage.Text](journalAPIMessage=linesByTypeAndProperty@L2)  # Returns the text from an APIMessage line
flatten = Flatten(text)
countOccurences = Custom[List.CountOccurences](seq=flatten)  # Counts the number of occurences of each unique element in a given list
sortByKey = List.SortByKey(list=countOccurences.uniqueElements, keys=countOccurences.count)
reverse = List.Reverse(sortByKey.sorted_list)
watch = Watch(reverse)
reverse_2 = List.Reverse(sortByKey.sorted_keys)
watch_2 = Watch(reverse_2)

# group: TimeStamps
string_4 = StringInput("JournalTimeStamp")
linesByType = Custom[Journal.LinesByType](journal=filterByBoolMask_2.out, journalLineType=string_4)  # Retrieves all JournalLines of a given type from a given journal

# group: Exceptions
description = Custom[JournalTimeStamp.Description](journalTimeStamp=linesByType@L2)  # Returns the description of a TimeStamp line
string_5 = StringInput("ExceptionCode")
startsWith = String.StartsWith(str=description, searchFor=string_5)
filterByBoolMask_3 = List.FilterByBoolMask(list=description, mask=startsWith)
flatten_2 = Flatten(filterByBoolMask_3.in)
countOccurences_2 = Custom[List.CountOccurences](seq=flatten_2)
sortByKey_2 = List.SortByKey(list=countOccurences_2.uniqueElements, keys=countOccurences_2.count)
reverse_3 = List.Reverse(sortByKey_2.sorted_list)
watch_3 = Watch(reverse_3)
reverse_4 = List.Reverse(sortByKey_2.sorted_keys)
watch_4 = Watch(reverse_4)

# group: Session Duration
sessionTime = Custom[Journal.SessionTime](journal=filterByBoolMask_2.out)  # Computes the entire Revit session time based on the given journal
string_from_object = FromObject(sessionTime)
code_block = CodeBlock(ts=string_from_object) { "'" + ts; }

# group: Last Used Command
string_6 = StringInput("JournalCommand")
linesByType_2 = Custom[Journal.LinesByType](journal=filterByBoolMask_2.out, journalLineType=string_6)
lastItem = List.LastItem(linesByType_2@L2)
ID = Custom[JournalCommand.ID](journalCommand=lastItem)  # Returns the command ID of a JournalCommand line

# group: Hard vs. Soft Crashes
lastItem_2 = List.LastItem(linesByType@L2)
description_2 = Custom[JournalTimeStamp.Description](journalTimeStamp=lastItem_2)
code_block_2 = CodeBlock(txt=description_2) { txt == "program terminated"; }

# group: Last Active Model
string_7 = StringInput("JournalBasicFileInfo")
linesByType_3 = Custom[Journal.LinesByType](journal=filterByBoolMask_2.out, journalLineType=string_7)
lastItem_3 = List.LastItem(linesByType_3@L2)
fileName = Custom[JournalBasicFileInfo.FileName](journalBasicFileInfo=lastItem_3)  # Returns the file name from the last save path of a BasicFileInfo line

# group: Last UIEvent after command
number = Custom[JournalLine.Number](journalLine=lastItem)  # Returns the line number of a given journal line
string_8 = StringInput("JournalUIEvent")
linesByType_4 = Custom[Journal.LinesByType](journal=filterByBoolMask_2.out, journalLineType=string_8)
lastItem_4 = List.LastItem(linesByType_4@L2)
number_2 = Custom[JournalLine.Number](journalLine=lastItem_4)
string_9 = StringInput("")
rawText = Custom[JournalLine.RawText](journalLine=lastItem_4)  # Returns the raw text of a given journal line
count = List.Count(rawText)
ofRepeatedItem = List.OfRepeatedItem(item=string_9, amount=count)
code_block_3 = CodeBlock(command=number, uievent=number_2, emptystring=ofRepeatedItem, uieventstring=rawText) { command > uievent ? emptystring : uieventstring; }

# group: Gather data
fileName_2 = FilePath.FileName(filterByBoolMask.out)
user = Custom[Journal.User](journal=filterByBoolMask_2.out)  # Returns the Revit user name from a given journal
count_2 = List.Count(linesByTypeAndProperty@L2)
count_3 = List.Count(filterByBoolMask_3.in@L2)
create = List.Create(fileName_2, user, count_2, count_3, code_block, ID, code_block_2, fileName, code_block_3)

# group: Create headings and add data
string_10 = StringInput("""JournalPath
User
NumAPIErrors
NumExceptions
SessionDuration
LastCommandUsed
CrashedWithReport
LastActiveModel
LastUIEventAfterCommand""")
string_11 = StringInput("\n")
split = String.Split(string_10, string_11)
create_2 = List.Create(split)
transpose = List.Transpose(create)
join = List.Join(create_2, transpose)

# group: Write to Excel
combine = FilePath.Combine(directory_path_target, filename_sheetname)
code_block_4 = CodeBlock(filename=combine) { filename + ".xlsx"; }
code_block_5 = CodeBlock { 0; }
boolean_2 = BoolSelector(true)
writeToFile = Excel.WriteToFile(filePath=code_block_4, sheetName=filename_sheetname, startRow=code_block_5, startCol=code_block_5, data=join, overWrite=boolean_2)
