# Dynamo graph WorksharingLogs_AllSyncs.dyn (Dynamo 1.3.4.6666)

# group: INPUT
directory_path_export_directory = Directory("C:\temp")
filename = StringInput("Syncs")
directory_path_log_directory = Directory("U:\Journals\SLOG")

# group: Process files
fromPath = DirectoryObject(directory_path_log_directory)  # "Directory.FromPath"
contents = Directory.Contents(fromPath)
byPath = Custom[WorksharingLog.ByPath](path=contents)  # Creates a queryable object from a Revit worksharing log
sessions = Custom[WorksharingLog.Sessions](worksharingLog=byPath)  # Returns all sessions of a given WorksharingLog
flatten = Flatten(sessions)

# group: Collect data
ID = Custom[WorksharingSession.ID](worksharingSession=flatten)  # Returns the ID of a given WorksharingSession
syncEvents = Custom[WorksharingSession.SyncEvents](worksharingSession=flatten)  # Extracts all SyncEvents from a given WorkharingSession
count = List.Count(syncEvents@L2)
ofRepeatedItem = List.OfRepeatedItem(item=ID@L1, amount=count@L1)
code_block = CodeBlock(id=ofRepeatedItem)
# ---------- code_block.designscript (2 lines) ----------
// Prevent Excel from assuming this is currency
"'" + id;
# ----------------------------------------
user = Custom[WorksharingSession.User](worksharingSession=flatten)  # Returns the Revit user name of a given WorksharingSession
ofRepeatedItem_2 = List.OfRepeatedItem(item=user@L1, amount=count@L1)
start = Custom[SyncEvent.Start](syncEvent=syncEvents@L2)  # Returns the date and time a given SyncEvent started
duration = Custom[SyncEvent.Duration](syncEvent=syncEvents@L2)  # Returns the duration of a given SyncEvent
totalSeconds = TimeSpan.TotalSeconds(duration)
string = StringInput("")
replaceNull = Custom[List.ReplaceNull](seq=totalSeconds@L2, replacement=string)  # Replaces all null values within a given list with a substitute
reloadLatestCount = Custom[SyncEvent.ReloadLatestCount](syncEvent=syncEvents@L2)  # Returns the number of times that Reload Latest occured during a given SyncEvent

hostName = Custom[WorksharingSession.HostName](worksharingSession=flatten)  # Returns the host name of a given WorksharingSession
ofRepeatedItem_3 = List.OfRepeatedItem(item=hostName@L1, amount=count@L1)
hasLoadedLinks = Custom[WorksharingSession.HasLoadedLinks](worksharingSession=flatten)  # Determines if linked models were loaded in this session
ofRepeatedItem_4 = List.OfRepeatedItem(item=hasLoadedLinks@L1, amount=count@L1)
central = Custom[WorksharingSession.Central](worksharingSession=flatten)  # Returns the file path to the central model of a given WorksharingSession
boolean = BoolSelector(false)
fileName = FilePath.FileName(central, boolean)
ofRepeatedItem_5 = List.OfRepeatedItem(item=fileName@L1, amount=count@L1)

# group (continued): Collect data
create = List.Create(code_block, ofRepeatedItem_2, ofRepeatedItem_3, ofRepeatedItem_4, ofRepeatedItem_5, start, replaceNull, reloadLatestCount)
flatten_2 = Flatten(create@L3)

# group: Export to Excel
code_block_2 = CodeBlock(filename=filename) { filename + ".xlsx"; }
combine = FilePath.Combine(directory_path_export_directory, code_block_2)
string_2 = StringInput("Syncs")
code_block_3 = CodeBlock { 0; }
string_3 = StringInput("""SessionID
Username
Machine
LinksLoaded
Model
SyncStarted
SyncDuration
ReloadLatest""")
string_4 = StringInput("\n")
split = String.Split(string_3, string_4)
create_2 = List.Create(split)
transpose = List.Transpose(flatten_2)
join = List.Join(create_2, transpose)
boolean_2 = BoolSelector(true)
writeToFile = Excel.WriteToFile(filePath=combine, sheetName=string_2, startRow=code_block_3, startCol=code_block_3, data=join, overWrite=boolean_2)
