# Dynamo graph AllJournalNodes.dyn (Dynamo 2.0.3.8810)

# group: INPUT
journal_file_path = Filename("..\..\..\..\Desktop\Journals\journal.0855.txt")  # graph input

# group: Journal.Create
byPath = Custom[Journal.ByPath](path=journal_file_path)  # Creates a queryable object from the contents of a Revit journal file

# group: Journal.Query
user = Custom[Journal.User](journal=byPath)  # Returns the Revit user name from a given journal
lineCount = Custom[Journal.LineCount](journal=byPath)  # Returns the number of lines in a given journal
blockCount = Custom[Journal.BlockCount](journal=byPath)  # Returns the number of blocks in a given journal
lines = Custom[Journal.Lines](journal=byPath)  # Returns all lines of a given journal
path = Custom[Journal.Path](journal=byPath)  # Returns the original path of a given journal
processingTime = Custom[Journal.ProcessingTime](journal=byPath)  # Returns the time it took the Journal.ByString node to process a given journal
revitBuild = Custom[Journal.RevitBuild](journal=byPath)  # Returns the Revit build from a given journal
revitBranch = Custom[Journal.RevitBranch](journal=byPath)  # Returns the Revit branch from a given journal
revitVersion = Custom[Journal.RevitVersion](journal=byPath)  # Returns the Revit version from a given journal
OSVersion = Custom[Journal.OSVersion](journal=byPath)  # Returns the Windows version from a given journal
machine = Custom[Journal.Machine](journal=byPath)  # Returns the computer name from a given journal
date = Custom[Journal.Date](journal=byPath)  # Computes the date of a given journal

# group: Test Inputs
code_block = CodeBlock { ["JournalData","JournalDirective"]; "JournalTimeStamp"; "Description"; "idle0_doc"; 30..34; 30; 2018; 3; 9; 11; }
boolean = BoolSelector(true)  # graph input
byDateAndTime = DateTime.ByDateAndTime(year=code_block.out6, month=code_block.out7, day=code_block.out8, hour=code_block.out9)

# group: Journal.Actions
linesByType = Custom[Journal.LinesByType](journal=byPath, journalLineType=code_block.out1)
linesByBlock = Custom[Journal.LinesByBlock](journal=byPath, journalBlock=code_block.out4)
sessionTime = Custom[Journal.SessionTime](journal=byPath)
startupTime = Custom[Journal.StartupTime](journal=byPath)
sessionTerminatedProperly = Custom[Journal.SessionTerminatedProperly](journal=byPath)
isInPlaybackMode = Custom[Journal.IsInPlaybackMode](journal=byPath)
playbackInterrupted = Custom[Journal.PlaybackInterrupted](journal=byPath)
containsAPIErrors = Custom[Journal.ContainsAPIErrors](journal=byPath)
containsExceptions = Custom[Journal.ContainsExceptions](journal=byPath)
maxRAMPeak = Custom[Journal.MaxRAMPeak](journal=byPath)
maxVMPeak = Custom[Journal.MaxVMPeak](journal=byPath)
minRAMAvailable = Custom[Journal.MinRAMAvailable](journal=byPath)
minVMAvailable = Custom[Journal.MinVMAvailable](journal=byPath)
linesByTypeAndProperty = Custom[Journal.LinesByTypeAndProperty](journal=byPath, journalLineType=code_block.out1, property=code_block.out2, value=code_block.out3)
dateTimeByBlock = Custom[Journal.DateTimeByBlock](journal=byPath, journalBlock=code_block.out4)
stripComments = Custom[Journal.StripComments](journal=byPath, preserveTimestamps=boolean)  # Strips all comments from the original journal string and only returns all (re-formatted) lines that are potentially relevant for journal playback.
loadedModels = Custom[Journal.LoadedModels](journal=byPath)
date_2 = Custom[Journal.Date](journal=byPath)
loadedAssemblies = Custom[Journal.LoadedAssemblies](journal=byPath)
linesByDateTime = Custom[Journal.LinesByDateTime](journal=byPath, fromDateTime=byDateAndTime)  # Retrieves all lines of a given journal that fall in a given time window. At least one DateTime needs to be given (from or to).
lastLines = Custom[Journal.LastLines](journal=byPath, numberOfLines=code_block.out5)  # Gets the last N lines of a given journal (faster than OOTB list operations).
firstLines = Custom[Journal.FirstLines](journal=byPath, numberOfLines=code_block.out5)  # Gets the first N lines of a given journal (faster than OOTB list operations).

# group: JournalLine.Query
number = Custom[JournalLine.Number](journalLine=lines)
type = Custom[JournalLine.Type](journalLine=lines)
block = Custom[JournalLine.Block](journalLine=lines)
rawText = Custom[JournalLine.RawText](journalLine=lines)

# group: Helpers
allJournalLineTypes = Custom[Helpers.AllJournalLineTypes]()  # Lists all JournalLine types
watch = Watch(allJournalLineTypes)
allJournalAPIMessageTypes = Custom[Helpers.AllJournalAPIMessageTypes]()
watch_2 = Watch(allJournalAPIMessageTypes)
allJournalCommandTypes = Custom[Helpers.AllJournalCommandTypes]()
watch_3 = Watch(allJournalCommandTypes)
allJournalMouseEventTypes = Custom[Helpers.AllJournalMouseEventTypes]()
watch_4 = Watch(allJournalMouseEventTypes)
allJournalTimeStampTypes = Custom[Helpers.AllJournalTimeStampTypes]()
watch_5 = Watch(allJournalTimeStampTypes)
allJournalUIEventTypes = Custom[Helpers.AllJournalUIEventTypes]()
watch_6 = Watch(allJournalUIEventTypes)
allLoadedModelEventTypes = Custom[Helpers.AllLoadedModelEventTypes]()  # Lists all LoadedModelEvent types
watch_7 = Watch(allLoadedModelEventTypes)

watch_8 = Watch()  # unwired: arg0

# group: JournalAPIMessage.Query
string = StringInput("JournalAPIMessage")  # graph input
linesByType_2 = Custom[Journal.LinesByType](journal=watch_8, journalLineType=string)
text = Custom[JournalAPIMessage.Text](journalAPIMessage=linesByType_2)  # Returns the text from an APIMessage line
type_2 = Custom[JournalAPIMessage.Type](journalAPIMessage=linesByType_2)  # Returns the type of an APIMessage line

# group: JournalCommand.Query
string_2 = StringInput("JournalCommand")  # graph input
linesByType_3 = Custom[Journal.LinesByType](journal=watch_8, journalLineType=string_2)
type_3 = Custom[JournalCommand.Type](journalCommand=linesByType_3)  # Returns the type of a JournalCommand line
description = Custom[JournalCommand.Description](journalCommand=linesByType_3)  # Returns the description of a JournalCommand line
ID = Custom[JournalCommand.ID](journalCommand=linesByType_3)  # Returns the command ID of a JournalCommand line

# group: JournalAddinEvent.Query
string_3 = StringInput("JournalAddinEvent")  # graph input
linesByType_4 = Custom[Journal.LinesByType](journal=watch_8, journalLineType=string_3)
text_2 = Custom[JournalAddinEvent.Text](journalAddinEvent=linesByType_4)  # Returns the text from an AddinEvent line

# group: JournalData.Query
string_4 = StringInput("JournalData")  # graph input
linesByType_5 = Custom[Journal.LinesByType](journal=watch_8, journalLineType=string_4)
key = Custom[JournalData.Key](journalData=linesByType_5)  # Returns the key of a JournalData line
values = Custom[JournalData.Values](journalData=linesByType_5)  # Returns the values from a JournalData line

# group: JournalDirective.Query
string_5 = StringInput("JournalDirective")  # graph input
linesByType_6 = Custom[Journal.LinesByType](journal=watch_8, journalLineType=string_5)
key_2 = Custom[JournalDirective.Key](journalDirective=linesByType_6)  # Returns the key of a JournalDirective line
values_2 = Custom[JournalDirective.Values](journalDirective=linesByType_6)  # Returns the values from a JournalDirective line

# group: JournalGUIResourceUsage.Query
string_6 = StringInput("JournalGUIResourceUsage")  # graph input
linesByType_7 = Custom[Journal.LinesByType](journal=watch_8, journalLineType=string_6)
available = Custom[JournalGUIResourceUsage.Available](journalGUIResourceUsage=linesByType_7)
used = Custom[JournalGUIResourceUsage.Used](journalGUIResourceUsage=linesByType_7)
user_2 = Custom[JournalGUIResourceUsage.User](journalGUIResourceUsage=linesByType_7)

# group: JournalKeyboardEvent.Query
string_7 = StringInput("JournalKeyboardEvent")  # graph input
linesByType_8 = Custom[Journal.LinesByType](journal=watch_8, journalLineType=string_7)
key_3 = Custom[JournalKeyboardEvent.Key](journalKeyboardEvent=linesByType_8)  # Returns the pressed key of a KeyboardEvent line

# group: JournalMemoryMetrics.Query
string_8 = StringInput("JournalMemoryMetrics")  # graph input
linesByType_9 = Custom[Journal.LinesByType](journal=watch_8, journalLineType=string_8)
VMAvailable = Custom[JournalMemoryMetrics.VMAvailable](journalMemoryMetrics=linesByType_9)  # Returns the available VM of a MemoryMetrics line
VMUsed = Custom[JournalMemoryMetrics.VMUsed](journalMemoryMetrics=linesByType_9)  # Returns the used VM of a MemoryMetrics line
VMPeak = Custom[JournalMemoryMetrics.VMPeak](journalMemoryMetrics=linesByType_9)  # Returns the peak VM of a MemoryMetrics line
RAMAvailable = Custom[JournalMemoryMetrics.RAMAvailable](journalMemoryMetrics=linesByType_9)  # Returns the available RAM of a MemoryMetrics line
RAMUsed = Custom[JournalMemoryMetrics.RAMUsed](journalMemoryMetrics=linesByType_9)  # Returns the used RAM of a MemoryMetrics line
RAMPeak = Custom[JournalMemoryMetrics.RAMPeak](journalMemoryMetrics=linesByType_9)  # Returns the peak RAM of a MemoryMetrics line

# group: JournalMouseEvent.Query
string_9 = StringInput("JournalMouseEvent")  # graph input
linesByType_10 = Custom[Journal.LinesByType](journal=watch_8, journalLineType=string_9)
type_4 = Custom[JournalMouseEvent.Type](journalMouseEvent=linesByType_10)  # Returns the type of a MouseEvent line
data = Custom[JournalMouseEvent.Data](journalMouseEvent=linesByType_10)  # Returns the data from a MouseEvent line

# group: JournalTimeStamp.Query
string_10 = StringInput("JournalTimeStamp")  # graph input
linesByType_11 = Custom[Journal.LinesByType](journal=watch_8, journalLineType=string_10)
type_5 = Custom[JournalTimeStamp.Type](journalTimeStamp=linesByType_11)  # Returns the type of a TimeStamp line
dateTime = Custom[JournalTimeStamp.DateTime](journalTimeStamp=linesByType_11)  # Returns the date and time of a TimeStamp line
description_2 = Custom[JournalTimeStamp.Description](journalTimeStamp=linesByType_11)  # Returns the description of a TimeStamp line

# group: JournalUIEvent.Query
string_11 = StringInput("JournalUIEvent")  # graph input
linesByType_12 = Custom[Journal.LinesByType](journal=watch_8, journalLineType=string_11)
type_6 = Custom[JournalUIEvent.Type](journalUIEvent=linesByType_12)  # Returns the type of a UIEvent line
data_2 = Custom[JournalUIEvent.Data](journalUIEvent=linesByType_12)  # Returns the data from a UIEvent line

# group: Test Inputs
code_block_2 = CodeBlock { 4; }
getItemAtIndex = List.GetItemAtIndex(list=lines, index=code_block_2)
count = List.Count(list=lines)
code_block_3 = CodeBlock(n=count) { n-5; }
getItemAtIndex_2 = List.GetItemAtIndex(list=lines, index=code_block_3)
code_block_4 = CodeBlock { "JournalCommand"; "CommandID"; "ID_CANCEL_EDITOR"; }

# group: JournalLine.Actions
next = Custom[JournalLine.Next](journalLine=getItemAtIndex)
previous = Custom[JournalLine.Previous](journalLine=getItemAtIndex_2)
allNext = Custom[JournalLine.AllNext](journalLine=getItemAtIndex)
allPrevious = Custom[JournalLine.AllPrevious](journalLine=getItemAtIndex_2)
allNextOfType = Custom[JournalLine.AllNextOfType](journalLine=getItemAtIndex, journalLineType=code_block_4.out0)
allNextOfTypeAndProperty = Custom[JournalLine.AllNextOfTypeAndProperty](journalLine=getItemAtIndex, journalLineType=code_block_4.out0, property=code_block_4.out1, value=code_block_4.out2)
allPreviousOfType = Custom[JournalLine.AllPreviousOfType](journalLine=getItemAtIndex_2, journalLineType=code_block_4.out0)
allPreviousOfTypeAndProperty = Custom[JournalLine.AllPreviousOfTypeAndProperty](journalLine=getItemAtIndex_2, journalLineType=code_block_4.out0, property=code_block_4.out1, value=code_block_4.out2)
nextOfType = Custom[JournalLine.NextOfType](journalLine=getItemAtIndex, journalLineType=code_block_4.out0)
nextOfTypeAndProperty = Custom[JournalLine.NextOfTypeAndProperty](journalLine=getItemAtIndex, journalLineType=code_block_4.out0, property=code_block_4.out1, value=code_block_4.out2)
previousOfType = Custom[JournalLine.PreviousOfType](journalLine=getItemAtIndex_2, journalLineType=code_block_4.out0)
previousOfTypeAndProperty = Custom[JournalLine.PreviousOfTypeAndProperty](journalLine=getItemAtIndex_2, journalLineType=code_block_4.out0, property=code_block_4.out1, value=code_block_4.out2)
dateTimeOfBlock = Custom[JournalLine.DateTimeOfBlock](journalLine=getItemAtIndex_2)

# group: LoadedModel.Query
events = Custom[LoadedModel.Events](loadedModel=loadedModels)  # Returns all events associated with a loaded model
path_2 = Custom[LoadedModel.Path](loadedModel=loadedModels)  # Returns the Rpath of a loaded model
fileName = FileSystem.FileName(path=path_2)

# group: LoadedModelEvent.Query
type_7 = Custom[LoadedModelEvent.Type](loadedModelEvent=events@L2)  # Returns the type of a given LoadedModelEvent
dateTime_2 = Custom[LoadedModelEvent.DateTime](loadedModelEvent=events@L2)  # Returns the date and time of a given LoadedModelEvent
journalLine = Custom[LoadedModelEvent.JournalLine](loadedModelEvent=events)  # Returns the JournalLIne of a given LoadedModelEvent

# group: LoadedModel.Actions
version = Custom[LoadedModel.Version](loadedModel=loadedModels)  # Retrieves the version of a loaded model
versionHistory = Custom[LoadedModel.VersionHistory](loadedModel=loadedModels)  # Retrieves the version history of a loaded model

# group: JournalBasicFileInfo.Query
string_12 = StringInput("JournalBasicFileInfo")  # graph input
linesByType_13 = Custom[Journal.LinesByType](journal=watch_8, journalLineType=string_12)
centralModelPath = Custom[JournalBasicFileInfo.CentralModelPath](journalBasicFileInfo=linesByType_13)  # Returns the central model path from a BasicFileInfo line
lastSavePath = Custom[JournalBasicFileInfo.LastSavePath](journalBasicFileInfo=linesByType_13)  # Returns the last save path from a BasicFileInfo line
locale = Custom[JournalBasicFileInfo.Locale](journalBasicFileInfo=linesByType_13)  # Returns the locale a model was saved in from a BasicFileInfo line
worksharing = Custom[JournalBasicFileInfo.Worksharing](journalBasicFileInfo=linesByType_13)  # Returns the worksharing status from a BasicFileInfo line

fileName_2 = Custom[JournalBasicFileInfo.FileName](journalBasicFileInfo=linesByType_13)  # Returns the file name from the last save path of a BasicFileInfo line

# group: LoadedAssembly.Query
class_ = Custom[LoadedAssembly.Class](loadedAssembly=loadedAssemblies)  # Returns the class name of a given LoadedAssembly
events_2 = Custom[LoadedAssembly.Events](loadedAssembly=loadedAssemblies)  # Returns all journal lines associated with a given LoadedAssembly
filename = Custom[LoadedAssembly.Filename](loadedAssembly=loadedAssemblies)  # Returns the file name of a given LoadedAssembly
GUID = Custom[LoadedAssembly.GUID](loadedAssembly=loadedAssemblies)  # Returns the GUID of a given LoadedAssembly
name = Custom[LoadedAssembly.Name](loadedAssembly=loadedAssemblies)  # Returns the name of a given LoadedAssembly
path_3 = Custom[LoadedAssembly.Path](loadedAssembly=loadedAssemblies)  # Returns the path of a given LoadedAssembly
vendor = Custom[LoadedAssembly.Vendor](loadedAssembly=loadedAssemblies)  # Returns the vendor information of a given LoadedAssembly

# group: JournalWorksharingEvent.Query
string_13 = StringInput("JournalWorksharingEvent")  # graph input
linesByType_14 = Custom[Journal.LinesByType](journal=watch_8, journalLineType=string_13)
sessionID = Custom[JournalWorksharingEvent.SessionID](journalWorksharingEvent=linesByType_14)  # Returns the session ID (used in the worksharing log of the central file) of a given JournalWorksharingEvent
dateTime_3 = Custom[JournalWorksharingEvent.DateTime](journalWorksharingEvent=linesByType_14)  # Returns the date and time of a given JournalWorksharingEvent
text_3 = Custom[JournalWorksharingEvent.Text](journalWorksharingEvent=linesByType_14)  # Returns the recorded text of a given JournalWorksharingEvent

# group: JournalSystemInformation.Query
string_14 = StringInput("JournalSystemInformation")  # graph input
linesByType_15 = Custom[Journal.LinesByType](journal=watch_8, journalLineType=string_14)
item = Custom[JournalSystemInformation.Item](journalSystemInformation=linesByType_15)  # Returns the item number of a given JournalSystemInformation line
key_4 = Custom[JournalSystemInformation.Key](journalSystemInformation=linesByType_15)  # Returns the key of a given JournalSystemInformation line
type_8 = Custom[JournalSystemInformation.Type](journalSystemInformation=linesByType_15)  # Returns the type of a given JournalSystemInformation line
value = Custom[JournalSystemInformation.Value](journalSystemInformation=linesByType_15)  # Returns the value of a given JournalSystemInformation line

# group: Paths
allJournalDirectories = Custom[Paths.AllJournalDirectories]()  # Retrieves a list of all journal folders on the current machine
watch_9 = Watch(allJournalDirectories)
string_15 = StringInput("2017")  # graph input
journalDirectoryByVersion = Custom[Paths.JournalDirectoryByVersion](revitVersion=string_15)  # Retrieves the path of the journal directory for a given Revit version.
watch_10 = Watch(journalDirectoryByVersion)
