# Dynamo graph AllKeyboardShortcutsNodes.dyn (Dynamo 2.0.3.8810)

# group: INPUT
keyboardshortcuts_file_path = Filename("C:\Users\adieckmann\Desktop\KeyboardShortcuts.xml")  # graph input

# group: KeyboardShortcuts.Create
byPath = Custom[KeyboardShortcuts.ByPath](path=keyboardshortcuts_file_path)  # Creates a queryable object from the content of a Revit KeyboardShortcuts.xml file

# group: KeyboardShortcuts.Query
commands = Custom[KeyboardShortcuts.Commands](keyboardShortcuts=byPath)  # Returns all commands from a given KeyboardShirtcuts object
commandCountWithShortcuts = Custom[KeyboardShortcuts.CommandCountWithShortcuts](keyboardShortcuts=byPath)  # Returns the total number of commands that have a shortcut assigned in a given KeyboardShirtcuts object
commandCount = Custom[KeyboardShortcuts.CommandCount](keyboardShortcuts=byPath)  # Returns the total number of commands in a given KeyboardShirtcuts object

# group: KeyboardShortcutCommand.Query
hasPaths = Custom[KeyboardShortcutCommand.HasPaths](keyboardShortcutCommand=commands)  # Returns whether a given command has any paths assigned
hasShortcuts = Custom[KeyboardShortcutCommand.HasShortcuts](keyboardShortcutCommand=commands)  # Returns whether a given command has any shortcuts assigned
name = Custom[KeyboardShortcutCommand.Name](keyboardShortcutCommand=commands)  # Returns the name of a given command
paths = Custom[KeyboardShortcutCommand.Paths](keyboardShortcutCommand=commands)  # Returns all paths assigned to a given command
shortcuts = Custom[KeyboardShortcutCommand.Shortcuts](keyboardShortcutCommand=commands)  # Returns all shortcuts assigned to a given command
ID = Custom[KeyboardShortcutCommand.ID](keyboardShortcutCommand=commands)  # Returns the ID of a given command

# group: KeyboardShortcuts.Actions
commandsWithShortcuts = Custom[KeyboardShortcuts.CommandsWithShortcuts](keyboardShortcuts=byPath)  # Returns all commands that have a shortcut assigned from a given KeyboardShirtcuts object
commandByID = Custom[KeyboardShortcuts.CommandByID](keyboardShortcuts=byPath, commandID=ID)  # Returns the command that corresponds with the given CommandID

# group: Paths
allKeyboardShortcutFiles = Custom[Paths.AllKeyboardShortcutFiles]()  # Retrieves a list of all journal folders on the current machine
watch = Watch(allKeyboardShortcutFiles)
string = StringInput("2017")  # graph input
keyboardShortcutsFileByVersion = Custom[Paths.KeyboardShortcutsFileByVersion](revitVersion=string)  # Retrieves the path of the keyboard shortcuts file for a given Revit version.
watch_2 = Watch(keyboardShortcutsFileByVersion)
