# Dynamo graph AllWorksharingLogNodes.dyn (Dynamo 2.0.3.8810)

# group: INPUT
worksharing_log_file_path = Filename("..\..\..\Journals\Projekt1.slog")  # graph input

# group: WorksharingLog.Create
byPath = Custom[WorksharingLog.ByPath](path=worksharing_log_file_path)  # Creates a queryable object from a Revit worksharing log

# group: WorksharingLog.Query
sessions = Custom[WorksharingLog.Sessions](worksharingLog=byPath)  # Returns all sessions of a given WorksharingLog
sessionCount = Custom[WorksharingLog.SessionCount](worksharingLog=byPath)  # Returns the number of sessions recorded in a given WorksharingLog
processingTime = Custom[WorksharingLog.ProcessingTime](worksharingLog=byPath)  # Returns the amount of time it took to process the given WorksharingLog
version = Custom[WorksharingLog.Version](worksharingLog=byPath)  # Returns the version of a given WorksharingLog

# group: WorksharingSession.Actions
syncEvents = Custom[WorksharingSession.SyncEvents](worksharingSession=sessions)  # Extracts all SyncEvents from a given WorkharingSession
loadDuration = Custom[WorksharingSession.LoadDuration](worksharingSession=sessions)  # Computes the load time of the model (and all linked models) for a given WorksharingSession
wasTerminatedProperly = Custom[WorksharingSession.WasTerminatedProperly](worksharingSession=sessions)  # Determines whether a given WorksharingSession was terminated properly
hasLoadedLinks = Custom[WorksharingSession.HasLoadedLinks](worksharingSession=sessions)  # Determines if linked models were loaded in this session
loadedLinks = Custom[WorksharingSession.LoadedLinks](worksharingSession=sessions)  # Retrieves a list of loaded links from a given WorkharingSession
type = Custom[WorksharingSession.Type](worksharingSession=sessions)  # Returns the Revit build of a given WorksharingSession

# group: SyncEvent.Query
duration = Custom[SyncEvent.Duration](syncEvent=syncEvents@L2)  # Returns the duration of a given SyncEvent
end = Custom[SyncEvent.End](syncEvent=syncEvents@L2)  # Returns the date and time a given SyncEvent concluded
start = Custom[SyncEvent.Start](syncEvent=syncEvents@L2)  # Returns the date and time a given SyncEvent started
reloadLatestCount = Custom[SyncEvent.ReloadLatestCount](syncEvent=syncEvents@L2)  # Returns the number of times that Reload Latest occured during a given SyncEvent
wasAborted = Custom[SyncEvent.WasAborted](syncEvent=syncEvents@L2)  # Returns the number of times that Reload Latest occured during a given SyncEvent

# group: WorksharingSession.Query
build = Custom[WorksharingSession.Build](worksharingSession=sessions)  # Returns the Revit build of a given WorksharingSession
central = Custom[WorksharingSession.Central](worksharingSession=sessions)  # Returns the file path to the central model of a given WorksharingSession
date = Custom[WorksharingSession.Date](worksharingSession=sessions)  # Returns the date of a given WorksharingSession
end_2 = Custom[WorksharingSession.End](worksharingSession=sessions)  # Returns the date and time a given WorksharingSession was concluded
duration_2 = Custom[WorksharingSession.Duration](worksharingSession=sessions)  # Returns the total duration of a given WorksharingSession
events = Custom[WorksharingSession.Events](worksharingSession=sessions)  # Returns all recorded events of a given WorksharingSession
hostName = Custom[WorksharingSession.HostName](worksharingSession=sessions)  # Returns the host name of a given WorksharingSession
journal = Custom[WorksharingSession.Journal](worksharingSession=sessions)  # Returns the journal file path of a given WorksharingSession
serverName = Custom[WorksharingSession.ServerName](worksharingSession=sessions)  # Returns the server name of a given WorksharingSession
start_2 = Custom[WorksharingSession.Start](worksharingSession=sessions)  # Returns the date and time a given WorksharingSession was started
user = Custom[WorksharingSession.User](worksharingSession=sessions)  # Returns the Revit user name of a given WorksharingSession
version_2 = Custom[WorksharingSession.Version](worksharingSession=sessions)  # Returns the Revit version of a given WorksharingSession
ID = Custom[WorksharingSession.ID](worksharingSession=sessions)  # Returns the ID of a given WorksharingSession
hostAddress = Custom[WorksharingSession.HostAddress](worksharingSession=sessions)  # Returns the host address (IP or MAC depending on environment) of a given WorksharingSession
serverAddress = Custom[WorksharingSession.ServerAddress](worksharingSession=sessions)  # Returns the server address (IP or MAC depending on environment) of a given WorksharingSession

# group: WorksharingEvent.Query
dateTime = Custom[WorksharingEvent.DateTime](worksharingEvent=events@L2)  # Returns the date and time of a given WorksharingEvent
text = Custom[WorksharingEvent.Text](worksharingEvent=events@L2)  # Returns the logged text of a given WorksharingEvent

# group: WorksharingLog.Actions
allSessionsUseSameBuild = Custom[WorksharingLog.AllSessionsUseSameBuild](worksharingLog=byPath)  # Determines whether all sessions of a given WorksharingLog use the same Revit build
sessionByID = Custom[WorksharingLog.SessionByID](worksharingLog=byPath, sessionID=ID)  # Retrieves a WorksharingSession from a WorksharingLog based on the session ID.

# group: LoadedLink.Query
fileName = Custom[LoadedLink.FileName](loadedLink=loadedLinks)  # Returns the file name of a given loaded link
fullPath = Custom[LoadedLink.FullPath](loadedLink=loadedLinks)  # Returns the full path of a given loaded link
loadDuration_2 = Custom[LoadedLink.LoadDuration](loadedLink=loadedLinks)  # Returns the load duration of a given loaded link
loadEnd = Custom[LoadedLink.LoadEnd](loadedLink=loadedLinks)  # Returns the date and time a given loaded link completed loading
loadStart = Custom[LoadedLink.LoadStart](loadedLink=loadedLinks)  # Returns the date and time a given loaded link started loading

# group: WorksharingLog.Helpers
findSyncEventOverlaps = Custom[Helpers.FindSyncEventOverlaps](SyncEvents=syncEvents)  # Identifies groups of SyncEvents that overlap in a given WorksharingLog. Expects a list of *all* SyncEvents of *all* WorksharingSessions within a WorksharingLog.
