# Dynamo graph Journals_AllIssues.dyn (Dynamo 2.0.3.8810)

# group: INPUTS
directory_path = Directory("U:\Journals\slow network")  # graph input

# group: Create Journal objects from directory
fromPath = DirectoryObject(path=directory_path)  # "Directory.FromPath"
string = StringInput("*.txt")  # graph input
getDirectoryContents = FileSystem.GetDirectoryContents(directory=fromPath, searchString=string)
byPath = Custom[Journal.ByPath](path=getDirectoryContents.files)  # Creates a queryable object from the contents of a Revit journal file

# group: Identify journals with issues
containsAPIErrors = Custom[Journal.ContainsAPIErrors](journal=byPath)  # Computes whether a given journal contains any API errors
containsExceptions = Custom[Journal.ContainsExceptions](journal=byPath)  # Computes whether a given journal contains any exceptions
sessionTerminatedProperly = Custom[Journal.SessionTerminatedProperly](journal=byPath)  # Computes whether the Revit session of the given journal was terminated properly
not_ = Not(x=sessionTerminatedProperly)
create = List.Create(item0=containsAPIErrors, item1=containsExceptions, item2=not_)
transpose = List.Transpose(lists=create)
anyTrue = Custom[List.AnyTrue](seq=transpose@L2)  # Returns true if any item in a list of booleans is true.
filterByBoolMask = List.FilterByBoolMask(list=getDirectoryContents.files, mask=anyTrue)

# group: OUTPUTS
journals_with_issues = Watch(filterByBoolMask.in)
