# Dynamo graph Journals_HealthCheck.dyn (Dynamo 2.12.0.5650)
# packages: Journalysis for Dynamo 2.x 0.9.0, LunchBox for Dynamo 2018.7.6, Clockwork for Dynamo 2.x 2.4.0

# group: Inputs
directory_path_target = Directory("C:\temp")  # graph input
filename_sheetname = StringInput("JournalHealthCheck")  # graph input
directory_path_source = Directory("U:\Projekte_Dynamo\Journals")  # graph input
process_subdirectories = BoolSelector(false)

# group: Read source directory
directory_from_path = DirectoryObject(path=directory_path_source)
string = StringInput("*.txt")  # graph input
getDirectoryContents = FileSystem.GetDirectoryContents(directory=directory_from_path, searchString=string, includeSubdirectories=process_subdirectories)
fromPath = FileObject(path=getDirectoryContents.files)  # "File.FromPath"

byPath = Custom[Journal.ByPath](path=getDirectoryContents.files)  # package Journalysis for Dynamo 2.x; Creates a queryable object from the contents of a Revit journal file

# group: Pull relevant meta data
revitBranch = Custom[Journal.RevitBranch](journal=byPath)  # package Journalysis for Dynamo 2.x; Returns the Revit branch from a given journal
revitBuild = Custom[Journal.RevitBuild](journal=byPath)  # package Journalysis for Dynamo 2.x; Returns the Revit build from a given journal
revitVersion = Custom[Journal.RevitVersion](journal=byPath)  # package Journalysis for Dynamo 2.x; Returns the Revit version from a given journal
startupTime = Custom[Journal.StartupTime](journal=byPath)  # package Journalysis for Dynamo 2.x; Computes the time it took Revit to display the startup screen based on the given journal
sessionTerminatedProperly = Custom[Journal.SessionTerminatedProperly](journal=byPath)  # package Journalysis for Dynamo 2.x; Computes whether the Revit session of the given journal was terminated properly
sessionTime = Custom[Journal.SessionTime](journal=byPath)  # package Journalysis for Dynamo 2.x; Computes the entire Revit session time based on the given journal
processingTime = Custom[Journal.ProcessingTime](journal=byPath)  # package Journalysis for Dynamo 2.x; Returns the time it took the Journal.ByString node to process a given journal
user = Custom[Journal.User](journal=byPath)  # package Journalysis for Dynamo 2.x; Returns the Revit user name from a given journal
isInPlaybackMode = Custom[Journal.IsInPlaybackMode](journal=byPath)  # package Journalysis for Dynamo 2.x; Computes whether a given journal is in playback mode
playbackInterrupted = Custom[Journal.PlaybackInterrupted](journal=byPath)  # package Journalysis for Dynamo 2.x; Computes whether playback was interrupted for the given journal
OSVersion = Custom[Journal.OSVersion](journal=byPath)  # package Journalysis for Dynamo 2.x; Returns the Windows version from a given journal
minVMAvailable = Custom[Journal.MinVMAvailable](journal=byPath)  # package Journalysis for Dynamo 2.x; Computes the minimum VM available during a Revit session based on the given journal
minRAMAvailable = Custom[Journal.MinRAMAvailable](journal=byPath)  # package Journalysis for Dynamo 2.x; Computes the minimum RAM available during a Revit session based on the given journal
maxVMPeak = Custom[Journal.MaxVMPeak](journal=byPath)  # package Journalysis for Dynamo 2.x; Computes the maximum VM used during a Revit session based on the given journal
maxRAMPeak = Custom[Journal.MaxRAMPeak](journal=byPath)  # package Journalysis for Dynamo 2.x; Computes the maximum RAM used during a Revit session based on the given journal
machine = Custom[Journal.Machine](journal=byPath)  # package Journalysis for Dynamo 2.x; Returns the computer name from a given journal
containsExceptions = Custom[Journal.ContainsExceptions](journal=byPath)  # package Journalysis for Dynamo 2.x; Computes whether a given journal contains any exceptions
containsAPIErrors = Custom[Journal.ContainsAPIErrors](journal=byPath)  # package Journalysis for Dynamo 2.x; Computes whether a given journal contains any API errors
size = Custom[File.Size](file=fromPath)  # package Clockwork for Dynamo 2.x; Returns the file size of a given file.
create = List.Create(item0=getDirectoryContents.files, item1=revitBranch, item2=revitBuild, item3=revitVersion, item4=startupTime, item5=sessionTerminatedProperly, item6=sessionTime, item7=processingTime, item8=user, item9=isInPlaybackMode, item10=playbackInterrupted, item11=OSVersion, item12=minVMAvailable, item13=minRAMAvailable, item14=maxVMPeak, item15=maxRAMPeak, item16=machine, item17=containsExceptions, item18=containsAPIErrors, item19=size.megabytes)

# group: Process data for export
string_2 = StringInput("")  # graph input
replaceNulls = Lists.Manage.ReplaceNulls(Data=create, ReplaceWith=string_2)
type = Object.Type(object=replaceNulls)
code_block = CodeBlock(obj=type) { obj == "System.String"; }
string_from_object = FromObject(obj=replaceNulls)
if_ = If(test=code_block, true=replaceNulls, false=string_from_object)

# group: Create headings and add data
string_3 = StringInput("""JournalPath
RevitBranch
RevitBuild
RevitVersion
StartupTime
SessionTerminatedProperly
SessionTime
ProcessingTime
User
IsInPlaybackMode
PlaybackInterrupted
OSVersion
MinVMAvailable
MinRAMAvailable
MaxVMPeak
MaxRAMPeak
Machine
ContainsExceptions
ContainsAPIErrors
FileSize""")  # graph input
string_4 = StringInput("\n")  # graph input
split = String.Split(string=string_3, separator0=string_4)
create_2 = List.Create(item0=split)
transpose = List.Transpose(lists=if_)
join = List.Join(list0=create_2, list1=transpose)

# group: Write to Excel
combinePath = FileSystem.CombinePath(string0=directory_path_target, string1=filename_sheetname)
code_block_2 = CodeBlock(filename=combinePath) { filename + ".xlsx"; }
code_block_3 = CodeBlock { 0; }
boolean = BoolSelector(true)  # graph input
exportToExcel = Data.ExportToExcel(filePath=code_block_2, sheetName=filename_sheetname, startRow=code_block_3, startColumn=code_block_3, data=join, overWrite=boolean)
