# Dynamo graph Journals_PythonExamples.dyn (Dynamo 2.0.3.8810)

# group: INPUT
# note: This sample shows how you can achieve the same goal using nodes or Python code.
file_path = Filename("..\..\..\Journals\Journals\journal.0140.txt")  # graph input

# group: Evaluate Journal
byPath = Custom[Journal.ByPath](path=file_path)  # Creates a queryable object from the contents of a Revit journal file

# group: Extract unique list of API error messages
string = StringInput("JournalAPIMessage")  # graph input
string_2 = StringInput("MessageType")  # graph input
string_3 = StringInput("Error")  # graph input
getLinesByTypeAndProperty = Custom[Journal.GetLinesByTypeAndProperty](journal=byPath, journalLineType=string, property=string_2, value=string_3)
text = Custom[JournalAPIMessage.Text](journalAPIMessage=getLinesByTypeAndProperty)
uniqueItems = List.UniqueItems(list=text)
watch = Watch(uniqueItems)
string_4 = StringInput("""import clr

OUT = []
if IN[0].__repr__() == 'Journal':
	OUT = set([x.MessageText for x in IN[0].GetLinesByTypeAndProperty('JournalAPIMessage', 'MessageType', 'Error')])""")  # graph input
python_script_from_string = PythonStringNode(script=string_4, IN[0]=byPath)
watch_2 = Watch(python_script_from_string)

# group: Extract unique list of commands triggered by a keyboard shortcut
string_5 = StringInput("JournalCommand")  # graph input
string_6 = StringInput("CommandType")  # graph input
string_7 = StringInput("KeyboardShortcut")  # graph input
getLinesByTypeAndProperty_2 = Custom[Journal.GetLinesByTypeAndProperty](journal=byPath, journalLineType=string_5, property=string_6, value=string_7)
ID = Custom[JournalCommand.ID](journalCommand=getLinesByTypeAndProperty_2)
uniqueItems_2 = List.UniqueItems(list=ID)
watch_3 = Watch(uniqueItems_2)
string_8 = StringInput("""import clr

OUT = []
if IN[0].__repr__() == 'Journal':
	OUT = set([x.CommandID for x in IN[0].GetLinesByTypeAndProperty('JournalCommand', 'CommandType', 'KeyboardShortcut')])""")  # graph input
python_script_from_string_2 = PythonStringNode(script=string_8, IN[0]=byPath)
watch_4 = Watch(python_script_from_string_2)
