# Dynamo graph WorksharingLogs_AllSessions.dyn (Dynamo 2.0.3.8810)

# group: INPUT
directory_path_report = Directory("C:\temp")  # graph input
filename = StringInput("WorksharingSessions")  # graph input
directory_path_log_directory = Directory("U:\Journals\SLOG\long_syncs")  # graph input

# group: Process files
fromPath = DirectoryObject(path=directory_path_log_directory)  # "Directory.FromPath"
getDirectoryContents = FileSystem.GetDirectoryContents(directory=fromPath)
byPath = Custom[WorksharingLog.ByPath](path=getDirectoryContents.files)  # Creates a queryable object from a Revit worksharing log
sessions = Custom[WorksharingLog.Sessions](worksharingLog=byPath)  # Returns all sessions of a given WorksharingLog
flatten = List.Flatten(list=sessions)

# group: Collect data
central = Custom[WorksharingSession.Central](worksharingSession=flatten)  # Returns the file path to the central model of a given WorksharingSession
boolean = BoolSelector(false)  # graph input
fileName = FileSystem.FileName(path=central, withExtension=boolean)
ID = Custom[WorksharingSession.ID](worksharingSession=flatten)  # Returns the ID of a given WorksharingSession
start = Custom[WorksharingSession.Start](worksharingSession=flatten)  # Returns the date and time a given WorksharingSession was started
user = Custom[WorksharingSession.User](worksharingSession=flatten)  # Returns the Revit user name of a given WorksharingSession
usesCentralModel = Custom[WorksharingSession.UsesCentralModel](worksharingSession=flatten)  # Determines if the user was working in the central model (as opposed to a local copy) in a given WorksharingSession
createsNewCentral = Custom[WorksharingSession.CreatesNewCentral](worksharingSession=flatten)  # Determines if a new central model was created in a given WorksharingSession
wasTerminatedProperly = Custom[WorksharingSession.WasTerminatedProperly](worksharingSession=flatten)  # Determines whether a given WorksharingSession was terminated properly
loadDuration = Custom[WorksharingSession.LoadDuration](worksharingSession=flatten)  # Computes the load time of the model (and all linked models) for a given WorksharingSession
totalSeconds = TimeSpan.TotalSeconds(timeSpan=loadDuration)
string = StringInput("")  # graph input
replaceNull = Custom[List.ReplaceNull](seq=totalSeconds, replacement=string)  # Replaces all null values within a given list with a substitute
loadedLinks = Custom[WorksharingSession.LoadedLinks](worksharingSession=flatten)  # Retrieves a list of loaded links from a given WorkharingSession
count = List.Count(list=loadedLinks@L2)
hostName = Custom[WorksharingSession.HostName](worksharingSession=flatten)  # Returns the host name of a given WorksharingSession
duration = Custom[WorksharingSession.Duration](worksharingSession=flatten)  # Returns the total duration of a given WorksharingSession
totalSeconds_2 = TimeSpan.TotalSeconds(timeSpan=duration)
string_2 = StringInput("")  # graph input
replaceNull_2 = Custom[List.ReplaceNull](seq=totalSeconds_2, replacement=string_2)
loadedLinks_2 = Custom[WorksharingSession.LoadedLinks](worksharingSession=flatten)
count_2 = List.Count(list=loadedLinks_2@L2)
loadDuration_2 = Custom[LoadedLink.LoadDuration](loadedLink=loadedLinks_2@L2)  # Returns the load duration of a given loaded link
totalSeconds_3 = TimeSpan.TotalSeconds(timeSpan=loadDuration_2)
sum = Math.Sum(values=totalSeconds_3)
create = List.Create(item0=fileName, item1=ID, item2=start, item3=user, item4=usesCentralModel, item5=createsNewCentral, item6=wasTerminatedProperly, item7=replaceNull, item8=count, item9=hostName, item10=replaceNull_2, item11=count_2, item12=sum)
hasLoadedLinks = Custom[WorksharingSession.HasLoadedLinks](worksharingSession=flatten)  # Determines if linked models were loaded in this session

# group: Export to Excel
code_block = CodeBlock(filename=filename) { filename + ".csv"; }
combinePath = FileSystem.CombinePath(path0=directory_path_report, path1=code_block)
string_3 = StringInput("Sessions")  # graph input
code_block_2 = CodeBlock { 0; }
string_4 = StringInput("""Model
SessionID
SessionStarted
Username
WorkingInCentral
CreatingNewCentral
SessionTerminatedProperly
LoadDuration
NumberOfSyncs
Machine
SessionDuration
LoadedLinks
LinkLoadTime""")  # graph input
string_5 = StringInput("\n")  # graph input
split = String.Split(str=string_4, separater0=string_5)
create_2 = List.Create(item0=split)
transpose = List.Transpose(lists=create)
join = List.Join(list0=create_2, list1=transpose)
boolean_2 = BoolSelector(true)  # graph input
exportExcel = Data.ExportExcel(filePath=combinePath, sheetName=string_3, startRow=code_block_2, startCol=code_block_2, data=join, overWrite=boolean_2)
