# Dynamo graph AllJournalNodes.dyn (Dynamo 3.3.0.6316)
# author: Andreas Dieckmann
# Sample graph for all journal nodes
# packages: Journalysis for Dynamo 2.x 2.4.0, Journalysis for Dynamo 3.x 3.2.1

# group: INPUT
journal_file_path = Filename("..\..\..\..\..\..\AppData\Local\Autodesk\Revit\Autodesk Revit 2025\Journals\journal.0058.txt")  # graph input

# group: Journal.Create
byPath = Custom[Journal.ByPath](path=journal_file_path)  # package Journalysis for Dynamo 2.x; Creates a queryable object from the contents of a Revit journal file

# group: Journal.Query
user = Custom[Journal.User](journal=byPath)  # package Journalysis for Dynamo 2.x; Returns the Revit user name from a given journal
lineCount = Custom[Journal.LineCount](journal=byPath)  # package Journalysis for Dynamo 2.x; Returns the number of lines in a given journal
blockCount = Custom[Journal.BlockCount](journal=byPath)  # package Journalysis for Dynamo 2.x; Returns the number of blocks in a given journal
lines = Custom[Journal.Lines](journal=byPath)  # package Journalysis for Dynamo 2.x; Returns all lines of a given journal
path = Custom[Journal.Path](journal=byPath)  # package Journalysis for Dynamo 2.x; Returns the original path of a given journal
processingTime = Custom[Journal.ProcessingTime](journal=byPath)  # package Journalysis for Dynamo 2.x; Returns the time it took the Journal.ByString node to process a given journal
revitBuild = Custom[Journal.RevitBuild](journal=byPath)  # package Journalysis for Dynamo 2.x; Returns the Revit build from a given journal
revitBranch = Custom[Journal.RevitBranch](journal=byPath)  # package Journalysis for Dynamo 2.x; Returns the Revit branch from a given journal
revitVersion = Custom[Journal.RevitVersion](journal=byPath)  # package Journalysis for Dynamo 2.x; Returns the Revit version from a given journal
OSVersion = Custom[Journal.OSVersion](journal=byPath)  # package Journalysis for Dynamo 2.x; Returns the Windows version from a given journal
machine = Custom[Journal.Machine](journal=byPath)  # package Journalysis for Dynamo 2.x; Returns the computer name from a given journal
date = Custom[Journal.Date](journal=byPath)  # package Journalysis for Dynamo 2.x; Computes the date of a given journal
revitRelease = Custom[Journal.RevitRelease](journal=byPath)  # package Journalysis for Dynamo 3.x; Returns the Revit release from a given journal

# group: Test Inputs
code_block = CodeBlock { ["JournalData","JournalDirective"]; "JournalTimeStamp"; "Description"; "idle0_doc"; 30..34; 30; 2018; 3; 9; 11; }
boolean = BoolSelector(true)  # graph input
byDateAndTime = DateTime.ByDateAndTime(year=code_block.out6, month=code_block.out7, day=code_block.out8, hour=code_block.out9)

# group: Journal.Actions
linesByType = Custom[Journal.LinesByType](journal=byPath, journalLineType=code_block.out1)  # package Journalysis for Dynamo 2.x; Retrieves all JournalLines of a given type from a given journal
linesByBlock = Custom[Journal.LinesByBlock](journal=byPath, journalBlock=code_block.out4)  # package Journalysis for Dynamo 2.x; Retrieves all JournalLines of a given block from a given journal
sessionTime = Custom[Journal.SessionTime](journal=byPath)  # package Journalysis for Dynamo 2.x; Computes the entire Revit session time based on the given journal
startupTime = Custom[Journal.StartupTime](journal=byPath)  # package Journalysis for Dynamo 2.x; Computes the time it took Revit to display the startup screen based on the given journal
sessionTerminatedProperly = Custom[Journal.SessionTerminatedProperly](journal=byPath)  # package Journalysis for Dynamo 2.x; Computes whether the Revit session of the given journal was terminated properly
isInPlaybackMode = Custom[Journal.IsInPlaybackMode](journal=byPath)  # package Journalysis for Dynamo 2.x; Computes whether a given journal is in playback mode
playbackInterrupted = Custom[Journal.PlaybackInterrupted](journal=byPath)  # package Journalysis for Dynamo 2.x; Computes whether playback was interrupted for the given journal
containsAPIErrors = Custom[Journal.ContainsAPIErrors](journal=byPath)  # package Journalysis for Dynamo 2.x; Computes whether a given journal contains any API errors
containsExceptions = Custom[Journal.ContainsExceptions](journal=byPath)  # package Journalysis for Dynamo 2.x; Computes whether a given journal contains any exceptions
maxRAMPeak = Custom[Journal.MaxRAMPeak](journal=byPath)  # package Journalysis for Dynamo 2.x; Computes the maximum RAM used during a Revit session based on the given journal
maxVMPeak = Custom[Journal.MaxVMPeak](journal=byPath)  # package Journalysis for Dynamo 2.x; Computes the maximum VM used during a Revit session based on the given journal
minRAMAvailable = Custom[Journal.MinRAMAvailable](journal=byPath)  # package Journalysis for Dynamo 2.x; Computes the minimum RAM available during a Revit session based on the given journal
minVMAvailable = Custom[Journal.MinVMAvailable](journal=byPath)  # package Journalysis for Dynamo 2.x; Computes the minimum VM available during a Revit session based on the given journal
linesByTypeAndProperty = Custom[Journal.LinesByTypeAndProperty](journal=byPath, journalLineType=code_block.out1, property=code_block.out2, value=code_block.out3)  # package Journalysis for Dynamo 2.x; Retrieves all JournalLines of a given type from a given journal, pre-filtered by a property value
dateTimeByBlock = Custom[Journal.DateTimeByBlock](journal=byPath, journalBlock=code_block.out4)  # package Journalysis for Dynamo 2.x; Retrieves the DateTime of a given block from a given journal
stripComments = Custom[Journal.StripComments](journal=byPath, preserveTimestamps=boolean)  # package Journalysis for Dynamo 2.x; Strips all comments from the original journal string and only returns all (re-formatted) lines that are potentially relevant for journal playback.
loadedModels = Custom[Journal.LoadedModels](journal=byPath)  # package Journalysis for Dynamo 2.x; Retrieves a list of all models loaded during a given Revit session
date_2 = Custom[Journal.Date](journal=byPath)
loadedAssemblies = Custom[Journal.LoadedAssemblies](journal=byPath)  # package Journalysis for Dynamo 2.x; Pulls a list of all loaded assemblies (i.e. addin DLLs) from a given journal
linesByDateTime = Custom[Journal.LinesByDateTime](journal=byPath, fromDateTime=byDateAndTime)  # package Journalysis for Dynamo 2.x; Retrieves all lines of a given journal that fall in a given time window. At least one DateTime needs to be given (from or to).
lastLines = Custom[Journal.LastLines](journal=byPath, numberOfLines=code_block.out5)  # package Journalysis for Dynamo 2.x; Gets the last N lines of a given journal (faster than OOTB list operations).
firstLines = Custom[Journal.FirstLines](journal=byPath, numberOfLines=code_block.out5)  # package Journalysis for Dynamo 2.x; Gets the first N lines of a given journal (faster than OOTB list operations).
exceptions = Custom[Journal.Exceptions](journal=byPath)  # package Journalysis for Dynamo 2.x; Retrieves all Journal lines that make reference to exceptions

# group: JournalLine.Query
number = Custom[JournalLine.Number](journalLine=lines)  # package Journalysis for Dynamo 2.x; Returns the line number of a given journal line
type = Custom[JournalLine.Type](journalLine=lines)  # package Journalysis for Dynamo 2.x; Returns the type of a given journal line
block = Custom[JournalLine.Block](journalLine=lines)  # package Journalysis for Dynamo 2.x; Returns the block number of a given journal line
rawText = Custom[JournalLine.RawText](journalLine=lines)  # package Journalysis for Dynamo 2.x; Returns the raw text of a given journal line

# group: Helpers
allJournalLineTypes = Custom[Helpers.AllJournalLineTypes]()  # package Journalysis for Dynamo 2.x; Lists all JournalLine types
watch = Watch(allJournalLineTypes)
allJournalAPIMessageTypes = Custom[Helpers.AllJournalAPIMessageTypes]()  # package Journalysis for Dynamo 2.x; Lists all JournalAPIMessage types
watch_2 = Watch(allJournalAPIMessageTypes)
allJournalCommandTypes = Custom[Helpers.AllJournalCommandTypes]()  # package Journalysis for Dynamo 2.x; Lists all known JournalCommand types
watch_3 = Watch(allJournalCommandTypes)
allJournalMouseEventTypes = Custom[Helpers.AllJournalMouseEventTypes]()  # package Journalysis for Dynamo 2.x; Lists all JournalMouseEvent types
watch_4 = Watch(allJournalMouseEventTypes)
allJournalTimeStampTypes = Custom[Helpers.AllJournalTimeStampTypes]()  # package Journalysis for Dynamo 2.x; Lists all JournalTimeStamp types
watch_5 = Watch(allJournalTimeStampTypes)
allJournalUIEventTypes = Custom[Helpers.AllJournalUIEventTypes]()  # package Journalysis for Dynamo 2.x; Lists all JournalUIEvent types
watch_6 = Watch(allJournalUIEventTypes)
allLoadedModelEventTypes = Custom[Helpers.AllLoadedModelEventTypes]()  # package Journalysis for Dynamo 2.x; Lists all LoadedModelEvent types
watch_7 = Watch(allLoadedModelEventTypes)

watch_8 = Watch(byPath)

# group: JournalAPIMessage.Query
string = StringInput("JournalAPIMessage")  # graph input
linesByType_2 = Custom[Journal.LinesByType](journal=watch_8, journalLineType=string)
text = Custom[JournalAPIMessage.Text](journalAPIMessage=linesByType_2)  # package Journalysis for Dynamo 2.x; Returns the text from an APIMessage line
type_2 = Custom[JournalAPIMessage.Type](journalAPIMessage=linesByType_2)  # package Journalysis for Dynamo 2.x; Returns the type of an APIMessage line
isError = Custom[JournalAPIMessage.IsError](journalAPIMessage=linesByType_2)  # package Journalysis for Dynamo 2.x; Returns whether an APIMessage reports an error

# group: JournalCommand.Query
string_2 = StringInput("JournalCommand")  # graph input
linesByType_3 = Custom[Journal.LinesByType](journal=watch_8, journalLineType=string_2)
type_3 = Custom[JournalCommand.Type](journalCommand=linesByType_3)  # package Journalysis for Dynamo 2.x; Returns the type of a JournalCommand line
description = Custom[JournalCommand.Description](journalCommand=linesByType_3)  # package Journalysis for Dynamo 2.x; Returns the description of a JournalCommand line
ID = Custom[JournalCommand.ID](journalCommand=linesByType_3)  # package Journalysis for Dynamo 2.x; Returns the command ID of a JournalCommand line

# group: JournalAddinEvent.Query
string_3 = StringInput("JournalAddinEvent")  # graph input
linesByType_4 = Custom[Journal.LinesByType](journal=watch_8, journalLineType=string_3)
text_2 = Custom[JournalAddinEvent.Text](journalAddinEvent=linesByType_4)  # package Journalysis for Dynamo 2.x; Returns the text from an AddinEvent line

# group: JournalData.Query
string_4 = StringInput("JournalData")  # graph input
linesByType_5 = Custom[Journal.LinesByType](journal=watch_8, journalLineType=string_4)
key = Custom[JournalData.Key](journalData=linesByType_5)  # package Journalysis for Dynamo 2.x; Returns the key of a JournalData line
values = Custom[JournalData.Values](journalData=linesByType_5)  # package Journalysis for Dynamo 2.x; Returns the values from a JournalData line

# group: JournalDirective.Query
string_5 = StringInput("JournalDirective")  # graph input
linesByType_6 = Custom[Journal.LinesByType](journal=watch_8, journalLineType=string_5)
key_2 = Custom[JournalDirective.Key](journalDirective=linesByType_6)  # package Journalysis for Dynamo 2.x; Returns the key of a JournalDirective line
values_2 = Custom[JournalDirective.Values](journalDirective=linesByType_6)  # package Journalysis for Dynamo 2.x; Returns the values from a JournalDirective line

# group: JournalGUIResourceUsage.Query
string_6 = StringInput("JournalGUIResourceUsage")  # graph input
linesByType_7 = Custom[Journal.LinesByType](journal=watch_8, journalLineType=string_6)
available = Custom[JournalGUIResourceUsage.Available](journalGUIResourceUsage=linesByType_7)  # package Journalysis for Dynamo 2.x
used = Custom[JournalGUIResourceUsage.Used](journalGUIResourceUsage=linesByType_7)  # package Journalysis for Dynamo 2.x
user_2 = Custom[JournalGUIResourceUsage.User](journalGUIResourceUsage=linesByType_7)  # package Journalysis for Dynamo 2.x

# group: JournalKeyboardEvent.Query
string_7 = StringInput("JournalKeyboardEvent")  # graph input
linesByType_8 = Custom[Journal.LinesByType](journal=watch_8, journalLineType=string_7)
key_3 = Custom[JournalKeyboardEvent.Key](journalKeyboardEvent=linesByType_8)  # package Journalysis for Dynamo 2.x; Returns the pressed key of a KeyboardEvent line

# group: JournalMemoryMetrics.Query
string_8 = StringInput("JournalMemoryMetrics")  # graph input
linesByType_9 = Custom[Journal.LinesByType](journal=watch_8, journalLineType=string_8)
VMAvailable = Custom[JournalMemoryMetrics.VMAvailable](journalMemoryMetrics=linesByType_9)  # package Journalysis for Dynamo 2.x; Returns the available VM of a MemoryMetrics line
VMUsed = Custom[JournalMemoryMetrics.VMUsed](journalMemoryMetrics=linesByType_9)  # package Journalysis for Dynamo 2.x; Returns the used VM of a MemoryMetrics line
VMPeak = Custom[JournalMemoryMetrics.VMPeak](journalMemoryMetrics=linesByType_9)  # package Journalysis for Dynamo 2.x; Returns the peak VM of a MemoryMetrics line
RAMAvailable = Custom[JournalMemoryMetrics.RAMAvailable](journalMemoryMetrics=linesByType_9)  # package Journalysis for Dynamo 2.x; Returns the available RAM of a MemoryMetrics line
RAMUsed = Custom[JournalMemoryMetrics.RAMUsed](journalMemoryMetrics=linesByType_9)  # package Journalysis for Dynamo 2.x; Returns the used RAM of a MemoryMetrics line
RAMPeak = Custom[JournalMemoryMetrics.RAMPeak](journalMemoryMetrics=linesByType_9)  # package Journalysis for Dynamo 2.x; Returns the peak RAM of a MemoryMetrics line

# group: JournalMouseEvent.Query
string_9 = StringInput("JournalMouseEvent")  # graph input
linesByType_10 = Custom[Journal.LinesByType](journal=watch_8, journalLineType=string_9)
type_4 = Custom[JournalMouseEvent.Type](journalMouseEvent=linesByType_10)  # package Journalysis for Dynamo 2.x; Returns the type of a MouseEvent line
data = Custom[JournalMouseEvent.Data](journalMouseEvent=linesByType_10)  # package Journalysis for Dynamo 2.x; Returns the data from a MouseEvent line

# group: JournalTimeStamp.Query
string_10 = StringInput("JournalTimeStamp")  # graph input
linesByType_11 = Custom[Journal.LinesByType](journal=watch_8, journalLineType=string_10)
type_5 = Custom[JournalTimeStamp.Type](journalTimeStamp=linesByType_11)  # package Journalysis for Dynamo 2.x; Returns the type of a TimeStamp line
dateTime = Custom[JournalTimeStamp.DateTime](journalTimeStamp=linesByType_11)  # package Journalysis for Dynamo 2.x; Returns the date and time of a TimeStamp line
description_2 = Custom[JournalTimeStamp.Description](journalTimeStamp=linesByType_11)  # package Journalysis for Dynamo 2.x; Returns the description of a TimeStamp line
debugInfoType = Custom[JournalTimeStamp.DebugInfoType](journalTimeStamp=linesByType_11)  # package Journalysis for Dynamo 2.x; Returns the debug information type (error, warning or info) if any.

# group: JournalUIEvent.Query
string_11 = StringInput("JournalUIEvent")  # graph input
linesByType_12 = Custom[Journal.LinesByType](journal=watch_8, journalLineType=string_11)
type_6 = Custom[JournalUIEvent.Type](journalUIEvent=linesByType_12)  # package Journalysis for Dynamo 2.x; Returns the type of a UIEvent line
data_2 = Custom[JournalUIEvent.Data](journalUIEvent=linesByType_12)  # package Journalysis for Dynamo 2.x; Returns the data from a UIEvent line

# group: Test Inputs
code_block_2 = CodeBlock { 4; }
getItemAtIndex = List.GetItemAtIndex(list=lines, index=code_block_2)
count = List.Count(list=lines)
code_block_3 = CodeBlock(n=count) { n-5; }
getItemAtIndex_2 = List.GetItemAtIndex(list=lines, index=code_block_3)
code_block_4 = CodeBlock { "JournalCommand"; "CommandID"; "ID_REVIT_FILE_OPEN"; }

# group: JournalLine.Actions
next = Custom[JournalLine.Next](journalLine=getItemAtIndex)  # package Journalysis for Dynamo 2.x; Retrieves the next line after the given line
previous = Custom[JournalLine.Previous](journalLine=getItemAtIndex_2)  # package Journalysis for Dynamo 2.x; Retrieves the previous line before the given line
allNext = Custom[JournalLine.AllNext](journalLine=getItemAtIndex)  # package Journalysis for Dynamo 2.x; Retrieves all lines after the given line from the journal
allPrevious = Custom[JournalLine.AllPrevious](journalLine=getItemAtIndex_2)  # package Journalysis for Dynamo 2.x; Retrieves all lines before the given line from the journal
allNextOfType = Custom[JournalLine.AllNextOfType](journalLine=getItemAtIndex, journalLineType=code_block_4.out0)  # package Journalysis for Dynamo 2.x; Retrieves all lines of a given type after the given line from the journal
allNextOfTypeAndProperty = Custom[JournalLine.AllNextOfTypeAndProperty](journalLine=getItemAtIndex, journalLineType=code_block_4.out0, property=code_block_4.out1, value=code_block_4.out2)  # package Journalysis for Dynamo 2.x; Retrieves all lines of a given type and property value after the given line from the journal
allPreviousOfType = Custom[JournalLine.AllPreviousOfType](journalLine=getItemAtIndex_2, journalLineType=code_block_4.out0)  # package Journalysis for Dynamo 2.x; Retrieves all lines of a given type before the given line from the journal
allPreviousOfTypeAndProperty = Custom[JournalLine.AllPreviousOfTypeAndProperty](journalLine=getItemAtIndex_2, journalLineType=code_block_4.out0, property=code_block_4.out1, value=code_block_4.out2)  # package Journalysis for Dynamo 2.x; Retrieves all lines of a given type and property value before the given line from the journal
nextOfType = Custom[JournalLine.NextOfType](journalLine=getItemAtIndex, journalLineType=code_block_4.out0)  # package Journalysis for Dynamo 2.x; Retrieves the next line of a given type after the given line from the journal
nextOfTypeAndProperty = Custom[JournalLine.NextOfTypeAndProperty](journalLine=getItemAtIndex, journalLineType=code_block_4.out0, property=code_block_4.out1, value=code_block_4.out2)  # package Journalysis for Dynamo 2.x; Retrieve the next line of a given type and property value after the given line from the journal
previousOfType = Custom[JournalLine.PreviousOfType](journalLine=getItemAtIndex_2, journalLineType=code_block_4.out0)  # package Journalysis for Dynamo 2.x; Retrieves the previous line of a given type before the given line from the journal
previousOfTypeAndProperty = Custom[JournalLine.PreviousOfTypeAndProperty](journalLine=getItemAtIndex_2, journalLineType=code_block_4.out0, property=code_block_4.out1, value=code_block_4.out2)  # package Journalysis for Dynamo 2.x; Retrieves the previous line of a given type and property value before the given line from the journal
dateTimeOfBlock = Custom[JournalLine.DateTimeOfBlock](journalLine=getItemAtIndex_2)  # package Journalysis for Dynamo 2.x; Retrieves the date and time of the block of a given JournalLine

# group: LoadedModel.Query
events = Custom[LoadedModel.Events](loadedModel=loadedModels)  # package Journalysis for Dynamo 2.x; Returns all events associated with a loaded model
path_2 = Custom[LoadedModel.Path](loadedModel=loadedModels)  # package Journalysis for Dynamo 2.x; Returns the Rpath of a loaded model
fileName = FileSystem.FileName(path=path_2)

# group: LoadedModelEvent.Query
type_7 = Custom[LoadedModelEvent.Type](loadedModelEvent=events@L2)  # package Journalysis for Dynamo 2.x; Returns the type of a given LoadedModelEvent
dateTime_2 = Custom[LoadedModelEvent.DateTime](loadedModelEvent=events@L2)  # package Journalysis for Dynamo 2.x; Returns the date and time of a given LoadedModelEvent
journalLine = Custom[LoadedModelEvent.JournalLine](loadedModelEvent=events)  # package Journalysis for Dynamo 2.x; Returns the JournalLIne of a given LoadedModelEvent

# group: LoadedModel.Actions
version = Custom[LoadedModel.Version](loadedModel=loadedModels)  # package Journalysis for Dynamo 2.x; Retrieves the version of a loaded model
versionHistory = Custom[LoadedModel.VersionHistory](loadedModel=loadedModels)  # package Journalysis for Dynamo 2.x; Retrieves the version history of a loaded model

# group: JournalBasicFileInfo.Query
string_12 = StringInput("JournalBasicFileInfo")  # graph input
linesByType_13 = Custom[Journal.LinesByType](journal=watch_8, journalLineType=string_12)
centralModelPath = Custom[JournalBasicFileInfo.CentralModelPath](journalBasicFileInfo=linesByType_13)  # package Journalysis for Dynamo 2.x; Returns the central model path from a BasicFileInfo line
lastSavePath = Custom[JournalBasicFileInfo.LastSavePath](journalBasicFileInfo=linesByType_13)  # package Journalysis for Dynamo 2.x; Returns the last save path from a BasicFileInfo line
locale = Custom[JournalBasicFileInfo.Locale](journalBasicFileInfo=linesByType_13)  # package Journalysis for Dynamo 2.x; Returns the locale a model was saved in from a BasicFileInfo line
worksharing = Custom[JournalBasicFileInfo.Worksharing](journalBasicFileInfo=linesByType_13)  # package Journalysis for Dynamo 2.x; Returns the worksharing status from a BasicFileInfo line
fileName_2 = Custom[JournalBasicFileInfo.FileName](journalBasicFileInfo=linesByType_13)  # package Journalysis for Dynamo 2.x; Returns the file name from the last save path of a BasicFileInfo line

# group: LoadedAssembly.Query
class_ = Custom[LoadedAssembly.Class](loadedAssembly=loadedAssemblies)  # package Journalysis for Dynamo 2.x; Returns the class name of a given LoadedAssembly
events_2 = Custom[LoadedAssembly.Events](loadedAssembly=loadedAssemblies)  # package Journalysis for Dynamo 2.x; Returns all journal lines associated with a given LoadedAssembly. ATTENTION: Note that this will most likely not catch all AddedPushbutton events of a given assembly.
filename = Custom[LoadedAssembly.Filename](loadedAssembly=loadedAssemblies)  # package Journalysis for Dynamo 2.x; Returns the file name of a given LoadedAssembly
GUID = Custom[LoadedAssembly.GUID](loadedAssembly=loadedAssemblies)  # package Journalysis for Dynamo 2.x; Returns the GUID of a given LoadedAssembly
name = Custom[LoadedAssembly.Name](loadedAssembly=loadedAssemblies)  # package Journalysis for Dynamo 2.x; Returns the name of a given LoadedAssembly
path_3 = Custom[LoadedAssembly.Path](loadedAssembly=loadedAssemblies)  # package Journalysis for Dynamo 2.x; Returns the path of a given LoadedAssembly
vendor = Custom[LoadedAssembly.Vendor](loadedAssembly=loadedAssemblies)  # package Journalysis for Dynamo 2.x; Returns the vendor information of a given LoadedAssembly
vendorDetails = Custom[LoadedAssembly.VendorDetails](loadedAssembly=loadedAssemblies)  # package Journalysis for Dynamo 3.x; Returns details about the vencor of a given LoadedAssembly (typically full name and URL)
version_2 = Custom[LoadedAssembly.Version](loadedAssembly=loadedAssemblies)  # package Journalysis for Dynamo 3.x; Returns the version of a given LoadedAssembly (starting with Revit 2023 journals)

# group: JournalWorksharingEvent.Query
string_13 = StringInput("JournalWorksharingEvent")  # graph input
linesByType_14 = Custom[Journal.LinesByType](journal=watch_8, journalLineType=string_13)
sessionID = Custom[JournalWorksharingEvent.SessionID](journalWorksharingEvent=linesByType_14)  # package Journalysis for Dynamo 2.x; Returns the session ID (used in the worksharing log of the central file) of a given JournalWorksharingEvent
dateTime_3 = Custom[JournalWorksharingEvent.DateTime](journalWorksharingEvent=linesByType_14)  # package Journalysis for Dynamo 2.x; Returns the date and time of a given JournalWorksharingEvent
text_3 = Custom[JournalWorksharingEvent.Text](journalWorksharingEvent=linesByType_14)  # package Journalysis for Dynamo 2.x; Returns the recorded text of a given JournalWorksharingEvent

# group: JournalSystemInformation.Query
string_14 = StringInput("JournalSystemInformation")  # graph input
linesByType_15 = Custom[Journal.LinesByType](journal=watch_8, journalLineType=string_14)
item = Custom[JournalSystemInformation.Item](journalSystemInformation=linesByType_15)  # package Journalysis for Dynamo 2.x; Returns the item number of a given JournalSystemInformation line
key_4 = Custom[JournalSystemInformation.Key](journalSystemInformation=linesByType_15)  # package Journalysis for Dynamo 2.x; Returns the key of a given JournalSystemInformation line
type_8 = Custom[JournalSystemInformation.Type](journalSystemInformation=linesByType_15)  # package Journalysis for Dynamo 2.x; Returns the type of a given JournalSystemInformation line
value = Custom[JournalSystemInformation.Value](journalSystemInformation=linesByType_15)  # package Journalysis for Dynamo 2.x; Returns the value of a given JournalSystemInformation line

# group: Paths
allJournalDirectories = Custom[Paths.AllJournalDirectories]()  # package Journalysis for Dynamo 2.x; Retrieves a list of all journal folders on the current machine
watch_9 = Watch(allJournalDirectories)
string_15 = StringInput("2022")  # graph input
journalDirectoryByVersion = Custom[Paths.JournalDirectoryByVersion](revitVersion=string_15)  # package Journalysis for Dynamo 2.x; Retrieves the path of the journal directory for a given Revit version.
watch_10 = Watch(journalDirectoryByVersion)

# group: RecordedException.Query
appGUID = Custom[RecordedException.AppGUID](recordedException=exceptions)  # package Journalysis for Dynamo 2.x; Returns the GUID of the addin responsible for the exception (if any)
appName = Custom[RecordedException.AppName](recordedException=exceptions)  # package Journalysis for Dynamo 2.x; Returns the name of the addin responsible for the exception (if any)
event = Custom[RecordedException.Event](recordedException=exceptions)  # package Journalysis for Dynamo 2.x; Returns the event the exception is attached to (if any)
journalLine_2 = Custom[RecordedException.JournalLine](recordedException=exceptions)  # package Journalysis for Dynamo 2.x; Returns the journal line where the exception was recorded
stackTrace = Custom[RecordedException.StackTrace](recordedException=exceptions)  # package Journalysis for Dynamo 2.x; Returns the stack trace of the exception (if any)
type_9 = Custom[RecordedException.Type](recordedException=exceptions)  # package Journalysis for Dynamo 2.x; Returns the type of the exception
message = Custom[RecordedException.Message](recordedException=exceptions)  # package Journalysis for Dynamo 3.x; Returns the message of the exception (if any)
