# Dynamo graph AllKeyboardShortcutsNodes.dyn (Dynamo 3.0.3.7597)
# author: Andreas Dieckmann
# Sample graph for all keyboard shortcuts nodes
# packages: Journalysis for Dynamo 2.x 2.4.0

# group: Paths
string = StringInput("2022")  # graph input
keyboardShortcutsFileByVersion = Custom[Paths.KeyboardShortcutsFileByVersion](revitVersion=string)  # package Journalysis for Dynamo 2.x; Retrieves the path of the keyboard shortcuts file for a given Revit version.
watch = Watch(keyboardShortcutsFileByVersion)
allKeyboardShortcutFiles = Custom[Paths.AllKeyboardShortcutFiles]()  # package Journalysis for Dynamo 2.x; Retrieves a list of all keyboard shortcuts files on the current machine
watch_2 = Watch(allKeyboardShortcutFiles)

# group: KeyboardShortcuts.Create
byPath = Custom[KeyboardShortcuts.ByPath](path=watch)  # package Journalysis for Dynamo 2.x; Creates a queryable object from the content of a Revit KeyboardShortcuts.xml file

# group: KeyboardShortcuts.Query
commands = Custom[KeyboardShortcuts.Commands](keyboardShortcuts=byPath)  # package Journalysis for Dynamo 2.x; Returns all commands from a given KeyboardShirtcuts object
commandCountWithShortcuts = Custom[KeyboardShortcuts.CommandCountWithShortcuts](keyboardShortcuts=byPath)  # package Journalysis for Dynamo 2.x; Returns the total number of commands that have a shortcut assigned in a given KeyboardShirtcuts object
commandCount = Custom[KeyboardShortcuts.CommandCount](keyboardShortcuts=byPath)  # package Journalysis for Dynamo 2.x; Returns the total number of commands in a given KeyboardShirtcuts object

# group: KeyboardShortcutCommand.Query
hasPaths = Custom[KeyboardShortcutCommand.HasPaths](keyboardShortcutCommand=commands)  # package Journalysis for Dynamo 2.x; Returns whether a given command has any paths assigned
hasShortcuts = Custom[KeyboardShortcutCommand.HasShortcuts](keyboardShortcutCommand=commands)  # package Journalysis for Dynamo 2.x; Returns whether a given command has any shortcuts assigned
name = Custom[KeyboardShortcutCommand.Name](keyboardShortcutCommand=commands)  # package Journalysis for Dynamo 2.x; Returns the name of a given command
paths = Custom[KeyboardShortcutCommand.Paths](keyboardShortcutCommand=commands)  # package Journalysis for Dynamo 2.x; Returns all paths assigned to a given command
shortcuts = Custom[KeyboardShortcutCommand.Shortcuts](keyboardShortcutCommand=commands)  # package Journalysis for Dynamo 2.x; Returns all shortcuts assigned to a given command
ID = Custom[KeyboardShortcutCommand.ID](keyboardShortcutCommand=commands)  # package Journalysis for Dynamo 2.x; Returns the ID of a given command

# group: KeyboardShortcuts.Actions
commandsWithShortcuts = Custom[KeyboardShortcuts.CommandsWithShortcuts](keyboardShortcuts=byPath)  # package Journalysis for Dynamo 2.x; Returns all commands that have a shortcut assigned from a given KeyboardShirtcuts object
commandByID = Custom[KeyboardShortcuts.CommandByID](keyboardShortcuts=byPath, commandID=ID)  # package Journalysis for Dynamo 2.x; Returns the command that corresponds with the given CommandID
