# Dynamo graph AllWorksharingLogNodes.dyn (Dynamo 3.0.3.7597)
# author: Andreas Dieckmann
# Sample graph for all worksgaring log nodes
# packages: Journalysis for Dynamo 2.x 2.4.0

# group: INPUT
worksharing_log_file_path = Filename("..\..\..\..\..\Desktop\NewFileName_backup\NewFileName.slog")  # graph input

# group: WorksharingLog.Create
byPath = Custom[WorksharingLog.ByPath](path=worksharing_log_file_path)  # package Journalysis for Dynamo 2.x; Creates a queryable object from a Revit worksharing log

# group: WorksharingLog.Query
sessions = Custom[WorksharingLog.Sessions](worksharingLog=byPath)  # package Journalysis for Dynamo 2.x; Returns all sessions of a given WorksharingLog
sessionCount = Custom[WorksharingLog.SessionCount](worksharingLog=byPath)  # package Journalysis for Dynamo 2.x; Returns the number of sessions recorded in a given WorksharingLog
processingTime = Custom[WorksharingLog.ProcessingTime](worksharingLog=byPath)  # package Journalysis for Dynamo 2.x; Returns the amount of time it took to process the given WorksharingLog
version = Custom[WorksharingLog.Version](worksharingLog=byPath)  # package Journalysis for Dynamo 2.x; Returns the version of a given WorksharingLog

# group: WorksharingSession.Actions
syncEvents = Custom[WorksharingSession.SyncEvents](worksharingSession=sessions)  # package Journalysis for Dynamo 2.x; Extracts all SyncEvents from a given WorkharingSession
loadDuration = Custom[WorksharingSession.LoadDuration](worksharingSession=sessions)  # package Journalysis for Dynamo 2.x; Computes the load time of the model (not including loading of linked models) for a given WorksharingSession
wasTerminatedProperly = Custom[WorksharingSession.WasTerminatedProperly](worksharingSession=sessions)  # package Journalysis for Dynamo 2.x; Determines whether a given WorksharingSession was terminated properly
hasLoadedLinks = Custom[WorksharingSession.HasLoadedLinks](worksharingSession=sessions)  # package Journalysis for Dynamo 2.x; Determines if linked models were loaded in this session
loadedLinks = Custom[WorksharingSession.LoadedLinks](worksharingSession=sessions)  # package Journalysis for Dynamo 2.x; Retrieves a list of loaded links from a given WorkharingSession
type = Custom[WorksharingSession.Type](worksharingSession=sessions)  # package Journalysis for Dynamo 2.x; Returns the type of a given WorksharingSession

# group: SyncEvent.Query
duration = Custom[SyncEvent.Duration](syncEvent=syncEvents@L2)  # package Journalysis for Dynamo 2.x; Returns the duration of a given SyncEvent
end = Custom[SyncEvent.End](syncEvent=syncEvents@L2)  # package Journalysis for Dynamo 2.x; Returns the date and time a given SyncEvent concluded
start = Custom[SyncEvent.Start](syncEvent=syncEvents@L2)  # package Journalysis for Dynamo 2.x; Returns the date and time a given SyncEvent started
reloadLatestCount = Custom[SyncEvent.ReloadLatestCount](syncEvent=syncEvents@L2)  # package Journalysis for Dynamo 2.x; Returns the number of times that Reload Latest occured during a given SyncEvent
wasAborted = Custom[SyncEvent.WasAborted](syncEvent=syncEvents@L2)  # package Journalysis for Dynamo 2.x; Returns the number of times that Reload Latest occured during a given SyncEvent

# group: WorksharingSession.Query
build = Custom[WorksharingSession.Build](worksharingSession=sessions)  # package Journalysis for Dynamo 2.x; Returns the Revit build of a given WorksharingSession
central = Custom[WorksharingSession.Central](worksharingSession=sessions)  # package Journalysis for Dynamo 2.x; Returns the file path to the central model of a given WorksharingSession
date = Custom[WorksharingSession.Date](worksharingSession=sessions)  # package Journalysis for Dynamo 2.x; Returns the date of a given WorksharingSession
end_2 = Custom[WorksharingSession.End](worksharingSession=sessions)  # package Journalysis for Dynamo 2.x; Returns the date and time a given WorksharingSession was concluded
duration_2 = Custom[WorksharingSession.Duration](worksharingSession=sessions)  # package Journalysis for Dynamo 2.x; Returns the total duration of a given WorksharingSession
events = Custom[WorksharingSession.Events](worksharingSession=sessions)  # package Journalysis for Dynamo 2.x; Returns all recorded events of a given WorksharingSession
hostName = Custom[WorksharingSession.HostName](worksharingSession=sessions)  # package Journalysis for Dynamo 2.x; Returns the host name of a given WorksharingSession
journal = Custom[WorksharingSession.Journal](worksharingSession=sessions)  # package Journalysis for Dynamo 2.x; Returns the journal file path of a given WorksharingSession
serverName = Custom[WorksharingSession.ServerName](worksharingSession=sessions)  # package Journalysis for Dynamo 2.x; Returns the server name of a given WorksharingSession
start_2 = Custom[WorksharingSession.Start](worksharingSession=sessions)  # package Journalysis for Dynamo 2.x; Returns the date and time a given WorksharingSession was started
user = Custom[WorksharingSession.User](worksharingSession=sessions)  # package Journalysis for Dynamo 2.x; Returns the Revit user name of a given WorksharingSession
version_2 = Custom[WorksharingSession.Version](worksharingSession=sessions)  # package Journalysis for Dynamo 2.x; Returns the Revit version of a given WorksharingSession
ID = Custom[WorksharingSession.ID](worksharingSession=sessions)  # package Journalysis for Dynamo 2.x; Returns the ID of a given WorksharingSession
hostAddress = Custom[WorksharingSession.HostAddress](worksharingSession=sessions)  # package Journalysis for Dynamo 2.x; Returns the host address (IP or MAC depending on environment) of a given WorksharingSession
serverAddress = Custom[WorksharingSession.ServerAddress](worksharingSession=sessions)  # package Journalysis for Dynamo 2.x; Returns the server address (IP or MAC depending on environment) of a given WorksharingSession

# group: WorksharingEvent.Query
dateTime = Custom[WorksharingEvent.DateTime](worksharingEvent=events@L2)  # package Journalysis for Dynamo 2.x; Returns the date and time of a given WorksharingEvent
text = Custom[WorksharingEvent.Text](worksharingEvent=events@L2)  # package Journalysis for Dynamo 2.x; Returns the logged text of a given WorksharingEvent

# group: WorksharingLog.Actions
allSessionsUseSameBuild = Custom[WorksharingLog.AllSessionsUseSameBuild](worksharingLog=byPath)  # package Journalysis for Dynamo 2.x; Determines whether all sessions of a given WorksharingLog use the same Revit build
sessionByID = Custom[WorksharingLog.SessionByID](worksharingLog=byPath, sessionID=ID)  # package Journalysis for Dynamo 2.x; Retrieves a WorksharingSession from a WorksharingLog based on the session ID.

# group: LoadedLink.Query
fileName = Custom[LoadedLink.FileName](loadedLink=loadedLinks@L2)  # package Journalysis for Dynamo 2.x; Returns the file name of a given loaded link
fullPath = Custom[LoadedLink.FullPath](loadedLink=loadedLinks@L2)  # package Journalysis for Dynamo 2.x; Returns the full path of a given loaded link
loadDuration_2 = Custom[LoadedLink.LoadDuration](loadedLink=loadedLinks@L2)  # package Journalysis for Dynamo 2.x; Returns the load duration of a given loaded link
loadEnd = Custom[LoadedLink.LoadEnd](loadedLink=loadedLinks@L2)  # package Journalysis for Dynamo 2.x; Returns the date and time a given loaded link completed loading
loadStart = Custom[LoadedLink.LoadStart](loadedLink=loadedLinks@L2)  # package Journalysis for Dynamo 2.x; Returns the date and time a given loaded link started loading

# group: WorksharingLog.Helpers
findSyncEventOverlaps = Custom[Helpers.FindSyncEventOverlaps](SyncEvents=syncEvents)  # package Journalysis for Dynamo 2.x; Identifies groups of SyncEvents that overlap in a given WorksharingLog. Expects a list of *all* SyncEvents of *all* WorksharingSessions within a WorksharingLog.
