# Dynamo graph Journal_LoadedAssembliesRegisteredEvents.dyn (Dynamo 2.12.0.5650)
# packages: Journalysis for Dynamo 2.x 0.9.0

# group: INPUTS
report_directory = Directory("C:\temp")
journal_file = Filename("c:\netz\adieckmann\Desktop\itashiro-2019-journal.0288.txt")

# group: Collect assemblies with registered events
byPath = Custom[Journal.ByPath](path=journal_file)  # package Journalysis for Dynamo 2.x; Creates a queryable object from the contents of a Revit journal file
loadedAssemblies = Custom[Journal.LoadedAssemblies](journal=byPath)  # package Journalysis for Dynamo 2.x; Pulls a list of all loaded assemblies (i.e. addin DLLs) from a given journal
class_ = Custom[LoadedAssembly.Class](loadedAssembly=loadedAssemblies)  # package Journalysis for Dynamo 2.x; Returns the class name of a given LoadedAssembly
events = Custom[LoadedAssembly.Events](loadedAssembly=loadedAssemblies)  # package Journalysis for Dynamo 2.x; Returns all journal lines associated with a given LoadedAssembly. ATTENTION: Note that this will most likely not catch all AddedPushbutton events of a given assembly.
text = Custom[JournalAPIMessage.Text](journalAPIMessage=events@L2)  # package Journalysis for Dynamo 2.x; Returns the text from an APIMessage line
string = StringInput("Registering ")
startsWith = String.StartsWith(string=text, searchFor=string)
filterByBoolMask = List.FilterByBoolMask(list=text, mask=startsWith)
isEmpty = List.IsEmpty(list=filterByBoolMask.in@L2)
filterByBoolMask_2 = List.FilterByBoolMask(list=class_, mask=isEmpty)
filterByBoolMask_3 = List.FilterByBoolMask(list=filterByBoolMask.in, mask=isEmpty)

# group: Group assemblies by events
list_create = List.Create()  # unwired: item0, item1
count = List.Count(list=filterByBoolMask_3.out@L2)
ofRepeatedItem = List.OfRepeatedItem(item=filterByBoolMask_2.out@L1, amount=count@L1)
combine = List.Combine(comb=list_create, list1=ofRepeatedItem, list2=filterByBoolMask_3.out)
transpose = List.Transpose(lists=combine)
flatten = List.Flatten(list=transpose@L3)
lastItem = List.LastItem(list=flatten)
string_2 = StringInput("")
replace = String.Replace(string=lastItem, searchFor=string, replaceWith=string_2)
string_3 = StringInput(" ")
split = String.Split(string=replace, separator0=string_3)
firstItem = List.FirstItem(list=split@L2)
firstItem_2 = List.FirstItem(list=flatten)
groupByKey = List.GroupByKey(list=firstItem, keys=firstItem_2)

# group: Export to Excel
string_4 = StringInput("SubscribedEvents")
code_block = CodeBlock(dir=report_directory, name=string_4) { dir + "\\" + name + ".xlsx"; }
code_block_2 = CodeBlock { 0; }
string_5 = StringInput("Assembly")
uniqueItems = List.UniqueItems(list=firstItem)
join = List.Join(list0=string_5, list1=uniqueItems)
list_create_2 = List.Create(item0=join)
join_2 = List.Join()  # unwired: list0, list1
indexOf = List.IndexOf(list=groupByKey.groups@L2, element=uniqueItems)
code_block_3 = CodeBlock(n=indexOf) { n > -1; }
combine_2 = List.Combine(comb=join_2, list1=groupByKey.uniqueKeys, list2=code_block_3)
join_3 = List.Join(list0=list_create_2, list1=combine_2)
boolean = BoolSelector(true)
exportToExcel = Data.ExportToExcel(filePath=code_block, sheetName=string_4, startRow=code_block_2, startColumn=code_block_2, data=join_3, overWrite=boolean)
