# Dynamo graph Journals_AllAudits.dyn (Dynamo 2.0.3.8810)

# group: INPUTS
directory_path = Directory("Z:\U\Desktop\journals")  # graph input

# group: Create Journal objects from directory
fromPath = DirectoryObject(path=directory_path)  # "Directory.FromPath"
string = StringInput("*.txt")  # graph input
getDirectoryContents = FileSystem.GetDirectoryContents(directory=fromPath, searchString=string)
byPath = Custom[Journal.ByPath](path=getDirectoryContents.files)  # Creates a queryable object from the contents of a Revit journal file

# group: Find all FileOpenSubDialogs commands
string_2 = StringInput("JournalData")  # graph input
string_3 = StringInput("Key")  # graph input
string_4 = StringInput("FileOpenSubDialog")  # graph input
linesByTypeAndProperty = Custom[Journal.LinesByTypeAndProperty](journal=byPath, journalLineType=string_2, property=string_3, value=string_4)  # Retrieves all JournalLines of a given type from a given journal, pre-filtered by a property value
isEmpty = List.IsEmpty(list=linesByTypeAndProperty@L2)
filterByBoolMask = List.FilterByBoolMask(list=linesByTypeAndProperty, mask=isEmpty)
flatten = List.Flatten(list=filterByBoolMask.out)

# group: Find all Audits
values = Custom[JournalData.Values](journalData=flatten)  # Returns the values from a JournalData line
transpose = List.Transpose(lists=values)
code_block = CodeBlock(data=transpose) { data[0] == "AuditCheckBox" && data[1] == "True"; }
filterByBoolMask_2 = List.FilterByBoolMask(list=flatten, mask=code_block)

# group: Ignore all cancelled audits
# note: NOTE:
# This isn't entirely accurate. An audit may also be acncelled later while the model is still loading. Too lazy for including that here, though.
string_5 = StringInput("JournalData")  # graph input
nextOfType = Custom[JournalLine.NextOfType](journalLine=filterByBoolMask_2.in, journalLineType=string_5)  # Retrieves the next line of a given type after the given line from the journal
key = Custom[JournalData.Key](journalData=nextOfType)  # Returns the key of a JournalData line
values_2 = Custom[JournalData.Values](journalData=nextOfType)
transpose_2 = List.Transpose(lists=values_2)
code_block_2 = CodeBlock(key=key, data=transpose_2) { key == "TaskDialogResult" && data[2] == "IDYES"; }
filterByBoolMask_3 = List.FilterByBoolMask(list=nextOfType, mask=code_block_2)

# group: Get model and date information
string_6 = StringInput("JournalBasicFileInfo")  # graph input
nextOfType_2 = Custom[JournalLine.NextOfType](journalLine=filterByBoolMask_3.in, journalLineType=string_6)
dateTimeOfBlock = Custom[JournalLine.DateTimeOfBlock](journalLine=nextOfType_2)  # Retrieves the date and time of the block of a given JournalLine
fileName = Custom[JournalBasicFileInfo.FileName](journalBasicFileInfo=nextOfType_2)  # Returns the file name from the last save path of a BasicFileInfo line
centralModelPath = Custom[JournalBasicFileInfo.CentralModelPath](journalBasicFileInfo=nextOfType_2)  # Returns the central model path from a BasicFileInfo line

# group: OUTPUTS
date_time = Watch(dateTimeOfBlock)
file_name = Watch(fileName)
central_model_path = Watch(centralModelPath)
