# Dynamo graph Journals_AllPurges.dyn (Dynamo 2.0.3.8810)

# group: INPUTS
directory_path = Directory("Z:\U\Desktop\journals")  # graph input

# group: Create Journal objects from directory
fromPath = DirectoryObject(path=directory_path)  # "Directory.FromPath"
string = StringInput("*.txt")  # graph input
getDirectoryContents = FileSystem.GetDirectoryContents(directory=fromPath, searchString=string)
byPath = Custom[Journal.ByPath](path=getDirectoryContents.files)  # Creates a queryable object from the contents of a Revit journal file

# group: Find all Purge commands
string_2 = StringInput("JournalCommand")  # graph input
string_3 = StringInput("CommandID")  # graph input
string_4 = StringInput("ID_PURGE_UNUSED")  # graph input
linesByTypeAndProperty = Custom[Journal.LinesByTypeAndProperty](journal=byPath, journalLineType=string_2, property=string_3, value=string_4)  # Retrieves all JournalLines of a given type from a given journal, pre-filtered by a property value
isEmpty = List.IsEmpty(list=linesByTypeAndProperty@L2)
filterByBoolMask = List.FilterByBoolMask(list=linesByTypeAndProperty, mask=isEmpty)
flatten = List.Flatten(list=filterByBoolMask.out)

# group: Ignore all cancelled commands
string_5 = StringInput("JournalUIEvent")  # graph input
nextOfType = Custom[JournalLine.NextOfType](journalLine=flatten, journalLineType=string_5)  # Retrieves the next line of a given type after the given line from the journal
type = Custom[JournalUIEvent.Type](journalUIEvent=nextOfType)  # Returns the type of a UIEvent line
data = Custom[JournalUIEvent.Data](journalUIEvent=nextOfType)  # Returns the data from a UIEvent line
transpose = List.Transpose(lists=data)
code_block = CodeBlock(type=type, data=transpose) { type == "PushButton"; data[2] == "Dialog_Revit_PurgeUnusedTree"; data[4] == "IDOK"; }
create = List.Create(item0=code_block.out0, item1=code_block.out1, item2=code_block.out2)
transpose_2 = List.Transpose(lists=create)
allTrue = List.AllTrue(list=transpose_2@L2)
filterByBoolMask_2 = List.FilterByBoolMask(list=flatten, mask=allTrue)

# group: Get model and date information
dateTimeOfBlock = Custom[JournalLine.DateTimeOfBlock](journalLine=filterByBoolMask_2.in)  # Retrieves the date and time of the block of a given JournalLine
string_6 = StringInput("JournalBasicFileInfo")  # graph input
previousOfType = Custom[JournalLine.PreviousOfType](journalLine=filterByBoolMask_2.in, journalLineType=string_6)  # Retrieves the previous line of a given type before the given line from the journal
fileName = Custom[JournalBasicFileInfo.FileName](journalBasicFileInfo=previousOfType)  # Returns the file name from the last save path of a BasicFileInfo line
centralModelPath = Custom[JournalBasicFileInfo.CentralModelPath](journalBasicFileInfo=previousOfType)  # Returns the central model path from a BasicFileInfo line

# group: OUTPUTS
date_time = Watch(dateTimeOfBlock)
file_name = Watch(fileName)
central_model_path = Watch(centralModelPath)
