# Dynamo graph Journals_CrashInvestigator.dyn (Dynamo 2.12.0.5650)
# packages: Journalysis for Dynamo 2.x 0.9.0, Clockwork for Dynamo 2.x 2.4.0

# group: Inputs
directory_path_source = Directory("U:\Journals\_abstürze_kw10")  # graph input
directory_path_target = Directory("C:\temp")  # graph input
filename_sheetname = StringInput("Crash_Investigator")  # graph input

# group: Read source directory
directory_from_path = DirectoryObject(path=directory_path_source)
string = StringInput("*.txt")  # graph input
getDirectoryContents = FileSystem.GetDirectoryContents(directory=directory_from_path, searchString=string)

# group: Crash Filter
byPath = Custom[Journal.ByPath](path=getDirectoryContents.files)  # package Journalysis for Dynamo 2.x; Creates a queryable object from the contents of a Revit journal file
sessionTerminatedProperly = Custom[Journal.SessionTerminatedProperly](journal=byPath)  # package Journalysis for Dynamo 2.x; Computes whether the Revit session of the given journal was terminated properly
filterByBoolMask = List.FilterByBoolMask(list=byPath, mask=sessionTerminatedProperly)
filterByBoolMask_2 = List.FilterByBoolMask(list=getDirectoryContents.files, mask=sessionTerminatedProperly)

# group: API Errors
string_2 = StringInput("JournalAPIMessage")  # graph input
string_3 = StringInput("IsError")  # graph input
boolean = BoolSelector(true)  # graph input
linesByTypeAndProperty = Custom[Journal.LinesByTypeAndProperty](journal=filterByBoolMask.out, journalLineType=string_2, property=string_3, value=boolean)  # package Journalysis for Dynamo 2.x; Retrieves all JournalLines of a given type from a given journal, pre-filtered by a property value
text = Custom[JournalAPIMessage.Text](journalAPIMessage=linesByTypeAndProperty@L2)  # package Journalysis for Dynamo 2.x; Returns the text from an APIMessage line
flatten = List.Flatten(list=text)
countOccurences = Custom[List.CountOccurences](seq=flatten)  # package Clockwork for Dynamo 2.x; Counts the number of occurences of each unique element in a given list
sortByKey = List.SortByKey(list=countOccurences.uniqueElements, keys=countOccurences.count)
reverse = List.Reverse(list=sortByKey.sortedList)
watch = Watch(reverse)
reverse_2 = List.Reverse(list=sortByKey.sortedKeys)
watch_2 = Watch(reverse_2)

# group: TimeStamps
string_4 = StringInput("JournalTimeStamp")  # graph input
linesByType = Custom[Journal.LinesByType](journal=filterByBoolMask.out, journalLineType=string_4)  # package Journalysis for Dynamo 2.x; Retrieves all JournalLines of a given type from a given journal

# group: Exceptions
description = Custom[JournalTimeStamp.Description](journalTimeStamp=linesByType@L2)  # package Journalysis for Dynamo 2.x; Returns the description of a TimeStamp line
string_5 = StringInput("ExceptionCode")  # graph input
startsWith = String.StartsWith(string=description, searchFor=string_5)
filterByBoolMask_3 = List.FilterByBoolMask(list=description, mask=startsWith)
flatten_2 = List.Flatten(list=filterByBoolMask_3.in)
countOccurences_2 = Custom[List.CountOccurences](seq=flatten_2)
sortByKey_2 = List.SortByKey(list=countOccurences_2.uniqueElements, keys=countOccurences_2.count)
reverse_3 = List.Reverse(list=sortByKey_2.sortedList)
watch_3 = Watch(reverse_3)
reverse_4 = List.Reverse(list=sortByKey_2.sortedKeys)
watch_4 = Watch(reverse_4)

# group: Session Duration
sessionTime = Custom[Journal.SessionTime](journal=filterByBoolMask.out)  # package Journalysis for Dynamo 2.x; Computes the entire Revit session time based on the given journal
string_from_object = FromObject(obj=sessionTime)
code_block = CodeBlock(ts=string_from_object) { "'" + ts; }

# group: Last Used Command
string_6 = StringInput("JournalCommand")  # graph input
linesByType_2 = Custom[Journal.LinesByType](journal=filterByBoolMask.out, journalLineType=string_6)
lastItem = List.LastItem(list=linesByType_2@L2)
ID = Custom[JournalCommand.ID](journalCommand=lastItem)  # package Journalysis for Dynamo 2.x; Returns the command ID of a JournalCommand line

# group: Hard vs. Soft Crashes
lastItem_2 = List.LastItem(list=linesByType@L2)
description_2 = Custom[JournalTimeStamp.Description](journalTimeStamp=lastItem_2)
code_block_2 = CodeBlock(txt=description_2) { txt == "program terminated"; }

# group: Last Active Model
string_7 = StringInput("JournalBasicFileInfo")  # graph input
linesByType_3 = Custom[Journal.LinesByType](journal=filterByBoolMask.out, journalLineType=string_7)
lastItem_3 = List.LastItem(list=linesByType_3@L2)
fileName = Custom[JournalBasicFileInfo.FileName](journalBasicFileInfo=lastItem_3)  # package Journalysis for Dynamo 2.x; Returns the file name from the last save path of a BasicFileInfo line

# group: Last UIEvent after command
number = Custom[JournalLine.Number](journalLine=lastItem)  # package Journalysis for Dynamo 2.x; Returns the line number of a given journal line
string_8 = StringInput("JournalUIEvent")  # graph input
linesByType_4 = Custom[Journal.LinesByType](journal=filterByBoolMask.out, journalLineType=string_8)
lastItem_4 = List.LastItem(list=linesByType_4@L2)
number_2 = Custom[JournalLine.Number](journalLine=lastItem_4)
string_9 = StringInput("")  # graph input
rawText = Custom[JournalLine.RawText](journalLine=lastItem_4)  # package Journalysis for Dynamo 2.x; Returns the raw text of a given journal line
count = List.Count(list=rawText)
ofRepeatedItem = List.OfRepeatedItem(item=string_9, amount=count)
code_block_3 = CodeBlock(command=number, uievent=number_2, emptystring=ofRepeatedItem, uieventstring=rawText) { command > uievent ? emptystring : uieventstring; }

# group: Gather data
fileName_2 = FileSystem.FileName(path=filterByBoolMask_2.out)
user = Custom[Journal.User](journal=filterByBoolMask.out)  # package Journalysis for Dynamo 2.x; Returns the Revit user name from a given journal
count_2 = List.Count(list=linesByTypeAndProperty@L2)
count_3 = List.Count(list=filterByBoolMask_3.in@L2)
create = List.Create(item0=fileName_2, item1=user, item2=count_2, item3=count_3, item4=code_block, item5=ID, item6=code_block_2, item7=fileName, item8=code_block_3)

# group: Create headings and add data
string_10 = StringInput("""JournalPath
User
NumAPIErrors
NumExceptions
SessionDuration
LastCommandUsed
CrashedWithReport
LastActiveModel
LastUIEventAfterCommand""")  # graph input
string_11 = StringInput("\n")  # graph input
split = String.Split(string=string_10, separator0=string_11)
create_2 = List.Create(item0=split)
transpose = List.Transpose(lists=create)
join = List.Join(list0=create_2, list1=transpose)

# group: Write to Excel
combinePath = FileSystem.CombinePath(string0=directory_path_target, string1=filename_sheetname)
code_block_4 = CodeBlock(filename=combinePath) { filename + ".xlsx"; }
code_block_5 = CodeBlock { 0; }
boolean_2 = BoolSelector(true)  # graph input
exportToExcel = Data.ExportToExcel(filePath=code_block_4, sheetName=filename_sheetname, startRow=code_block_5, startColumn=code_block_5, data=join, overWrite=boolean_2)
