# Dynamo graph WorksharingLogs_AllSessions.dyn (Dynamo 2.12.0.5650)
# packages: Journalysis for Dynamo 2.x 0.9.0, Clockwork for Dynamo 2.x 2.4.0

# group: INPUT
directory_path_log_directory = Directory("U:\Projekte_Dynamo\SLOGs\long_syncs")  # graph input
directory_path_report = Directory("C:\temp")  # graph input
filename = StringInput("WorksharingSessions")  # graph input

# group: Process files
fromPath = DirectoryObject(path=directory_path_log_directory)  # "Directory.FromPath"
getDirectoryContents = FileSystem.GetDirectoryContents(directory=fromPath)
byPath = Custom[WorksharingLog.ByPath](path=getDirectoryContents.files)  # package Journalysis for Dynamo 2.x; Creates a queryable object from a Revit worksharing log
sessions = Custom[WorksharingLog.Sessions](worksharingLog=byPath)  # package Journalysis for Dynamo 2.x; Returns all sessions of a given WorksharingLog
flatten = List.Flatten(list=sessions)

# group: Collect data
hasLoadedLinks = Custom[WorksharingSession.HasLoadedLinks](worksharingSession=flatten)  # package Journalysis for Dynamo 2.x; Determines if linked models were loaded in this session
central = Custom[WorksharingSession.Central](worksharingSession=flatten)  # package Journalysis for Dynamo 2.x; Returns the file path to the central model of a given WorksharingSession
boolean = BoolSelector(false)  # graph input
fileName = FileSystem.FileName(path=central, withExtension=boolean)
ID = Custom[WorksharingSession.ID](worksharingSession=flatten)  # package Journalysis for Dynamo 2.x; Returns the ID of a given WorksharingSession
start = Custom[WorksharingSession.Start](worksharingSession=flatten)  # package Journalysis for Dynamo 2.x; Returns the date and time a given WorksharingSession was started
user = Custom[WorksharingSession.User](worksharingSession=flatten)  # package Journalysis for Dynamo 2.x; Returns the Revit user name of a given WorksharingSession
type = Custom[WorksharingSession.Type](worksharingSession=flatten)  # package Journalysis for Dynamo 2.x; Returns the type of a given WorksharingSession
wasTerminatedProperly = Custom[WorksharingSession.WasTerminatedProperly](worksharingSession=flatten)  # package Journalysis for Dynamo 2.x; Determines whether a given WorksharingSession was terminated properly
loadDuration = Custom[WorksharingSession.LoadDuration](worksharingSession=flatten)  # package Journalysis for Dynamo 2.x; Computes the load time of the model (not including loading of linked models) for a given WorksharingSession
totalSeconds = TimeSpan.TotalSeconds(timeSpan=loadDuration)
string = StringInput("")  # graph input
replaceNull = Custom[List.ReplaceNull](seq=totalSeconds, replacement=string)  # package Clockwork for Dynamo 2.x; Replaces all null values within a given list with a substitute
loadedLinks = Custom[WorksharingSession.LoadedLinks](worksharingSession=flatten)  # package Journalysis for Dynamo 2.x; Retrieves a list of loaded links from a given WorkharingSession
count = List.Count(list=loadedLinks@L2)
hostName = Custom[WorksharingSession.HostName](worksharingSession=flatten)  # package Journalysis for Dynamo 2.x; Returns the host name of a given WorksharingSession
duration = Custom[WorksharingSession.Duration](worksharingSession=flatten)  # package Journalysis for Dynamo 2.x; Returns the total duration of a given WorksharingSession
totalSeconds_2 = TimeSpan.TotalSeconds(timeSpan=duration)
string_2 = StringInput("")  # graph input
replaceNull_2 = Custom[List.ReplaceNull](seq=totalSeconds_2, replacement=string_2)
loadedLinks_2 = Custom[WorksharingSession.LoadedLinks](worksharingSession=flatten)
count_2 = List.Count(list=loadedLinks_2@L2)
loadDuration_2 = Custom[LoadedLink.LoadDuration](loadedLink=loadedLinks_2@L2)  # package Journalysis for Dynamo 2.x; Returns the load duration of a given loaded link
totalSeconds_3 = TimeSpan.TotalSeconds(timeSpan=loadDuration_2)
sum = Math.Sum(values=totalSeconds_3)
create = List.Create(item0=fileName, item1=ID, item2=start, item3=user, item4=type, item5=wasTerminatedProperly, item6=replaceNull, item7=count, item8=hostName, item9=replaceNull_2, item10=count_2, item11=sum)

# group: Export to Excel
code_block = CodeBlock(filename=filename) { filename + ".csv"; }
combinePath = FileSystem.CombinePath(string0=directory_path_report, string1=code_block)
string_3 = StringInput("Sessions")  # graph input
code_block_2 = CodeBlock { 0; }
string_4 = StringInput("""Model
SessionID
SessionStarted
Username
SessionType
SessionTerminatedProperly
LoadDuration
NumberOfSyncs
Machine
SessionDuration
LoadedLinks
LinkLoadTime""")  # graph input
string_5 = StringInput("\n")  # graph input
split = String.Split(string=string_4, separator0=string_5)
create_2 = List.Create(item0=split)
transpose = List.Transpose(lists=create)
join = List.Join(list0=create_2, list1=transpose)
boolean_2 = BoolSelector(true)  # graph input
exportToExcel = Data.ExportToExcel(filePath=combinePath, sheetName=string_3, startRow=code_block_2, startColumn=code_block_2, data=join, overWrite=boolean_2)
