# Dynamo graph AllNodes.dyn (Dynamo 1.3.1.1736)

# group: INPUT
# note: QUESTION:
# Does the graph execute okay? Do any nodes turn yellow?
journal_file_path = Filename("..\..\..\Desktop\journals\journal.0855.txt")
keyboardshortcuts_file_path = Filename("C:\Users\adieckmann\Desktop\KeyboardShortcuts.xml")
worksharing_log_file_path = Filename("..\..\..\Desktop\Projekt1_backup\Projekt1.slog")

# group: Journal.Create
fromPath = FileObject(journal_file_path)  # "File.FromPath"
readText = File.ReadText(fromPath)
byString = Custom[Journal.ByString](str=readText)  # Creates a queriable object from the contents of a Revit journal file

# group: Journal.Query
user = Custom[Journal.User](journal=byString)  # Returns the Revit user name from a given journal
lineCount = Custom[Journal.LineCount](journal=byString)  # Returns the number of lines in a given journal
blockCount = Custom[Journal.BlockCount](journal=byString)  # Returns the number of blocks in a given journal
lines = Custom[Journal.Lines](journal=byString)  # Returns all lines of a given journal
path = Custom[Journal.Path](journal=byString)  # Returns the original path of a given journal
processingTime = Custom[Journal.ProcessingTime](journal=byString)  # Returns the time it took the Journal.ByString node to process a given journal
revitBuild = Custom[Journal.RevitBuild](journal=byString)  # Returns the Revit build from a given journal
revitBranch = Custom[Journal.RevitBranch](journal=byString)  # Returns the Revit branch from a given journal
revitVersion = Custom[Journal.RevitVersion](journal=byString)  # Returns the Revit version from a given journal
OSVersion = Custom[Journal.OSVersion](journal=byString)  # Returns the Windows version from a given journal
machine = Custom[Journal.Machine](journal=byString)  # Returns the computer name from a given journal
date = Custom[Journal.Date](journal=byString)  # Computes the date of a given journal

# group: Test Inputs
code_block = CodeBlock { {"JournalData","JournalDirective"}; "JournalTimeStamp"; "Description"; "idle0_doc"; 30..34; 30; }

# group: Journal.Actions
linesByType = Custom[Journal.GetLinesByType](journal=byString, journalLineType=code_block.out1)  # "Journal.LinesByType"
linesByBlock = Custom[Journal.GetLinesByBlock](journal=byString, journalBlock=code_block.out4)  # "Journal.LinesByBlock"
sessionTime = Custom[Journal.SessionTime](journal=byString)
startupTime = Custom[Journal.StartupTime](journal=byString)
sessionTerminatedProperly = Custom[Journal.SessionTerminatedProperly](journal=byString)
isInPlaybackMode = Custom[Journal.IsInPlaybackMode](journal=byString)
playbackInterrupted = Custom[Journal.PlaybackInterrupted](journal=byString)
containsAPIErrors = Custom[Journal.ContainsAPIErrors](journal=byString)
containsExceptions = Custom[Journal.ContainsExceptions](journal=byString)
maxRAMPeak = Custom[Journal.MaxRAMPeak](journal=byString)
maxVMPeak = Custom[Journal.MaxVMPeak](journal=byString)
minRAMAvailable = Custom[Journal.MinRAMAvailable](journal=byString)
minVMAvailable = Custom[Journal.MinVMAvailable](journal=byString)
linesByTypeAndProperty = Custom[Journal.GetLinesByTypeAndProperty](journal=byString, journalLineType=code_block.out1, property=code_block.out2, value=code_block.out3)  # "Journal.LinesByTypeAndProperty"
dateTimeByBlock = Custom[Journal.GetDateTimeByBlock](journal=byString, journalBlock=code_block.out4)  # "Journal.DateTimeByBlock"
stripComments = Custom[Journal.StripComments](journal=byString)  # Strips all comments from the original journal string and only returns all (re-formatted) lines that are potentially relevant for journal playback.
loadedModels = Custom[Journal.LoadedModels](journal=byString)
date_2 = Custom[Journal.Date](journal=byString)
loadedAssemblies = Custom[Journal.LoadedAssemblies](journal=byString)

# group: JournalLine.Query
number = Custom[JournalLine.Number](journalLine=lines)
type = Custom[JournalLine.Type](journalLine=lines)
block = Custom[JournalLine.Block](journalLine=lines)
rawText = Custom[JournalLine.RawText](journalLine=lines)

# group: Helpers
allJournalLineTypes = Custom[Helpers.AllJournalLineTypes]()  # Lists all JournalLine types
watch = Watch(allJournalLineTypes)
allJournalAPIMessageTypes = Custom[Helpers.AllJournalAPIMessageTypes]()
watch_2 = Watch(allJournalAPIMessageTypes)
allJournalCommandTypes = Custom[Helpers.AllJournalCommandTypes]()
watch_3 = Watch(allJournalCommandTypes)
allJournalMouseEventTypes = Custom[Helpers.AllJournalMouseEventTypes]()
watch_4 = Watch(allJournalMouseEventTypes)
allJournalTimeStampTypes = Custom[Helpers.AllJournalTimeStampTypes]()
watch_5 = Watch(allJournalTimeStampTypes)
allJournalUIEventTypes = Custom[Helpers.AllJournalUIEventTypes]()
watch_6 = Watch(allJournalUIEventTypes)
allLoadedModelEventTypes = Custom[Helpers.AllLoadedModelEventTypes]()  # Lists all LoadedModelEvent types
watch_7 = Watch(allLoadedModelEventTypes)

watch_8 = Watch(byString)

# group: JournalAPIMessage.Query
string = StringInput("JournalAPIMessage")
linesByType_2 = Custom[Journal.GetLinesByType](journal=watch_8, journalLineType=string)  # "Journal.LinesByType"
text = Custom[JournalAPIMessage.Text](journalAPIMessage=linesByType_2)  # Returns the text from an APIMessage line
type_2 = Custom[JournalAPIMessage.Type](journalAPIMessage=linesByType_2)  # Returns the type of an APIMessage line

# group: JournalCommand.Query
string_2 = StringInput("JournalCommand")
linesByType_3 = Custom[Journal.GetLinesByType](journal=watch_8, journalLineType=string_2)  # "Journal.LinesByType"
type_3 = Custom[JournalCommand.Type](journalCommand=linesByType_3)  # Returns the type of a JournalCommand line
description = Custom[JournalCommand.Description](journalCommand=linesByType_3)  # Returns the description of a JournalCommand line
ID = Custom[JournalCommand.ID](journalCommand=linesByType_3)  # Returns the command ID of a JournalCommand line

# group: JournalAddinEvent.Query
string_3 = StringInput("JournalAddinEvent")
linesByType_4 = Custom[Journal.GetLinesByType](journal=watch_8, journalLineType=string_3)  # "Journal.LinesByType"
text_2 = Custom[JournalAddinEvent.Text](journalAddinEvent=linesByType_4)  # Returns the text from an AddinEvent line

# group: JournalData.Query
string_4 = StringInput("JournalData")
linesByType_5 = Custom[Journal.GetLinesByType](journal=watch_8, journalLineType=string_4)  # "Journal.LinesByType"
key = Custom[JournalData.Key](journalData=linesByType_5)  # Returns the key of a JournalData line
values = Custom[JournalData.Values](journalData=linesByType_5)  # Returns the values from a JournalData line

# group: JournalDirective.Query
string_5 = StringInput("JournalDirective")
linesByType_6 = Custom[Journal.GetLinesByType](journal=watch_8, journalLineType=string_5)  # "Journal.LinesByType"
key_2 = Custom[JournalDirective.Key](journalDirective=linesByType_6)  # Returns the key of a JournalDirective line
values_2 = Custom[JournalDirective.Values](journalDirective=linesByType_6)  # Returns the values from a JournalDirective line

# group: JournalGUIResourceUsage.Query
string_6 = StringInput("JournalGUIResourceUsage")
linesByType_7 = Custom[Journal.GetLinesByType](journal=watch_8, journalLineType=string_6)  # "Journal.LinesByType"
available = Custom[JournalGUIResourceUsage.Available](journalGUIResourceUsage=linesByType_7)
used = Custom[JournalGUIResourceUsage.Used](journalGUIResourceUsage=linesByType_7)
user_2 = Custom[JournalGUIResourceUsage.User](journalGUIResourceUsage=linesByType_7)

# group: JournalKeyboardEvent.Query
string_7 = StringInput("JournalKeyboardEvent")
linesByType_8 = Custom[Journal.GetLinesByType](journal=watch_8, journalLineType=string_7)  # "Journal.LinesByType"
key_3 = Custom[JournalKeyboardEvent.Key](journalKeyboardEvent=linesByType_8)  # Returns the pressed key of a KeyboardEvent line

# group: JournalMemoryMetrics.Query
string_8 = StringInput("JournalMemoryMetrics")
linesByType_9 = Custom[Journal.GetLinesByType](journal=watch_8, journalLineType=string_8)  # "Journal.LinesByType"
VMAvailable = Custom[JournalMemoryMetrics.VMAvailable](journalMemoryMetrics=linesByType_9)  # Returns the available VM of a MemoryMetrics line
VMUsed = Custom[JournalMemoryMetrics.VMUsed](journalMemoryMetrics=linesByType_9)  # Returns the used VM of a MemoryMetrics line
VMPeak = Custom[JournalMemoryMetrics.VMPeak](journalMemoryMetrics=linesByType_9)  # Returns the peak VM of a MemoryMetrics line
RAMAvailable = Custom[JournalMemoryMetrics.RAMAvailable](journalMemoryMetrics=linesByType_9)  # Returns the available RAM of a MemoryMetrics line
RAMUsed = Custom[JournalMemoryMetrics.RAMUsed](journalMemoryMetrics=linesByType_9)  # Returns the used RAM of a MemoryMetrics line
RAMPeak = Custom[JournalMemoryMetrics.RAMPeak](journalMemoryMetrics=linesByType_9)  # Returns the peak RAM of a MemoryMetrics line

# group: JournalMouseEvent.Query
string_9 = StringInput("JournalMouseEvent")
linesByType_10 = Custom[Journal.GetLinesByType](journal=watch_8, journalLineType=string_9)  # "Journal.LinesByType"
type_4 = Custom[JournalMouseEvent.Type](journalMouseEvent=linesByType_10)  # Returns the type of a MouseEvent line
data = Custom[JournalMouseEvent.Data](journalMouseEvent=linesByType_10)  # Returns the data from a MouseEvent line

# group: JournalTimeStamp.Query
string_10 = StringInput("JournalTimeStamp")
linesByType_11 = Custom[Journal.GetLinesByType](journal=watch_8, journalLineType=string_10)  # "Journal.LinesByType"
type_5 = Custom[JournalTimeStamp.Type](journalTimeStamp=linesByType_11)  # Returns the type of a TimeStamp line
dateTime = Custom[JournalTimeStamp.DateTime](journalTimeStamp=linesByType_11)  # Returns the date and time of a TimeStamp line
description_2 = Custom[JournalTimeStamp.Description](journalTimeStamp=linesByType_11)  # Returns the description of a TimeStamp line

# group: JournalUIEvent.Query
string_11 = StringInput("JournalUIEvent")
linesByType_12 = Custom[Journal.GetLinesByType](journal=watch_8, journalLineType=string_11)  # "Journal.LinesByType"
type_6 = Custom[JournalUIEvent.Type](journalUIEvent=linesByType_12)  # Returns the type of a UIEvent line
data_2 = Custom[JournalUIEvent.Data](journalUIEvent=linesByType_12)  # Returns the data from a UIEvent line

# group: Test Inputs
code_block_2 = CodeBlock { 4; }
getItemAtIndex = List.GetItemAtIndex(list=lines, index=code_block_2)
count = List.Count(lines)
code_block_3 = CodeBlock(n=count) { n-5; }
getItemAtIndex_2 = List.GetItemAtIndex(list=lines, index=code_block_3)
code_block_4 = CodeBlock { "JournalCommand"; "CommandID"; "ID_CANCEL_EDITOR"; }

# group: JournalLine.Actions
next = Custom[JournalLine.Next](journalLine=getItemAtIndex)
previous = Custom[JournalLine.Previous](journalLine=getItemAtIndex_2)
allNext = Custom[JournalLine.AllNext](journalLine=getItemAtIndex)
allPrevious = Custom[JournalLine.AllPrevious](journalLine=getItemAtIndex_2)
allNextOfType = Custom[JournalLine.AllNextOfType](journalLine=getItemAtIndex, journalLineType=code_block_4.out0)
allNextOfTypeAndProperty = Custom[JournalLine.AllNextOfTypeAndProperty](journalLine=getItemAtIndex, journalLineType=code_block_4.out0, property=code_block_4.out1, value=code_block_4.out2)
allPreviousOfType = Custom[JournalLine.AllPreviousOfType](journalLine=getItemAtIndex_2, journalLineType=code_block_4.out0)
allPreviousOfTypeAndProperty = Custom[JournalLine.AllPreviousOfTypeAndProperty](journalLine=getItemAtIndex_2, journalLineType=code_block_4.out0, property=code_block_4.out1, value=code_block_4.out2)
nextOfType = Custom[JournalLine.NextOfType](journalLine=getItemAtIndex, journalLineType=code_block_4.out0)
nextOfTypeAndProperty = Custom[JournalLine.NextOfTypeAndProperty](journalLine=getItemAtIndex, journalLineType=code_block_4.out0, property=code_block_4.out1, value=code_block_4.out2)
previousOfType = Custom[JournalLIne.PreviousOfType](journalLine=getItemAtIndex_2, journalLineType=code_block_4.out0)
previousOfTypeAndProperty = Custom[JournalLine.PreviousOfTypeAndProperty](journalLine=getItemAtIndex_2, journalLineType=code_block_4.out0, property=code_block_4.out1, value=code_block_4.out2)
dateTimeOfBlock = Custom[JournalLIne.GetDateTimeOfBlock](journalLine=getItemAtIndex_2)  # "JournalLine.DateTimeOfBlock"

# group: KeyboardShortcuts.Create
fromPath_2 = FileObject(keyboardshortcuts_file_path)  # "File.FromPath"
readText_2 = File.ReadText(fromPath_2)
byString_2 = Custom[KeyboardShortcuts.ByString](str=readText_2)  # Creates a queriable object from the content of a Revit KeyboardShortcuts.xml file

# group: KeyboardShortcuts.Query
commands = Custom[KeyboardShortcuts.Commands](keyboardShortcuts=byString_2)  # Returns all commands from a given KeyboardShirtcuts object
commandCountWithShortcuts = Custom[KeyboardShortcuts.CommandCountWithShortcuts](keyboardShortcuts=byString_2)  # Returns the total number of commands that have a shortcut assigned in a given KeyboardShirtcuts object
commandCount = Custom[KeyboardShortcuts.CommandCount](keyboardShortcuts=byString_2)  # Returns the total number of commands in a given KeyboardShirtcuts object
commandsWithShortcuts = Custom[KeyboardShortcuts.CommandsWithShortcuts](keyboardShortcuts=byString_2)  # Returns all commands that have a shortcut assigned from a given KeyboardShirtcuts object

# group: KeyboardShortcutCommand.Query
hasPaths = Custom[KeyboardShortcutCommand.HasPaths](keyboardShortcutCommand=commands)  # Returns whether a given command has any paths assigned
hasShortcuts = Custom[KeyboardShortcutCommand.HasShortcuts](keyboardShortcutCommand=commands)  # Returns whether a given command has any shortcuts assigned
ID_2 = Custom[KeyboardShortcutCommand.ID](keyboardShortcutCommand=commands)  # Returns the ID of a given command
name = Custom[KeyboardShortcutCommand.Name](keyboardShortcutCommand=commands)  # Returns the name of a given command
paths = Custom[KeyboardShortcutCommand.Paths](keyboardShortcutCommand=commands)  # Returns all paths assigned to a given command
shortcuts = Custom[KeyboardShortcutCommand.Shortcuts](keyboardShortcutCommand=commands)  # Returns all shortcuts assigned to a given command

# group: LoadedModel.Query
path_2 = Custom[LoadedModel.Path](loadedModel=loadedModels)  # Returns the Rpath of a loaded model
events = Custom[LoadedModel.Events](loadedModel=loadedModels)  # Returns all events associated with a loaded model

# group: LoadedModelEvent.Query
type_7 = Custom[LoadedModelEvent.Type](loadedModelEvent=events@L2)  # Returns the type of a given LoadedModelEvent
dateTime_2 = Custom[LoadedModelEvent.DateTime](loadedModelEvent=events@L2)  # Returns the date and time of a given LoadedModelEvent

# group: LoadedModel.Actions
version = Custom[LoadedModel.Version](loadedModel=loadedModels)  # Retrieves the version of a loaded model
versionHistory = Custom[LoadedModel.VersionHistory](loadedModel=loadedModels)  # Retrieves the version history of a loaded model

# group: JournalBasicFileInfo.Query
string_12 = StringInput("JournalBasicFileInfo")
linesByType_13 = Custom[Journal.GetLinesByType](journal=watch_8, journalLineType=string_12)  # "Journal.LinesByType"
centralModelPath = Custom[JournalBasicFileInfo.CentralModelPath](journalBasicFileInfo=linesByType_13)  # Returns the central model path from a BasicFileInfo line
lastSavePath = Custom[JournalBasicFileInfo.LastSavePath](journalBasicFileInfo=linesByType_13)  # Returns the last save path from a BasicFileInfo line
locale = Custom[JournalBasicFileInfo.Locale](journalBasicFileInfo=linesByType_13)  # Returns the locale a model was saved in from a BasicFileInfo line
worksharing = Custom[JournalBasicFileInfo.Worksharing](journalBasicFileInfo=linesByType_13)  # Returns the worksharing status from a BasicFileInfo line

fileName = Custom[JournalBasicFileInfo.FileName](journalBasicFileInfo=linesByType_13)  # Returns the file name from the last save path of a BasicFileInfo line

# group: WorksharingLog.Create
fromPath_3 = FileObject(worksharing_log_file_path)  # "File.FromPath"
readText_3 = File.ReadText(fromPath_3)
byString_3 = Custom[WorksharingLog.ByString](str=readText_3)  # Creates a queriable object from a Revit worksharing log

# group: WorksharingLog.Query
sessions = Custom[WorksharingLog.Sessions](worksharingLog=byString_3)  # Returns all sessions of a given WorksharingLog
sessionCount = Custom[WorksharingLog.SessionCount](worksharingLog=byString_3)  # Returns the number of sessions recorded in a given WorksharingLog
processingTime_2 = Custom[WorksharingLog.ProcessingTime](worksharingLog=byString_3)  # Returns the amount of time it took to process the given WorksharingLog
version_2 = Custom[WorksharingLog.Version](worksharingLog=byString_3)  # Returns the version of a given WorksharingLog

# group: WorksharingSession.Actions
syncEvents = Custom[WorksharingSession.SyncEvents](worksharingSession=sessions)  # Extracts all SyncEvents from a given WorkharingSession
createsNewCentral = Custom[WorksharingSession.CreatesNewCentral](worksharingSession=sessions)  # Determines if a new central model was created in a given WorksharingSession
loadDuration = Custom[WorksharingSession.LoadDuration](worksharingSession=sessions)  # Computes the load time of the model (and all linked models) for a given WorksharingSession
usesCentralModel = Custom[WorksharingSession.UsesCentralModel](worksharingSession=sessions)  # Determines if the user was working in the central model (as opposed to a local copy) in a given WorksharingSession
wasTerminatedProperly = Custom[WorksharingSession.WasTerminatedProperly](worksharingSession=sessions)  # Determines whether a given WorksharingSession was terminated properly

# group: SyncEvent.Query
duration = Custom[SyncEvent.Duration](syncEvent=syncEvents@L2)  # Returns the duration of a given SyncEvent
end = Custom[SyncEvent.End](syncEvent=syncEvents@L2)  # Returns the date and time a given SyncEvent concluded
start = Custom[SyncEvent.Start](syncEvent=syncEvents@L2)  # Returns the date and time a given SyncEvent started

# group: WorksharingSession.Query
build = Custom[WorksharingSession.Build](worksharingSession=sessions)  # Returns the Revit build of a given WorksharingSession
central = Custom[WorksharingSession.Central](worksharingSession=sessions)  # Returns the file path to the central model of a given WorksharingSession
date_3 = Custom[WorksharingSession.Date](worksharingSession=sessions)  # Returns the date of a given WorksharingSession
end_2 = Custom[WorksharingSession.End](worksharingSession=sessions)  # Returns the date and time a given WorksharingSession was concluded
duration_2 = Custom[WorksharingSession.Duration](worksharingSession=sessions)  # Returns the total duration of a given WorksharingSession
events_2 = Custom[WorksharingSession.Events](worksharingSession=sessions)  # Returns all recorded events of a given WorksharingSession
hostIP = Custom[WorksharingSession.HostIP](worksharingSession=sessions)  # Returns the host IP address of a given WorksharingSession
hostName = Custom[WorksharingSession.HostName](worksharingSession=sessions)  # Returns the host name of a given WorksharingSession
ID_3 = Custom[WorksharingSession.ID](worksharingSession=sessions)  # Returns the ID of a given WorksharingSession
journal = Custom[WorksharingSession.Journal](worksharingSession=sessions)  # Returns the journal file path of a given WorksharingSession
serverIP = Custom[WorksharingSession.ServerIP](worksharingSession=sessions)  # Returns the server IP address of a given WorksharingSession
serverName = Custom[WorksharingSession.ServerName](worksharingSession=sessions)  # Returns the server name of a given WorksharingSession
start_2 = Custom[WorksharingSession.Start](worksharingSession=sessions)  # Returns the date and time a given WorksharingSession was started
timeBias = Custom[WorksharingSession.TimeBias](worksharingSession=sessions)  # Returns the time bias of a given WorksharingSession
user_3 = Custom[WorksharingSession.User](worksharingSession=sessions)  # Returns the Revit user name of a given WorksharingSession
version_3 = Custom[WorksharingSession.Version](worksharingSession=sessions)  # Returns the Revit version of a given WorksharingSession

# group: WorksharingEvent.Query
dateTime_3 = Custom[WorksharingEvent.DateTime](worksharingEvent=events_2@L2)  # Returns the date and time of a given WorksharingEvent
text_3 = Custom[WorksharingEvent.Text](worksharingEvent=events_2@L2)  # Returns the logged text of a given WorksharingEvent

# group: LoadedAssembly.Query
class_ = Custom[LoadedAssembly.Class](loadedAssembly=loadedAssemblies)  # Returns the class name of a given LoadedAssembly
events_3 = Custom[LoadedAssembly.Events](loadedAssembly=loadedAssemblies)  # Returns all journal lines associated with a given LoadedAssembly
filename = Custom[LoadedAssembly.Filename](loadedAssembly=loadedAssemblies)  # Returns the file name of a given LoadedAssembly
GUID = Custom[LoadedAssembly.GUID](loadedAssembly=loadedAssemblies)  # Returns the GUID of a given LoadedAssembly
name_2 = Custom[LoadedAssembly.Name](loadedAssembly=loadedAssemblies)  # Returns the name of a given LoadedAssembly
path_3 = Custom[LoadedAssembly.Path](loadedAssembly=loadedAssemblies)  # Returns the path of a given LoadedAssembly
vendor = Custom[LoadedAssembly.Vendor](loadedAssembly=loadedAssemblies)  # Returns the vendor information of a given LoadedAssembly

# group: WorksharingLog.Actions
allSessionsUseSameBuild = Custom[WorksharingLog.AllSessionsUseSameBuild](worksharingLog=byString_3)  # Determines whether all sessions of a given WorksharingLog use the same Revit build
