# Dynamo graph AllWorksharingLogNodes.dyn (Dynamo 1.3.1.1736)

# group: INPUT
# note: QUESTION:
# Does the graph execute okay? Do any nodes turn yellow?
worksharing_log_file_path = Filename("C:\Users\adieckmann\Desktop\Projekt1_backup\Projekt1.slog")

# group: WorksharingLog.Create
fromPath = FileObject(worksharing_log_file_path)  # "File.FromPath"
readText = File.ReadText(fromPath)
byString = Custom[WorksharingLog.ByString](str=readText)  # Creates a queriable object from a Revit worksharing log

# group: WorksharingLog.Query
sessions = Custom[WorksharingLog.Sessions](worksharingLog=byString)  # Returns all sessions of a given WorksharingLog
sessionCount = Custom[WorksharingLog.SessionCount](worksharingLog=byString)  # Returns the number of sessions recorded in a given WorksharingLog
processingTime = Custom[WorksharingLog.ProcessingTime](worksharingLog=byString)  # Returns the amount of time it took to process the given WorksharingLog
version = Custom[WorksharingLog.Version](worksharingLog=byString)  # Returns the version of a given WorksharingLog

# group: WorksharingSession.Actions
syncEvents = Custom[WorksharingSession.SyncEvents](worksharingSession=sessions)  # Extracts all SyncEvents from a given WorkharingSession
createsNewCentral = Custom[WorksharingSession.CreatesNewCentral](worksharingSession=sessions)  # Determines if a new central model was created in a given WorksharingSession
loadDuration = Custom[WorksharingSession.LoadDuration](worksharingSession=sessions)  # Computes the load time of the model (and all linked models) for a given WorksharingSession
usesCentralModel = Custom[WorksharingSession.UsesCentralModel](worksharingSession=sessions)  # Determines if the user was working in the central model (as opposed to a local copy) in a given WorksharingSession
wasTerminatedProperly = Custom[WorksharingSession.WasTerminatedProperly](worksharingSession=sessions)  # Determines whether a given WorksharingSession was terminated properly
createsDetached = Custom[WorksharingSession.CreatesDetached](worksharingSession=sessions)

# group: SyncEvent.Query
duration = Custom[SyncEvent.Duration](syncEvent=syncEvents@L2)  # Returns the duration of a given SyncEvent
end = Custom[SyncEvent.End](syncEvent=syncEvents@L2)  # Returns the date and time a given SyncEvent concluded
start = Custom[SyncEvent.Start](syncEvent=syncEvents@L2)  # Returns the date and time a given SyncEvent started

# group: WorksharingSession.Query
build = Custom[WorksharingSession.Build](worksharingSession=sessions)  # Returns the Revit build of a given WorksharingSession
central = Custom[WorksharingSession.Central](worksharingSession=sessions)  # Returns the file path to the central model of a given WorksharingSession
date = Custom[WorksharingSession.Date](worksharingSession=sessions)  # Returns the date of a given WorksharingSession
end_2 = Custom[WorksharingSession.End](worksharingSession=sessions)  # Returns the date and time a given WorksharingSession was concluded
duration_2 = Custom[WorksharingSession.Duration](worksharingSession=sessions)  # Returns the total duration of a given WorksharingSession
events = Custom[WorksharingSession.Events](worksharingSession=sessions)  # Returns all recorded events of a given WorksharingSession
hostIP = Custom[WorksharingSession.HostIP](worksharingSession=sessions)  # Returns the host IP address of a given WorksharingSession
hostName = Custom[WorksharingSession.HostName](worksharingSession=sessions)  # Returns the host name of a given WorksharingSession
journal = Custom[WorksharingSession.Journal](worksharingSession=sessions)  # Returns the journal file path of a given WorksharingSession
serverIP = Custom[WorksharingSession.ServerIP](worksharingSession=sessions)  # Returns the server IP address of a given WorksharingSession
serverName = Custom[WorksharingSession.ServerName](worksharingSession=sessions)  # Returns the server name of a given WorksharingSession
start_2 = Custom[WorksharingSession.Start](worksharingSession=sessions)  # Returns the date and time a given WorksharingSession was started
user = Custom[WorksharingSession.User](worksharingSession=sessions)  # Returns the Revit user name of a given WorksharingSession
version_2 = Custom[WorksharingSession.Version](worksharingSession=sessions)  # Returns the Revit version of a given WorksharingSession
ID = Custom[WorksharingSession.ID](worksharingSession=sessions)  # Returns the ID of a given WorksharingSession

# group: WorksharingEvent.Query
dateTime = Custom[WorksharingEvent.DateTime](worksharingEvent=events@L2)  # Returns the date and time of a given WorksharingEvent
text = Custom[WorksharingEvent.Text](worksharingEvent=events@L2)  # Returns the logged text of a given WorksharingEvent

# group: WorksharingLog.Actions
allSessionsUseSameBuild = Custom[WorksharingLog.AllSessionsUseSameBuild](worksharingLog=byString)  # Determines whether all sessions of a given WorksharingLog use the same Revit build
sessionByID = Custom[WorksharingLog.SessionByID](worksharingLog=byString, sessionID=ID)  # Retrieves a WorksharingSession from a WorksharingLog based on the session ID.
