# Dynamo graph BatchProcess---UnprocessedData.dyn (Dynamo 1.3.1.1736)

directory_path = Directory("U:\Desktop\journals")

# group: Evaluate Journals
string = StringInput("*.txt")
contents = Custom[Directory.Contents+](directoryPath=directory_path, searchString=string)  # Unlike the built-in node Directory.Contents, this node browses a directory recursively and returns all relevant files contained in subfolders as well.
fromPath = FileObject(contents)  # "File.FromPath"
readText = File.ReadText(fromPath)
byString = Custom[Journal.ByString](str=readText@L1)

# group: Identify unclassified JournalMiscCommands
string_2 = StringInput("JournalMiscCommand")
getLinesByType = Custom[Journal.GetLinesByType](journal=byString@L1, journalLineType=string_2)
flatten = Flatten(getLinesByType)
rawText = Custom[JournalLine.RawText](journalLine=flatten)
string_3 = StringInput(" ")
split = String.Split(rawText, string_3)
transpose = List.Transpose(split)
firstItem = List.FirstItem(transpose)
groupByKey = List.GroupByKey(list=rawText, keys=firstItem)
string_4 = StringInput("""Dim
Set
Jrn.Size""")
string_5 = StringInput("\n")
split_2 = String.Split(string_4, string_5)
containsItem = List.ContainsItem(list=split_2, item=groupByKey.unique_keys)
filterByBoolMask = List.FilterByBoolMask(list=groupByKey.groups, mask=containsItem)
watch = Watch(filterByBoolMask.out)
filterByBoolMask_2 = List.FilterByBoolMask(list=groupByKey.unique_keys, mask=containsItem)
watch_2 = Watch(filterByBoolMask_2.out)

# group: JournalComment TEST
string_6 = StringInput("JournalComment")
getLinesByType_2 = Custom[Journal.GetLinesByType](journal=byString, journalLineType=string_6)  # frozen
rawText_2 = Custom[JournalLine.RawText](journalLine=getLinesByType_2)
string_7 = StringInput(" ")
split_3 = String.Split(rawText_2, string_7)
transpose_2 = List.Transpose(split_3)
firstItem_2 = List.FirstItem(transpose_2)
groupByKey_2 = List.GroupByKey(list=rawText_2, keys=firstItem_2)
# note: QUESTION:
# Would you like to be able to pull any of this data from the journal file?
watch_3 = Watch(groupByKey_2.unique_keys)
watch_4 = Watch(groupByKey_2.groups)
watch_5 = Watch(rawText_2)
