# Dynamo graph Journals_AllIssues.dyn (Dynamo 1.3.1.1736)

# group: INPUTS
directory_path = Directory("Z:\U\Desktop\journals\asternberg_BIMcollabCrashes")

# group: Create Journal objects from directory
fromPath = DirectoryObject(directory_path)  # "Directory.FromPath"
string = StringInput("*.txt")
contents = Directory.Contents(fromPath, string)
readText = File.ReadText(contents)
byString = Custom[Journal.ByString](str=readText@L1)  # Creates a queriable object from the contents of a Revit journal file

# group: Identify journals with issues
containsAPIErrors = Custom[Journal.ContainsAPIErrors](journal=byString)  # Computes whether a given journal contains any API errors
containsExceptions = Custom[Journal.ContainsExceptions](journal=byString)  # Computes whether a given journal contains any exceptions
sessionTerminatedProperly = Custom[Journal.SessionTerminatedProperly](journal=byString)  # Computes whether the Revit session of the given journal was terminated properly
not_ = Not(sessionTerminatedProperly)
create = List.Create(containsAPIErrors, containsExceptions, not_)
transpose = List.Transpose(create)
anyTrue = Custom[List.AnyTrue](seq=transpose@L2)  # Returns true if any item in a list of booleans is true.
filterByBoolMask = List.FilterByBoolMask(list=contents, mask=anyTrue)

# group: OUTPUTS
journals_with_issues = Watch(filterByBoolMask.in)
