# Dynamo graph PythonExamples.dyn (Dynamo 1.3.1.1736)

# group: INPUT
file_path = Filename("..\..\..\Desktop\journals\journal.0855.txt")

# group: Evaluate Journal
fromPath = FileObject(file_path)  # "File.FromPath"
readText = File.ReadText(fromPath)
byString = Custom[Journal.ByString](str=readText)

# group: Python Examples
# note: When was a model closed during the session?
python_script = Python(IN[0]=byString)
# ---------- python_script.python (12 lines) ----------
import clr

OUT = []
files = []
ts = []
if IN[0].__repr__() == 'Journal':
	allUIEvents = IN[0].GetLinesByType('JournalUIEvent')
	closingEvents = [x for x in allUIEvents if x.UIEventType == 'Close']
	for event in closingEvents:
		files.append(event.Data[0][1:-1])
		ts.append(IN[0].GetLinesByBlock(event.Block)[0].DateTime)
OUT = (files,ts)
# ----------------------------------------
watch = Watch(python_script)

# group: Extract unique list of API error messages
string = StringInput("JournalAPIMessage")
getLinesByType = Custom[Journal.GetLinesByType](journal=byString, journalLineType=string)
type = Custom[JournalAPIMessage.Type](journalAPIMessage=getLinesByType)
code_block = CodeBlock(type=type) { type == "Error"; }
filterByBoolMask = List.FilterByBoolMask(list=getLinesByType, mask=code_block)
text = Custom[JournalAPIMessage.Text](journalAPIMessage=filterByBoolMask.in)
uniqueItems = List.UniqueItems(text)
watch_2 = Watch(uniqueItems)
string_2 = StringInput("""import clr

OUT = []
if IN[0].__repr__() == 'Journal':
 allAPImsgs = IN[0].GetLinesByType('JournalAPIMessage')
 OUT = set([x.MessageText for x in allAPImsgs if x.MessageType == 'Error'])""")
python_script_from_string = PythonStringNode(script=string_2, IN[0]=byString)
watch_3 = Watch(python_script_from_string)

# group: Extract unique list of commands triggered by a keyboard shortcut
string_3 = StringInput("JournalCommand")
getLinesByType_2 = Custom[Journal.GetLinesByType](journal=byString, journalLineType=string_3)
type_2 = Custom[JournalCommand.Type](journalCommand=getLinesByType_2)
code_block_2 = CodeBlock(type=type_2) { type == "KeyboardShortcut"; }
filterByBoolMask_2 = List.FilterByBoolMask(list=getLinesByType_2, mask=code_block_2)
ID = Custom[JournalCommand.ID](journalCommand=filterByBoolMask_2.in)
uniqueItems_2 = List.UniqueItems(ID)
watch_4 = Watch(uniqueItems_2)
string_4 = StringInput("""import clr

OUT = []
if IN[0].__repr__() == 'Journal':
 allJCommands = IN[0].GetLinesByType('JournalCommand')
 OUT = set([x.CommandID for x in allJCommands if x.CommandType == 'KeyboardShortcut'])""")
python_script_from_string_2 = PythonStringNode(script=string_4, IN[0]=byString)
watch_5 = Watch(python_script_from_string_2)
