# Dynamo graph WorksharingLog_AllSessions.dyn (Dynamo 1.3.4.6666)

# group: INPUT
directory_path_report = Directory("C:\temp")
filename = StringInput("WorksharingSessions")
directory_path_log_directory = Directory("U:\Journals\SLOG\long_syncs")

# group: Process files
fromPath = DirectoryObject(directory_path_log_directory)  # "Directory.FromPath"
contents = Directory.Contents(fromPath)
byPath = Custom[WorksharingLog.ByPath](path=contents)  # Creates a queryable object from a Revit worksharing log
sessions = Custom[WorksharingLog.Sessions](worksharingLog=byPath)  # Returns all sessions of a given WorksharingLog
flatten = Flatten(sessions)

# group: Collect data
central = Custom[WorksharingSession.Central](worksharingSession=flatten)  # Returns the file path to the central model of a given WorksharingSession
boolean = BoolSelector(false)
fileName = FilePath.FileName(central, boolean)
ID = Custom[WorksharingSession.ID](worksharingSession=flatten)  # Returns the ID of a given WorksharingSession
start = Custom[WorksharingSession.Start](worksharingSession=flatten)  # Returns the date and time a given WorksharingSession was started
user = Custom[WorksharingSession.User](worksharingSession=flatten)  # Returns the Revit user name of a given WorksharingSession
usesCentralModel = Custom[WorksharingSession.UsesCentralModel](worksharingSession=flatten)  # Determines if the user was working in the central model (as opposed to a local copy) in a given WorksharingSession
createsNewCentral = Custom[WorksharingSession.CreatesNewCentral](worksharingSession=flatten)  # Determines if a new central model was created in a given WorksharingSession
wasTerminatedProperly = Custom[WorksharingSession.WasTerminatedProperly](worksharingSession=flatten)  # Determines whether a given WorksharingSession was terminated properly
loadDuration = Custom[WorksharingSession.LoadDuration](worksharingSession=flatten)  # Computes the load time of the model (and all linked models) for a given WorksharingSession
totalSeconds = TimeSpan.TotalSeconds(loadDuration)
string = StringInput("")
replaceNull = Custom[List.ReplaceNull](seq=totalSeconds, replacement=string)  # Replaces all null values within a given list with a substitute
loadedLinks = Custom[WorksharingSession.LoadedLinks](worksharingSession=flatten)  # Retrieves a list of loaded links from a given WorkharingSession
count = List.Count(loadedLinks@L2)
hostName = Custom[WorksharingSession.HostName](worksharingSession=flatten)  # Returns the host name of a given WorksharingSession
duration = Custom[WorksharingSession.Duration](worksharingSession=flatten)  # Returns the total duration of a given WorksharingSession
totalSeconds_2 = TimeSpan.TotalSeconds(duration)
string_2 = StringInput("")
replaceNull_2 = Custom[List.ReplaceNull](seq=totalSeconds_2, replacement=string_2)
loadedLinks_2 = Custom[WorksharingSession.LoadedLinks](worksharingSession=flatten)
count_2 = List.Count(loadedLinks_2@L2)
loadDuration_2 = Custom[LoadedLink.LoadDuration](loadedLink=loadedLinks_2@L2)  # Returns the load duration of a given loaded link
totalSeconds_3 = TimeSpan.TotalSeconds(loadDuration_2)
sum = Math.Sum(totalSeconds_3)
create = List.Create(fileName, ID, start, user, usesCentralModel, createsNewCentral, wasTerminatedProperly, replaceNull, count, hostName, replaceNull_2, count_2, sum)
hasLoadedLinks = Custom[WorksharingSession.HasLoadedLinks](worksharingSession=flatten)  # Determines if linked models were loaded in this session

# group: Export to Excel
code_block = CodeBlock(filename=filename) { filename + ".csv"; }
combine = FilePath.Combine(directory_path_report, code_block)
string_3 = StringInput("Sessions")
code_block_2 = CodeBlock { 0; }
string_4 = StringInput("""Model
SessionID
SessionStarted
Username
WorkingInCentral
CreatingNewCentral
SessionTerminatedProperly
LoadDuration
NumberOfSyncs
Machine
SessionDuration
LoadedLinks
LinkLoadTime""")
string_5 = StringInput("\n")
split = String.Split(string_4, string_5)
create_2 = List.Create(split)
transpose = List.Transpose(create)
join = List.Join(create_2, transpose)
boolean_2 = BoolSelector(true)
writeToFile = Excel.WriteToFile(filePath=combine, sheetName=string_3, startRow=code_block_2, startCol=code_block_2, data=join, overWrite=boolean_2)
