# Dynamo graph WorksharingLog_AllSyncs.dyn (Dynamo 1.3.1.1736)

# group: INPUT
directory_path = Directory("C:\temp")
worksharing_log_file_path = Filename("..\..\..\Journals\Projekt1.slog")
filename = StringInput("Syncs")

# group: Process file
fromPath = FileObject(worksharing_log_file_path)  # "File.FromPath"
readText = File.ReadText(fromPath)
byString = Custom[WorksharingLog.ByString](str=readText)  # Creates a queriable object from a Revit worksharing log
sessions = Custom[WorksharingLog.Sessions](worksharingLog=byString)  # Returns all sessions of a given WorksharingLog

# group: Collect data
ID = Custom[WorksharingSession.ID](worksharingSession=sessions)  # Returns the ID of a given WorksharingSession
syncEvents = Custom[WorksharingSession.SyncEvents](worksharingSession=sessions)  # Extracts all SyncEvents from a given WorkharingSession
count = List.Count(syncEvents@L2)
ofRepeatedItem = List.OfRepeatedItem(item=ID@L1, amount=count@L1)
user = Custom[WorksharingSession.User](worksharingSession=sessions)  # Returns the Revit user name of a given WorksharingSession
ofRepeatedItem_2 = List.OfRepeatedItem(item=user@L1, amount=count@L1)
start = Custom[SyncEvent.Start](syncEvent=syncEvents@L2)  # Returns the date and time a given SyncEvent started
duration = Custom[SyncEvent.Duration](syncEvent=syncEvents@L2)  # Returns the duration of a given SyncEvent
totalSeconds = TimeSpan.TotalSeconds(duration)
string = StringInput("")
replaceNull = Custom[List.ReplaceNull](seq=totalSeconds@L2, replacement=string)  # Replaces all null values within a given list with a substitute

hostName = Custom[WorksharingSession.HostName](worksharingSession=sessions)  # Returns the host name of a given WorksharingSession
ofRepeatedItem_3 = List.OfRepeatedItem(item=hostName@L1, amount=count@L1)

# group (continued): Collect data
create = List.Create(ofRepeatedItem, ofRepeatedItem_2, ofRepeatedItem_3, start, replaceNull)
flatten = Flatten(create@L3)

# group: Export to Excel
central = Custom[WorksharingSession.Central](worksharingSession=sessions)  # Returns the file path to the central model of a given WorksharingSession
firstItem = List.FirstItem(central)
boolean = BoolSelector(true)
fileName = FilePath.FileName(firstItem, boolean)
code_block = CodeBlock(model=fileName, filename=filename) { model + "__" + filename + ".xlsx"; }
combine = FilePath.Combine(directory_path, code_block)
string_2 = StringInput("Syncs")
code_block_2 = CodeBlock { 0; }
string_3 = StringInput("""SessionID
Username
Machine
SyncStarted
SyncDuration""")
string_4 = StringInput("\n")
split = String.Split(string_3, string_4)
create_2 = List.Create(split)
transpose = List.Transpose(flatten)
join = List.Join(create_2, transpose)
boolean_2 = BoolSelector(true)
writeToFile = Excel.WriteToFile(filePath=combine, sheetName=string_2, startRow=code_block_2, startCol=code_block_2, data=join, overWrite=boolean_2)
