# Dynamo graph WorksharingLog_Example.dyn (Dynamo 1.3.1.1736)

# group: INPUT
worksharing_log_file_path = Filename("..\..\..\Journals\Projekt1.slog")
max_minutes_for_loading = DoubleInput(3.5)
max_minutes_for_syncing = DoubleInput(2)

# group: Process file
fromPath = FileObject(worksharing_log_file_path)  # "File.FromPath"
readText = File.ReadText(fromPath)
byString = Custom[WorksharingLog.ByString](str=readText)  # Creates a queriable object from a Revit worksharing log
sessions = Custom[WorksharingLog.Sessions](worksharingLog=byString)  # Returns all sessions of a given WorksharingLog

# group: Sessions working in central
usesCentralModel = Custom[WorksharingSession.UsesCentralModel](worksharingSession=sessions)  # Determines if the user was working in the central model (as opposed to a local copy) in a given WorksharingSession
filterByBoolMask = List.FilterByBoolMask(list=sessions, mask=usesCentralModel)

# group: Sessions with aborted load operations
loadDuration = Custom[WorksharingSession.LoadDuration](worksharingSession=filterByBoolMask.out)  # Computes the load time of the model (and all linked models) for a given WorksharingSession
isNull = Object.IsNull(loadDuration)
filterByBoolMask_2 = List.FilterByBoolMask(list=filterByBoolMask.out, mask=isNull)

# group: Sessions with long load operations
create = TimeSpan.Create(arg2=max_minutes_for_loading)
filterByBoolMask_3 = List.FilterByBoolMask(list=loadDuration, mask=isNull)
subtract = TimeSpan.Subtract(create, filterByBoolMask_3.out)
string_from_object = FromObject(subtract)
string = StringInput("-")
startsWith = String.StartsWith(str=string_from_object, searchFor=string)
filterByBoolMask_4 = List.FilterByBoolMask(list=filterByBoolMask_2.out, mask=startsWith)

# group: Sessions with long sync operations
create_2 = TimeSpan.Create(arg2=max_minutes_for_syncing)
syncEvents = Custom[WorksharingSession.SyncEvents](worksharingSession=filterByBoolMask_2.out)  # Extracts all SyncEvents from a given WorkharingSession
duration = Custom[SyncEvent.Duration](syncEvent=syncEvents@L2)  # Returns the duration of a given SyncEvent
# note: Lunchbox
removeNulls = Lists.Manage.RemoveNulls(duration)
subtract_2 = TimeSpan.Subtract(create_2, removeNulls)
string_from_object_2 = FromObject(subtract_2)
string_2 = StringInput("-")
startsWith_2 = String.StartsWith(str=string_from_object_2, searchFor=string_2)
# note: Clockwork
anyTrue = Custom[List.AnyTrue](seq=startsWith_2@L2)  # Returns true if any item in a list of booleans is true.
filterByBoolMask_5 = List.FilterByBoolMask(list=filterByBoolMask_2.out, mask=anyTrue)

# group: Sessions with aborted sync operations
isNull_2 = Object.IsNull(duration)
anyTrue_2 = Custom[List.AnyTrue](seq=isNull_2@L2)
filterByBoolMask_6 = List.FilterByBoolMask(list=filterByBoolMask_2.out, mask=anyTrue_2)

# group: REPORT
create_3 = List.Create(filterByBoolMask.in, filterByBoolMask_2.in, filterByBoolMask_4.in, filterByBoolMask_5.in, filterByBoolMask_6.in)
ID = Custom[WorksharingSession.ID](worksharingSession=create_3@L2)  # Returns the ID of a given WorksharingSession
# note: [0] Sessions working in central
# [1] Sessions with aborted load operations
# [2] Sessions with long load operations
# [3] Sessions with long sync operations
# [4] Sessions with aborted sync operations
count = List.Count(create_3@L2)
user = Custom[WorksharingSession.User](worksharingSession=create_3@L2)  # Returns the Revit user name of a given WorksharingSession
start = Custom[WorksharingSession.Start](worksharingSession=create_3@L2)  # Returns the date and time a given WorksharingSession was started
