# Dynamo graph WorksharingLog_SessionsByDateTime.dyn (Dynamo 1.3.1.1736)

# group: INPUT
directory_path = Directory("C:\temp")
worksharing_log_file_path = Filename("..\..\..\Journals\Projekt1.slog")
filename = StringInput("WorksharingSessions")
date_time_to = DateTime("February 23, 2018 9:00 PM")
date_time_from = DateTime("February 22, 2018 4:00 PM")

# group: Process file
fromPath = FileObject(worksharing_log_file_path)  # "File.FromPath"
readText = File.ReadText(fromPath)
byString = Custom[WorksharingLog.ByString](str=readText)  # Creates a queriable object from a Revit worksharing log
sessions = Custom[WorksharingLog.Sessions](worksharingLog=byString)  # Returns all sessions of a given WorksharingLog

# group: Filter by date and time
start = Custom[WorksharingSession.Start](worksharingSession=sessions)  # Returns the date and time a given WorksharingSession was started
isEarlier = Custom[DateTime.IsEarlier](dateTime1=start, dateTime2=date_time_to)  # Determines if a given date and time are earlier than another given date and time.
end = Custom[WorksharingSession.End](worksharingSession=sessions)  # Returns the date and time a given WorksharingSession was concluded
isLater = Custom[DateTime.IsLater](dateTime1=end, dateTime2=date_time_from)  # Determines if a given date and time are later than another given date and time.
boolean = BoolSelector(true)
replaceNull = Custom[List.ReplaceNull](seq=isLater, replacement=boolean)  # Replaces all null values within a given list with a substitute
and_ = isEarlier && replaceNull
filterByBoolMask = List.FilterByBoolMask(list=sessions, mask=and_)

# group: Collect data
ID = Custom[WorksharingSession.ID](worksharingSession=filterByBoolMask.in)  # Returns the ID of a given WorksharingSession
start_2 = Custom[WorksharingSession.Start](worksharingSession=filterByBoolMask.in)
user = Custom[WorksharingSession.User](worksharingSession=filterByBoolMask.in)  # Returns the Revit user name of a given WorksharingSession
usesCentralModel = Custom[WorksharingSession.UsesCentralModel](worksharingSession=filterByBoolMask.in)  # Determines if the user was working in the central model (as opposed to a local copy) in a given WorksharingSession
createsNewCentral = Custom[WorksharingSession.CreatesNewCentral](worksharingSession=filterByBoolMask.in)  # Determines if a new central model was created in a given WorksharingSession
wasTerminatedProperly = Custom[WorksharingSession.WasTerminatedProperly](worksharingSession=filterByBoolMask.in)  # Determines whether a given WorksharingSession was terminated properly
loadDuration = Custom[WorksharingSession.LoadDuration](worksharingSession=filterByBoolMask.in)  # Computes the load time of the model (and all linked models) for a given WorksharingSession
totalSeconds = TimeSpan.TotalSeconds(loadDuration)
string = StringInput("")
replaceNull_2 = Custom[List.ReplaceNull](seq=totalSeconds, replacement=string)
syncEvents = Custom[WorksharingSession.SyncEvents](worksharingSession=filterByBoolMask.in)  # Extracts all SyncEvents from a given WorkharingSession
count = List.Count(syncEvents@L2)
hostName = Custom[WorksharingSession.HostName](worksharingSession=filterByBoolMask.in)  # Returns the host name of a given WorksharingSession
create = List.Create(ID, start_2, user, usesCentralModel, createsNewCentral, wasTerminatedProperly, replaceNull_2, count, hostName)

# group: Export to Excel
central = Custom[WorksharingSession.Central](worksharingSession=sessions)  # Returns the file path to the central model of a given WorksharingSession
firstItem = List.FirstItem(central)
boolean_2 = BoolSelector(false)
fileName = FilePath.FileName(firstItem, boolean_2)
code_block = CodeBlock(model=fileName, filename=filename) { model + "__" + filename + ".xlsx"; }
combine = FilePath.Combine(directory_path, code_block)
string_2 = StringInput("Sessions")
code_block_2 = CodeBlock { 0; }
string_3 = StringInput("""SessionID
SessionStarted
Username
WorkingInCentral
CreatingNewCentral
SessionTerminatedProperly
LoadDuration
NumberOfSyncs
Machine""")
string_4 = StringInput("\n")
split = String.Split(string_3, string_4)
create_2 = List.Create(split)
transpose = List.Transpose(create)
join = List.Join(create_2, transpose)
boolean_3 = BoolSelector(true)
writeToFile = Excel.WriteToFile(filePath=combine, sheetName=string_2, startRow=code_block_2, startCol=code_block_2, data=join, overWrite=boolean_3)
