# Dynamo graph WorksharingLog_SyncsByDateTime.dyn (Dynamo 1.3.1.1736)

# group: INPUT
directory_path = Directory("C:\temp")
worksharing_log_file_path = Filename("..\..\..\Journals\Projekt1.slog")
date_time_to = DateTime("March 09, 2018 8:32 PM")
date_time_from = DateTime("March 09, 2018 8:32 PM")
filename = StringInput("Syncs")

# group: Process file
fromPath = FileObject(worksharing_log_file_path)  # "File.FromPath"
readText = File.ReadText(fromPath)
byString = Custom[WorksharingLog.ByString](str=readText)  # Creates a queriable object from a Revit worksharing log
sessions = Custom[WorksharingLog.Sessions](worksharingLog=byString)  # Returns all sessions of a given WorksharingLog

# group: Filter sessions by date and time
start = Custom[WorksharingSession.Start](worksharingSession=sessions)  # Returns the date and time a given WorksharingSession was started
isEarlier = Custom[DateTime.IsEarlier](dateTime1=start, dateTime2=date_time_to)  # Determines if a given date and time are earlier than another given date and time.
end = Custom[WorksharingSession.End](worksharingSession=sessions)  # Returns the date and time a given WorksharingSession was concluded
isLater = Custom[DateTime.IsLater](dateTime1=end, dateTime2=date_time_from)  # Determines if a given date and time are later than another given date and time.
boolean = BoolSelector(true)
replaceNull = Custom[List.ReplaceNull](seq=isLater, replacement=boolean)  # Replaces all null values within a given list with a substitute
and_ = isEarlier && replaceNull
filterByBoolMask = List.FilterByBoolMask(list=sessions, mask=and_)

# group: Filter sync events by date and time
syncEvents = Custom[WorksharingSession.SyncEvents](worksharingSession=filterByBoolMask.in)  # Extracts all SyncEvents from a given WorkharingSession
start_2 = Custom[SyncEvent.Start](syncEvent=syncEvents@L2)  # Returns the date and time a given SyncEvent started
isEarlier_2 = Custom[DateTime.IsEarlier](dateTime1=date_time_from, dateTime2=start_2)
isLater_2 = Custom[DateTime.IsLater](dateTime1=date_time_to, dateTime2=start_2)
boolean_2 = BoolSelector(true)
replaceNull_2 = Custom[List.ReplaceNull](seq=isLater_2, replacement=boolean_2)
and_2 = isEarlier_2 && replaceNull_2
filterByBoolMask_2 = List.FilterByBoolMask(list=syncEvents, mask=and_2)
filterByBoolMask_3 = List.FilterByBoolMask(list=start_2, mask=and_2)

# group: Collect data
ID = Custom[WorksharingSession.ID](worksharingSession=filterByBoolMask.in)  # Returns the ID of a given WorksharingSession
count = List.Count(filterByBoolMask_2.in@L2)
ofRepeatedItem = List.OfRepeatedItem(item=ID@L1, amount=count@L1)
user = Custom[WorksharingSession.User](worksharingSession=filterByBoolMask.in)  # Returns the Revit user name of a given WorksharingSession
ofRepeatedItem_2 = List.OfRepeatedItem(item=user@L1, amount=count@L1)
hostName = Custom[WorksharingSession.HostName](worksharingSession=filterByBoolMask.in)  # Returns the host name of a given WorksharingSession
ofRepeatedItem_3 = List.OfRepeatedItem(item=hostName@L1, amount=count@L1)
duration = Custom[SyncEvent.Duration](syncEvent=filterByBoolMask_2.in@L2)  # Returns the duration of a given SyncEvent
totalSeconds = TimeSpan.TotalSeconds(duration)
string = StringInput("")
replaceNull_3 = Custom[List.ReplaceNull](seq=totalSeconds@L2, replacement=string)
create = List.Create(ofRepeatedItem, ofRepeatedItem_2, ofRepeatedItem_3, filterByBoolMask_3.in, replaceNull_3)
flatten = Flatten(create@L3)

# group: Export to Excel
central = Custom[WorksharingSession.Central](worksharingSession=filterByBoolMask.in)  # Returns the file path to the central model of a given WorksharingSession
firstItem = List.FirstItem(central)
boolean_3 = BoolSelector(true)
fileName = FilePath.FileName(firstItem, boolean_3)
code_block = CodeBlock(model=fileName, filename=filename) { model + "__" + filename + ".xlsx"; }
combine = FilePath.Combine(directory_path, code_block)
string_2 = StringInput("Syncs")
code_block_2 = CodeBlock { 0; }
string_3 = StringInput("""SessionID
Username
Machine
SyncStarted
SyncDuration""")
string_4 = StringInput("\n")
split = String.Split(string_3, string_4)
create_2 = List.Create(split)
transpose = List.Transpose(flatten)
join = List.Join(create_2, transpose)
boolean_4 = BoolSelector(true)
writeToFile = Excel.WriteToFile(filePath=combine, sheetName=string_2, startRow=code_block_2, startCol=code_block_2, data=join, overWrite=boolean_4)
